vi "Function_2.gvi"   [LabVIEW NXG 5.0.0]
panel indicators:
  "Graph": f64[][]
diagram:
  for (N = 5) (iteration -> i1) {
    Increment(x=i1) -> w1
    Property Node(instance in=reference to "Graph", "ActivePlot"=w1) -> ("Plot"=w2)
    Format Into String(w1) -> w3
    Property Node(instance in=w2, "Name"=w3)
  }
  w4 = [[230, 330, 0, 0, 0, 0, 0, 0, 0], [320, 230, 230, 0, 0, 0, 0, 0, 0], [0, 0, 0, 0, 0, 0, 0, 0, 0], [0, 0, 0, 0, 0, 0, 0, 320, 0], [0, 0, 0, 0, 0, 0, 0, 0, 0], [0, 0, 32320, 0, 0, 0, 0, 0, 0], [0, 0, 0, 0, 320, 0, 0, 0, 0], [32, 0, 0, 0, 0, 0, 0, 0, 0], [0, 0, 0, 0, 0, 0, 0, 0, 320]]
  $Graph <- w4
