vi "Debugging Prompt.gvi"   [LabVIEW NXG 5.0.0]
inputs:
  "Error In": error
  "Debugging Cluster In": "Debugging Cluster.gtype"
outputs:
  "Error Out": error
  "Debugging Cluster Out": "Debugging Cluster.gtype"
types:
  "Insturment Debugging Cluster.gtype" = cluster{"Keithley": bool, "Arduinos": bool, "Thorlabs Motors": bool, "Photodetector": bool}
  "Debugging Cluster.gtype" = cluster{"Debugging mode?": bool, "Initialize App": bool, "Insturment Debugging": "Insturment Debugging Cluster.gtype"}
uses:
  Rainbow Measurement Setup::Main Functions::Instruction Queue::Current State::FGV Current State.gvi
diagram:
  # This SubVI prompts the user warning him that the software is on debugging mode and might
  # have compromised functionalities and offers the option to turn debugging off.
  case ($"Error In") {
    frame Error, Default {
      w1 = $"Error In"
    }
    frame No Error {
      Property Node(instance in=$"Debugging Cluster In") -> ("Debugging mode?"=w2, "Initialize App"=w3, instance out=w4)
      call "FGV Current State.gvi"(Current State Instructions="Set Current State and Substate", Current State="Debug Check", Current Substate="", Error In=$"Error In") -> (Error Out=w5)
      case (w2) {
        frame True {
          Select(s=w3, t="", f="Initialize App") -> w7
          w8 = "BEWARE!! Debugging Mode\nis on and these functionalities\nhave been turned off:"
          w9 = "Some functionalities might be\ncompromised.\nDo you wish to continue with\nthe debugging mode on?"
          Concatenate Strings(w8, "\r\n", w7, "\r\n", w9) -> w10
          Two Button Dialog(F button name ("Cancel")="Oh no Please turn \ndebugging off D:", T button name ("OK")="Yes Please I'm debugging\nthe software :D", message=w10) -> (T Button?=w11)
          case (w11) {
            frame True {
              w6 = w4
            }
            frame False {
              Property Node(instance in=w4, "Debugging mode?"=FALSE, "Initialize App"=FALSE, "Insturment Debugging:Keithley"=FALSE, "Insturment Debugging:Arduinos"=FALSE, "Insturment Debugging:Thorlabs Motors"=FALSE, "Insturment Debugging:Photodetector"=FALSE) -> (instance out=w6)
            }
          }
          w1 = w5
        }
        frame False {
          w6 = w4
          w1 = w5
        }
      }
      $"Debugging Cluster Out" <- w6
    }
  }
  $"Error Out" <- w1
