vi "Initialize Detect Insturments SbRt.gvi"   [LabVIEW NXG 5.0.0]
inputs:
  "Instrument Control Mega Cluster In": "Instrument Control Mega Cluster.gtype"
  "Error In": error
outputs:
  "Instrument Control Mega Cluster Out": "Instrument Control Mega Cluster.gtype"
  "Error Out": error
types:
  "Instrument Coms Info.gtype" = cluster{"Arduino Coms Info": "Arduino Detection cluster control.gtype", "Photodetector Names": string[], "Keythley Address": "VISA Instr", "Photodetector Detected?": bool, "Thorlabs Motors Detected?": bool, "Keithley Detected?": bool, "Thorlabs Motors Serial Number": "Thorlabs Motors Serial Number In.gtype", "Photodetector IVI session": "Ivi IviDefault", "Flame ID": string, "Flame Detected?": bool, "Flame Wrapper ID": u64}
  "Debugging Cluster.gtype" = cluster{"Debugging mode?": bool, "Initialize App": bool, "Insturment Debugging": "Insturment Debugging Cluster.gtype"}
  "Instrument Control Mega Cluster.gtype" = cluster{"Instruments Coms Info": "Instrument Coms Info.gtype", "Debugging Cluster": "Debugging Cluster.gtype"}
uses:
  Rainbow Measurement Setup::Side Functions::Instrument Control::Debug Cluster Instrument Extractor.gvi
  Rainbow Measurement Setup::Side Functions::Instrument Control::Instrument Detector.gvi
  Rainbow Measurement Setup::Side Functions::Global Abort::FGV Global Abort.gvi
diagram:
  # This SubVI Initializes all the instruments that the Debugging cluster allows to initialize
  case ($"Error In") {
    frame Error, Default {
      w1 = $"Instrument Control Mega Cluster In"
      w2 = $"Error In"
    }
    frame No Error {
      call "Debug Cluster Instrument Extractor.gvi"(Instrument Control Mega Cluster In=$"Instrument Control Mega Cluster In", Error In=$"Error In") -> (Instrument Control Mega Cluster Out=w3, Instruments to Detect=w4, Error Out=w5)
      s1 = w5  # shift register
      s2 = w3  # shift register
      for {
        w6 = each element of w4
        call "Instrument Detector.gvi"(Instruments To Detect control=w6, Instrument Control Mega Cluster In=s2, Error In=s1) -> (Instrument Control Mega Cluster Out=w7, Error Out=w8)
        call "FGV Global Abort.gvi"(Global Abort Instructions="Read Current State", Error In=w8) -> (Global Abort Out=w9, Error Out=w10)
        next s1 = w10
        next s2 = w7
        stop if w9
      }
      w1 = s2
      w2 = s1
    }
  }
  $"Instrument Control Mega Cluster Out" <- w1
  $"Error Out" <- w2
