vi "Initialize app subroutine.gvi"   [LabVIEW NXG 5.0.0]
inputs:
  "Error In": error
  "Initialize App Bundle Cluster In": "Initialize App Bundle Cluster.gtype"
outputs:
  "Error Out": error
  "Initialize App Bundle Cluster Out": "Initialize App Bundle Cluster.gtype"
types:
  "Instrument Coms Info.gtype" = cluster{"Arduino Coms Info": "Arduino Detection cluster control.gtype", "Photodetector Names": string[], "Keythley Address": "VISA Instr", "Photodetector Detected?": bool, "Thorlabs Motors Detected?": bool, "Keithley Detected?": bool, "Thorlabs Motors Serial Number": "Thorlabs Motors Serial Number In.gtype", "Photodetector IVI session": "Ivi IviDefault", "Flame ID": string, "Flame Detected?": bool, "Flame Wrapper ID": u64}
  "Full Reference Cluster.gtype" = cluster{"Enum Reference Cluster": "Enum Control Reference Cluster.gtype", "Boolean Reference Cluster": "Boolean Control Reference Cluster.gtype", "Numeric Reference Cluster": "Numeric Control Reference Cluster.gtype", "Numeric Cluster Reference Cluster": "Numeric Cluster Reference Cluster.gtype", "Path Reference Cluster": "Path Reference Cluster.gtype", "Cluster Reference Cluster": "Cluster Reference Cluster.gtype", "XZ Stage Controls Reference Cluster": "XZ Stage Controls Reference Cluster.gtype"}
  "Debugging Cluster.gtype" = cluster{"Debugging mode?": bool, "Initialize App": bool, "Insturment Debugging": "Insturment Debugging Cluster.gtype"}
  "All Paths Cluster.gtype" = cluster{"Thorlabs Motor Serial Number File Path": path}
  "Initialize App Bundle Cluster.gtype" = cluster{"Instrument Coms Info": "Instrument Coms Info.gtype", "Full Reference Cluster": "Full Reference Cluster.gtype", "Debugging Cluster": "Debugging Cluster.gtype", "All Paths": "All Paths Cluster.gtype"}
uses:
  Rainbow Measurement Setup::Main Functions::Instruction Queue::Current State::FGV Current State.gvi
  Rainbow Measurement Setup::Main Functions::Initialize App::Instruction Extractor Initialize.gvi
  Rainbow Measurement Setup::Side Functions::Instrument Control::Thorlabs Motors::Detection::Thorlabs Serial Number Check.gvi
  Rainbow Measurement Setup::Side Functions::Global Abort::FGV Global Abort.gvi
  Rainbow Measurement Setup::Side Functions::Instrument Control::Arduino::XZ Stage Arduino::Low Level::XZ Stage Homed FGV.gvi
  Rainbow Measurement Setup::Main Functions::Rainbow Measurement::Light Power Calibration::Light Power Operation FGV.gvi
  Rainbow Measurement Setup::Side Functions::Instrument Control::Thorlabs Motors::Dividing Wavelength Control::Dividing Wavelength Calibration Data FGV.gvi
  Rainbow Measurement Setup::Side Functions::Utilities::Progress Handling::Progress FGV.gvi
  Rainbow Measurement Setup::Main Functions::Rainbow Measurement::Light Power Calibration::Light Calibration Live Parameters FGV.gvi
  Rainbow Measurement Setup::Side Functions::Sample Naming::Sample Prefix FGV.gvi
  Rainbow Measurement Setup::Main Functions::Rainbow Measurement::Cell Single Rainbow Measurement::SRM Live Parameters::SRM Sweep Live Parameters FGV.gvi
  Rainbow Measurement Setup::Side Functions::Messages And Prompts::FGV Cancel Prompts until Finished Routine.gvi
  Rainbow Measurement Setup::Side Functions::Instrument Control::Keithley::FGV Keithley timeout.gvi
  Rainbow Measurement Setup::Main Functions::Rainbow Measurement::Cell Single Rainbow Measurement::SRM Operation FGV.gvi
  Rainbow Measurement Setup::Main Functions::Initialize App::Initialize Detect Insturments SbRt.gvi
diagram:
  Property Node(instance in=$"Initialize App Bundle Cluster In") -> ("Debugging Cluster:Debugging mode?"=w1, "Debugging Cluster:Initialize App"=w2)
  Logical And(w1, not w2) -> w3
  # This is the Initialization Subroutine, its main job is to reset the values of controls, reset functional global variables, scan for instruments
  # and read configuration files among other things.
  case (w3) {
    frame True {
      w4 = $"Error In"
      w5 = $"Initialize App Bundle Cluster In"
    }
    frame False {
      case ($"Error In") {
        frame Error, Default {
          w4 = $"Error In"
          w5 = $"Initialize App Bundle Cluster In"
        }
        frame No Error {
          call "FGV Current State.gvi"(Current State Instructions="Set Current State", Current State="Initialize App", Error In=$"Error In") -> (Error Out=w6)
          call "Instruction Extractor Initialize.gvi"(Initialize app subroutine states="Reset Disabled/Enabled Controls", Error In=w6) -> (Initialize app States array=w7, SubStates Output Array=w8, Error Out=w9)
          s1 = w9  # shift register
          s2 = $"Initialize App Bundle Cluster In"  # shift register
          for {
            w10 = each element of w7
            w11 = each element of w8
            call "FGV Current State.gvi"(Current State Instructions="Set Current Substate", Current Substate=w11, Error In=s1) -> (Error Out=w12)
            case (w10) {
              frame "Read Configuration Files" {
                call "Thorlabs Serial Number Check.gvi"(Initialize App Bundle Cluster In=s2, Error In=w12) -> (Initialize App Bundle Cluster Out=w14, Error Out=w13)
              }
              frame "Reset Disabled/Enabled Controls", Default {
                w13 = w12
                w14 = s2
              }
              frame "Reset Doubles" {
                w13 = w12
                w14 = s2
              }
              frame "Reset Booleans" {
                w13 = w12
                w14 = s2
              }
              frame "Reset Strings" {
                w13 = w12
                w14 = s2
              }
              frame "Reset Global Variables" {
                call "FGV Global Abort.gvi"(Global Abort Instructions="Reset State", Error In=w12) -> (Error Out=w15)
                call "XZ Stage Homed FGV.gvi"(FGV Instructions="Reset State", Error In=w15) -> (Error Out=w16)
                call "Light Power Operation FGV.gvi"(FGV Instructions="Reset State", Error In=w16) -> (Error Out=w17)
                call "Dividing Wavelength Calibration Data FGV.gvi"(Div Wavelength FGV Instructions="Load Data", Error In=w17) -> (Error Out=w18)
                call "Progress FGV.gvi"(FGV Instructions="Reset State", Error In=w18) -> (Error Out=w19)
                call "Light Calibration Live Parameters FGV.gvi"(FGV Instructions="Reset State", Error In=w19) -> (Error Out=w20)
                call "Sample Prefix FGV.gvi"(FGV Instructions="Reset State", Error In=w20) -> (Error Out=w21)
                call "SRM Sweep Live Parameters FGV.gvi"(FGV Instructions="Reset State", Error In=w21) -> (Error Out=w22)
                call "FGV Cancel Prompts until Finished Routine.gvi"(Error In=w22, FGV Instructions="Reset State") -> (Error Out=w23)
                call "FGV Keithley timeout.gvi"(FGV Instructions="Reset State", Error In=w23) -> (Error Out=w24)
                call "SRM Operation FGV.gvi"(FGV Instructions="Reset State", Error In=w24) -> (Error Out=w13)
                w14 = s2
              }
              frame "Detect Instruments" {
                call "Initialize Detect Insturments SbRt.gvi"(Initialize App Bundle In=s2, Error In=w12) -> (Initialize App Bundle Out=w14, Error Out=w13)
              }
            }
            call "FGV Global Abort.gvi"(Global Abort Instructions="Read Current State", Error In=w13) -> (Global Abort Out=w25, Error Out=w26)
            next s1 = w26
            next s2 = w14
            stop if w25
          }
          w4 = s1
          w5 = s2
        }
      }
    }
  }
  $"Initialize App Bundle Cluster Out" <- w5
  $"Error Out" <- w4
