vi "Reset Global Variables Subroutine.gvi"   [LabVIEW NXG 5.0.0]
inputs:
  "Error In": error
  "Misc Data Mega Cluster In": "Misc Data Mega Cluster.gtype"
outputs:
  "Error Out": error
types:
  "Full Reference Cluster.gtype" = cluster{"Enum Reference Cluster": "Enum Control Reference Cluster.gtype", "Boolean Reference Cluster": "Boolean Control Reference Cluster.gtype", "Numeric Reference Cluster": "Numeric Control Reference Cluster.gtype", "Numeric Cluster Reference Cluster": "Numeric Cluster Reference Cluster.gtype", "Path Reference Cluster": "Path Reference Cluster.gtype", "Cluster Reference Cluster": "Cluster Reference Cluster.gtype", "XZ Stage Controls Reference Cluster": "XZ Stage Controls Reference Cluster.gtype"}
  "Cell Naming Cluster.gtype" = cluster{"Cell Label": string, "Sample Prefix": string, "Author Initials": string, "Current Date": string, "Batch Name": string}
  T1 = cluster{"X Coordinate (mm)": f64, "Z Coordinate (mm)": f64}
  T2 = cluster{"X Coordinate (mm)": f64, "Z Coordinate (mm)": f64, "Vertical Spacing (mm)": f64}
  "XZ All Position Cluster.gtype" = cluster{"Diffusor Coordinates": T1, "Photodetector Coordinates": T1, "Cell R.01 Coordinates": T2}
  T3 = cluster{"Thorlabs Motor Serial Number File Path": path, "Default Data Saving Location": path}
  "Misc Data Mega Cluster.gtype" = cluster{"Full Reference Cluster": "Full Reference Cluster.gtype", "Cell Naming Cluster": "Cell Naming Cluster.gtype", "All XZ Position Cluster": "XZ All Position Cluster.gtype", "All Paths": T3}
uses:
  Rainbow Measurement Setup::Main Functions::Rainbow Measurement::Cell Multiple Rainbow Measurement::Plotting::MRM Sweep Refined Data FGV.gvi
  Rainbow Measurement Setup::Main Functions::Rainbow Measurement::Cell Multiple Rainbow Measurement::MRM Live Parameters::MRM Sweep Live Parameters FGV.gvi
  Rainbow Measurement Setup::Side Functions::Global Abort::FGV Global Abort.gvi
  Rainbow Measurement Setup::Side Functions::Instrument Control::Arduino::XZ Stage Arduino::Low Level::XZ Stage Homed FGV.gvi
  Rainbow Measurement Setup::Main Functions::Rainbow Measurement::Light Power Calibration::Light Power Operation FGV.gvi
  Rainbow Measurement Setup::Side Functions::Instrument Control::Thorlabs Motors::Dividing Wavelength Control::Dividing Wavelength Calibration Data FGV.gvi
  Rainbow Measurement Setup::Side Functions::Utilities::Progress Handling::Progress FGV.gvi
  Rainbow Measurement Setup::Main Functions::Rainbow Measurement::Light Power Calibration::Light Calibration Live Parameters FGV.gvi
  Rainbow Measurement Setup::Side Functions::Sample Naming::Sample Prefix FGV.gvi
  Rainbow Measurement Setup::Main Functions::Rainbow Measurement::Cell Single Rainbow Measurement::SRM Live Parameters::SRM Sweep Live Parameters FGV.gvi
  Rainbow Measurement Setup::Side Functions::Messages And Prompts::FGV Cancel Prompts until Finished Routine.gvi
  Rainbow Measurement Setup::Side Functions::Instrument Control::Keithley::FGV Keithley timeout.gvi
  Rainbow Measurement Setup::Main Functions::Rainbow Measurement::Cell Single Rainbow Measurement::SRM Operation FGV.gvi
  Rainbow Measurement Setup::Main Functions::Rainbow Measurement::Single Multiple Measurement Utilities::FGV Last Measurement Type.gvi
diagram:
  # This SubVI Resets all the Global Variables
  case ($"Error In") {
    frame Error, Default {
      w1 = $"Error In"
    }
    frame No Error {
      call "MRM Sweep Refined Data FGV.gvi"(Misc Data Mega Cluster In=$"Misc Data Mega Cluster In", Error In=$"Error In", FGV Instructions="Read State") -> (Error Out=w2)
      call "MRM Sweep Live Parameters FGV.gvi"(FGV Instructions="Reset State", Misc Data Mega Cluster In=$"Misc Data Mega Cluster In", Error In=w2) -> (Error Out=w3)
      call "FGV Global Abort.gvi"(Global Abort Instructions="Reset State", Error In=w3) -> (Error Out=w4)
      call "XZ Stage Homed FGV.gvi"(FGV Instructions="Reset State", Error In=w4) -> (Error Out=w5)
      call "Light Power Operation FGV.gvi"(FGV Instructions="Reset State", Error In=w5) -> (Error Out=w6)
      call "Dividing Wavelength Calibration Data FGV.gvi"(Div Wavelength FGV Instructions="Load Data", Error In=w6) -> (Error Out=w7)
      call "Progress FGV.gvi"(FGV Instructions="Reset State", Error In=w7) -> (Error Out=w8)
      call "Light Calibration Live Parameters FGV.gvi"(FGV Instructions="Reset State", Error In=w8) -> (Error Out=w9)
      call "Sample Prefix FGV.gvi"(FGV Instructions="Reset State", Error In=w9) -> (Error Out=w10)
      call "SRM Sweep Live Parameters FGV.gvi"(FGV Instructions="Reset State", Error In=w10) -> (Error Out=w11)
      call "FGV Cancel Prompts until Finished Routine.gvi"(Error In=w11, FGV Instructions="Reset State") -> (Error Out=w12)
      call "FGV Keithley timeout.gvi"(FGV Instructions="Reset State", Error In=w12) -> (Error Out=w13)
      call "SRM Operation FGV.gvi"(FGV Instructions="Reset State", Error In=w13) -> (Error Out=w14)
      call "FGV Last Measurement Type.gvi"(FGV Instructions="Reset State", Error In=w14) -> (Error Out=w1)
    }
  }
  $"Error Out" <- w1
