vi "Beam Power Density Calibration Subroutine.gvi"   [LabVIEW NXG 5.0.0]
inputs:
  "Error In": error
outputs:
  "Error Out": error
panel controls:
  "Stand Alone?": bool
  "Instrument Coms Info Out": "Instrument Coms Info.gtype"
  "XZ Scan Parameters In": "XZ Scan Parameters.gtype" = {"X Scan Range (mm)"=3, "Z Scan Range (mm)"=3, "X Steps"=3, "Z Steps"=3, "Center Coordinate X"=50, "Center Coordinate Z"=50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}
  "Rainbow Sweep Parameters": "Rainbow Sweep Param Selector.gtype" = {0, 500, 498, 1, 0, 0}
panel indicators:
  "Beam Power Density Full Scan Data": "Beam Power Density Full Scan Data Cluster.gtype"[]
types:
  T1 = cluster{"Element 1": "VISA Instr", "Element 2": string}
  "Arduino Detection cluster control.gtype" = cluster{"XZ Stage Arduino Address": "VISA Instr", "XZ Stage Arduino Detected?": bool, "Multiplexer Arduino Detected?": bool, "Multiplexer Arduino Address": "VISA Instr", "Arduinos List": T1[], "XZ Stage Log": string, "Multiplexer Log": string}
  "Thorlabs Motors Serial Number In.gtype" = cluster{"Thorlabs Blue Motor": string, "Thorlabs Red Motor": string, "Blue Motor Homed?": bool, "Red Motor Homed?": bool}
  "Instrument Coms Info.gtype" = cluster{"Arduino Coms Info": "Arduino Detection cluster control.gtype", "Photodetector Names": string[], "Keythley Address": "VISA Instr", "Photodetector Detected?": bool, "Thorlabs Motors Detected?": bool, "Keithley Detected?": bool, "Thorlabs Motors Serial Number": "Thorlabs Motors Serial Number In.gtype", "Photodetector IVI session": "Ivi IviDefault"}
  "XZ Scan Parameters.gtype" = cluster{"X Scan Range (mm)": f64, "Z Scan Range (mm)": f64, "X Steps": f64, "Z Steps": f64, "Center Coordinate X": f64, "Center Coordinate Z": f64, "Z Step size": f64, "X Step size": f64, "Total Steps": f64, "Z Starting Point": f64, "X Starting Point": f64, "Z End Point": f64, "X End Point": f64}
  "Raibow Sweep Selector.gtype" = enum{"Red Sweep", "Blue Sweep", "Full Sweep Red First", "Full Sweep Blue First"}
  "Rainbow Sweep Type Selector.gtype" = cluster{"Red Sweep Mode": enum{"Red Sweep Closing", "Red Sweep Opening"}, "Blue Sweep Mode": enum{"Blue Sweep Opening", "Blue Sweep Closing"}}
  "Rainbow Sweep Param Selector.gtype" = cluster{"Raibow Sweep Selector": "Raibow Sweep Selector.gtype", "Max Wavelength (nm)": f64, "Min Wavelength (nm)": f64, "Wavelength Step (nm)": f64, "Rainbow Sweep Types": "Rainbow Sweep Type Selector.gtype"}
  "XZ Coordinate Array.gtype" = "XZ Coordinate Cluster.gtype"[]
  "Beam Power Density Single Sweep Data Cluster.gtype" = cluster{"Beam Power Density": f64[][], "Dividing Wavelength": f64, "XZ Array": "XZ Coordinate Array.gtype"}
  "Rainbow Sweep Types.gtype" = enum{"Red Sweep Closing", "Red Sweep Opening", "Blue Sweep Closing", "Blue Sweep Opening"}
  "Beam Power Density Full Scan Data Cluster.gtype" = cluster{"Beam Power Density Single Sweep Data Array": "Beam Power Density Single Sweep Data Cluster.gtype"[], "Rainbow Sweep Types": "Rainbow Sweep Types.gtype"}
uses:
  Rainbow Measurement Setup::Side Functions::Scanning Calculations::Scan Points Generator.gvi
  Rainbow Measurement Setup::Main Functions::One Time Calibrations::Beam Power Density::Specific Detect Instruments Subroutine.gvi
  Rainbow Measurement Setup::Side Functions::Instrument Control::Thorlabs Motors::Dividing Wavelength Control::Dividing Wavelength Calibration Data FGV.gvi
  Rainbow Measurement Setup::Side Functions::Instrument Control::Thorlabs Motors::Movement::KCube Move to 0 or Home.gvi
  Rainbow Measurement Setup::Side Functions::Instrument Control::Thorlabs Motors::Movement::KCube Motors Initialize.gvi
  Rainbow Measurement Setup::Side Functions::Instrument Control::Arduino::XZ Stage Arduino::Low Level::XZ Stage Initialize.gvi
  Rainbow Measurement Setup::Side Functions::Instrument Control::Arduino::XZ Stage Arduino::XZ Stage Home Sequence.gvi
  LabView_NXG_Thorlabs_PM100::Examples::Photodetector initialization Sequence with prompt.gvi
  Rainbow Measurement Setup::Side Functions::Rainbow Sweep::Rainbow Sweep Param Generator.gvi
  Rainbow Measurement Setup::Main Functions::One Time Calibrations::Beam Power Density::Beam Power Density Full Scan Subroutine.gvi
  LabView_NXG_Thorlabs_PM100::Miscelanous::TLPM Close.gvi
  NI::G Core::Error::Clear Error Cluster.gvi
  NI::VISA::Close (Instr).gvi
  Rainbow Measurement Setup::Side Functions::Instrument Control::Thorlabs Motors::Movement::KCube Motors Close.gvi
  Rainbow Measurement Setup::Main Functions::One Time Calibrations::Beam Power Density::Beam Power Density Visualizer.gvi
  Rainbow Measurement Setup::Side Functions::Global Abort::FGV Global Abort.gvi
diagram:
  w1 = $"Rainbow Sweep Parameters"
  w2 = $"Stand Alone?"
  # This subVI performs a scan of the beam. It basically measures the power at several points while also changing the guillotine motors to see how the wavelength division
  # affects the power density output of the beam. Aftewards (still to be implemented) it exposes the data in an understandable way so that the user can extract conclusions from it
  case ($"Error In") {
    frame Error, Default {
      w3 = $"Error In"
      w4 = default
      w5 = $"Instrument Coms Info Out"
    }
    frame No Error {
      s1 = $"Error In"  # shift register
      s2 = $"Instrument Coms Info Out"  # shift register
      s3 = "Check Scan Area Range"  # shift register
      s4 = uninitialised  # shift register
      s5 = $"XZ Scan Parameters In"  # shift register
      s6 = "Beam Power Density Full Scan Data Cluster.gtype"[] []  # shift register
      while {
        case (s3) {
          frame "Check Scan Area Range", Default {
            Select(s=w2, t="Detect Instruments", f="Initialize Instruments") -> w13
            call "Scan Points Generator.gvi"(XZ Scan Parameters In=s5, Error In=s1) -> (XZ Scan Parameters Out=w11, XZ Coordinate Array=w9, All In Range?=w14, Error Out=w6)
            Select(s=w14, t=w13, f="Stop App") -> w8
            w7 = s2
            w10 = default
            w12 = s6
          }
          frame "Detect Instruments" {
            call "Specific Detect Instruments Subroutine.gvi"(Instrument Coms Info In=s2, Error In=s1, Instruments To Detect Array=["Photodetector", "Arduinos", "Thorlabs Motors"], Stand Alone?=w2) -> (Instrument Coms Info Out=w7, Error Out=w15)
            call "Dividing Wavelength Calibration Data FGV.gvi"(General FGV Instructions="Set State", Error In=w15) -> (Error Out=w6)
            w8 = "Initialize Instruments"
            w9 = s4
            w10 = default
            w11 = s5
            w12 = s6
          }
          frame "Initialize Instruments" {
            call "KCube Move to 0 or Home.gvi"(Instrument Coms Info In=s2, Error In=s1) -> (Instrument Coms Info Out=w16, Error Out=w17)
            call "KCube Motors Initialize.gvi"(Instrument Coms Info In=w16, Error In=w17) -> (Instrument Coms Info Out=w18, Error Out=w19)
            Property Node(instance in=w18) -> ("Arduino Coms Info:XZ Stage Arduino Address"=w20, instance out=w21)
            call "XZ Stage Initialize.gvi"(XZ Carriage Arduino Adress In=w20, Error In=w19) -> (XZ Carriage Arduino Visa Session Out=w22, XZ Carriage Arduino Log=w23, Error Out=w24)
            call "XZ Stage Home Sequence.gvi"(XZ Carriage Arduino Open Visa Session In=w22, XZ Carriage Arduino Log In=w23, Error In=w24) -> (XZ Carriage Arduino Log Out=w25, Error Out=w26)
            call "Photodetector initialization Sequence with prompt.gvi"(Error In=w26) -> (Photodetector IVI session=w27, Error Out=w6)
            Property Node(instance in=w21, "Photodetector IVI session"=w27, "Arduino Coms Info:XZ Stage Log"=w25) -> (instance out=w7)
            w8 = "Scan"
            w9 = s4
            w10 = default
            w11 = s5
            w12 = s6
          }
          frame "Scan" {
            call "Rainbow Sweep Param Generator.gvi"(Rainbow Sweep Parameters=w1, Error In=s1) -> (Rainbow Sweep Parameters Array=w28, Error Out=w29)
            call "Beam Power Density Full Scan Subroutine.gvi"(Beam Power Density Full Scan Data Array In=s6, Instrument Coms Info In=s2, XZ Coordinate Array In=s4, XZ Scan Parameters In=s5, Rainbow Sweep Parameters Array=w28, Error In=w29) -> (Beam Power Density Full Scan Data Array Out=w12, Instrument Coms Info Out=w7, Error Out=w6)
            w8 = "Close Coms"
            w9 = s4
            w10 = default
            w11 = s5
          }
          frame "Close Coms" {
            Property Node(instance in=s2) -> ("Arduino Coms Info:XZ Stage Arduino Address"=w30, "Photodetector IVI session"=w31, instance out=w32)
            call "TLPM Close.gvi"(IVI session in=w31, error in (no error)=s1) -> (error out=w33)
            call "Clear Error Cluster.gvi"(error in=w33) -> (error out=w34)
            call "Close (Instr).gvi"(session in=w30, error in=w34) -> (error out=w35)
            call "KCube Motors Close.gvi"(Instrument Coms Info In=w32, Error In=w35) -> (Instrument Coms Info Out=w7, Error Out=w6)
            w8 = "Check Graphs"
            w9 = s4
            w10 = default
            w11 = s5
            w12 = s6
          }
          frame "Check Graphs" {
            call "Beam Power Density Visualizer.gvi"(Beam Power Density Full Scan Data Array=s6, XZ Scan Parameters In=s5, Error In=s1) -> (Error Out=w6)
            w7 = s2
            w8 = "Stop App"
            w9 = s4
            w10 = default
            w11 = s5
            w12 = s6
          }
          frame "Stop App" {
            w6 = s1
            w7 = s2
            w8 = "Check Scan Area Range"
            w9 = s4
            w10 = TRUE
            w11 = s5
            w12 = s6
          }
        }
        call "FGV Global Abort.gvi"(Global Abort Instructions="Read Current State", Error In=w6) -> (Local Abort Out=w36, Global Abort Out=w37, Error Out=w38)
        Logical Or(w36, w37, w10) -> w39
        next s1 = w38
        next s2 = w7
        next s3 = w8
        next s4 = w9
        next s5 = w11
        next s6 = w12
        stop if w39
      }
      w3 = s1
      w4 = s6
      w5 = s2
    }
  }
  $"Beam Power Density Full Scan Data" <- w4
  $"Instrument Coms Info Out" <- w5
  $"Error Out" <- w3
