vi "Single Scan Subroutine.gvi"   [LabVIEW NXG 5.0.0]
inputs:
  "Error In": error
  "Instrument Control Mega Cluster In": "Instrument Control Mega Cluster.gtype"
  "XZ Coordinate Array In": "XZ Coordinate Array.gtype"
outputs:
  "Error Out": error
  "Instrument Control Mega Cluster Out": "Instrument Control Mega Cluster.gtype"
  "XZ Coordinate Array Out": "XZ Coordinate Array.gtype"
types:
  "XZ Coordinate Cluster.gtype" = cluster{"X Coordinate (mm)": f64, "Z Coordinate (mm)": f64, "Coordinate Gcode": string, "Beam Power (W)": f64}
  "XZ Coordinate Array.gtype" = "XZ Coordinate Cluster.gtype"[]
  "Instrument Coms Info.gtype" = cluster{"Arduino Coms Info": "Arduino Detection cluster control.gtype", "Photodetector Names": string[], "Keythley Address": "VISA Instr", "Photodetector Detected?": bool, "Thorlabs Motors Detected?": bool, "Keithley Detected?": bool, "Thorlabs Motors Serial Number": "Thorlabs Motors Serial Number In.gtype", "Photodetector IVI session": "Ivi IviDefault", "Flame ID": string, "Flame Detected?": bool, "Flame Wrapper ID": u64}
  "Debugging Cluster.gtype" = cluster{"Debugging mode?": bool, "Initialize App": bool, "Insturment Debugging": "Insturment Debugging Cluster.gtype"}
  "Instrument Control Mega Cluster.gtype" = cluster{"Instruments Coms Info": "Instrument Coms Info.gtype", "Debugging Cluster": "Debugging Cluster.gtype"}
uses:
  Rainbow Measurement Setup::Side Functions::Instrument Control::Arduino::XZ Stage Arduino::Low Level::XZ Stage Move To Location.gvi
  Rainbow Measurement Setup::Side Functions::Instrument Control::Arduino::XZ Stage Arduino::Low Level::XZ Stage Fast Movement.gvi
  Rainbow Measurement Setup::Side Functions::Instrument Control::Photodetector::Photodetector Measure Power.gvi
  Rainbow Measurement Setup::Side Functions::Global Abort::FGV Global Abort.gvi
diagram:
  # This SubVI Reads the XZ Coordinates of the desired map and sweeps the entire area
  # measuring the light power at each point and it saves the value to the XZ Coordinate Array
  case ($"Error In") {
    frame Error, Default {
      w1 = $"Error In"
      w2 = $"XZ Coordinate Array In"
      w3 = $"Instrument Control Mega Cluster In"
    }
    frame No Error {
      Array Size(array=$"XZ Coordinate Array In") -> (size(s)=w4)
      Property Node(instance in=$"Instrument Control Mega Cluster In") -> ("Instruments Coms Info:Arduino Coms Info:XZ Stage Arduino Address"=w5, "Instruments Coms Info:Arduino Coms Info:XZ Stage Log"=w6, instance out=w7)
      Array Index(array=$"XZ Coordinate Array In") -> (out0[0]=w8)
      Property Node(instance in=w8) -> ("Coordinate Gcode"=w9)
      call "XZ Stage Move To Location.gvi"(XZ Carriage Arduino open Visa session In=w5, XZ Carriage Arduino Log In=w6, Error In=$"Error In", Input Command=w9) -> (XZ Carriage Arduino open Visa Session Out=w10, XZ Carriage Arduino Log Out=w11, Error Out=w12)
      s1 = w12  # shift register
      s2 = w10  # shift register
      s3 = w11  # shift register
      s4 = $"XZ Coordinate Array In"  # shift register
      s5 = w7  # shift register
      for (N = w4) (iteration -> i1) {
        Array Index(array=s4) -> (out0[i1]=w13)
        Property Node(instance in=w13) -> ("Coordinate Gcode"=w14, instance out=w15)
        call "XZ Stage Fast Movement.gvi"(XZ Carriage Arduino open Visa session In=s2, XZ Stage Arduino Log In=s3, Error In=s1, Input Command=w14, ms Wait Fast Movement=10) -> (XZ Carriage Arduino open Visa Session Out=w16, XZ Stage Arduino Log Out=w17, Error Out=w18)
        call "Photodetector Measure Power.gvi"(Instrument Control Mega Cluster In=s5, Error In=w18) -> (Instrument Control Mega Cluster Out=w19, Measured Power=w20, Error Out=w21)
        Property Node(instance in=w15, "Beam Power (W)"=w20) -> (instance out=w22)
        Replace Array Subset(inArray=s4, index=i1, new=w22) -> w23
        call "FGV Global Abort.gvi"(Global Abort Instructions="Read Current State", Error In=w21) -> (Local Abort Out=w24, Global Abort Out=w25, Error Out=w26)
        Logical Or(w24, w25) -> w27
        next s1 = w26
        next s2 = w16
        next s3 = w17
        next s4 = w23
        next s5 = w19
        stop if w27
      }
      w1 = s1
      w2 = s4
      w3 = s5
    }
  }
  $"XZ Coordinate Array Out" <- w2
  $"Instrument Control Mega Cluster Out" <- w3
  $"Error Out" <- w1
