vi "Specific Detect Instruments Subroutine.gvi"   [LabVIEW NXG 5.0.0]
inputs:
  "Instrument Control Mega Cluster In": "Instrument Control Mega Cluster.gtype"
  "Error In": error
  "Instruments To Detect Array": "Instruments To Detect control.gtype"[] = ["Photodetector", "Arduinos"]
  "Stand Alone?": bool
outputs:
  "Instrument Control Mega Cluster Out": "Instrument Control Mega Cluster.gtype"
  "Error Out": error
types:
  "Instruments To Detect control.gtype" = enum{"Photodetector", "Keithley", "Arduinos", "Thorlabs Motors", "Flame Spectr"}
  "Instrument Coms Info.gtype" = cluster{"Arduino Coms Info": "Arduino Detection cluster control.gtype", "Photodetector Names": string[], "Keythley Address": "VISA Instr", "Photodetector Detected?": bool, "Thorlabs Motors Detected?": bool, "Keithley Detected?": bool, "Thorlabs Motors Serial Number": "Thorlabs Motors Serial Number In.gtype", "Photodetector IVI session": "Ivi IviDefault", "Flame ID": string, "Flame Detected?": bool, "Flame Wrapper ID": u64}
  "Debugging Cluster.gtype" = cluster{"Debugging mode?": bool, "Initialize App": bool, "Insturment Debugging": "Insturment Debugging Cluster.gtype"}
  "Instrument Control Mega Cluster.gtype" = cluster{"Instruments Coms Info": "Instrument Coms Info.gtype", "Debugging Cluster": "Debugging Cluster.gtype"}
uses:
  Rainbow Measurement Setup::Side Functions::Instrument Control::Instrument Detector.gvi
  Rainbow Measurement Setup::Side Functions::Global Abort::FGV Global Abort.gvi
diagram:
  # This subVI Basically detects the arduino and photodetector
  # only if the arduino address is empty. It is basically to prevent long
  # wait times when debugging.
  case ($"Error In") {
    frame Error, Default {
      w1 = $"Error In"
      w2 = $"Instrument Control Mega Cluster In"
    }
    frame No Error {
      Property Node(instance in=$"Instrument Control Mega Cluster In") -> ("Instruments Coms Info:Arduino Coms Info:XZ Stage Arduino Address"=w3, instance out=w4)
      Is Empty String Or Path(string/path=w3) -> w5
      case (w5) {
        frame False, Default {
          w2 = w4
          w1 = $"Error In"
        }
        frame True {
          s1 = $"Error In"  # shift register
          s2 = w4  # shift register
          for {
            w6 = each element of $"Instruments To Detect Array"
            call "Instrument Detector.gvi"(Instruments To Detect control=w6, Instrument Control Mega Cluster In=s2, Error In=s1, Stand Alone?=$"Stand Alone?") -> (Instrument Control Mega Cluster Out=w7, Error Out=w8)
            call "FGV Global Abort.gvi"(Global Abort Instructions="Read Current State", Error In=w8) -> (Global Abort Out=w9, Error Out=w10)
            next s1 = w10
            next s2 = w7
            stop if w9
          }
          w2 = s2
          w1 = s1
        }
      }
    }
  }
  $"Instrument Control Mega Cluster Out" <- w2
  $"Error Out" <- w1
