vi "Beam Spectrum Calibration Subroutine.gvi"   [LabVIEW NXG 5.0.0]
inputs:
  "Error In": error
outputs:
  "Error Out": error
panel controls:
  "Stand Alone?": bool
  "Instrument Coms Info In": "Instrument Coms Info.gtype"
  "Beam Spectrum Calibration Parameters": "Beam Spectrum Calibration Parameters.gtype"
  "Rainbow Sweep Param Selector": "Rainbow Sweep Param Selector.gtype" = {0, 1100, 300, 1, 1, 0}
types:
  T1 = cluster{"Element 1": "VISA Instr", "Element 2": string}
  "Arduino Detection cluster control.gtype" = cluster{"XZ Stage Arduino Address": "VISA Instr", "XZ Stage Arduino Detected?": bool, "Multiplexer Arduino Detected?": bool, "Multiplexer Arduino Address": "VISA Instr", "Arduinos List": T1[], "XZ Stage Log": string, "Multiplexer Log": string}
  "Thorlabs Motors Serial Number In.gtype" = cluster{"Thorlabs Blue Motor": string, "Thorlabs Red Motor": string}
  "Instrument Coms Info.gtype" = cluster{"Arduino Coms Info": "Arduino Detection cluster control.gtype", "Photodetector Names": string[], "Keythley Address": "VISA Instr", "Photodetector Detected?": bool, "Thorlabs Motors Detected?": bool, "Keithley Detected?": bool, "Thorlabs Motors Serial Number": "Thorlabs Motors Serial Number In.gtype", "Photodetector IVI session": "Ivi IviDefault"}
  "Beam Spectrum Calibration Parameters.gtype" = cluster{"Min Position (mm)": f64, "Max Position (mm)": f64, "Position step size (mm)": f64}
  "Raibow Sweep Selector.gtype" = enum{"Red Sweep", "Blue Sweep", "Full Sweep Red First", "Full Sweep Blue First"}
  "Rainbow Sweep Type Selector.gtype" = cluster{"Red Sweep Mode": enum{"Red Sweep Closing", "Red Sweep Opening"}, "Blue Sweep Mode": enum{"Blue Sweep Opening", "Blue Sweep Closing"}}
  "Rainbow Sweep Param Selector.gtype" = cluster{"Raibow Sweep Selector": "Raibow Sweep Selector.gtype", "Max Wavelength (nm)": f64, "Min Wavelength (nm)": f64, "Wavelength Step (nm)": f64, "Rainbow Sweep Types": "Rainbow Sweep Type Selector.gtype"}
  "Beam Spectrum Data.gtype" = cluster{"Beam Spectrum": cluster{"Wavelength": f64[], "Counts": f64[]}, "Blue Motor Position (mm)": f64, "Red Motor Position (mm)": f64}
  "Rainbow Sweep Types.gtype" = enum{"Red Sweep Closing", "Red Sweep Opening", "Blue Sweep Closing", "Blue Sweep Opening"}
  "Full Beam Multispectral Data.gtype" = cluster{"Beam Spectrum Data Array": "Beam Spectrum Data.gtype"[], "Rainbow Sweep Types": "Rainbow Sweep Types.gtype"}
uses:
  Rainbow Measurement Setup::Main Functions::One Time Calibrations::Beam Power Density::Specific Detect Instruments Subroutine.gvi
  Rainbow Measurement Setup::Side Functions::Instrument Control::Arduino::XZ Stage Arduino::Low Level::XZ Stage Initialize.gvi
  Rainbow Measurement Setup::Side Functions::Instrument Control::Arduino::XZ Stage Arduino::XZ Stage Home Sequence.gvi
  LabView_NXG_Thorlabs_PM100::Examples::Photodetector initialization Sequence with prompt.gvi
  Rainbow Measurement Setup::Side Functions::Rainbow Sweep::Rainbow Sweep Type Extractor.gvi
  NXG_KCube_DC_Servo_Control::Utilities::Initialize Motor.gvi
  NXG_KCube_DC_Servo_Control::Utilities::Home Subroutine.gvi
diagram:
  w1 = $"Stand Alone?"
  w2 = $"Beam Spectrum Calibration Parameters"
  w3 = $"Rainbow Sweep Param Selector"
  # Falta comunicar amb el flame :') DRAMA
  case ($"Error In") {
    frame Error, Default {
      w4 = $"Error In"
    }
    frame No Error {
      s1 = $"Error In"  # shift register
      s2 = uninitialised  # shift register
      s3 = $"Instrument Coms Info In"  # shift register
      while {
        case ("Start App") {
          frame "Start App", Default {
            Select(s=w1, t="Detect Instruments", f="Initialize Instruments") -> w5
            w6 = _
            w7 = _
          }
          frame "Detect Instruments" {
            call "Specific Detect Instruments Subroutine.gvi"(Instrument Coms Info In=s3, Error In=s1, Instruments To Detect Array=["Photodetector", "Arduinos", "Thorlabs Motors"]) -> (Instrument Coms Info Out=w7, Error Out=w6)
            w5 = "Initialize Instruments"
          }
          frame "Initialize Instruments" {
            Property Node(instance in=s3) -> ("Arduino Coms Info:XZ Stage Arduino Address"=w8, instance out=w9)
            call "XZ Stage Initialize.gvi"(XZ Carriage Arduino Adress In=w8, Error In=s1) -> (XZ Carriage Arduino Visa Session Out=w10, XZ Carriage Arduino Log=w11, Error Out=w12)
            call "XZ Stage Home Sequence.gvi"(XZ Carriage Arduino Open Visa Session In=w10, XZ Carriage Arduino Log In=w11, Error In=w12) -> (XZ Carriage Arduino Log Out=w13, Error Out=w14)
            call "Photodetector initialization Sequence with prompt.gvi"(Error In=w14) -> (Photodetector IVI session=w15, Error Out=w6)
            Property Node(instance in=w9, "Photodetector IVI session"=w15, "Arduino Coms Info:XZ Stage Log"=w13) -> (instance out=w7)
            w5 = "Rainbow Sweep"
          }
          frame "Rainbow Sweep" {
            Property Node(instance in=w2) -> ("Min Position (mm)"=w16, "Max Position (mm)"=w17, "Position step size (mm)"=w18)
            call "Rainbow Sweep Type Extractor.gvi"(Rainbow Sweep Parameters=w3, Error In=s1) -> (Rainbow Sweep Array=w19, Error Out=w20)
            Subtract(x=w17, y=w16) -> w21
            Divide(x=w21, y=w18) -> w22
            To Signed 32 Bit Integer(number=w22) -> w23
            # w23: Number of Steps
            s4 = "Full Beam Multispectral Data.gtype"[] []  # shift register
            s5 = w20  # shift register
            s6 = s3  # shift register
            for {
              w24 = each element of w19
              case (w24) {
                frame "Red Sweep Closing", Default {
                  w25 = _
                }
                frame "Red Sweep Opening" {
                  for (N = w23) (iteration -> i1) {
                    To Double Precision Float(number=i1) -> w26
                    Multiply(w18, w26) -> w27
                    Subtract(x=w17, y=w27)
                  }
                  Property Node(instance in=s6) -> ("Thorlabs Motors Serial Number:Thorlabs Blue Motor"=w28, instance out=w25)
                  call "Initialize Motor.gvi"(Current Motor Serial nº In=w28, Error In=s5) -> (Current Motor Serial nº Out=w29, Error Out=w30)
                  call "Home Subroutine.gvi"(Motor Serial Number In=w29, Error In=w30)
                }
              }
              next s4 = _
              next s5 = _
              next s6 = w25
            }
            w5 = _
            w6 = _
            w7 = _
          }
        }
        next s1 = w6
        next s2 = w5
        next s3 = w7
        stop if _
      }
      w4 = _
    }
  }
  $"Error Out" <- w4
