vi "MSpot Spectrum Visualizer.gvi"   [LabVIEW NXG 5.0.0]
inputs:
  "Error In": error
  "MSpot Mega Cluster In": "MSpot Mega Cluster.gtype"
outputs:
  "Error Out": error
panel controls:
  "Sweep Type Selector": i32
  "Graph (position) Selector": i32
  "Continue": bool
  "Divide?": bool
  "Smooth Peaks?": bool
  "Graph (position) Selector 2": i32
  "Add Two Spectra": bool
  "Full Spectrum": bool
panel indicators:
  "Rainbow Sweep Type": "Rainbow Sweep Types.gtype"
  "M Spot Spectrum": cluster{"Element 1": f64[], "Element 2": f64[]}[]
  "MSpot Spectrum Data": "MSpot Spectrum Data.gtype"
types:
  "Rainbow Sweep Types.gtype" = enum{"Red Sweep Closing", "Red Sweep Opening", "Blue Sweep Closing", "Blue Sweep Opening"}
  "MSpot Spectrum Data.gtype" = cluster{"M Spot Spectrum": cluster{"Wavelength": f64[], "Counts": f64[]}, "Blue Motor Position (mm)": f64, "Red Motor Position (mm)": f64, "Dividing Wavelength (nm)": f64}
  "Raibow Sweep Selector.gtype" = enum{"Red Sweep", "Blue Sweep", "Full Sweep Red First", "Full Sweep Blue First"}
  "Rainbow Sweep Param Selector.gtype" = cluster{"Raibow Sweep Selector": "Raibow Sweep Selector.gtype", "Max Wavelength (nm)": f64, "Min Wavelength (nm)": f64, "Wavelength Step (nm)": f64, "Rainbow Sweep Type Selector": "Rainbow Sweep Type Selector.gtype"}
  "MSpot Spectrum Calibration Parameters.gtype" = cluster{"Min Position (mm)": f64, "Max Position (mm)": f64, "Position step size (mm)": f64, "Manual Spectra?": bool, "Flame Integration Time (us)": f64, "Flame Scans to Average": u32}
  "Full MSpot Multispectral Data.gtype" = cluster{"MSpot Spectrum Data Array": "MSpot Spectrum Data.gtype"[], "Rainbow Sweep Types": "Rainbow Sweep Types.gtype"}
  "MSpot Mega Cluster.gtype" = cluster{"Rainbow Sweep Parameters MSpot": "Rainbow Sweep Param Selector.gtype", "MSpot Sperctrum Calibration Parameters": "MSpot Spectrum Calibration Parameters.gtype", "Full Beam Multispectral Data Array": "Full MSpot Multispectral Data.gtype"[]}
uses:
  Rainbow Measurement Setup::Side Functions::Instrument Control::Thorlabs Motors::Dividing Wavelength Control::Dividing Wavelength Calibration Data FGV.gvi
  Rainbow Measurement Setup::Main Functions::One Time Calibrations::MSpot Spectrum::Data Visualization::Two Different Sweep Type Check and extract.gvi
  Rainbow Measurement Setup::Main Functions::One Time Calibrations::MSpot Spectrum::Data Visualization::Max Spectra Extractor.gvi
  Rainbow Measurement Setup::Side Functions::Instrument Control::Thorlabs Motors::Dividing Wavelength Control::Dividing Wavelength Basic Translator.gvi
  NI::G Core::Error::Multiplex Errors.gvi
  Rainbow Measurement Setup::Main Functions::One Time Calibrations::MSpot Spectrum::Dividing Wavelength Calculations::Spectra Operator.gvi
diagram:
  Property Node(instance in=reference to unnamed native front panel, error in=$"Error In") -> ("Window"=w1, error out=w2)
  Open Window(reference in=w1, error in=w2) -> (reference out=w3, error out=w4)
  Property Node(instance in=reference to "Graph (position) Selector 2", "Visible"=FALSE, error in=w4) -> (error out=w5)
  Property Node(instance in=reference to "Full Spectrum", "Visible"=FALSE, error in=w5) -> (error out=w6)
  # This subVI allows us to visualize the data obtained on the Measuring Spot Spectrum Calibration subroutine so that we can
  # extract our own conclusions and elaborate the calibration file.
  case (w6) {
    frame Error, Default {
      w7 = w6
      w8 = w3
    }
    frame No Error {
      Property Node(instance in=$"MSpot Mega Cluster In") -> ("Full Beam Multispectral Data Array"=w9)
      Is Empty Array(array=w9) -> w10
      case (w10) {
        frame True {
          One Button Dialog(button name ("OK")="Oh, sorry", message="No Calibration Found")
          w7 = w6
        }
        frame False {
          call "Dividing Wavelength Calibration Data FGV.gvi"(Div Wavelength FGV Instructions="Read Loaded Data", Error In=w6) -> (Dividing Wavelength Calibration Data Out=w11, Error Out=w12)
          Array Index(array=w9) -> (out0[$"Sweep Type Selector"]=w13)
          s1 = w13  # shift register
          while {
            event (timeout = 50) {
              on "Timeout" {
                call "Two Different Sweep Type Check and extract.gvi"(Full Beam Multispectral data Array In=w9, Error In=w12) -> (Red Spectra=w15, Blue Spectra=w16, Error Out=w17)
                Array Size(array=w9) -> (size(s)=w18)
                Decrement(x=w18) -> w19
                Is Not Equal To 0(x=w19) -> w20
                Logical And(w20, not $"Add Two Spectra") -> w21
                Property Node(instance in=reference to "Sweep Type Selector", "Maximum"=w19, "Minimum"=0, "Visible"=w21, error in=w17) -> (error out=w22)
                Not(x=$"Add Two Spectra") -> w23
                Property Node(instance in=reference to "Rainbow Sweep Type", "Visible"=w23, error in=w22) -> (error out=w24)
                case ($"Add Two Spectra") {
                  frame False {
                    Property Node(instance in=s1) -> ("MSpot Spectrum Data Array"=w25, "Rainbow Sweep Types"=w26, instance out=w14)
                    Array Index(array=w25) -> (out0[$"Graph (position) Selector"]=w27)
                    Property Node(instance in=w27) -> ("M Spot Spectrum"=w28, "Dividing Wavelength (nm)"=w29)
                    Property Node(instance in=w28) -> ("Wavelength"=w30, "Counts"=w31)
                    Is Empty Array(array=w31) -> w32
                    case (w32) {
                      frame True { }
                      frame False {
                        Build Cluster(w30, w31) -> w33
                        Build Array(w33) -> w34
                        $"M Spot Spectrum" <- w34
                      }
                    }
                    $"MSpot Spectrum Data" <- w27
                    $"Rainbow Sweep Type" <- w26
                    Property Node(instance in=reference to "M Spot Spectrum") -> ("Cursor"=w35)
                    Property Node(instance in=w35, "XPosition"=w29, "Visible"=TRUE)
                    Array Size(array=w25) -> (size(s)=w36)
                    Decrement(x=w36) -> w37
                    Property Node(instance in=reference to "Graph (position) Selector", "Minimum"=0, "Maximum"=w37, error in=w24) -> (error out=w7)
                  }
                  frame True {
                    Property Node(instance in=w15) -> ("MSpot Spectrum Data Array"=w38)
                    Array Index(array=w38) -> (out0[$"Graph (position) Selector"]=w39)
                    Property Node(instance in=w39) -> ("M Spot Spectrum"=w40, "Blue Motor Position (mm)"=w41)
                    call "Max Spectra Extractor.gvi"(Full MSpot Multispectral Data=w16, Error In=w24) -> (Max Open Spectra Graph=w42, Error Out=w43)
                    call "Max Spectra Extractor.gvi"(Full MSpot Multispectral Data=w15, Error In=w43) -> (Max Open Spectra Graph=w44, Error Out=w45)
                    call "Dividing Wavelength Basic Translator.gvi"(Dividing Wavelength Calibration Data In=w11, Blue Motor Position=w41, Error In=w45) -> (Blue Motor Dividing Wavelength=w46, Error Out=w47)
                    Property Node(instance in=reference to "M Spot Spectrum") -> ("Cursor"=w48)
                    Property Node(instance in=w48, "XPosition"=w46, "Visible"=TRUE)
                    Property Node(instance in=w40) -> ("Wavelength"=w49, "Counts"=w50)
                    Build Cluster(w49, w50) -> w51
                    Property Node(instance in=w16) -> ("MSpot Spectrum Data Array"=w52)
                    Array Index(array=w52) -> (out0[$"Graph (position) Selector 2"]=w53)
                    Property Node(instance in=w53) -> ("M Spot Spectrum"=w54)
                    Property Node(instance in=w54) -> ("Wavelength"=w55, "Counts"=w56)
                    Build Cluster(w55, w56) -> w57
                    Add(w50, w56) -> w58
                    Build Cluster(w55, w58) -> w59
                    case ($"Full Spectrum") {
                      frame True {
                        Build Array(w51, w57, w59, w44, w42) -> w60
                      }
                      frame False {
                        Build Array(w51, w57, w59) -> w60
                      }
                    }
                    $"M Spot Spectrum" <- w60
                    Array Size(array=w38) -> (size(s)=w61)
                    Decrement(x=w61) -> w62
                    Property Node(instance in=reference to "Graph (position) Selector", "Minimum"=0, "Maximum"=w62, error in=w47) -> (error out=w63)
                    Array Size(array=w52) -> (size(s)=w64)
                    Property Node(instance in=reference to "Graph (position) Selector 2", "Minimum"=0, "Maximum"=w64, error in=w47) -> (error out=w65)
                    call "Multiplex Errors.gvi"(error in 1=w63, error in 2=w65) -> (error out=w7)
                    w14 = s1
                  }
                }
              }
              on "Divide?" Value changed; "Smooth Peaks?" Value changed; "Sweep Type Selector" Value changed {
                Array Index(array=w9) -> (out0[$"Sweep Type Selector"]=w66)
                case ($"Divide?") {
                  frame False, Default {
                    w67 = w66
                    w68 = w12
                  }
                  frame True {
                    call "Spectra Operator.gvi"(Full MSpot Multispectral Data=w66, Error In=w12, Spectra Operator control="Divide Spectra") -> (Operated Data=w67, Error Out=w68)
                  }
                }
                case ($"Smooth Peaks?") {
                  frame False, Default {
                    w14 = w67
                    w7 = w68
                  }
                  frame True {
                    call "Spectra Operator.gvi"(Full MSpot Multispectral Data=w67, Error In=w68, Spectra Operator control="Smooth Peaks") -> (Operated Data=w14, Error Out=w7)
                  }
                }
              }
              on "Add Two Spectra" Value changed {
                Event Data() -> ("New Value"=w69)
                call "Two Different Sweep Type Check and extract.gvi"(Full Beam Multispectral data Array In=w9, Error In=w12) -> (Two Different Sweep Types?=w70, Error Out=w7)
                case (w70) {
                  frame False, Default {
                    w71 = "To add two spectra you need to perform at least a red sweep and a blue sweep calibration. Please perform the needed calibrations and try again."
                    One Button Dialog(button name ("OK")="Oh sorry I will", message=w71)
                    $"Add Two Spectra" <- FALSE
                    Property Node(instance in=reference to "Graph (position) Selector 2", "Visible"=FALSE)
                  }
                  frame True {
                    Property Node(instance in=reference to "Full Spectrum", "Visible"=w69)
                    Property Node(instance in=reference to "Graph (position) Selector 2", "Visible"=w69)
                    Not(x=w69) -> w72
                    Property Node(instance in=reference to "MSpot Spectrum Data", "Visible"=w72)
                    Property Node(instance in=reference to "Smooth Peaks?", "Visible"=w72)
                    Property Node(instance in=reference to "Divide?", "Visible"=w72)
                  }
                }
                w14 = s1
              }
            }
            next s1 = w14
            stop if $Continue
          }
        }
      }
      w8 = w3
    }
  }
  Close Window(reference in=w8, error in=w7) -> (error out=w73)
  $"Error Out" <- w73
