vi "Dividing Wavelength Calculator.gvi"   [LabVIEW NXG 5.0.0]
inputs:
  "Error In": error
  "Full MSpot Multispectral Data Array In": "Full MSpot Multispectral Data.gtype"[]
  "Dividing Wavelength Threshold": f64 = 0.85
outputs:
  "Error Out": error
  "Full MSpot Multispectral Data Array Out": "Full MSpot Multispectral Data.gtype"[]
  "Interpolation error": bool
panel indicators:
  "Dividing Wavelength Graph": cluster{"Element 1": f64[], "Element 2": f64[]}[]
types:
  "MSpot Spectrum Data.gtype" = cluster{"M Spot Spectrum": cluster{"Wavelength": f64[], "Counts": f64[]}, "Blue Motor Position (mm)": f64, "Red Motor Position (mm)": f64, "Dividing Wavelength (nm)": f64}
  "Rainbow Sweep Types.gtype" = enum{"Red Sweep Closing", "Red Sweep Opening", "Blue Sweep Closing", "Blue Sweep Opening"}
  "Full MSpot Multispectral Data.gtype" = cluster{"MSpot Spectrum Data Array": "MSpot Spectrum Data.gtype"[], "Rainbow Sweep Types": "Rainbow Sweep Types.gtype"}
  "Dividing Wavelength Calibration Data.gtype" = cluster{"Dividing Wavelength (nm) Array": f64[], "Blue Motor Position (mm) Array": f64[], "Red Motor Position (mm) Array": f64[]}
uses:
  Rainbow Measurement Setup::Main Functions::One Time Calibrations::MSpot Spectrum::Dividing Wavelength Calculations::Spectra Operator.gvi
  Rainbow Measurement Setup::Side Functions::Utilities::Custom Number Array Generator.gvi
  NI::Analysis::Interpolation::Hermite Interpolation 1D.gvi
  Rainbow Measurement Setup::Side Functions::Instrument Control::Thorlabs Motors::Dividing Wavelength Control::Dividing Wavelength Calibration Data FGV.gvi
  NI::G Core::Error::Is Error Or Warning.gvi
diagram:
  # This SubVI Takes the Input Data Array from the MSpot spectra calibration
  # and divides the spectra to extract the difference and then smoothes out the
  # peaks to extract the dividing wavelength. To do so it searches for the first value that
  # is below or above a certain threshold either from one end of the array in the case
  # of the red sweeps or from the other end in the case of the blue sweeps.
  case ($"Error In") {
    frame Error, Default {
      w1 = $"Error In"
      w2 = $"Full MSpot Multispectral Data Array In"
    }
    frame No Error {
      s1 = $"Error In"  # shift register
      for {
        w3 = each element of $"Full MSpot Multispectral Data Array In"
        call "Spectra Operator.gvi"(Full MSpot Multispectral Data=w3, Error In=s1, Spectra Operator control="Divide Spectra") -> (Operated Data=w4, Error Out=w5)
        call "Spectra Operator.gvi"(Full MSpot Multispectral Data=w4, Error In=w5, Spectra Operator control="Smooth Peaks") -> (Operated Data=w6, Error Out=w7)
        call "Custom Number Array Generator.gvi"(Start Value=385, End Value=917, Step Value=0.1, Error In=w7) -> (Generated Array=w8, Error Out=w9)
        Property Node(instance in=w3) -> ("MSpot Spectrum Data Array"=w10, "Rainbow Sweep Types"=w11, instance out=w12)
        Property Node(instance in=w6) -> ("MSpot Spectrum Data Array"=w13)
        # Interpolate for a ton of positions
        for {
          w14 = each element of w13
          w15 = each element of w10
          Property Node(instance in=w14) -> ("M Spot Spectrum"=w19, "Blue Motor Position (mm)"=w20, "Red Motor Position (mm)"=w21)
          Property Node(instance in=w19) -> ("Wavelength"=w22, "Counts"=w23)
          case (w11) {
            frame "Red Sweep Closing" {
              # Find Dividing wavelength
              for {
                w26 = each element of w22
                w27 = each element of w23
                Is Greater(x=w27, y=$"Dividing Wavelength Threshold") -> w28
                w24 = w26 if w28
                stop if w28
              }
              w25 = w20
            }
            frame "Blue Sweep Opening" {
              for {
                w29 = each element of w22
                w30 = each element of w23
                Is Greater(x=w30, y=$"Dividing Wavelength Threshold") -> w31
                w24 = w29 if w31
              }
              w25 = w21
            }
            frame "Blue Sweep Closing" {
              for {
                w32 = each element of w22
                w33 = each element of w23
                Is Greater(x=w33, y=$"Dividing Wavelength Threshold") -> w34
                w24 = w32 if w34
              }
              w25 = w21
            }
            frame "Red Sweep Opening" {
              for {
                w35 = each element of w22
                w36 = each element of w23
                Is Greater(x=w36, y=$"Dividing Wavelength Threshold") -> w37
                w24 = w35 if w37
                stop if w37
              }
              w25 = w20
            }
          }
          Property Node(instance in=w15) -> (instance out=w38)
          Property Node(instance in=w38, "Dividing Wavelength (nm)"=w24) -> (instance out=w39)
          append w39 to w16
          append w25 to w17
          append w24 to w18
        }
        Property Node(instance in=w12, "MSpot Spectrum Data Array"=w16) -> ("Rainbow Sweep Types"=w40, instance out=w41)
        call "Hermite Interpolation 1D.gvi"(y=w17, x=w18, xi=w8) -> (yi=w42, xi used=w43, error out=w44)
        case (w40) {
          frame "Red Sweep Opening" {
            w46 = "Dividing Wavelength Calibration Data.gtype" {all zero or empty}
            Property Node(instance in=w46, "Dividing Wavelength (nm) Array"=w43, "Blue Motor Position (mm) Array"=w42) -> (instance out=w45)
          }
          frame "Blue Sweep Closing" {
            w47 = "Dividing Wavelength Calibration Data.gtype" {all zero or empty}
            Property Node(instance in=w47, "Dividing Wavelength (nm) Array"=w43, "Red Motor Position (mm) Array"=w42) -> (instance out=w45)
          }
          frame "Blue Sweep Opening" {
            w48 = "Dividing Wavelength Calibration Data.gtype" {all zero or empty}
            Property Node(instance in=w48, "Dividing Wavelength (nm) Array"=w43, "Red Motor Position (mm) Array"=w42) -> (instance out=w45)
          }
          frame "Red Sweep Closing" {
            w49 = "Dividing Wavelength Calibration Data.gtype" {all zero or empty}
            Property Node(instance in=w49, "Dividing Wavelength (nm) Array"=w43, "Blue Motor Position (mm) Array"=w42) -> (instance out=w45)
          }
        }
        call "Dividing Wavelength Calibration Data FGV.gvi"(Div Wavelength FGV Instructions="Acquire New Data", Div Wavelength New Data In=w45, Error In=w9) -> (Error Out=w50)
        Build Cluster(w43, w42) -> w51
        Build Array(w51) -> w52
        $"Dividing Wavelength Graph" <- w52
        call "Is Error Or Warning.gvi"(error in=w44) -> (error or warning?=w53)
        $"Interpolation error" <- w53
        append w41 to w2
        next s1 = w50
      }
      w1 = s1
    }
  }
  $"Full MSpot Multispectral Data Array Out" <- w2
  $"Error Out" <- w1
