vi "Spectrum Blank Correction.gvi"   [LabVIEW NXG 5.0.0]
inputs:
  "Error In": error
  "Full MSpot Multispectral Data": "Full MSpot Multispectral Data.gtype"
outputs:
  "Error Out": error
  "Corrected Data": "Full MSpot Multispectral Data.gtype"
types:
  "MSpot Spectrum Data.gtype" = cluster{"M Spot Spectrum": cluster{"Wavelength": f64[], "Counts": f64[]}, "Blue Motor Position (mm)": f64, "Red Motor Position (mm)": f64, "Dividing Wavelength (nm)": f64}
  "Rainbow Sweep Types.gtype" = enum{"Red Sweep Closing", "Red Sweep Opening", "Blue Sweep Closing", "Blue Sweep Opening"}
  "Full MSpot Multispectral Data.gtype" = cluster{"MSpot Spectrum Data Array": "MSpot Spectrum Data.gtype"[], "Rainbow Sweep Types": "Rainbow Sweep Types.gtype"}
diagram:
  # This SubVI takes the "blank spectrum" of each type of sweep and substracts it to all the spectrums to have a normalized spectrum.
  case ($"Error In") {
    frame Error, Default {
      w1 = $"Error In"
      w2 = $"Full MSpot Multispectral Data"
    }
    frame No Error {
      Property Node(instance in=$"Full MSpot Multispectral Data") -> ("MSpot Spectrum Data Array"=w3, "Rainbow Sweep Types"=w4, instance out=w5)
      case (w4) {
        frame "Red Sweep Closing", Default {
          Array Size(array=w3) -> (size(s)=w7)
          Array Index(array=w3) -> (out0[w7]=w6)
        }
        frame "Blue Sweep Closing" {
          Array Size(array=w3) -> (size(s)=w8)
          Array Index(array=w3) -> (out0[w8]=w6)
        }
        frame "Blue Sweep Opening" {
          Array Index(array=w3) -> (out0[0]=w6)
        }
        frame "Red Sweep Opening" {
          Array Index(array=w3) -> (out0[0]=w6)
        }
      }
      for {
        w9 = each element of w3
        Property Node(instance in=w9) -> ("M Spot Spectrum"=w11, instance out=w12)
        Property Node(instance in=w11) -> ("Counts"=w13, "Wavelength"=w14, instance out=w15)
        Property Node(instance in=w6) -> ("M Spot Spectrum"=w16)
        Property Node(instance in=w16) -> ("Counts"=w17)
        Subtract(x=w13, y=w17) -> w18
        Property Node(instance in=w15, "Wavelength"=w14, "Counts"=w18) -> (instance out=w19)
        Property Node(instance in=w12, "M Spot Spectrum"=w19) -> (instance out=w20)
        append w20 to w10
      }
      Property Node(instance in=w5, "MSpot Spectrum Data Array"=w10) -> (instance out=w2)
      w1 = $"Error In"
    }
  }
  $"Error Out" <- w1
  $"Corrected Data" <- w2
