vi "MSpot Data Extractor.gvi"   [LabVIEW NXG 5.0.0]
inputs:
  "Filepath to load": path
  "Sub Array Index In": i32
  "M Spot Spectrum Sub Array In": "MSpot Spectrum Data.gtype"[]
  "Modify file operation": "Modify File Operation.gtype" = "Save TXT"
  "Calibration file?": bool
  "Error In": error
outputs:
  "Sub Array Index Out": i32
  "M Spot Spectrum Sub Array Out": "MSpot Spectrum Data.gtype"[]
  "File Found?": bool
  "Error Out": error
types:
  "Modify File Operation.gtype" = enum{"Save TXT", "Load TXT"}
  "MSpot Spectrum Data.gtype" = cluster{"M Spot Spectrum": cluster{"Wavelength": f64[], "Counts": f64[]}, "Blue Motor Position (mm)": f64, "Red Motor Position (mm)": f64}
uses:
  Rainbow Measurement Setup::Main Functions::Modify TXT file::Modify Measurement TXT File.gvi
diagram:
  # This subVI takes the data from the calibration file we specify and converts it into the Mspot Spectrum format, storing it within the M Spot Spectrum Sub Array which will
  # be later appended to the full M Spot Spectrum array. To do so we load the file and we store the data as wavelength and counts. We also scan the header data where we find the
  # motors position for each spectrum. Then we bundle everything and we store it within the array.
  case ($"Error In") {
    frame Error, Default {
      w1 = $"Error In"
      w2 = $"Sub Array Index In"
      w3 = $"M Spot Spectrum Sub Array In"
      w4 = default
    }
    frame No Error {
      case ($"Calibration file?") {
        frame False, Default {
          w2 = $"Sub Array Index In"
          w1 = $"Error In"
          w3 = $"M Spot Spectrum Sub Array In"
          w4 = default
        }
        frame True {
          Increment(x=$"Sub Array Index In") -> w2
          Array Index(array=$"M Spot Spectrum Sub Array In") -> (out0[$"Sub Array Index In"]=w5)
          call "Modify Measurement TXT File.gvi"(Filename to load/save=$"Filepath to load", Modify File Operation=$"Modify file operation", Error In=$"Error In", Measurement File Type="Light Calibration Dividing Wavelength Spectrum") -> (Loaded Data=w6, Header Data=w7, Error Out=w8)
          Array Index(array=w6) -> (out0[_, 0]=w9, out1[_, 1]=w10)
          w11 = cluster{"Wavelength": f64[], "Counts": f64[]} {all zero or empty}
          Property Node(instance in=w11, "Wavelength"=w9, "Counts"=w10) -> (instance out=w12)
          String Length(string="Blue Motor Position (mm): ") -> (length=w13)
          Search And Replace String(error in (no error)=w8, input string=w7, search string="Blue Motor Position (mm): ") -> (error out=w1, offset past replacement=w14)
          Add(w14, w13) -> w15
          String Subset(length (rest)=8, offset (0)=w15, string=w7) -> w16
          Floating Point String To Number(string=w16) -> (number=w17)
          Search And Replace String(input string=w7, search string="Red Motor Position (mm): ") -> (offset past replacement=w18)
          String Length(string="Red Motor Position (mm): ") -> (length=w19)
          Add(w18, w19) -> w20
          String Subset(length (rest)=8, offset (0)=w20, string=w7) -> w21
          Floating Point String To Number(string=w21) -> (number=w22)
          Property Node(instance in=w5, "M Spot Spectrum"=w12, "Blue Motor Position (mm)"=w17, "Red Motor Position (mm)"=w22) -> (instance out=w23)
          Insert Into Array(inArray=$"M Spot Spectrum Sub Array In", new=w23) -> w3
          w4 = TRUE
        }
      }
    }
  }
  $"Sub Array Index Out" <- w2
  $"M Spot Spectrum Sub Array Out" <- w3
  $"Error Out" <- w1
  $"File Found?" <- w4
