vi "MSpot Load Prompt.gvi"   [LabVIEW NXG 5.0.0]
inputs:
  "Found Any File?": bool
  "Stand Alone": bool
  "Error In": error
outputs:
  "Desired State": "MSpot Spectrum Calibration State Machine Instructions.gtype"
  "Error Out": error
types:
  "MSpot Spectrum Calibration State Machine Instructions.gtype" = enum{"Start App", "Detect Instruments", "Initialize Instruments", "Rainbow Sweep", "Close Coms", "Load Calibration", "Check Graphs", "Save Graphs", "Stop App"}
diagram:
  # This SubVI Prompts the user in case it does not find any calibration file and asks if it
  # wants to perform a new calibration
  case ($"Error In") {
    frame Error, Default {
      w1 = "Stop App"
      w2 = $"Error In"
    }
    frame No Error {
      case ($"Found Any File?") {
        frame False, Default {
          Select(s=$"Stand Alone", t="Detect Instruments", f="Initialize Instruments") -> w3
          w4 = """I could not find any calibration file
on the Extra installers\Calibration_Files\Div_Wav_Spectra\
folder. Do you want to perform a new calibration?"""
          Two Button Dialog(F button name ("Cancel")="Nah, I'm feeling lazy", T button name ("OK")="Okay, let's do it", message=w4) -> (T Button?=w5)
          Select(s=w5, t=w3, f="Stop App") -> w1
        }
        frame True {
          w1 = "Check Graphs"
        }
      }
      w2 = $"Error In"
    }
  }
  $"Error Out" <- w2
  $"Desired State" <- w1
