vi "MSpot Spectra file handling.gvi"   [LabVIEW NXG 5.0.0]
inputs:
  "Error In": error
  "MSpot Mega Cluster In": "MSpot Mega Cluster.gtype"
  "Modify File Operation": "Modify File Operation.gtype" = "Save TXT"
  "Divided Graphs?": bool
outputs:
  "Error Out": error
  "MSpot Mega Cluster Out": "MSpot Mega Cluster.gtype"
  "Found Any File?": bool
types:
  "Modify File Operation.gtype" = enum{"Save TXT", "Load TXT"}
  "Raibow Sweep Selector.gtype" = enum{"Red Sweep", "Blue Sweep", "Full Sweep Red First", "Full Sweep Blue First"}
  "Rainbow Sweep Param Selector.gtype" = cluster{"Raibow Sweep Selector": "Raibow Sweep Selector.gtype", "Max Wavelength (nm)": f64, "Min Wavelength (nm)": f64, "Wavelength Step (nm)": f64, "Rainbow Sweep Type Selector": "Rainbow Sweep Type Selector.gtype"}
  "MSpot Spectrum Calibration Parameters.gtype" = cluster{"Min Position (mm)": f64, "Max Position (mm)": f64, "Position step size (mm)": f64, "Manual Spectra?": bool, "Flame Integration Time (us)": f64, "Flame Scans to Average": u32}
  "Rainbow Sweep Types.gtype" = enum{"Red Sweep Closing", "Red Sweep Opening", "Blue Sweep Closing", "Blue Sweep Opening"}
  "Full MSpot Multispectral Data.gtype" = cluster{"MSpot Spectrum Data Array": "MSpot Spectrum Data.gtype"[], "Rainbow Sweep Types": "Rainbow Sweep Types.gtype"}
  "MSpot Mega Cluster.gtype" = cluster{"Rainbow Sweep Parameters MSpot": "Rainbow Sweep Param Selector.gtype", "MSpot Sperctrum Calibration Parameters": "MSpot Spectrum Calibration Parameters.gtype", "Full Beam Multispectral Data Array": "Full MSpot Multispectral Data.gtype"[]}
  "MSpot Spectrum Data.gtype" = cluster{"M Spot Spectrum": cluster{"Wavelength": f64[], "Counts": f64[]}, "Blue Motor Position (mm)": f64, "Red Motor Position (mm)": f64, "Dividing Wavelength (nm)": f64}
uses:
  Rainbow Measurement Setup::Main Functions::One Time Calibrations::MSpot Spectrum::File Handling::MSpot Folder Scan.gvi
  Rainbow Measurement Setup::Main Functions::One Time Calibrations::MSpot Spectrum::File Handling::Folder Scan Sweep type.gvi
  Rainbow Measurement Setup::Main Functions::One Time Calibrations::MSpot Spectrum::File Handling::File number Sorter.gvi
  Rainbow Measurement Setup::Main Functions::One Time Calibrations::MSpot Spectrum::File Handling::MSpot Data Extractor.gvi
  Rainbow Measurement Setup::Main Functions::One Time Calibrations::MSpot Spectrum::Dividing Wavelength Calculations::Spectra Operator.gvi
  Rainbow Measurement Setup::Main Functions::One Time Calibrations::MSpot Spectrum::File Handling::MSpot Folder Check.gvi
  Rainbow Measurement Setup::Side Functions::Sample Naming::txt Extension adder.gvi
  Rainbow Measurement Setup::Main Functions::Modify TXT file::Modify Measurement TXT File.gvi
  Rainbow Measurement Setup::Side Functions::Messages And Prompts::FGV Repeat Operation for all following files.gvi
diagram:
  # This subVI Handles the Saving of all the MSpot Spectra Calibration Files
  case ($"Error In") {
    frame Error, Default {
      w1 = $"Error In"
      w2 = default
      w3 = $"MSpot Mega Cluster In"
    }
    frame No Error {
      Property Node(instance in=$"MSpot Mega Cluster In") -> ("Full Beam Multispectral Data Array"=w4, instance out=w5)
      case ($"Modify File Operation") {
        frame "Load TXT" {
          call "MSpot Folder Scan.gvi"(Error In=$"Error In") -> (Folder Path=w8, Folder Names=w9, Error Out=w10)
          s1 = w10  # shift register
          s2 = "Full MSpot Multispectral Data.gtype"[] []  # shift register
          s3 = 0  # shift register
          for {
            w11 = each element of w9
            call "Folder Scan Sweep type.gvi"(Folder Name In=w11, Error In=s1) -> (Foldername Out=w13, Sweep Type=w14, Is folder sweep type?=w15, Error Out=w16)
            case (w15) {
              frame False, Default {
                w17 = s3
                w18 = s2
                w19 = w16
                w20 = default
              }
              frame True {
                Increment(x=s3) -> w17
                Array Index(array=s2) -> (out0[s3]=w21)
                Build Path(base path=w8, name or relative path=w13) -> (appended path=w22)
                List Folder(error in=w16, path=w22) -> (error out=w23, file names=w24, path out=w25)
                call "File number Sorter.gvi"(Sweep Type=w14, File Names=w24, Error In=w23) -> (Sorted Files Array=w26, Error Out=w27)
                s4 = w27  # shift register
                s5 = "MSpot Spectrum Data.gtype"[] []  # shift register
                s6 = 0  # shift register
                for {
                  w28 = each element of w26
                  Build Path(base path=w25, name or relative path=w28) -> (appended path=w30)
                  Search And Replace String(input string=w28, search string="MSpot_Spectrum_Calibration") -> (number of replacements=w31)
                  Is Not Equal To 0(x=w31) -> w32
                  call "MSpot Data Extractor.gvi"(Filepath to load=w30, Sub Array Index In=s6, M Spot Spectrum Sub Array In=s5, Modify file operation=$"Modify File Operation", Calibration file?=w32, Error In=s4) -> (Sub Array Index Out=w33, M Spot Spectrum Sub Array Out=w34, File Found?=w35, Error Out=w36)
                  append w35 to w29
                  next s4 = w36
                  next s5 = w34
                  next s6 = w33
                }
                Property Node(instance in=w21, "MSpot Spectrum Data Array"=s5, "Rainbow Sweep Types"=w14) -> (instance out=w37)
                Insert Into Array(inArray=s2, new=w37) -> w18
                Or Array Elements(Boolean array=w29) -> (logical OR=w20)
                w19 = s4
              }
            }
            append w20 to w12
            next s1 = w19
            next s2 = w18
            next s3 = w17
          }
          Or Array Elements(Boolean array=w12) -> (logical OR=w2)
          w6 = s1
          w7 = s2
        }
        frame "Save TXT", Default {
          case ($"Divided Graphs?") {
            frame False, Default {
              w7 = w4
              w38 = $"Error In"
            }
            frame True {
              s7 = $"Error In"  # shift register
              for {
                w39 = each element of w4
                call "Spectra Operator.gvi"(Full MSpot Multispectral Data=w39, Error In=s7, Spectra Operator control="Divide Spectra") -> (Operated Data=w40, Error Out=w41)
                append w40 to w7
                next s7 = w41
              }
              w38 = s7
            }
          }
          s8 = w38  # shift register
          for {
            w42 = each element of w7
            Property Node(instance in=w42) -> ("MSpot Spectrum Data Array"=w43, "Rainbow Sweep Types"=w44)
            call "MSpot Folder Check.gvi"(Rainbow Sweep Types=w44, Divided Graphs?=$"Divided Graphs?", Error In=s8, Create New Folders?=TRUE) -> (Folder Out=w45, Error Out=w46)
            s9 = w46  # shift register
            for {
              w47 = each element of w43
              Property Node(instance in=w47) -> ("M Spot Spectrum"=w48, "Blue Motor Position (mm)"=w49, "Red Motor Position (mm)"=w50)
              Format Into String(w49) -> w51
              Format Into String(w50) -> w52
              Concatenate Strings("Blue Motor Position (mm): ", w51, "\t", "Red Motor Position (mm): ", w52) -> w53
              Format Into String(initString="MSpot_Spectrum_Calibration_Position_", w49) -> w54
              Concatenate Strings(w54, "_") -> w55
              Format Into String(initString=w55, w50) -> w56
              call "txt Extension adder.gvi"(Name without .txt=w56, Error In=s9) -> (Name with .txt=w57, Error Out=w58)
              Property Node(instance in=w48) -> ("Wavelength"=w59, "Counts"=w60)
              Build Array(w59, w60) -> w61
              Transpose 2D Array(2D array=w61) -> (transposed array=w62)
              Build Path(base path=w45, name or relative path=w57) -> (appended path=w63)
              call "Modify Measurement TXT File.gvi"(Filename to load/save=w63, Variable Header Info=w53, Modify File Operation=$"Modify File Operation", Data To Save=w62, Error In=w58, Measurement File Type="Light Calibration Dividing Wavelength Spectrum") -> (Error Out=w64)
              next s9 = w64
            }
            next s8 = s9
          }
          w6 = s8
          w2 = default
        }
      }
      Property Node(instance in=w5, "Full Beam Multispectral Data Array"=w7) -> (instance out=w3)
      call "FGV Repeat Operation for all following files.gvi"(FGV Instructions="Reset State", Error In=w6) -> (Error Out=w1)
    }
  }
  $"MSpot Mega Cluster Out" <- w3
  $"Found Any File?" <- w2
  $"Error Out" <- w1
