vi "MSpot Calibration Operation Translator.gvi"   [LabVIEW NXG 5.0.0]
inputs:
  "Error In": error
  "Check Dividing Wavelength Calibration": bool
  "New Dividing Wavelength Calibration": bool
  "Load Dividing Wavelength Calibration": bool
outputs:
  "Error Out": error
uses:
  Rainbow Measurement Setup::Main Functions::One Time Calibrations::MSpot Spectrum::FGV MSpot Operation.gvi
diagram:
  # This SubVI Checks which button has been pressed and
  # decides the operation that needs to be done.
  # If more than one button was pressed it prompts the user
  # to not press so many buttons at the same time
  case ($"Error In") {
    frame Error, Default {
      w1 = $"Error In"
    }
    frame No Error {
      Logical And($"Check Dividing Wavelength Calibration", $"New Dividing Wavelength Calibration") -> w2
      Logical And($"New Dividing Wavelength Calibration", $"Load Dividing Wavelength Calibration") -> w3
      Logical And($"Check Dividing Wavelength Calibration", $"Load Dividing Wavelength Calibration") -> w4
      Logical Or(w2, w3, w4) -> w5
      case (w5) {
        frame False, Default {
          Select(s=$"Load Dividing Wavelength Calibration", t="Load Calibration", f="Check Calibration") -> w7
          Select(s=$"New Dividing Wavelength Calibration", t="New Calibration", f=w7) -> w6
        }
        frame True {
          w8 = "Please do not Press all the buttons\nat once, otherwise I do not know what\nyou want me to do first :("
          w9 = "Oh, sorry I will press them\none by one, while waiting for\nyou to finish."
          One Button Dialog(button name ("OK")=w9, message=w8)
          w6 = "Check Calibration"
        }
      }
      call "FGV MSpot Operation.gvi"(FGV Instructions="Set State", MSpot Calibration Operation Control=w6, Error In=$"Error In") -> (Error Out=w1)
    }
  }
  $"Error Out" <- w1
