vi "MSpot Spectrum Calibration Subroutine.gvi"   [LabVIEW NXG 5.0.0]
inputs:
  "Error In": error
  "Stand Alone?": bool
  "Instrument Control Mega Cluster In": "Instrument Control Mega Cluster.gtype"
  "Misc Data Mega Cluster In": "Misc Data Mega Cluster.gtype"
  "MSpot Mega Cluster In": "MSpot Mega Cluster.gtype"
outputs:
  "Error Out": error
  "Instrument Control Mega Cluster Out": "Instrument Control Mega Cluster.gtype"
  "Misc Data Mega Cluster Out": "Misc Data Mega Cluster.gtype"
  "MSpot Mega Cluster Out": "MSpot Mega Cluster.gtype"
panel controls:
  "Calibration Operation Control": "Calibration Operation Control.gtype" = "Check Calibration"
types:
  "Calibration Operation Control.gtype" = enum{"Check Calibration", "Load Calibration", "New Calibration", "Load Fityc Data"}
  "Full Reference Cluster.gtype" = cluster{"Enum Reference Cluster": "Enum Control Reference Cluster.gtype", "Boolean Reference Cluster": "Boolean Control Reference Cluster.gtype", "Numeric Reference Cluster": "Numeric Control Reference Cluster.gtype", "Numeric Cluster Reference Cluster": "Numeric Cluster Reference Cluster.gtype", "Path Reference Cluster": "Path Reference Cluster.gtype", "Cluster Reference Cluster": "Cluster Reference Cluster.gtype", "XZ Stage Controls Reference Cluster": "XZ Stage Controls Reference Cluster.gtype"}
  "Cell Naming Cluster.gtype" = cluster{"Cell Label": string, "Sample Prefix": string, "Author Initials": string, "Current Date": string, "Batch Name": string}
  T1 = cluster{"X Coordinate (mm)": f64, "Z Coordinate (mm)": f64, "Aprch Distance (mm)": f64}
  T2 = cluster{"X Coordinate (mm)": f64, "Z Coordinate (mm)": f64, "Vertical Spacing (mm)": f64, "Aprch Distance (mm)": f64, "Aprch Dstnc L.12 (mm)": f64}
  "XZ All Position Cluster.gtype" = cluster{"Diffusor Coordinates": T1, "Photodetector Coordinates": T1, "Cell R.01 Coordinates": T2}
  T3 = cluster{"Thorlabs Motor Serial Number File Path": path, "Default Data Saving Location": path}
  "Misc Data Mega Cluster.gtype" = cluster{"Full Reference Cluster": "Full Reference Cluster.gtype", "Cell Naming Cluster": "Cell Naming Cluster.gtype", "All XZ Position Cluster": "XZ All Position Cluster.gtype", "All Paths": T3}
  "Instrument Coms Info.gtype" = cluster{"Arduino Coms Info": "Arduino Detection cluster control.gtype", "Photodetector Names": string[], "Keythley Address": "VISA Instr", "Photodetector Detected?": bool, "Thorlabs Motors Detected?": bool, "Keithley Detected?": bool, "Thorlabs Motors Serial Number": "Thorlabs Motors Serial Number In.gtype", "Photodetector IVI session": "Ivi IviDefault", "Flame ID": string, "Flame Detected?": bool, "Flame Wrapper ID": u64}
  "Debugging Cluster.gtype" = cluster{"Debugging mode?": bool, "Initialize App": bool, "Insturment Debugging": "Insturment Debugging Cluster.gtype"}
  "Instrument Control Mega Cluster.gtype" = cluster{"Instruments Coms Info": "Instrument Coms Info.gtype", "Debugging Cluster": "Debugging Cluster.gtype"}
  "Raibow Sweep Selector.gtype" = enum{"Red Sweep", "Blue Sweep", "Full Sweep Red First", "Full Sweep Blue First"}
  "Rainbow Sweep Param Selector.gtype" = cluster{"Raibow Sweep Selector": "Raibow Sweep Selector.gtype", "Max Wavelength (nm)": f64, "Min Wavelength (nm)": f64, "Wavelength Step (nm)": f64, "Rainbow Sweep Type Selector": "Rainbow Sweep Type Selector.gtype"}
  "MSpot Spectrum Calibration Parameters.gtype" = cluster{"Min Position (mm)": f64, "Max Position (mm)": f64, "Position step size (mm)": f64, "Manual Spectra?": bool, "Flame Integration Time (us)": f64, "Flame Scans to Average": u32}
  "Rainbow Sweep Types.gtype" = enum{"Red Sweep Closing", "Red Sweep Opening", "Blue Sweep Closing", "Blue Sweep Opening"}
  "Full MSpot Multispectral Data.gtype" = cluster{"MSpot Spectrum Data Array": "MSpot Spectrum Data.gtype"[], "Rainbow Sweep Types": "Rainbow Sweep Types.gtype"}
  "MSpot Mega Cluster.gtype" = cluster{"Rainbow Sweep Parameters MSpot": "Rainbow Sweep Param Selector.gtype", "MSpot Sperctrum Calibration Parameters": "MSpot Spectrum Calibration Parameters.gtype", "Full Beam Multispectral Data Array": "Full MSpot Multispectral Data.gtype"[]}
  "XZ Coordinate Cluster In.gtype" = cluster{"X Coordinate (mm)": f64, "Z Coordinate (mm)": f64}
uses:
  Rainbow Measurement Setup::Main Functions::Instruction Queue::Current State::FGV Current State.gvi
  Rainbow Measurement Setup::Main Functions::One Time Calibrations::MSpot Spectrum::FGV MSpot Operation.gvi
  Rainbow Measurement Setup::Main Functions::One Time Calibrations::MSpot Spectrum::File Handling::MSpot Folder Check.gvi
  Rainbow Measurement Setup::Side Functions::Global Abort::FGV Global Abort.gvi
  Rainbow Measurement Setup::Main Functions::One Time Calibrations::MSpot Spectrum::Mspot Abort Handler.gvi
  Rainbow Measurement Setup::Main Functions::One Time Calibrations::MSpot Spectrum::MSpot Start App Handler.gvi
  Rainbow Measurement Setup::Side Functions::Instrument Control::Debug Cluster Instrument Extractor.gvi
  Rainbow Measurement Setup::Main Functions::One Time Calibrations::Beam Power Density::Specific Detect Instruments Subroutine.gvi
  Rainbow Measurement Setup::Side Functions::Instrument Control::Thorlabs Motors::Movement::KCube Move to 0 or Home.gvi
  Rainbow Measurement Setup::Side Functions::Instrument Control::Arduino::XZ Stage Arduino::XZ Stage Initialize And Home.gvi
  Rainbow Measurement Setup::Main Functions::XZ Stage Movements::MRM Move To Coordinate Safely.gvi
  Rainbow Measurement Setup::Side Functions::Instrument Control::Flame Spectrometer::Flame Initialize.gvi
  Rainbow Measurement Setup::Main Functions::One Time Calibrations::MSpot Spectrum::MSpot Spectrum Rainbow Sweep Subroutine.gvi
  Rainbow Measurement Setup::Side Functions::Instrument Control::Arduino::XZ Stage Arduino::XZ Y Safe Approach and Retract.gvi
  Rainbow Measurement Setup::Side Functions::Instrument Control::Arduino::XZ Stage Arduino::XZ Stage Move to Position.gvi
  Rainbow Measurement Setup::Side Functions::Instrument Control::Arduino::XZ Stage Arduino::XZ Stage Close Coms.gvi
  Rainbow Measurement Setup::Side Functions::Instrument Control::Flame Spectrometer::Flame Close.gvi
  Rainbow Measurement Setup::Main Functions::One Time Calibrations::MSpot Spectrum::File Handling::MSpot Spectra file handling.gvi
  Rainbow Measurement Setup::Main Functions::One Time Calibrations::MSpot Spectrum::File Handling::MSpot Load Prompt.gvi
  Rainbow Measurement Setup::Main Functions::One Time Calibrations::MSpot Spectrum::File Handling::Load Fytic Data Subroutine.gvi
  Rainbow Measurement Setup::Main Functions::One Time Calibrations::MSpot Spectrum::Data Visualization::MSpot Spectrum Visualizer.gvi
  Rainbow Measurement Setup::Main Functions::One Time Calibrations::MSpot Spectrum::File Handling::MSpot Calibration Save Graphs Prompt.gvi
  Rainbow Measurement Setup::Side Functions::Instrument Control::Thorlabs Motors::Dividing Wavelength Control::Dividing Wavelength Calibration Data FGV.gvi
diagram:
  # This subVI takes a full spectrum for each guillotine motor position and then changes the guillotine position and continues on taking spectra.
  # After all the spectra have been taken we are presented with the results to determine the dividing wavelength for each position and then we can
  # write down the dividing wavelength file.
  case ($"Error In") {
    frame Error, Default {
      w1 = $"Error In"
      w2 = $"Misc Data Mega Cluster In"
      w3 = $"MSpot Mega Cluster In"
      w4 = $"Instrument Control Mega Cluster In"
    }
    frame No Error {
      Property Node(instance in=$"Misc Data Mega Cluster In") -> ("Full Reference Cluster:Path Reference Cluster:Calibration Files Path"=w5, instance out=w6)
      call "FGV Current State.gvi"(Current State Instructions="Set Current State and Substate", Current State="MSpot Spectrum Calibration", Current Substate="", Error In=$"Error In") -> (Error Out=w7)
      call "FGV MSpot Operation.gvi"(FGV Instructions="Read State", Error In=w7) -> (Mspot Calibration Operation Control Out=w8, Error Out=w9)
      Select(s=$"Stand Alone?", t=$"Calibration Operation Control", f=w8) -> w10
      call "MSpot Folder Check.gvi"(Error In=w9) -> (Calibration Files Folder=w11, Error Out=w12)
      Property Node(instance in=w5, "Value"=w11, error in=w12) -> (error out=w13)
      s1 = w13  # shift register
      s2 = "Start App"  # shift register
      s2.prev1 = uninitialised  # shift register
      s3 = w6  # shift register
      s4 = $"Instrument Control Mega Cluster In"  # shift register
      s5 = $"MSpot Mega Cluster In"  # shift register
      while {
        call "FGV Global Abort.gvi"(Global Abort Instructions="Read Current State") -> (Local Abort Out=w14, Global Abort Out=w15)
        call "Mspot Abort Handler.gvi"(Local Abort Out=w14, Previous State=s2) -> (Resulting State=w16)
        case (w16) {
          frame "Start App", Default {
            call "FGV Current State.gvi"(Current State Instructions="Set Current Substate", Current Substate="Starting MSpot Calibration", Error In=s1) -> (Error Out=w18)
            call "MSpot Start App Handler.gvi"(Stand Alone?=$"Stand Alone?", Operatin Control=w10) -> (Desired State=w17)
            w19 = default
            w20 = s4
            w21 = s5
            w22 = s3
          }
          frame "Detect Instruments" {
            call "FGV Current State.gvi"(Current State Instructions="Set Current Substate", Current Substate="Detecting Instruments", Error In=s1) -> (Error Out=w23)
            call "Debug Cluster Instrument Extractor.gvi"(Instrument Control Mega Cluster In=s4, Error In=w23) -> (Instrument Control Mega Cluster Out=w24, Instruments to Detect=w25, Error Out=w26)
            call "Specific Detect Instruments Subroutine.gvi"(Instrument Control Mega Cluster In=w24, Error In=w26, Instruments To Detect Array=w25, Stand Alone?=$"Stand Alone?") -> (Instrument Control Mega Cluster Out=w20, Error Out=w18)
            w17 = "Initialize Instruments"
            w19 = default
            w21 = s5
            w22 = s3
          }
          frame "Initialize Instruments" {
            call "FGV Current State.gvi"(Current State Instructions="Set Current Substate", Current Substate="Initializing Instruments", Error In=s1) -> (Error Out=w27)
            call "KCube Move to 0 or Home.gvi"(Instrument Control Mega Cluster In=s4, Error In=w27) -> (Instrument Control Mega Cluster Out=w28, Error Out=w29)
            call "XZ Stage Initialize And Home.gvi"(Instrument Control Mega Cluster In=w28, Error In=w29) -> (Instrument Control Mega Cluster Out=w30, Error Out=w31)
            call "MRM Move To Coordinate Safely.gvi"(Instrument Control Mega Cluster In=w30, Misc Data Mega Cluster In=s3, Error In=w31, Approach Operation="Approach Diffusor") -> (Instrument Control Mega Cluster Out=w32, Error Out=w33)
            call "Flame Initialize.gvi"(Instrument Control Mega Cluster In=w32, Error In=w33) -> (Instrument Control Mega Cluster Out=w20, Error Out=w18)
            w17 = "Rainbow Sweep"
            w19 = default
            w21 = s5
            w22 = s3
          }
          frame "Rainbow Sweep" {
            call "FGV Current State.gvi"(Current State Instructions="Set Current Substate", Current Substate="Acquiring Spectra", Error In=s1) -> (Error Out=w34)
            call "MSpot Spectrum Rainbow Sweep Subroutine.gvi"(Instrument Control Mega Cluster In=s4, MSpot Mega Cluster In=s5, Error In=w34) -> (Instrument Control Mega Cluster Out=w20, MSpot Mega Cluster Out=w21, Error Out=w18)
            w17 = "Close Coms"
            w19 = default
            w22 = s3
          }
          frame "Close Coms" {
            call "FGV Current State.gvi"(Current State Instructions="Set Current Substate", Current Substate="Closing Coms", Error In=s1) -> (Error Out=w35)
            call "XZ Y Safe Approach and Retract.gvi"(Instrument Control Mega Cluster In=s4, Error In=w35, Approach Operation="Retract", Misc Data Mega Cluster=s3) -> (Instrument Control Mega Cluster Out=w36, Error Out=w37)
            call "XZ Stage Move to Position.gvi"(Instrument Control Mega Cluster In=w36, Error In=w37, XZ Coordinate Cluster In="XZ Coordinate Cluster In.gtype" {all zero or empty}) -> (Instrument Control Mega Cluster Out=w38, Error Out=w39)
            call "XZ Stage Close Coms.gvi"(Instrument Control Mega Cluster In=w38, Error In=w39) -> (Instrument Control Mega Cluster Out=w40, Error Out=w41)
            call "Flame Close.gvi"(Instrument Control Mega Cluster In=w40, Error In=w41) -> (Instrument Control Mega Cluster Out=w20, Error Out=w18)
            Select(s=w14, t="Stop App", f="Check Graphs") -> w17
            w19 = default
            w21 = s5
            w22 = s3
          }
          frame "Load Calibration" {
            call "FGV Current State.gvi"(Current State Instructions="Set Current Substate", Current Substate="Loading Calibration", Error In=s1) -> (Error Out=w42)
            call "MSpot Spectra file handling.gvi"(MSpot Mega Cluster In=s5, Modify File Operation="Load TXT", Error In=w42) -> (MSpot Mega Cluster Out=w21, Found Any File?=w43, Error Out=w44)
            call "MSpot Load Prompt.gvi"(Found Any File?=w43, Stand Alone=$"Stand Alone?", Error In=w44) -> (Desired State=w17, Error Out=w18)
            w19 = default
            w20 = s4
            w22 = s3
          }
          frame "Load Fityc Data" {
            call "Load Fytic Data Subroutine.gvi"(Current State=w16, Error In=s1) -> (Selected State=w17, Error Out=w18)
            w19 = default
            w20 = s4
            w21 = s5
            w22 = s3
          }
          frame "Check Graphs" {
            call "FGV Current State.gvi"(Current State Instructions="Set Current Substate", Current Substate="Checking Graphs", Error In=s1) -> (Error Out=w45)
            call "MSpot Spectrum Visualizer.gvi"(MSpot Mega Cluster In=s5, Error In=w45) -> (Error Out=w46)
            call "MSpot Calibration Save Graphs Prompt.gvi"(M Spot Spectrum Calibration State Machine Instructions=s2.prev1, Instrument Control Mega Cluster In=s4, Error In=w46) -> (Selected State=w17, Instrument Control Mega Cluster Out=w20, Error Out=w18)
            w19 = default
            w21 = s5
            w22 = s3
          }
          frame "Save Graphs" {
            call "FGV Current State.gvi"(Current State Instructions="Set Current Substate", Current Substate="Saving Graphs", Error In=s1) -> (Error Out=w47)
            call "MSpot Spectra file handling.gvi"(MSpot Mega Cluster In=s5, Modify File Operation="Save TXT", Error In=w47, Divided Graphs?=FALSE) -> (MSpot Mega Cluster Out=w21, Error Out=w18)
            w17 = "Save Dividing Wavelength"
            w19 = default
            w20 = s4
            w22 = s3
          }
          frame "Save Divided Graphs" {
            call "FGV Current State.gvi"(Current State Instructions="Set Current Substate", Current Substate="Saving Divided Graphs", Error In=s1) -> (Error Out=w48)
            call "MSpot Spectra file handling.gvi"(MSpot Mega Cluster In=s5, Modify File Operation="Save TXT", Error In=w48, Divided Graphs?=TRUE) -> (Error Out=w18)
            w17 = "Save Graphs"
            w19 = default
            w20 = s4
            w21 = s5
            w22 = s3
          }
          frame "Save Dividing Wavelength" {
            call "Dividing Wavelength Calibration Data FGV.gvi"(Div Wavelength FGV Instructions="File Save Data", Error In=s1) -> (Error Out=w18)
            w17 = "Stop App"
            w19 = default
            w20 = s4
            w21 = s5
            w22 = s3
          }
          frame "Stop App" {
            call "FGV Current State.gvi"(Current State Instructions="Set Current Substate", Current Substate="Finishing MSpot Calibration", Error In=s1) -> (Error Out=w18)
            w17 = "Start App"
            w19 = TRUE
            w20 = s4
            w21 = s5
            w22 = s3
          }
        }
        Logical Or(w15, w19) -> w49
        next s1 = w18
        next s2 = w17
        next s3 = w22
        next s4 = w20
        next s5 = w21
        stop if w49
      }
      w1 = s1
      w2 = s3
      w3 = s5
      w4 = s4
    }
  }
  $"MSpot Mega Cluster Out" <- w3
  $"Instrument Control Mega Cluster Out" <- w4
  $"Error Out" <- w1
  $"Misc Data Mega Cluster Out" <- w2
