vi "MSpot Spectrum Rainbow Sweep Subroutine.gvi"   [LabVIEW NXG 5.0.0]
inputs:
  "Instrument Coms Info In": "Instrument Coms Info.gtype"
  "MSpot Spectrum Calibration Parameters In": "MSpot Spectrum Calibration Parameters.gtype" = {"Min Position (mm)"=0, "Max Position (mm)"=10, "Position step size (mm)"=0.1, "Manual Spectra?"=FALSE, "Flame Integration Time (us)"=1000, "Flame Scans to Average"=1}
  "Rainbow Sweep Param Selector": "Rainbow Sweep Param Selector.gtype" = {0, 1100, 300, 1, 1, 0}
  "Error In": error
  "Debugging Cluster In": "Debugging Cluster.gtype"
outputs:
  "Instrument Coms Info Out": "Instrument Coms Info.gtype"
  "Full MSpot Multispectral Data Array": "Full MSpot Multispectral Data.gtype"[]
  "Debugging Cluster Out": "Debugging Cluster.gtype"
  "Error Out": error
types:
  "Raibow Sweep Selector.gtype" = enum{"Red Sweep", "Blue Sweep", "Full Sweep Red First", "Full Sweep Blue First"}
  T1 = enum{"Red Sweep Closing", "Red Sweep Opening", "Red Sweep Both Ways"}
  T2 = enum{"Blue Sweep Opening", "Blue Sweep Closing", "Blue Sweep Both Ways"}
  "Rainbow Sweep Type Selector.gtype" = cluster{"Red Sweep Mode": T1, "Blue Sweep Mode": T2}
  "Rainbow Sweep Param Selector.gtype" = cluster{"Raibow Sweep Selector": "Raibow Sweep Selector.gtype", "Max Wavelength (nm)": f64, "Min Wavelength (nm)": f64, "Wavelength Step (nm)": f64, "Rainbow Sweep Type Selector": "Rainbow Sweep Type Selector.gtype"}
  "MSpot Spectrum Data.gtype" = cluster{"M Spot Spectrum": cluster{"Wavelength": f64[], "Counts": f64[]}, "Blue Motor Position (mm)": f64, "Red Motor Position (mm)": f64}
  "Rainbow Sweep Types.gtype" = enum{"Red Sweep Closing", "Red Sweep Opening", "Blue Sweep Closing", "Blue Sweep Opening"}
  "Full MSpot Multispectral Data.gtype" = cluster{"MSpot Spectrum Data Array": "MSpot Spectrum Data.gtype"[], "Rainbow Sweep Types": "Rainbow Sweep Types.gtype"}
  T3 = cluster{"Element 1": "VISA Instr", "Element 2": string}
  "Arduino Detection cluster control.gtype" = cluster{"XZ Stage Arduino Address": "VISA Instr", "XZ Stage Arduino Detected?": bool, "Multiplexer Arduino Detected?": bool, "Multiplexer Arduino Address": "VISA Instr", "Arduinos List": T3[], "XZ Stage Log": string, "Multiplexer Log": string}
  "Thorlabs Motors Serial Number In.gtype" = cluster{"Thorlabs Blue Motor": string, "Thorlabs Red Motor": string, "Blue Motor Homed?": bool, "Red Motor Homed?": bool}
  "Instrument Coms Info.gtype" = cluster{"Arduino Coms Info": "Arduino Detection cluster control.gtype", "Photodetector Names": string[], "Keythley Address": "VISA Instr", "Photodetector Detected?": bool, "Thorlabs Motors Detected?": bool, "Keithley Detected?": bool, "Thorlabs Motors Serial Number": "Thorlabs Motors Serial Number In.gtype", "Photodetector IVI session": "Ivi IviDefault", "Flame ID": string, "Flame Detected?": bool, "Flame Wrapper ID": u64}
  "Insturment Debugging Cluster.gtype" = cluster{"Keithley": bool, "Arduinos": bool, "Thorlabs Motors": bool, "Photodetector": bool, "Flame Spectr": bool}
  "Debugging Cluster.gtype" = cluster{"Debugging mode?": bool, "Initialize App": bool, "Insturment Debugging": "Insturment Debugging Cluster.gtype"}
  "MSpot Spectrum Calibration Parameters.gtype" = cluster{"Min Position (mm)": f64, "Max Position (mm)": f64, "Position step size (mm)": f64, "Manual Spectra?": bool, "Flame Integration Time (us)": f64, "Flame Scans to Average": u32}
uses:
  Rainbow Measurement Setup::Side Functions::Rainbow Sweep::Rainbow Sweep Type Extractor.gvi
  Rainbow Measurement Setup::Main Functions::One Time Calibrations::MSpot Spectrum::MSpot Step Calculator.gvi
  Rainbow Measurement Setup::Side Functions::Instrument Control::Thorlabs Motors::Movement::KCube Initialize and Home.gvi
  Rainbow Measurement Setup::Side Functions::Instrument Control::Thorlabs Motors::Movement::KCube Motor Single Move to Position.gvi
  Rainbow Measurement Setup::Side Functions::Instrument Control::Flame Spectrometer::Flame Set Scans to Average.gvi
  Rainbow Measurement Setup::Side Functions::Instrument Control::Flame Spectrometer::Flame Set Integration Time.gvi
  Rainbow Measurement Setup::Side Functions::Instrument Control::Flame Spectrometer::Flame Get Spectra.gvi
  Rainbow Measurement Setup::Side Functions::Instrument Control::Thorlabs Motors::Movement::KCube Motors Close.gvi
diagram:
  # This SubVI Performs a scan of the spectrum of the beam (STILL FLAME CONNECTION MISSING) and then moves the blade motors to perform a full scan of the spectrum with respect to position.
  case ($"Error In") {
    frame Error, Default {
      w1 = default
      w2 = $"Error In"
      w3 = $"Instrument Coms Info In"
      w4 = $"Debugging Cluster In"
    }
    frame No Error {
      call "Rainbow Sweep Type Extractor.gvi"(Rainbow Sweep Parameters=$"Rainbow Sweep Param Selector", Error In=$"Error In") -> (Rainbow Sweep Array=w5, Error Out=w6)
      call "MSpot Step Calculator.gvi"(MSpot Spectrum Calibration Parameters In=$"MSpot Spectrum Calibration Parameters In") -> (Manual Spectra?=w7, Number of steps=w8)
      s1 = "Full MSpot Multispectral Data.gtype"[] []  # shift register
      s2 = w6  # shift register
      s3 = $"Instrument Coms Info In"  # shift register
      s4 = $"Debugging Cluster In"  # shift register
      for (iteration -> i1) {
        w9 = each element of w5
        Array Index(array=s1) -> (out0[i1]=w10)
        case (w9) {
          frame "Red Sweep Opening", Default {
            call "KCube Initialize and Home.gvi"(Instrument Coms Info In=s3, Debugging Cluster In=s4, Error In=s2, KCube Motor Selector="Blue Motor") -> (Instrument Coms Info Out=w15, Debugging Cluster Out=w16, Error Out=w17)
            s5 = w17  # shift register
            s6 = "MSpot Spectrum Data.gtype"[] []  # shift register
            s7 = w15  # shift register
            s8 = w16  # shift register
            for (N = w8) (iteration -> i2) {
              Property Node(instance in=$"MSpot Spectrum Calibration Parameters In") -> ("Max Position (mm)"=w18, "Position step size (mm)"=w19, "Flame Integration Time (us)"=w20, "Flame Scans to Average"=w21)
              To Double Precision Float(number=i2) -> w22
              Multiply(w19, w22) -> w23
              Subtract(x=w18, y=w23) -> w24
              call "KCube Motor Single Move to Position.gvi"(Instrument Coms Info In=s7, Debugging Cluster In=s8, Motor Position to move to (mm)=w24, Error In=s5, KCube Motor Selector="Blue Motor") -> (Instrument Coms Info Out=w25, Debugging Cluster Out=w26, Error Out=w27)
              case (w7) {
                frame False, Default {
                  call "Flame Set Scans to Average.gvi"(Instrument Coms Info In=w25, Debugging Cluster In=w26, Scans to Average=w21, Error In=w27) -> (Instrument Coms Info Out=w32, Debugging Cluster Out=w33, Error Out=w34)
                  call "Flame Set Integration Time.gvi"(Instrument Coms Info In=w32, Debugging Cluster In=w33, Integration Time=w20, Error In=w34) -> (Instrument Coms Info Out=w35, Debugging Cluster Out=w36, Error Out=w37)
                  call "Flame Get Spectra.gvi"(Instrument Coms Info In=w35, Debugging Cluster In=w36, Error In=w37) -> (Instrument Coms Info Out=w31, Debugging Cluster Out=w29, Beam Spectrum=w28, Error Out=w30)
                }
                frame True {
                  w38 = cluster{"Wavelength": f64[], "Counts": f64[]} {all zero or empty}
                  Wait Until Next Multiple(multiple to wait=300)
                  w39 = "Please Save the spectrum file\non the oceanview software\nbefore continuing."
                  One Button Dialog(button name ("OK")="Okay, I will", message=w39)
                  w28 = w38
                  w29 = w26
                  w30 = w27
                  w31 = w25
                }
              }
              Property Node(instance in="MSpot Spectrum Data.gtype" {all zero or empty}, "M Spot Spectrum"=w28, "Blue Motor Position (mm)"=w24, "Red Motor Position (mm)"=0) -> (instance out=w40)
              Insert Into Array(inArray=s6, index0=i2, new=w40) -> w41
              next s5 = w30
              next s6 = w41
              next s7 = w31
              next s8 = w29
            }
            Property Node(instance in=w10, "Rainbow Sweep Types"=w9, "MSpot Spectrum Data Array"=s6) -> (instance out=w13)
            call "KCube Motors Close.gvi"(Instrument Coms Info In=s7, Error In=s5) -> (Instrument Coms Info Out=w11, Error Out=w12)
            w14 = s8
          }
          frame "Red Sweep Closing" {
            call "KCube Initialize and Home.gvi"(Instrument Coms Info In=s3, Debugging Cluster In=s4, Error In=s2, KCube Motor Selector="Blue Motor") -> (Instrument Coms Info Out=w42, Debugging Cluster Out=w43, Error Out=w44)
            s9 = w44  # shift register
            s10 = "MSpot Spectrum Data.gtype"[] []  # shift register
            s11 = w42  # shift register
            s12 = w43  # shift register
            for (N = w8) (iteration -> i3) {
              Property Node(instance in=$"MSpot Spectrum Calibration Parameters In") -> ("Min Position (mm)"=w45, "Position step size (mm)"=w46, "Flame Integration Time (us)"=w47, "Flame Scans to Average"=w48)
              To Double Precision Float(number=i3) -> w49
              Multiply(w46, w49) -> w50
              Add(w45, w50) -> w51
              call "KCube Motor Single Move to Position.gvi"(Instrument Coms Info In=s11, Debugging Cluster In=s12, Motor Position to move to (mm)=w51, Error In=s9, KCube Motor Selector="Blue Motor") -> (Instrument Coms Info Out=w52, Debugging Cluster Out=w53, Error Out=w54)
              case (w7) {
                frame False, Default {
                  call "Flame Set Scans to Average.gvi"(Instrument Coms Info In=w52, Debugging Cluster In=w53, Scans to Average=w48, Error In=w54) -> (Instrument Coms Info Out=w58, Debugging Cluster Out=w59, Error Out=w60)
                  call "Flame Set Integration Time.gvi"(Instrument Coms Info In=w58, Debugging Cluster In=w59, Integration Time=w47, Error In=w60) -> (Instrument Coms Info Out=w61, Debugging Cluster Out=w62, Error Out=w63)
                  call "Flame Get Spectra.gvi"(Instrument Coms Info In=w61, Debugging Cluster In=w62, Error In=w63) -> (Instrument Coms Info Out=w57, Debugging Cluster Out=w56, Beam Spectrum=w55, Error Out=w64)
                }
                frame True {
                  w65 = cluster{"Wavelength": f64[], "Counts": f64[]} {all zero or empty}
                  w66 = "Please Save the spectrum file\non the oceanview software\nbefore continuing."
                  One Button Dialog(button name ("OK")="Okay, I will", message=w66)
                  Wait Until Next Multiple(multiple to wait=300)
                  w55 = w65
                  w56 = w53
                  w57 = w52
                }
              }
              Property Node(instance in="MSpot Spectrum Data.gtype" {all zero or empty}, "M Spot Spectrum"=w55, "Blue Motor Position (mm)"=w51, "Red Motor Position (mm)"=0) -> (instance out=w67)
              Insert Into Array(inArray=s10, index0=i3, new=w67) -> w68
              next s9 = w54
              next s10 = w68
              next s11 = w57
              next s12 = w56
            }
            Property Node(instance in=w10, "Rainbow Sweep Types"=w9, "MSpot Spectrum Data Array"=s10) -> (instance out=w13)
            call "KCube Motors Close.gvi"(Instrument Coms Info In=s11, Error In=s9) -> (Instrument Coms Info Out=w11, Error Out=w12)
            w14 = s12
          }
          frame "Blue Sweep Closing" {
            call "KCube Initialize and Home.gvi"(Instrument Coms Info In=s3, Debugging Cluster In=s4, Error In=s2, KCube Motor Selector="Red Motor") -> (Instrument Coms Info Out=w69, Debugging Cluster Out=w70, Error Out=w71)
            s13 = w71  # shift register
            s14 = "MSpot Spectrum Data.gtype"[] []  # shift register
            s15 = w70  # shift register
            s16 = w69  # shift register
            for (N = w8) (iteration -> i4) {
              Property Node(instance in=$"MSpot Spectrum Calibration Parameters In") -> ("Min Position (mm)"=w72, "Position step size (mm)"=w73, "Flame Integration Time (us)"=w74, "Flame Scans to Average"=w75)
              To Double Precision Float(number=i4) -> w76
              Multiply(w73, w76) -> w77
              Add(w72, w77) -> w78
              call "KCube Motor Single Move to Position.gvi"(Instrument Coms Info In=s16, Debugging Cluster In=s15, Motor Position to move to (mm)=w78, Error In=s13, KCube Motor Selector="Red Motor") -> (Instrument Coms Info Out=w79, Debugging Cluster Out=w80, Error Out=w81)
              case (w7) {
                frame False, Default {
                  call "Flame Set Scans to Average.gvi"(Instrument Coms Info In=w79, Debugging Cluster In=w80, Scans to Average=w75, Error In=w81) -> (Instrument Coms Info Out=w86, Debugging Cluster Out=w87, Error Out=w88)
                  call "Flame Set Integration Time.gvi"(Instrument Coms Info In=w86, Debugging Cluster In=w87, Integration Time=w74, Error In=w88) -> (Instrument Coms Info Out=w89, Debugging Cluster Out=w90, Error Out=w91)
                  call "Flame Get Spectra.gvi"(Instrument Coms Info In=w89, Debugging Cluster In=w90, Error In=w91) -> (Instrument Coms Info Out=w85, Debugging Cluster Out=w83, Beam Spectrum=w82, Error Out=w84)
                }
                frame True {
                  w92 = cluster{"Wavelength": f64[], "Counts": f64[]} {all zero or empty}
                  w93 = "Please Save the spectrum file\non the oceanview software\nbefore continuing."
                  One Button Dialog(button name ("OK")="Okay, I will", message=w93)
                  Wait Until Next Multiple(multiple to wait=300)
                  w82 = w92
                  w83 = w80
                  w84 = w81
                  w85 = w79
                }
              }
              Property Node(instance in="MSpot Spectrum Data.gtype" {all zero or empty}, "M Spot Spectrum"=w82, "Red Motor Position (mm)"=w78, "Blue Motor Position (mm)"=0) -> (instance out=w94)
              Insert Into Array(inArray=s14, index0=i4, new=w94) -> w95
              next s13 = w84
              next s14 = w95
              next s15 = w83
              next s16 = w85
            }
            Property Node(instance in=w10, "Rainbow Sweep Types"=w9, "MSpot Spectrum Data Array"=s14) -> (instance out=w13)
            call "KCube Motors Close.gvi"(Instrument Coms Info In=s16, Error In=s13) -> (Instrument Coms Info Out=w11, Error Out=w12)
            w14 = s15
          }
          frame "Blue Sweep Opening" {
            call "KCube Initialize and Home.gvi"(Instrument Coms Info In=s3, Debugging Cluster In=s4, Error In=s2, KCube Motor Selector="Red Motor") -> (Instrument Coms Info Out=w96, Debugging Cluster Out=w97, Error Out=w98)
            s17 = w98  # shift register
            s18 = "MSpot Spectrum Data.gtype"[] []  # shift register
            s19 = w97  # shift register
            s20 = w96  # shift register
            for (N = w8) (iteration -> i5) {
              Property Node(instance in=$"MSpot Spectrum Calibration Parameters In") -> ("Position step size (mm)"=w99, "Max Position (mm)"=w100, "Flame Integration Time (us)"=w101, "Flame Scans to Average"=w102)
              To Double Precision Float(number=i5) -> w103
              Multiply(w99, w103) -> w104
              Subtract(x=w100, y=w104) -> w105
              call "KCube Motor Single Move to Position.gvi"(Instrument Coms Info In=s20, Debugging Cluster In=s19, Motor Position to move to (mm)=w105, Error In=s17, KCube Motor Selector="Red Motor") -> (Instrument Coms Info Out=w106, Debugging Cluster Out=w107, Error Out=w108)
              case (w7) {
                frame False, Default {
                  call "Flame Set Scans to Average.gvi"(Instrument Coms Info In=w106, Debugging Cluster In=w107, Scans to Average=w102, Error In=w108) -> (Instrument Coms Info Out=w113, Debugging Cluster Out=w114, Error Out=w115)
                  call "Flame Set Integration Time.gvi"(Instrument Coms Info In=w113, Debugging Cluster In=w114, Integration Time=w101, Error In=w115) -> (Instrument Coms Info Out=w116, Debugging Cluster Out=w117, Error Out=w118)
                  call "Flame Get Spectra.gvi"(Instrument Coms Info In=w116, Debugging Cluster In=w117, Error In=w118) -> (Instrument Coms Info Out=w112, Debugging Cluster Out=w110, Beam Spectrum=w109, Error Out=w111)
                }
                frame True {
                  w119 = cluster{"Wavelength": f64[], "Counts": f64[]} {all zero or empty}
                  w120 = "Please Save the spectrum file\non the oceanview software\nbefore continuing."
                  One Button Dialog(button name ("OK")="Okay, I will", message=w120)
                  Wait Until Next Multiple(multiple to wait=300)
                  w109 = w119
                  w110 = w107
                  w111 = w108
                  w112 = w106
                }
              }
              Property Node(instance in="MSpot Spectrum Data.gtype" {all zero or empty}, "M Spot Spectrum"=w109, "Red Motor Position (mm)"=w105, "Blue Motor Position (mm)"=0) -> (instance out=w121)
              Insert Into Array(inArray=s18, index0=i5, new=w121) -> w122
              next s17 = w111
              next s18 = w122
              next s19 = w110
              next s20 = w112
            }
            Property Node(instance in=w10, "Rainbow Sweep Types"=w9, "MSpot Spectrum Data Array"=s18) -> (instance out=w13)
            call "KCube Motors Close.gvi"(Instrument Coms Info In=s20, Error In=s17) -> (Instrument Coms Info Out=w11, Error Out=w12)
            w14 = s19
          }
        }
        Insert Into Array(inArray=s1, index0=i1, new=w13) -> w123
        next s1 = w123
        next s2 = w12
        next s3 = w11
        next s4 = w14
      }
      w1 = s1
      w2 = s2
      w3 = s3
      w4 = s4
    }
  }
  $"Instrument Coms Info Out" <- w3
  $"Debugging Cluster Out" <- w4
  $"Full MSpot Multispectral Data Array" <- w1
  $"Error Out" <- w2
