vi "MSpot Spectrum Visualizer.gvi"   [LabVIEW NXG 5.0.0]
inputs:
  "Error In": error
  "Full MSpot Multispectral Data Array": "Full MSpot Multispectral Data.gtype"[]
outputs:
  "Error Out": error
panel controls:
  "Sweep Type Selector": i32
  "Graph (position) Selector": i32
  "Continue": bool
  "Div Wavelength Threshold": f64 = 0.85
  "Divide?": bool
  "Smooth Peaks?": bool
panel indicators:
  "Rainbow Sweep Type": "Rainbow Sweep Types.gtype"
  "M Spot Spectrum": cluster{"Element 1": f64[], "Element 2": f64[]}
  "MSpot Spectrum Data": "MSpot Spectrum Data.gtype"
types:
  "Rainbow Sweep Types.gtype" = enum{"Red Sweep Closing", "Red Sweep Opening", "Blue Sweep Closing", "Blue Sweep Opening"}
  "MSpot Spectrum Data.gtype" = cluster{"M Spot Spectrum": cluster{"Wavelength": f64[], "Counts": f64[]}, "Blue Motor Position (mm)": f64, "Red Motor Position (mm)": f64, "Dividing Wavelength (nm)": f64}
  "Full MSpot Multispectral Data.gtype" = cluster{"MSpot Spectrum Data Array": "MSpot Spectrum Data.gtype"[], "Rainbow Sweep Types": "Rainbow Sweep Types.gtype"}
uses:
  Rainbow Measurement Setup::Main Functions::One Time Calibrations::MSpot Spectrum::Dividing Wavelength Calculations::Dividing Wavelength Calculator.gvi
  Rainbow Measurement Setup::Main Functions::One Time Calibrations::MSpot Spectrum::Dividing Wavelength Calculations::Spectra Operator.gvi
diagram:
  Property Node(instance in=reference to unnamed native front panel, error in=$"Error In") -> ("Window"=w1, error out=w2)
  Open Window(reference in=w1, error in=w2) -> (reference out=w3, error out=w4)
  # This subVI allows us to visualize the data obtained on the Measuring Spot Spectrum Calibration subroutine so that we can
  # extract our own conclusions and elaborate the calibration file.
  case (w4) {
    frame Error, Default {
      w5 = w4
      w6 = w3
    }
    frame No Error {
      Is Empty Array(array=$"Full MSpot Multispectral Data Array") -> w7
      case (w7) {
        frame True {
          One Button Dialog(button name ("OK")="Oh, sorry", message="No Calibration Found")
          w5 = w4
        }
        frame False {
          call "Dividing Wavelength Calculator.gvi"(Full MSpot Multispectral Data Array In=$"Full MSpot Multispectral Data Array", Error In=w4) -> (Full MSpot Multispectral Data Array Out=w8, Error Out=w9)
          Array Index(array=$"Full MSpot Multispectral Data Array") -> (out0[$"Sweep Type Selector"]=w10)
          s1 = w10  # shift register
          while {
            event (timeout = 50) {
              on "Timeout" {
                Property Node(instance in=s1) -> ("MSpot Spectrum Data Array"=w12, "Rainbow Sweep Types"=w13, instance out=w11)
                Array Index(array=w12) -> (out0[$"Graph (position) Selector"]=w14)
                Property Node(instance in=w14) -> ("M Spot Spectrum"=w15, "Dividing Wavelength (nm)"=w16)
                Property Node(instance in=w15) -> ("Wavelength"=w17, "Counts"=w18)
                Is Empty Array(array=w18) -> w19
                case (w19) {
                  frame True { }
                  frame False {
                    Build Cluster(w17, w18) -> w20
                    $"M Spot Spectrum" <- w20
                  }
                }
                $"MSpot Spectrum Data" <- w14
                Property Node(instance in=reference to "M Spot Spectrum") -> ("Cursor"=w21)
                Property Node(instance in=w21, "XPosition"=w16, "Visible"=TRUE)
                $"Rainbow Sweep Type" <- w13
                Array Size(array=w8) -> (size(s)=w22)
                Decrement(x=w22) -> w23
                Is Equal To 0(x=w23) -> w24
                Not(x=w24) -> w25
                Property Node(instance in=reference to "Sweep Type Selector", "Maximum"=w23, "Minimum"=0, "Visible"=w25) -> (error out=w26)
                Array Size(array=w12) -> (size(s)=w27)
                Decrement(x=w27) -> w28
                Property Node(instance in=reference to "Graph (position) Selector", "Minimum"=0, "Maximum"=w28, error in=w26) -> (error out=w5)
              }
              on "Div Wavelength Threshold" Value changed; "Divide?" Value changed; "Smooth Peaks?" Value changed; "Sweep Type Selector" Value changed {
                call "Dividing Wavelength Calculator.gvi"(Full MSpot Multispectral Data Array In=w8, Error In=w9, Dividing Wavelength Threshold=$"Div Wavelength Threshold") -> (Full MSpot Multispectral Data Array Out=w29, Interpolation error=w30, Error Out=w31)
                case (w30) {
                  frame False, Default {
                    w32 = w31
                  }
                  frame True {
                    Add($"Div Wavelength Threshold", 0.1) -> w33
                    $"Div Wavelength Threshold" <- w33
                    w34 = "Dividing wavelength threshold too low, automatically raised it by 0.1"
                    One Button Dialog(button name ("OK")="Oops sorry :3", message=w34)
                    w32 = w31
                  }
                }
                Array Index(array=w29) -> (out0[$"Sweep Type Selector"]=w35)
                case ($"Divide?") {
                  frame False, Default {
                    w36 = w35
                    w37 = w32
                  }
                  frame True {
                    call "Spectra Operator.gvi"(Full MSpot Multispectral Data=w35, Error In=w32, Spectra Operator control="Divide Spectra") -> (Operated Data=w36, Error Out=w37)
                  }
                }
                case ($"Smooth Peaks?") {
                  frame False, Default {
                    w11 = w36
                    w5 = w37
                  }
                  frame True {
                    call "Spectra Operator.gvi"(Full MSpot Multispectral Data=w36, Error In=w37, Spectra Operator control="Smooth Peaks") -> (Operated Data=w11, Error Out=w5)
                  }
                }
              }
            }
            next s1 = w11
            stop if $Continue
          }
        }
      }
      w6 = w3
    }
  }
  Close Window(reference in=w6, error in=w5) -> (error out=w38)
  $"Error Out" <- w38
