vi "MSpot Step Calculator.gvi"   [LabVIEW NXG 5.0.0]
inputs:
  "MSpot Spectrum Calibration Parameters In": "MSpot Spectrum Calibration Parameters.gtype" = {"Min Position (mm)"=0, "Max Position (mm)"=10, "Position step size (mm)"=0.1}
outputs:
  "Number of steps": i32
types:
  "MSpot Spectrum Calibration Parameters.gtype" = cluster{"Min Position (mm)": f64, "Max Position (mm)": f64, "Position step size (mm)": f64}
diagram:
  Property Node(instance in=$"MSpot Spectrum Calibration Parameters In") -> ("Min Position (mm)"=w1, "Max Position (mm)"=w2, "Position step size (mm)"=w3)
  Subtract(x=w2, y=w1) -> w4
  Divide(x=w4, y=w3) -> w5
  Increment(x=w5) -> w6
  To Signed 32 Bit Integer(number=w6) -> w7
  # w7: Number of Steps
  $"Number of steps" <- w7
