vi "PowerMeter Sample.gvi"   [LabVIEW NXG 5.0.0]
inputs:
  "Error In": error
outputs:
  "Error Out": error
  "Graph": cluster{"Element 1": f64, "Element 2": f64}[]
panel controls:
  "Reset measurement": bool
  "Parameter to measure": enum{"Photocurrent", "Power"} = "Photocurrent"
  "Stop App": bool
  "Save Graph Data": bool
  "Data Array": f64[][]
panel indicators:
  "Power Value": f64  # This parameter returns the last measured temperature value in °C.
  "Active": bool
  "Current": f64
  "Elapsed Time": f64
  "Stopped?": bool
  "Wait for save?": bool
uses:
  LabView_NXG_Thorlabs_PM100::Miscelanous::TLPM Find Resources.gvi
  LabView_NXG_Thorlabs_PM100::Get Parameters::TLPM Get Resource Name.gvi
  LabView_NXG_Thorlabs_PM100::Miscelanous::TLPM Initialize.gvi
  LabView_NXG_Thorlabs_PM100::Miscelanous::TLPM Timer.gvi
  LabView_NXG_Thorlabs_PM100::Measure::TLPM Measure Power.gvi
  LabView_NXG_Thorlabs_PM100::Measure::TLPM Measure Current.gvi
  LabView_NXG_Thorlabs_PM100::Miscelanous::TLPM Close.gvi
  NI::G Core::Error::Multiplex Errors.gvi
diagram:
  case (TRUE) {
    frame False, Default {
      w1 = $"Error In"
    }
    frame True {
      $"Stopped?" <- FALSE
      $"Wait for save?" <- FALSE
      w1 = $"Error In"
    }
  }
  # TLPM LabVIEW Example
  while {
    # Check for TLPM Devices
    # Returns Number of
    # found Devices
    Wait Until Next Multiple(multiple to wait=50)
    $Active <- FALSE
    call "TLPM Find Resources.gvi"(IVI session in="", error in (no error)=w1) -> (Resource Count=w2, error out=w3)
    Is Greater Or Equal(x=w2, y=1) -> w4
    case (w4) {
      frame False, Default {
        w5 = TRUE
        w6 = w3
      }
      frame True {
        # Initialize
        call "TLPM Get Resource Name.gvi"(Index (0)=0, error in (no error)=w3) -> (error out=w7, Resource Name=w8)
        # Select first Device
        # (Device Index 0)
        call "TLPM Initialize.gvi"(resource name=w8, ID Query (Do Query)=FALSE, Reset Device (Reset Device)=FALSE, error in (no error)=w7) -> (IVI session out=w9, error out=w10)
        w11 = $"Parameter to measure"
        s1 = w10  # shift register
        s2 = w9  # shift register
        s3 = cluster{"Element 1": f64, "Element 2": f64}[] []  # shift register
        s4 = uninitialised  # shift register
        s5 = f64[][] []  # shift register
        s6 = "Reset Timer"  # shift register
        s7 = 0  # shift register
        while {
          call "TLPM Timer.gvi"(Timer Commands=s6, Error In=s1) -> (Elapsed Time (Seconds)=w12, Paused?=w13, Error Out=w14)
          case (w11) {
            frame "Power", Default {
              $Active <- TRUE
              # Get Power
              Wait(time to wait=10)
              call "TLPM Measure Power.gvi"(IVI session in=s2, error in (no error)=w14) -> (IVI session out=w15, Power=w18, error out=w16)
              $"Power Value" <- w18
              w17 = FALSE
            }
            frame "Photocurrent" {
              Wait Until Next Multiple(multiple to wait=10)
              $Active <- TRUE
              call "TLPM Measure Current.gvi"(IVI session in=s2, error in (no error)=w14) -> (IVI session out=w15, Current=w18, error out=w16)
              # Get Current
              $Current <- w18
              w17 = FALSE
            }
          }
          Build Array(w12, w18) -> w19
          Build Cluster(w12, w18) -> w20
          case (w13) {
            frame True {
              w21 = s3
              w22 = s5
              w23 = s7
            }
            frame False {
              Increment(x=s7) -> w23
              Insert Into Array(inArray=s5, index0=s7, new=w19) -> w22
              Insert Into Array(inArray=s3, index0=s7, new=w20) -> w21
            }
          }
          $"Data Array" <- w22
          $"Elapsed Time" <- w12
          $Graph <- w21
          Property Node(instance in=reference to "Parameter to measure") -> ("Value"=w24)
          Is Not Equal(x=w24, y=s4) -> w25
          w26 = $"Stop App"
          Logical Or($"Reset measurement", w26, w25) -> w27
          next s1 = w16
          next s2 = w15
          next s3 = w21
          next s4 = w24
          next s5 = w22
          next s6 = "Check Timer"
          next s7 = w23
          stop if w27
        }
        # Close
        $Active <- w17
        call "TLPM Close.gvi"(IVI session in=s2, error in (no error)=s1) -> (error out=w6)
        w5 = w26
      }
    }
    $"Stopped?" <- w5
    stop if w5
  }
  s8 = w1  # shift register
  while {
    case ($"Save Graph Data") {
      frame False, Default {
        $"Wait for save?" <- FALSE
        call "TLPM Timer.gvi"(Timer Commands="Resume Timer", Error In=s8) -> (Error Out=w28)
      }
      frame True {
        $"Wait for save?" <- TRUE
        call "TLPM Timer.gvi"(Timer Commands="Pause Timer", Error In=s8) -> (Error Out=w29)
        Open Or Create Or Replace File(access (0:read/write)="read/write", error in=w29, operation (0:open)="replace or create") -> (error out=w30, refnum out=w31)
        Array To Spreadsheet String(array=$"Data Array", format string="%g") -> (spreadsheet string=w32)
        Concatenate Strings("Elapsed Time (s)    Power (W)", "\r\n", w32) -> w33
        Write To Text File(error in=w30, file (use dialog)=w31, text=w33) -> (error out=w34, refnum out=w35)
        Close File(error in=w34, refnum=w35) -> (error out=w28)
      }
    }
    Logical Or(w28, $"Stopped?") -> w36
    Wait Until Next Multiple(multiple to wait=50)
    next s8 = w28
    stop if w36
  }
  call "Multiplex Errors.gvi"(error in 1=w6, error in 2=s8) -> (error out=w37)
  $"Error Out" <- w37
