vi "Sun Simulator data.gvi"   [LabVIEW NXG 5.0.0]
inputs:
  "Operation Control": enum{"Load File", "Load Data"} = "Load File"
  "Multiplier": f64
  "Offset": f64
  "Path": path
outputs:
  "Sun Simulator Data": cluster{"Wavelength": f64[], "Counts": f64[]}
panel indicators:
  "Extracted TExt": string
  "Extracted Array": f64[][]
diagram:
  case ($"Operation Control") {
    frame "Load File", Default {
      Open Or Create Or Replace File(file path (use dialog)=$Path) -> (error out=w3, refnum out=w4)
      Read From Text File(error in=w3, file (use dialog)=w4) -> (error out=w5, refnum out=w6, text=w7)
      $"Extracted TExt" <- w7
      Spreadsheet String To Array(format string="%g", spreadsheet string=w7) -> (array=w8)
      $"Extracted Array" <- w8
      Array Index(array=w8) -> (out0[_, 0]=w2, out1[_, 1]=w1)
      Close File(error in=w5, refnum=w6)
    }
    frame "Load Data" {
      w9 = [341.279, 341.662, 342.045, 342.429, 342.812, 343.195, 343.578, 343.962, 344.345, 344.728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]
      w10 = [-48.05, -51.02, -54.67, -56.41, -53.69, -53.4, -55.78, -57.13, -55.64, -47.92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]
      w1 = w10
      w2 = w9
    }
  }
  w11 = cluster{"Wavelength": f64[], "Counts": f64[]} {all zero or empty}
  Multiply($Multiplier, w1) -> w12
  Add(w12, $Offset) -> w13
  Property Node(instance in=w11, "Wavelength"=w2, "Counts"=w13) -> (instance out=w14)
  $"Sun Simulator Data" <- w14
