vi "MRM file handling.gvi"   [LabVIEW NXG 5.0.0]
inputs:
  "Error In": error
  "Misc Data Mega Cluster In": "Misc Data Mega Cluster.gtype"
  "MRM Mega Cluster In": "MRM Mega Cluster.gtype" = {"MRM Specific Parameters"={"V Points"=1, "Current Avg"=1, "Sweep Speed"="Smart Sweep"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}, "Cell Selector"={FALSE, FALSE, FALSE, FALSE, FALSE, FALSE, FALSE, FALSE, FALSE, FALSE, FALSE, FALSE, FALSE, FALSE, FALSE, FALSE, FALSE, FALSE, FALSE, FALSE, FALSE, FALSE, FALSE, FALSE, FALSE, FALSE, FALSE, FALSE}, "Cells to Measure Array"=[], "Rainbow Sweep Parameters MRM"={0, 900, 400, 1, 1, 0}, "MRM Data Array"=[]}
  "Modify File Operation": "Modify File Operation.gtype" = "Save TXT"
outputs:
  "Error Out": error
  "MRM Mega Cluster Out": "MRM Mega Cluster.gtype"
  "Boolean Handler Out": "SRM Load Boolean Handler.gtype"
  "Loaded Files": string[]
panel indicators:
  "Misc Data Mega Cluster Out": "Misc Data Mega Cluster.gtype"
types:
  "Modify File Operation.gtype" = enum{"Save TXT", "Load TXT"}
  "SRM Load Boolean Handler.gtype" = cluster{"Canceled Loading?": bool, "Found Any Folder?": bool, "Found Files Within all Folders?": bool, "Duplicate Measurement Files?": bool}
  T1 = cluster{"SRM Light Power Density Ref": "NumericTextBoxDouble reference", "Rainbow Sweep Parameters RSM": "Cluster reference", "SRM Refined Plot Rainbow Sweep Types": "ComboBoxSelector reference", "Sweep Live Parameters RSM": "Cluster reference", "SRM Raw Plot Rainbow Sweep Selector": "ComboBoxSelector reference", "SRM Plot Parameter Selector Ref": "EnumSelector reference", "IV Plot Out Ref": "Graph reference", "SRM Specific Parameters": "Cluster reference"}
  T2 = cluster{"Calibration Files Path": "PathSelector reference", "Default Data Saving Location": "PathSelector reference"}
  T3 = cluster{"Main Tab": "TabControl reference", "Rainbow Measurement tab": "TabControl reference", "Configuration tab": "TabControl reference", "Light Calibration tab": "TabControl reference"}
  T4 = cluster{"Custom date": "CheckBox reference", "Batch Name": "StringControl reference", "Author Initials": "ComboBoxSelector reference", "Cell Number": "StringControl reference", "Current Date": "StringControl reference", "Sample Comments": "StringControl reference", "Sample Prefix": "StringControl reference", "Label Info Missing Error": "BooleanControl reference", "Label Info Error Label": "StringControl reference"}
  T5 = cluster{"Beam Power Density": "IntensityGraph reference"[][], "Irradiance Calibration": "Graph reference"[], "MSpot Spectrum Calibration Parameters": "Cluster reference", "Rainbow Sweep Param Selector MSpot": "Cluster reference"}
  T6 = cluster{"LPC Parameters Ref": "Cluster reference", "Sweep Live Parameters LPC ref": "Cluster reference", "Light Power Calibration": "Graph reference", "Light Power Calibration Data Ref": "ArrayViewer reference", "Rainbow Sweep Parameters LPC": "Cluster reference"}
  T7 = cluster{"Current State Ref": "EnumSelector reference", "Substate": "StringControl reference", "State": "StringControl reference", "Current Substate": "StringControl reference"}
  T8 = cluster{"Custom Position": "BooleanControl reference", "Set Position": "BooleanControl reference", "XZ Stage Active": "BooleanControl reference", "Release XZ Stage": "BooleanControl reference", "XZ Coordinates": "Cluster reference", "Activate XZ Stage": "BooleanControl reference", "XZ Stage Cell Reference": "EnumSelector reference", "XZ All Position Cluster Ref": "Cluster reference"}
  T9 = cluster{"IV Extracted Parameter Plot ": "Graph reference", "MRM Cell Selector Ref": "Cluster reference", "IV Plot Out Multiple Reference": "Graph reference", "Rainbow Sweep Parameters MRM Ref": "Cluster reference", "MRM Cell Refined Plot Selector ref": "ComboBoxSelector reference", "MRM Current Raw Cell Plot": "ComboBoxSelector reference", "MRM Raw Plot Rainbow Sweep Relector Ref": "ComboBoxSelector reference", "MRM Specific Parameters Ref": "Cluster reference"}
  T10 = cluster{"Smart Sweep Mega Cluster Ref": "Cluster reference"}
  "Full Reference Cluster.gtype" = cluster{"SRM Reference Cluster": T1, "Path Reference Cluster": T2, "Tab Reference Cluster": T3, "Cell Naming Parameters Ref Cluster": T4, "One Time Calibrations Ref Cluster": T5, "LPC Controls Reference Cluster": T6, "System Parameters Ref Cluster": T7, "XZ Stage Controls Reference Cluster": T8, "MRM Reference Cluster": T9, "Other Parameters Cluster": T10}
  T11 = cluster{"X Coordinate (mm)": f64, "Z Coordinate (mm)": f64, "Aprch Distance (mm)": f64}
  T12 = cluster{"X Coordinate (mm)": f64, "Z Coordinate (mm)": f64, "Vertical Spacing (mm)": f64, "Aprch Distance (mm)": f64, "Aprch Dstnc L.12 (mm)": f64}
  "XZ All Position Cluster.gtype" = cluster{"Diffusor Coordinates": T11, "Photodetector Coordinates": T11, "Cell R.01 Coordinates": T12}
  T13 = cluster{"Thorlabs Motor Serial Number File Path": path, "Default Data Saving Location": path}
  "Cell Naming Cluster.gtype" = cluster{"Cell Label": string, "Sample Prefix": string, "Author Initials": string, "Current Date": string, "Batch Name": string}
  "Misc Data Mega Cluster.gtype" = cluster{"Full Reference Cluster": "Full Reference Cluster.gtype", "All XZ Position Cluster": "XZ All Position Cluster.gtype", "All Paths": T13, "Cell Naming Cluster": "Cell Naming Cluster.gtype"}
  "Sweep Speed Selector.gtype" = enum{"Smart Sweep", "Fast Sweep", "Normal Sweep"}
  "MRM Specific Parameters.gtype" = cluster{"Max (V)": f64, "Min (V)": f64, "V Points": u32, "Curr Range (A)": f64, "Sweep Dir": bool, "Current Avg": u32, "Max (A)": f64, "PLC Speed": f64, "Cell Area (m^2)": f64, "Autorange": bool, "Full Spctr Ref": bool, "Sweep Speed": "Sweep Speed Selector.gtype"}
  T14 = cluster{"L.01": bool, "R.01": bool, "L.02": bool, "R.02": bool, "L.03": bool, "R.03": bool, "L.04": bool, "R.04": bool, "L.05": bool, "R.05": bool, "L.06": bool, "R.06": bool, "L.07": bool, "R.07": bool, "L.08": bool, "R.08": bool, "L.09": bool, "R.09": bool, "L.10": bool, "R.10": bool, "L.11": bool, "R.11": bool, "L.12": bool, "R.12": bool}
  "MRM Cell Selector.gtype" = cluster{"All": bool, "Left": bool, "Right": bool, "Cell Cluster": T14, "Reset": bool}
  "XZ Stage Cell.gtype" = enum{"L.01", "L.02", "L.03", "L.04", "L.05", "L.06", "L.07", "L.08", "L.09", "L.10", "L.11", "L.12", "R.01", "R.02", "R.03", "R.04", "R.05", "R.06", "R.07", "R.08", "R.09", "R.10", "R.11", "R.12"}
  "Selected Cells Array.gtype" = "XZ Stage Cell.gtype"[]
  "Raibow Sweep Selector.gtype" = enum{"Red Sweep", "Blue Sweep", "Full Sweep Red First", "Full Sweep Blue First"}
  "Rainbow Sweep Param Selector.gtype" = cluster{"Raibow Sweep Selector": "Raibow Sweep Selector.gtype", "Max Wavelength (nm)": f64, "Min Wavelength (nm)": f64, "Wavelength Step (nm)": f64, "Rainbow Sweep Type Selector": "Rainbow Sweep Type Selector.gtype"}
  T15 = enum{"L.01", "L.02", "L.03", "L.04", "L.05", "L.06", "L.07", "L.08", "L.09", "L.10", "L.11", "L.12", "R.01", "R.02", "R.03", "R.04", "R.05", "R.06", "R.07", "R.08", "R.09", "R.10", "R.11", "R.12"}
  "MRM Full Data From SRM Cluster.gtype" = cluster{"SRM Mega Cluster": "SRM Mega Cluster.gtype", "Cell Label": T15}
  "MRM Mega Cluster.gtype" = cluster{"MRM Specific Parameters": "MRM Specific Parameters.gtype", "Cell Selector": "MRM Cell Selector.gtype", "Cells to Measure Array": "Selected Cells Array.gtype", "Rainbow Sweep Parameters MRM": "Rainbow Sweep Param Selector.gtype", "MRM Data Array": "MRM Full Data From SRM Cluster.gtype"[]}
  "Rainbow Sweep Types.gtype" = enum{"Red Sweep Closing", "Red Sweep Opening", "Blue Sweep Closing", "Blue Sweep Opening"}
  T16 = cluster{"Isc (A)": f64, "Voc (V)": f64, "FF (%)": f64, "Rs (Ω)": f64, "Rsh (Ω)": f64}
  "IV Single Measurement.gtype" = cluster{"Voltage (V)": f64[], "Current (A)": f64[], "Current Density (A/m^2)": f64[], "Dividing Wavelength (nm)": f64, "Light Power Density (W/m^2)": f64, "Total Light Power Density (W/m^2)": f64, "Smart Sweep Data": T16}
  "IV Full Raw Data.gtype" = cluster{"Rainbow Sweep Types": "Rainbow Sweep Types.gtype", "IV Raw Data Array": "IV Single Measurement.gtype"[]}
uses:
  Rainbow Measurement Setup::Side Functions::Messages And Prompts::Select path prompt.gvi
  Rainbow Measurement Setup::Side Functions::Path Manipulation::File_FolderName Scan For Sweep.gvi
  Rainbow Measurement Setup::Main Functions::Modify TXT file::Modify Measurement TXT File.gvi
  Rainbow Measurement Setup::Main Functions::Rainbow Measurement::Cell Single Rainbow Measurement::File Handling::SRM Header Info Extractor.gvi
  Rainbow Measurement Setup::Side Functions::Utilities::Array Operations::Array Detect Duplicates.gvi
  Rainbow Measurement Setup::Side Functions::Messages And Prompts::FGV Repeat Operation for all following files.gvi
diagram:
  # This subVI Handles the Saving of all the Single Rainbow Measurement files. It can both save and load the files from a specified folder and to the user folder respectively
  case ($"Error In") {
    frame Error, Default {
      w1 = $"Error In"
      w2 = default
      w3 = default
      w4 = $"MRM Mega Cluster In"
      w5 = $"Misc Data Mega Cluster In"
    }
    frame No Error {
      case ($"Modify File Operation") {
        frame "Load TXT" {
          w12 = "Please Select the folder with the Rainbow Measurement Files you want to Load. "
          w13 = "Please select the cell folder within the device you want to analyze (i.e. L12)"
          call "Select path prompt.gvi"(Main Message=w12, Sub message=w13, Error In=$"Error In", Cancel Available?=TRUE) -> (New Path=w14, Cancelled?=w15, Error Out=w16)
          case (w15) {
            frame True {
              w17 = default
              w6 = w16
              w8 = TRUE
              w2 = default
              w7 = TRUE
              w9 = default
              w10 = default
            }
            frame False {
              List Folder(error in=w16, path=w14) -> (error out=w18, folder names=w19, path out=w20)
              s1 = w18  # shift register
              s2 = 0  # shift register
              s3 = "IV Full Raw Data.gtype"[] []  # shift register
              for {
                w21 = each element of w19
                Build Path(base path=w20, name or relative path=w21) -> (appended path=w25)
                Search And Replace String(error in (no error)=s1, input string=w21, search string="Raw IV Curves") -> (error out=w26, number of replacements=w27)
                call "File_FolderName Scan For Sweep.gvi"(FileName/FolderName In=w21, Error In=w26) -> (Is File/Folder sweep type?=w28, Sweep Type=w29, Error Out=w30)
                Is Not Equal To 0(x=w27) -> w31
                Logical And(w31, w28) -> w32
                case (w32) {
                  frame False, Default {
                    w33 = s2
                    w34 = s3
                    w35 = w30
                    w36 = default
                    w37 = "Red Sweep Closing"
                    w38 = default
                  }
                  frame True {
                    Array Index(array=s3) -> (out0[s2]=w39)
                    Property Node(instance in=w39) -> ("IV Raw Data Array"=w40)
                    List Folder(error in=w30, path=w25) -> (error out=w41, file names=w42, path out=w43)
                    s4 = w41  # shift register
                    s5 = w40  # shift register
                    s6 = 0  # shift register
                    for {
                      w44 = each element of w42
                      Build Path(base path=w43, name or relative path=w44) -> (appended path=w46)
                      Search And Replace String(input string=w44, search string=".txt") -> (number of replacements=w47)
                      Is Not Equal To 0(x=w47) -> w48
                      case (w48) {
                        frame False, Default {
                          w49 = s4
                          w50 = s5
                          w51 = s6
                          w52 = default
                        }
                        frame True {
                          call "Modify Measurement TXT File.gvi"(Filename to load/save=w46, Modify File Operation="Load TXT", Error In=s4, Measurement File Type="Single Cell Rainbow Raw") -> (Loaded Data=w53, Header Data=w54, Error Out=w55)
                          Array Index(array=w53) -> (out0[_, 0]=w56, out1[_, 1]=w57, out2[_, 2]=w58)
                          call "SRM Header Info Extractor.gvi"(Header Data=w54, Error In=w55) -> (Dividing Wavelength=w59, Light Power Density=w60, Total Light Power Density=w61, Error Out=w49)
                          Property Node(instance in="IV Single Measurement.gtype" {all zero or empty}, "Voltage (V)"=w56, "Current (A)"=w57, "Current Density (A/m^2)"=w58, "Dividing Wavelength (nm)"=w59, "Light Power Density (W/m^2)"=w60, "Total Light Power Density (W/m^2)"=w61) -> (instance out=w62)
                          Insert Into Array(inArray=s5, index0=s6, new=w62) -> w50
                          Increment(x=s6) -> w51
                          w52 = TRUE
                        }
                      }
                      append w52 to w45
                      next s4 = w49
                      next s5 = w50
                      next s6 = w51
                    }
                    Or Array Elements(Boolean array=w45) -> (logical OR=w38)
                    Property Node(instance in=w39, "IV Raw Data Array"=s5, "Rainbow Sweep Types"=w29) -> (instance out=w63)
                    Insert Into Array(inArray=s3, new=w63) -> w34
                    Increment(x=s2) -> w33
                    w35 = s4
                    w36 = TRUE
                    w37 = w29
                  }
                }
                append w36 to w22
                append w21 to w2 if w32
                append w37 to w23 if w32
                append w38 to w24
                next s1 = w35
                next s2 = w33
                next s3 = w34
              }
              Or Array Elements(Boolean array=w22) -> (logical OR=w7)
              Or Array Elements(Boolean array=w24) -> (logical OR=w10)
              call "Array Detect Duplicates.gvi"(Array In=w23, Error In=s1) -> (Repeated?=w9, Error Out=w6)
              w17 = s3
              w8 = default
            }
          }
          w11 = $"MRM Mega Cluster In"
          w5 = $"Misc Data Mega Cluster In"
        }
        frame "Save TXT", Default {
          w6 = $"Error In"
          w7 = default
          w8 = default
          w2 = default
          w9 = default
          w10 = default
          w11 = $"MRM Mega Cluster In"
          w5 = $"Misc Data Mega Cluster In"
        }
      }
      Property Node(instance in=w11, "MRM Data Array"="MRM Full Data From SRM Cluster.gtype"[] []) -> (instance out=w4)
      Property Node(instance in="SRM Load Boolean Handler.gtype" {all zero or empty}, "Canceled Loading?"=w8, "Found Any Folder?"=w7, "Found Files Within all Folders?"=w10, "Duplicate Measurement Files?"=w9) -> (instance out=w3)
      call "FGV Repeat Operation for all following files.gvi"(FGV Instructions="Reset State", Error In=w6) -> (Error Out=w1)
    }
  }
  $"Misc Data Mega Cluster Out" <- w5
  $"MRM Mega Cluster Out" <- w4
  $"Boolean Handler Out" <- w3
  $"Error Out" <- w1
  $"Loaded Files" <- w2
