vi "MRM Cell Updater.gvi"   [LabVIEW NXG 5.0.0]
inputs:
  "Error In": error
  "Misc Data Mega Cluster In": "Misc Data Mega Cluster.gtype"
outputs:
  "Error Out": error
types:
  "Full Reference Cluster.gtype" = cluster{"Enum Reference Cluster": "Enum Control Reference Cluster.gtype", "Boolean Reference Cluster": "Boolean Control Reference Cluster.gtype", "Numeric Reference Cluster": "Numeric Control Reference Cluster.gtype", "Numeric Cluster Reference Cluster": "Numeric Cluster Reference Cluster.gtype", "Path Reference Cluster": "Path Reference Cluster.gtype", "Cluster Reference Cluster": "Cluster Reference Cluster.gtype", "XZ Stage Controls Reference Cluster": "XZ Stage Controls Reference Cluster.gtype"}
  "Cell Naming Cluster.gtype" = cluster{"Cell Label": string, "Sample Prefix": string, "Author Initials": string, "Current Date": string, "Batch Name": string}
  T1 = cluster{"X Coordinate (mm)": f64, "Z Coordinate (mm)": f64}
  T2 = cluster{"X Coordinate (mm)": f64, "Z Coordinate (mm)": f64, "Vertical Spacing (mm)": f64}
  "XZ All Position Cluster.gtype" = cluster{"Diffusor Coordinates": T1, "Photodetector Coordinates": T1, "Cell R.01 Coordinates": T2}
  T3 = cluster{"Thorlabs Motor Serial Number File Path": path, "Default Data Saving Location": path}
  "Misc Data Mega Cluster.gtype" = cluster{"Full Reference Cluster": "Full Reference Cluster.gtype", "Cell Naming Cluster": "Cell Naming Cluster.gtype", "All XZ Position Cluster": "XZ All Position Cluster.gtype", "All Paths": T3}
  T4 = cluster{"L.01": bool, "R.01": bool, "L.02": bool, "R.02": bool, "L.03": bool, "R.03": bool, "L.04": bool, "R.04": bool, "L.05": bool, "R.05": bool, "L.06": bool, "R.06": bool, "L.07": bool, "R.07": bool, "L.08": bool, "R.08": bool, "L.09": bool, "R.09": bool, "L.10": bool, "R.10": bool, "L.11": bool, "R.11": bool, "L.12": bool, "R.12": bool}
diagram:
  # This SubVI Takes care of the control of the MRM Cell Selector update process. It reads the multiple states and sets the controls
  # accordingly to ease the selection of the cells.
  case ($"Error In") {
    frame Error, Default {
      w1 = $"Error In"
    }
    frame No Error {
      Property Node(instance in=$"Misc Data Mega Cluster In") -> ("Full Reference Cluster:Cluster Reference Cluster:MRM Cell Selector Ref"=w2)
      Property Node(instance in=w2, error in=$"Error In") -> ("Value"=w3, error out=w4, instance out=w5)
      Property Node(instance in=w3) -> ("All"=w6, "Left"=w7, "Right"=w8, "Cell Cluster"=w9, "Reset"=w10, instance out=w11)
      case (w10) {
        frame True {
          Property Node(instance in=w11, "All"=FALSE, "Left"=FALSE, "Right"=FALSE, "Cell Cluster"=T4 {all zero or empty}, "Reset"=FALSE) -> (instance out=w12)
        }
        frame False {
          case (w6) {
            frame False, Default {
              case (w8) {
                frame False, Default {
                  w14 = w9
                }
                frame True {
                  Property Node(instance in=w9, "R.01"=TRUE, "R.02"=TRUE, "R.03"=TRUE, "R.04"=TRUE, "R.05"=TRUE, "R.06"=TRUE, "R.07"=TRUE, "R.08"=TRUE, "R.09"=TRUE, "R.10"=TRUE, "R.11"=TRUE, "R.12"=TRUE) -> (instance out=w14)
                }
              }
              case (w7) {
                frame False, Default {
                  w13 = w14
                }
                frame True {
                  Property Node(instance in=w14, "L.01"=TRUE, "L.02"=TRUE, "L.03"=TRUE, "L.04"=TRUE, "L.05"=TRUE, "L.06"=TRUE, "L.07"=TRUE, "L.08"=TRUE, "L.09"=TRUE, "L.10"=TRUE, "L.11"=TRUE, "L.12"=TRUE) -> (instance out=w13)
                }
              }
            }
            frame True {
              Property Node(instance in=w9, "R.05"=TRUE, "L.06"=TRUE, "R.06"=TRUE, "L.07"=TRUE, "R.07"=TRUE, "L.08"=TRUE, "R.08"=TRUE, "L.09"=TRUE, "R.09"=TRUE, "L.10"=TRUE, "R.10"=TRUE, "L.11"=TRUE, "R.11"=TRUE, "L.12"=TRUE, "R.12"=TRUE) -> (instance out=w15)
              Property Node(instance in=w15, "L.01"=TRUE, "R.01"=TRUE, "L.02"=TRUE, "R.02"=TRUE, "L.03"=TRUE, "R.03"=TRUE, "L.04"=TRUE, "R.04"=TRUE, "L.05"=TRUE) -> (instance out=w13)
            }
          }
          Property Node(instance in=w11, "Cell Cluster"=w13) -> (instance out=w12)
        }
      }
      Property Node(instance in=w5, "Value"=w12, error in=w4) -> (error out=w1)
    }
  }
  $"Error Out" <- w1
