vi "MRM To SRM Specific Parameters.gvi"   [LabVIEW NXG 5.0.0]
inputs:
  "Error In": error
  "MRM Specific Parameters": "MRM Specific Parameters.gtype" = {"V Points"=1, "Current Avg"=1, "PLC Speed"=0.001, "Sweep Speed"="Smart Sweep"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}
outputs:
  "Error Out": error
  "SRM Specific Parameters": "SRM Specific Parameters.gtype"
types:
  "Sweep Speed Selector.gtype" = enum{"Smart Sweep", "Fast Sweep", "Normal Sweep"}
  "MRM Specific Parameters.gtype" = cluster{"Max (V)": f64, "Min (V)": f64, "V Points": u32, "Curr Range (A)": f64, "Sweep Dir": bool, "Current Avg": u32, "Max (A)": f64, "PLC Speed": f64, "Cell Area (m^2)": f64, "Autorange": bool, "Full Spctr Ref": bool, "Sweep Speed": "Sweep Speed Selector.gtype"}
  "SRM Specific Parameters.gtype" = cluster{"Max (V)": f64, "Min (V)": f64, "V Points": u32, "Current Range (A)": f64, "Autorange": bool, "Sweep Dir": bool, "Current Averages": u32, "Max (A)": f64, "PLC Speed": f64, "Cell Area (m^2)": f64, "Full Spctr Ref": bool, "Sweep Speed": "Sweep Speed Selector.gtype"}
diagram:
  # This subVI transforms MRM specific
  # to SRM specific parameters
  case ($"Error In") {
    frame Error, Default {
      w1 = $"Error In"
      w2 = default
    }
    frame No Error {
      Property Node(instance in=$"MRM Specific Parameters") -> ("Max (V)"=w3, "Min (V)"=w4, "V Points"=w5, "Curr Range (A)"=w6, "Sweep Dir"=w7, "Current Avg"=w8, "Max (A)"=w9, "PLC Speed"=w10, "Cell Area (m^2)"=w11, "Autorange"=w12, "Full Spctr Ref"=w13, "Sweep Speed"=w14)
      Property Node(instance in="SRM Specific Parameters.gtype" {all zero or empty}, "Max (V)"=w3, "Min (V)"=w4, "V Points"=w5, "Current Range (A)"=w6, "Autorange"=w12, "Sweep Dir"=w7, "Current Averages"=w8, "Max (A)"=w9, "PLC Speed"=w10, "Cell Area (m^2)"=w11, "Full Spctr Ref"=w13, "Sweep Speed"=w14) -> (instance out=w2)
      w1 = $"Error In"
    }
  }
  $"Error Out" <- w1
  $"SRM Specific Parameters" <- w2
