vi "MRM IV Parameters Calculator.gvi"   [LabVIEW NXG 5.0.0]
inputs:
  "Error In": error
  "MRM Mega Cluster In": "MRM Mega Cluster.gtype" = {"MRM Specific Parameters"={"Max (V)"=1.2, "Min (V)"=-0.5, "V Points"=100, "Curr Range (A)"=0, "Sweep Dir"=FALSE, "Current Avg"=3, "Max (A)"=0.1, "Integration Time"=0.5, "Cell Area (m^2)"=8e-06, "Autorange"=TRUE, "Full Spctr Ref"=TRUE}, "Cell Selector"={FALSE, FALSE, FALSE, FALSE, FALSE, FALSE, FALSE, FALSE, FALSE, FALSE, FALSE, FALSE, FALSE, FALSE, FALSE, FALSE, FALSE, FALSE, FALSE, FALSE, FALSE, FALSE, FALSE, FALSE, FALSE, FALSE, FALSE, FALSE}, "Cells to Measure Array"=[], "Rainbow Sweep Parameters MRM"={0, 900, 400, 1, 1, 0}, "MRM Data Array"=[]}
outputs:
  "Error Out": error
  "MRM Mega Cluster Out": "MRM Mega Cluster.gtype"
types:
  "MRM Specific Parameters.gtype" = cluster{"Max (V)": f64, "Min (V)": f64, "V Points": u32, "Curr Range (A)": f64, "Sweep Dir": bool, "Current Avg": u32, "Max (A)": f64, "Integration Time": f64, "Cell Area (m^2)": f64, "Autorange": bool, "Full Spctr Ref": bool}
  T1 = cluster{"L.01": bool, "R.01": bool, "L.02": bool, "R.02": bool, "L.03": bool, "R.03": bool, "L.04": bool, "R.04": bool, "L.05": bool, "R.05": bool, "L.06": bool, "R.06": bool, "L.07": bool, "R.07": bool, "L.08": bool, "R.08": bool, "L.09": bool, "R.09": bool, "L.10": bool, "R.10": bool, "L.11": bool, "R.11": bool, "L.12": bool, "R.12": bool}
  "MRM Cell Selector.gtype" = cluster{"All": bool, "Left": bool, "Right": bool, "Cell Cluster": T1, "Reset": bool}
  "XZ Stage Cell.gtype" = enum{"L.01", "L.02", "L.03", "L.04", "L.05", "L.06", "L.07", "L.08", "L.09", "L.10", "L.11", "L.12", "R.01", "R.02", "R.03", "R.04", "R.05", "R.06", "R.07", "R.08", "R.09", "R.10", "R.11", "R.12"}
  "Selected Cells Array.gtype" = "XZ Stage Cell.gtype"[]
  "Raibow Sweep Selector.gtype" = enum{"Red Sweep", "Blue Sweep", "Full Sweep Red First", "Full Sweep Blue First"}
  "Rainbow Sweep Param Selector.gtype" = cluster{"Raibow Sweep Selector": "Raibow Sweep Selector.gtype", "Max Wavelength (nm)": f64, "Min Wavelength (nm)": f64, "Wavelength Step (nm)": f64, "Rainbow Sweep Type Selector": "Rainbow Sweep Type Selector.gtype"}
  T2 = enum{"L.01", "L.02", "L.03", "L.04", "L.05", "L.06", "L.07", "L.08", "L.09", "L.10", "L.11", "L.12", "R.01", "R.02", "R.03", "R.04", "R.05", "R.06", "R.07", "R.08", "R.09", "R.10", "R.11", "R.12"}
  "MRM Full Data From SRM Cluster.gtype" = cluster{"SRM Mega Cluster": "SRM Mega Cluster.gtype", "Cell Label": T2}
  "MRM Mega Cluster.gtype" = cluster{"MRM Specific Parameters": "MRM Specific Parameters.gtype", "Cell Selector": "MRM Cell Selector.gtype", "Cells to Measure Array": "Selected Cells Array.gtype", "Rainbow Sweep Parameters MRM": "Rainbow Sweep Param Selector.gtype", "MRM Data Array": "MRM Full Data From SRM Cluster.gtype"[]}
  "IV Refined Full Sweep Data.gtype" = cluster{"Rs (Ω · m^2)": f64[], "Rsh (Ω · m^2)": f64[], "Jsc (A/m^2)": f64[], "Voc (V)": f64[], "FF (%)": f64[], "Efficiency (%)": f64[], "Dividing Wavelength (nm)": f64[], "Light Power Density (W/m^2)": f64[]}
  "IV Single Measurement.gtype" = cluster{"Voltage (V)": f64[], "Current (A)": f64[], "Current Density (A/m^2)": f64[], "Dividing Wavelength (nm)": f64, "Light Power Density (W/m^2)": f64, "Total Light Power Density (W/m^2)": f64}
  "Rainbow Sweep Types.gtype" = enum{"Red Sweep Closing", "Red Sweep Opening", "Blue Sweep Closing", "Blue Sweep Opening"}
  "IV Full Data Cluster.gtype" = cluster{"IV Measurements Array": "IV Single Measurement.gtype"[], "Rainbow Sweep Types": "Rainbow Sweep Types.gtype", "IV Refined Data": "IV Refined Full Sweep Data.gtype", "Total Light Power Density (W/m^2)": f64}
uses:
  Rainbow Measurement Setup::Main Functions::Rainbow Measurement::Cell Single Rainbow Measurement::IV Calculations::Jsc and Voc.gvi
  Rainbow Measurement Setup::Main Functions::Rainbow Measurement::Cell Single Rainbow Measurement::IV Calculations::FF and Efficiency.gvi
diagram:
  # This SubVI takes raw IV Data in and transforms it into computed
  # IV Sweep data with all the calculated parameters. Then it stores it all
  # into an array with all the information so that it can be later saved and processed
  case ($"Error In") {
    frame Error, Default {
      w1 = $"Error In"
      w2 = $"MRM Mega Cluster In"
    }
    frame No Error {
      Property Node(instance in=$"MRM Mega Cluster In") -> ("MRM Data Array"=w3, instance out=w4)
      s1 = $"Error In"  # shift register
      for {
        w5 = each element of w3
        Property Node(instance in=w5) -> ("SRM Mega Cluster"=w7, instance out=w8)
        Property Node(instance in=w7) -> ("Full IV Curve Raw Data"=w9, "SRM Specific Parameters:Full Spctr Ref"=w10, instance out=w11)
        s2 = s1  # shift register
        s3 = w11  # shift register
        for {
          w12 = each element of w9
          Property Node(instance in=w12) -> ("Rainbow Sweep Types"=w14, "IV Raw Data Array"=w15)
          s4 = s2  # shift register
          for {
            w16 = each element of w15
            call "Jsc and Voc.gvi"(IV Single Measurement=w16, Points For Average=5, Error In=s4) -> (IV Sweep Data Out=w25, Error Out=w26)
            call "FF and Efficiency.gvi"(IV Sweep Data In=w25, IV Single Measurement=w16, Full Spectrum Reference?=w10, Error In=w26) -> (IV Sweep Data Out=w27, Error Out=w28)
            Property Node(instance in=w27) -> ("Rs (Ω · m^2)"=w29, "Rsh (Ω · m^2)"=w30, "Jsc (A/m^2)"=w31, "Voc (V)"=w32, "FF (%)"=w33, "Efficiency (%)"=w34, "Dividing Wavelength (nm)"=w35, "Light Power Density (W/m^2)"=w36)
            Property Node(instance in=w16) -> ("Total Light Power Density (W/m^2)"=w37)
            append w36 to w17
            append w35 to w18
            append w34 to w19
            append w33 to w20
            append w32 to w21
            append w31 to w22
            append w30 to w23
            append w29 to w24
            next s4 = w28
          }
          Property Node(instance in="IV Refined Full Sweep Data.gtype" {all zero or empty}, "Rs (Ω · m^2)"=w24, "Rsh (Ω · m^2)"=w23, "Jsc (A/m^2)"=w22, "Voc (V)"=w21, "FF (%)"=w20, "Efficiency (%)"=w19, "Dividing Wavelength (nm)"=w18, "Light Power Density (W/m^2)"=w17) -> (instance out=w38)
          Property Node(instance in="IV Full Data Cluster.gtype" {all zero or empty}, "IV Measurements Array"=w15, "Rainbow Sweep Types"=w14, "IV Refined Data"=w38, "Total Light Power Density (W/m^2)"=w37) -> (instance out=w39)
          append w39 to w13
          next s2 = s4
        }
        Property Node(instance in=s3, "SRM Full IV data Array"=w13) -> (instance out=w40)
        Property Node(instance in=w8, "SRM Mega Cluster"=w40) -> (instance out=w41)
        append w41 to w6
        next s1 = s2
      }
      Property Node(instance in=w4, "MRM Data Array"=w6) -> (instance out=w2)
      w1 = s1
    }
  }
  $"Error Out" <- w1
  $"MRM Mega Cluster Out" <- w2
