vi "FGV Controls Raw Plat Changed Value.gvi"   [LabVIEW NXG 5.0.0]
inputs:
  "Error In": error
  "FGV Instructions": "General FGV Instructions.gtype" = "Read State", required
  "Misc Data Mega Cluster In": "Misc Data Mega Cluster.gtype"
outputs:
  "Error Out": error
  "Changed?": bool
types:
  "General FGV Instructions.gtype" = enum{"Read State", "Set State", "Reset State"}
  "Full Reference Cluster.gtype" = cluster{"Enum Reference Cluster": "Enum Control Reference Cluster.gtype", "Boolean Reference Cluster": "Boolean Control Reference Cluster.gtype", "Numeric Reference Cluster": "Numeric Control Reference Cluster.gtype", "Numeric Cluster Reference Cluster": "Numeric Cluster Reference Cluster.gtype", "Path Reference Cluster": "Path Reference Cluster.gtype", "Cluster Reference Cluster": "Cluster Reference Cluster.gtype", "XZ Stage Controls Reference Cluster": "XZ Stage Controls Reference Cluster.gtype"}
  "Cell Naming Cluster.gtype" = cluster{"Cell Label": string, "Sample Prefix": string, "Author Initials": string, "Current Date": string, "Batch Name": string}
  T1 = cluster{"X Coordinate (mm)": f64, "Z Coordinate (mm)": f64}
  T2 = cluster{"X Coordinate (mm)": f64, "Z Coordinate (mm)": f64, "Vertical Spacing (mm)": f64}
  "XZ All Position Cluster.gtype" = cluster{"Diffusor Coordinates": T1, "Photodetector Coordinates": T1, "Cell R.01 Coordinates": T2}
  T3 = cluster{"Thorlabs Motor Serial Number File Path": path, "Default Data Saving Location": path}
  "Misc Data Mega Cluster.gtype" = cluster{"Full Reference Cluster": "Full Reference Cluster.gtype", "Cell Naming Cluster": "Cell Naming Cluster.gtype", "All XZ Position Cluster": "XZ All Position Cluster.gtype", "All Paths": T3}
diagram:
  case ($"Error In") {
    frame Error, Default {
      w1 = $"Error In"
    }
    frame No Error {
      s1 = uninitialised  # shift register
      s2 = uninitialised  # shift register
      while {
        case ($"FGV Instructions") {
          frame "Read State", Default {
            Property Node(instance in=$"Misc Data Mega Cluster In") -> ("Full Reference Cluster:Cluster Reference Cluster:MRM Raw Plot Rainbow Sweep Relector Ref"=w4, "Full Reference Cluster:Cluster Reference Cluster:MRM Current Raw Cell Plot"=w5)
            Property Node(instance in=w4, error in=$"Error In") -> ("Value"=w2, error out=w6)
            Is Not Equal(x=w2, y=s1) -> w7
            Property Node(instance in=w5, error in=w6) -> ("Value"=w3, error out=w1)
            Is Not Equal(x=w3, y=s2) -> w8
            Logical Or(w7, w8) -> w9
            $"Changed?" <- w9
          }
          frame "Set State" {
            w1 = $"Error In"
            w2 = s1
            w3 = s2
          }
          frame "Reset State" {
            w1 = $"Error In"
            w2 = default
            w3 = default
          }
        }
        next s1 = w2
        next s2 = w3
        stop if TRUE
      }
    }
  }
  $"Error Out" <- w1
