vi "MRM FGV Read Handler.gvi"   [LabVIEW NXG 5.0.0]
inputs:
  "MRM sweep live parameters FGV Cluster In": "MRM Sweep Live Parameters FGV Cluster.gtype"
  "Misc Data Mega Cluster In": "Misc Data Mega Cluster.gtype"
  "Error In": error
outputs:
  "MRM sweep live parameters FGV Cluster Out": "MRM Sweep Live Parameters FGV Cluster.gtype"
  "Misc Data Mega Cluster Out": "Misc Data Mega Cluster.gtype"
  "Error Out": error
types:
  "XZ Stage Cell.gtype" = enum{"L.01", "L.02", "L.03", "L.04", "L.05", "L.06", "L.07", "L.08", "L.09", "L.10", "L.11", "L.12", "R.01", "R.02", "R.03", "R.04", "R.05", "R.06", "R.07", "R.08", "R.09", "R.10", "R.11", "R.12"}
  T1 = cluster{"IV Single Measurement Array": "IV Single Measurement.gtype"[], "IV Single Measurement Plot Array": "SRM Single Plot Cluster.gtype"[], "Full IV Data Array": "IV Full Raw Data.gtype"[], "Measured Cell": "XZ Stage Cell.gtype"}
  "SRM Single Plot Cluster.gtype" = cluster{"Voltage (V)": f64[], "Current Density (A/m^2)": f64[]}
  "MRM Sweep Live Parameters FGV Cluster.gtype" = cluster{"Refresh now": bool, "All Cell Measurements": T1[], "IV Current Selected Cell Plot": "SRM Single Plot Cluster.gtype"[], "Counter": f64}
  "Full Reference Cluster.gtype" = cluster{"Enum Reference Cluster": "Enum Control Reference Cluster.gtype", "Boolean Reference Cluster": "Boolean Control Reference Cluster.gtype", "Numeric Reference Cluster": "Numeric Control Reference Cluster.gtype", "Numeric Cluster Reference Cluster": "Numeric Cluster Reference Cluster.gtype", "Path Reference Cluster": "Path Reference Cluster.gtype", "Cluster Reference Cluster": "Cluster Reference Cluster.gtype", "XZ Stage Controls Reference Cluster": "XZ Stage Controls Reference Cluster.gtype"}
  "Cell Naming Cluster.gtype" = cluster{"Cell Label": string, "Sample Prefix": string, "Author Initials": string, "Current Date": string, "Batch Name": string}
  T2 = cluster{"X Coordinate (mm)": f64, "Z Coordinate (mm)": f64}
  T3 = cluster{"X Coordinate (mm)": f64, "Z Coordinate (mm)": f64, "Vertical Spacing (mm)": f64}
  "XZ All Position Cluster.gtype" = cluster{"Diffusor Coordinates": T2, "Photodetector Coordinates": T2, "Cell R.01 Coordinates": T3}
  T4 = cluster{"Thorlabs Motor Serial Number File Path": path, "Default Data Saving Location": path}
  "Misc Data Mega Cluster.gtype" = cluster{"Full Reference Cluster": "Full Reference Cluster.gtype", "Cell Naming Cluster": "Cell Naming Cluster.gtype", "All XZ Position Cluster": "XZ All Position Cluster.gtype", "All Paths": T4}
uses:
  Rainbow Measurement Setup::Main Functions::Rainbow Measurement::Cell Multiple Rainbow Measurement::MRM Live Parameters::FGV Controls Raw Plat Changed Value.gvi
  Rainbow Measurement Setup::Main Functions::Rainbow Measurement::Cell Multiple Rainbow Measurement::Plotting::MRM Raw Data Graph Adapter.gvi
diagram:
  # This SubVI Takes care of selecting the right set of data to plot from the SRM Sweep Raw Data and it also sets both the name of the available plots and the dividing wavelength that corresponds to each and
  # every plot within the graph. It does so every now and then to prevent being too wasteful on resources.
  case ($"Error In") {
    frame Error, Default {
      w1 = $"Error In"
      w2 = $"MRM sweep live parameters FGV Cluster In"
      w3 = $"Misc Data Mega Cluster In"
    }
    frame No Error {
      Property Node(instance in=$"MRM sweep live parameters FGV Cluster In") -> ("All Cell Measurements"=w4, "Refresh now"=w5, "Counter"=w6, "IV Current Selected Cell Plot"=w7, instance out=w8)
      Property Node(instance in=$"Misc Data Mega Cluster In") -> ("Full Reference Cluster:Cluster Reference Cluster:MRM Current Raw Cell Plot"=w9, "Full Reference Cluster:Cluster Reference Cluster:IV Plot Out Multiple Reference"=w10, "Full Reference Cluster:Cluster Reference Cluster:MRM Raw Plot Rainbow Sweep Relector Ref"=w11, instance out=w3)
      Property Node(instance in=w9, error in=$"Error In") -> ("Value"=w12, error out=w13)
      call "FGV Controls Raw Plat Changed Value.gvi"(FGV Instructions="Read State", Misc Data Mega Cluster In=w3, Error In=w13) -> (Changed?=w14, Error Out=w15)
      Logical Or(w14, w5) -> w16
      s1 = uninitialised  # shift register
      for {
        w17 = each element of w4
        Property Node(instance in=w17) -> ("Measured Cell"=w19, instance out=w20)
        Format Into String(errIn=s1, w19) -> (outString=w21, errOut=w22)
        Is Equal(x=w12, y=w21) -> w23
        w18 = w20 if w23
        next s1 = w22
        stop if w23
      }
      Property Node(instance in=w18) -> ("IV Single Measurement Array"=w24, "Full IV Data Array"=w25)
      Property Node(instance in=w11, error in=w15) -> ("Value"=w26, error out=w27, instance out=w28)
      case (w16) {
        frame False, Default {
          w29 = w7
          w30 = w27
          w31 = w24
          w32 = w28
          w33 = default
        }
        frame True {
          for {
            w34 = each element of w25
            Property Node(instance in=w34) -> ("Rainbow Sweep Types"=w35, "IV Raw Data Array"=w36)
            Format Into String(w35) -> w37
            Is Equal(x=w26, y=w37) -> w38
            w31 = w36 if w38
          }
          call "MRM Raw Data Graph Adapter.gvi"(IV Single Measurement Array=w31, Error In=w27, Latest Measurement?=FALSE) -> (IV Plot Out=w29, Error Out=w30)
          w32 = w28
          w33 = TRUE
        }
      }
      Increment(x=w6) -> w39
      Is Greater(x=w39, y=50) -> w40
      Logical Or(w40, w5) -> w41
      case (w41) {
        frame False, Default {
          w1 = w30
          w42 = w39
          w43 = default
        }
        frame True {
          s2 = w30  # shift register
          for (iteration -> i1) {
            w44 = each element of w31
            Property Node(instance in=w10, "ActivePlot"=i1, error in=s2) -> ("Plot"=w45, error out=w46)
            Property Node(instance in=w44) -> ("Dividing Wavelength (nm)"=w47)
            Format Into String(formatString="%d", w47) -> w48
            Concatenate Strings(w48, " nm") -> w49
            Property Node(instance in=w45, "Name"=w49, error in=w46) -> (error out=w50, instance out=w51)
            next s2 = w50
          }
          for {
            w52 = each element of w25
            Property Node(instance in=w52) -> ("Rainbow Sweep Types"=w54)
            Format Into String(w54) -> w55
            append w55 to w53
          }
          Property Node(instance in=w32, "Items"=w53, error in=s2) -> (error out=w1)
          w42 = 0
          w43 = TRUE
        }
      }
      Logical And[output inverted](w43, w33) -> w56
      Select(s=w5, t=w56, f=FALSE) -> w57
      Property Node(instance in=w8, "Counter"=w42, "IV Current Selected Cell Plot"=w29, "Refresh now"=w57) -> (instance out=w2)
    }
  }
  $"Misc Data Mega Cluster Out" <- w3
  $"MRM sweep live parameters FGV Cluster Out" <- w2
  $"Error Out" <- w1
