vi "MRM Sweep Live Parameters Extractor.gvi"   [LabVIEW NXG 5.0.0]
inputs:
  "Error In": error
  "MRM sweep live parameters FGV Cluster New State": "MRM Sweep Live Parameters FGV Cluster.gtype"
  "MRM sweep live parameters FGV Cluster Previous State": "MRM Sweep Live Parameters FGV Cluster.gtype"
  "Misc Data Mega Cluster In": "Misc Data Mega Cluster.gtype"
outputs:
  "Error Out": error
  "MRM sweep live parameters FGV Cluster Out": "MRM Sweep Live Parameters FGV Cluster.gtype"
  "Misc Data Mega Cluster Out": "Misc Data Mega Cluster.gtype"
types:
  "XZ Stage Cell.gtype" = enum{"L.01", "L.02", "L.03", "L.04", "L.05", "L.06", "L.07", "L.08", "L.09", "L.10", "L.11", "L.12", "R.01", "R.02", "R.03", "R.04", "R.05", "R.06", "R.07", "R.08", "R.09", "R.10", "R.11", "R.12"}
  T1 = cluster{"IV Single Measurement Array": "IV Single Measurement.gtype"[], "IV Single Measurement Plot Array": "SRM Single Plot Cluster.gtype"[], "Full IV Data Array": "IV Full Raw Data.gtype"[], "Measured Cell": "XZ Stage Cell.gtype"}
  "SRM Single Plot Cluster.gtype" = cluster{"Voltage (V)": f64[], "Current Density (A/m^2)": f64[]}
  "MRM Sweep Live Parameters FGV Cluster.gtype" = cluster{"Refresh now": bool, "All Cell Measurements": T1[], "IV Current Selected Cell Plot": "SRM Single Plot Cluster.gtype"[], "Counter": f64}
  "Full Reference Cluster.gtype" = cluster{"Enum Reference Cluster": "Enum Control Reference Cluster.gtype", "Boolean Reference Cluster": "Boolean Control Reference Cluster.gtype", "Numeric Reference Cluster": "Numeric Control Reference Cluster.gtype", "Numeric Cluster Reference Cluster": "Numeric Cluster Reference Cluster.gtype", "Path Reference Cluster": "Path Reference Cluster.gtype", "Cluster Reference Cluster": "Cluster Reference Cluster.gtype", "XZ Stage Controls Reference Cluster": "XZ Stage Controls Reference Cluster.gtype"}
  "Cell Naming Cluster.gtype" = cluster{"Cell Label": string, "Sample Prefix": string, "Author Initials": string, "Current Date": string, "Batch Name": string}
  T2 = cluster{"X Coordinate (mm)": f64, "Z Coordinate (mm)": f64}
  T3 = cluster{"X Coordinate (mm)": f64, "Z Coordinate (mm)": f64, "Vertical Spacing (mm)": f64}
  "XZ All Position Cluster.gtype" = cluster{"Diffusor Coordinates": T2, "Photodetector Coordinates": T2, "Cell R.01 Coordinates": T3}
  T4 = cluster{"Thorlabs Motor Serial Number File Path": path, "Default Data Saving Location": path}
  "Misc Data Mega Cluster.gtype" = cluster{"Full Reference Cluster": "Full Reference Cluster.gtype", "Cell Naming Cluster": "Cell Naming Cluster.gtype", "All XZ Position Cluster": "XZ All Position Cluster.gtype", "All Paths": T4}
uses:
  Rainbow Measurement Setup::Main Functions::Rainbow Measurement::Cell Multiple Rainbow Measurement::Plotting::MRM Raw Data Graph Adapter.gvi
diagram:
  # This SubVI Checks if the input cluster has some empty values and for each empty value it keeps the value it had before.
  # Otherwise it changes to the new value
  case ($"Error In") {
    frame Error, Default {
      w1 = $"Error In"
      w2 = $"MRM sweep live parameters FGV Cluster Previous State"
      w3 = $"Misc Data Mega Cluster In"
    }
    frame No Error {
      Property Node(instance in=$"MRM sweep live parameters FGV Cluster Previous State") -> ("All Cell Measurements"=w4, "IV Current Selected Cell Plot"=w5, "Refresh now"=w6, instance out=w7)
      Property Node(instance in=$"MRM sweep live parameters FGV Cluster New State") -> ("All Cell Measurements"=w8, "IV Current Selected Cell Plot"=w9, "Refresh now"=w10)
      Is Empty Array(array=w8) -> w11
      Select(s=w11, t=w4, f=w8) -> w12
      Property Node(instance in=$"Misc Data Mega Cluster In") -> ("Full Reference Cluster:Cluster Reference Cluster:MRM Raw Plot Rainbow Sweep Relector Ref"=w13, instance out=w3)
      Logical Or(w10, w6) -> w14
      call "MRM Raw Data Graph Adapter.gvi"(All Cell Measurements=w12, Error In=$"Error In", Latest Measurement?=TRUE) -> (IV Plot Out=w15, Error Out=w16)
      Array Index(array=w12) -> (out0[0]=w17)
      Property Node(instance in=w17) -> ("Full IV Data Array"=w18)
      case (w14) {
        frame False, Default {
          w1 = w16
          w19 = w14
        }
        frame True {
          for {
            w20 = each element of w18
            Property Node(instance in=w20) -> ("Rainbow Sweep Types"=w21)
            Format Into String(w21) -> w22
          }
          Property Node(instance in=w13, "ValueSignaling"=w22, error in=w16) -> (error out=w1)
          w19 = w14
        }
      }
      Is Empty Array(array=w9) -> w23
      Select(s=w23, t=w5, f=w9) -> w24
      Is Empty Array(array=w15) -> w25
      Select(s=w25, t=w24, f=w15) -> w26
      Property Node(instance in=w7, "All Cell Measurements"=w12, "IV Current Selected Cell Plot"=w26, "Refresh now"=w19) -> (instance out=w2)
    }
  }
  $"Error Out" <- w1
  $"MRM sweep live parameters FGV Cluster Out" <- w2
  $"Misc Data Mega Cluster Out" <- w3
