vi "MRM Rainbow Sweep.gvi"   [LabVIEW NXG 5.0.0]
inputs:
  "Error In": error
  "Instrument Control Mega Cluster In": "Instrument Control Mega Cluster.gtype"
  "LPC Mega Cluster In": "LPC Mega Cluster.gtype"
  "MRM Mega Cluster In": "MRM Mega Cluster.gtype" = {"MRM Specific Parameters"={"Max (V)"=1.2, "Min (V)"=-0.5, "V Points"=100, "Curr Range (A)"=0, "Sweep Dir"=FALSE, "Current Avg"=3, "Max (A)"=0.1, "Integration Time"=0.5, "Cell Area (m^2)"=8e-06, "Autorange"=TRUE, "Full Spctr Ref"=TRUE}, "Cell Selector"={FALSE, FALSE, FALSE, FALSE, FALSE, FALSE, FALSE, FALSE, FALSE, FALSE, FALSE, FALSE, FALSE, FALSE, FALSE, FALSE, FALSE, FALSE, FALSE, FALSE, FALSE, FALSE, FALSE, FALSE, FALSE, FALSE, FALSE, FALSE}, "Cells to Measure Array"=[], "Rainbow Sweep Parameters MRM"={0, 900, 400, 1, 1, 0}, "MRM Data Array"=[]}
  "Misc Data Mega Cluster In": "Misc Data Mega Cluster.gtype"
outputs:
  "Error Out": error
  "Instrument Control Mega Cluster Out": "Instrument Control Mega Cluster.gtype"
  "MRM Mega Cluster Out": "MRM Mega Cluster.gtype"
panel indicators:
  "output array": T4[]
types:
  "Instrument Coms Info.gtype" = cluster{"Arduino Coms Info": "Arduino Detection cluster control.gtype", "Photodetector Names": string[], "Keythley Address": "VISA Instr", "Photodetector Detected?": bool, "Thorlabs Motors Detected?": bool, "Keithley Detected?": bool, "Thorlabs Motors Serial Number": "Thorlabs Motors Serial Number In.gtype", "Photodetector IVI session": "Ivi IviDefault", "Flame ID": string, "Flame Detected?": bool, "Flame Wrapper ID": u64}
  "Debugging Cluster.gtype" = cluster{"Debugging mode?": bool, "Initialize App": bool, "Insturment Debugging": "Insturment Debugging Cluster.gtype"}
  "Instrument Control Mega Cluster.gtype" = cluster{"Instruments Coms Info": "Instrument Coms Info.gtype", "Debugging Cluster": "Debugging Cluster.gtype"}
  "Raibow Sweep Selector.gtype" = enum{"Red Sweep", "Blue Sweep", "Full Sweep Red First", "Full Sweep Blue First"}
  "Rainbow Sweep Param Selector.gtype" = cluster{"Raibow Sweep Selector": "Raibow Sweep Selector.gtype", "Max Wavelength (nm)": f64, "Min Wavelength (nm)": f64, "Wavelength Step (nm)": f64, "Rainbow Sweep Type Selector": "Rainbow Sweep Type Selector.gtype"}
  "Light power Calibration Parameters.gtype" = cluster{"Powermeter Averages": u32, "Photodtctr Area (m^2)": f64, "Only Full Spectrum": bool}
  T1 = cluster{"Dividing Wavelength Array": f64[], "Measured Power Array": f64[], "Power Density Array": f64[]}
  "Rainbow Sweep Types.gtype" = enum{"Red Sweep Closing", "Red Sweep Opening", "Blue Sweep Closing", "Blue Sweep Opening"}
  "Light Power Calibration Data.gtype" = cluster{"Single Light Calibration": T1, "Rainbow Sweep Types": "Rainbow Sweep Types.gtype", "Total Light Power Density (W/m^2)": f64}
  "LPC Mega Cluster.gtype" = cluster{"Rainbow Sweep Parameters LPC": "Rainbow Sweep Param Selector.gtype", "LPC Specific Parameters": "Light power Calibration Parameters.gtype", "Light Power Calibration Data": "Light Power Calibration Data.gtype"[]}
  "MRM Specific Parameters.gtype" = cluster{"Max (V)": f64, "Min (V)": f64, "V Points": u32, "Curr Range (A)": f64, "Sweep Dir": bool, "Current Avg": u32, "Max (A)": f64, "Integration Time": f64, "Cell Area (m^2)": f64, "Autorange": bool, "Full Spctr Ref": bool}
  T2 = cluster{"L.01": bool, "R.01": bool, "L.02": bool, "R.02": bool, "L.03": bool, "R.03": bool, "L.04": bool, "R.04": bool, "L.05": bool, "R.05": bool, "L.06": bool, "R.06": bool, "L.07": bool, "R.07": bool, "L.08": bool, "R.08": bool, "L.09": bool, "R.09": bool, "L.10": bool, "R.10": bool, "L.11": bool, "R.11": bool, "L.12": bool, "R.12": bool}
  "MRM Cell Selector.gtype" = cluster{"All": bool, "Left": bool, "Right": bool, "Cell Cluster": T2, "Reset": bool}
  "XZ Stage Cell.gtype" = enum{"L.01", "L.02", "L.03", "L.04", "L.05", "L.06", "L.07", "L.08", "L.09", "L.10", "L.11", "L.12", "R.01", "R.02", "R.03", "R.04", "R.05", "R.06", "R.07", "R.08", "R.09", "R.10", "R.11", "R.12"}
  "Selected Cells Array.gtype" = "XZ Stage Cell.gtype"[]
  T3 = enum{"L.01", "L.02", "L.03", "L.04", "L.05", "L.06", "L.07", "L.08", "L.09", "L.10", "L.11", "L.12", "R.01", "R.02", "R.03", "R.04", "R.05", "R.06", "R.07", "R.08", "R.09", "R.10", "R.11", "R.12"}
  "MRM Full Data From SRM Cluster.gtype" = cluster{"SRM Mega Cluster": "SRM Mega Cluster.gtype", "Cell Label": T3}
  "MRM Mega Cluster.gtype" = cluster{"MRM Specific Parameters": "MRM Specific Parameters.gtype", "Cell Selector": "MRM Cell Selector.gtype", "Cells to Measure Array": "Selected Cells Array.gtype", "Rainbow Sweep Parameters MRM": "Rainbow Sweep Param Selector.gtype", "MRM Data Array": "MRM Full Data From SRM Cluster.gtype"[]}
  "IV Single Measurement.gtype" = cluster{"Voltage (V)": f64[], "Current (A)": f64[], "Current Density (A/m^2)": f64[], "Dividing Wavelength (nm)": f64, "Light Power Density (W/m^2)": f64, "Total Light Power Density (W/m^2)": f64}
  "SRM Single Plot Cluster.gtype" = cluster{"Voltage (V)": f64[], "Current Density (A/m^2)": f64[]}
  "IV Full Raw Data.gtype" = cluster{"Rainbow Sweep Types": "Rainbow Sweep Types.gtype", "IV Raw Data Array": "IV Single Measurement.gtype"[]}
  T4 = cluster{"IV Single Measurement Array": "IV Single Measurement.gtype"[], "IV Single Measurement Plot Array": "SRM Single Plot Cluster.gtype"[], "Full IV Data Array": "IV Full Raw Data.gtype"[], "Measured Cell": "XZ Stage Cell.gtype"}
  "Full Reference Cluster.gtype" = cluster{"Enum Reference Cluster": "Enum Control Reference Cluster.gtype", "Boolean Reference Cluster": "Boolean Control Reference Cluster.gtype", "Numeric Reference Cluster": "Numeric Control Reference Cluster.gtype", "Numeric Cluster Reference Cluster": "Numeric Cluster Reference Cluster.gtype", "Path Reference Cluster": "Path Reference Cluster.gtype", "Cluster Reference Cluster": "Cluster Reference Cluster.gtype", "XZ Stage Controls Reference Cluster": "XZ Stage Controls Reference Cluster.gtype"}
  "Cell Naming Cluster.gtype" = cluster{"Cell Label": string, "Sample Prefix": string, "Author Initials": string, "Current Date": string, "Batch Name": string}
  T5 = cluster{"X Coordinate (mm)": f64, "Z Coordinate (mm)": f64, "Aprch Distance (mm)": f64}
  T6 = cluster{"X Coordinate (mm)": f64, "Z Coordinate (mm)": f64, "Vertical Spacing (mm)": f64, "Aprch Distance (mm)": f64, "Aprch Dstnc L.12 (mm)": f64}
  "XZ All Position Cluster.gtype" = cluster{"Diffusor Coordinates": T5, "Photodetector Coordinates": T5, "Cell R.01 Coordinates": T6}
  T7 = cluster{"Thorlabs Motor Serial Number File Path": path, "Default Data Saving Location": path}
  "Misc Data Mega Cluster.gtype" = cluster{"Full Reference Cluster": "Full Reference Cluster.gtype", "Cell Naming Cluster": "Cell Naming Cluster.gtype", "All XZ Position Cluster": "XZ All Position Cluster.gtype", "All Paths": T7}
  "SRM Sweep Live Parameters.gtype" = cluster{"Current Wavelength (nm)": f64, "Rainbow Sweep Types": "Rainbow Sweep Types.gtype", "Finished Measurement?": bool}
uses:
  Rainbow Measurement Setup::Side Functions::Messages And Prompts::FGV Cancel Prompts until Finished Routine.gvi
  Rainbow Measurement Setup::Main Functions::XZ Stage Movements::MRM Move To Cell Safely.gvi
  Rainbow Measurement Setup::Side Functions::Rainbow Sweep::Rainbow Sweep Param Generator.gvi
  Rainbow Measurement Setup::Side Functions::Instrument Control::Keithley::Keithley Set Constant Parameters.gvi
  Rainbow Measurement Setup::Side Functions::Instrument Control::Thorlabs Motors::Dividing Wavelength Control::Dividing Wavelength Calibration Data FGV.gvi
  Rainbow Measurement Setup::Main Functions::Rainbow Measurement::Cell Single Rainbow Measurement::SRM Extract Correct Calibration Data.gvi
  Rainbow Measurement Setup::Side Functions::Global Abort::FGV Global Abort.gvi
  Rainbow Measurement Setup::Side Functions::Instrument Control::Thorlabs Motors::Dividing Wavelength Control::KCube Dividing Wavelength Translator.gvi
  Rainbow Measurement Setup::Main Functions::Rainbow Measurement::Cell Single Rainbow Measurement::SRM Extract Measured Power.gvi
  Rainbow Measurement Setup::Side Functions::Instrument Control::Keithley::Keithley Sweep Subroutine.gvi
  Rainbow Measurement Setup::Main Functions::Rainbow Measurement::Cell Single Rainbow Measurement::IV Calculations::IV to IJV Data.gvi
  Rainbow Measurement Setup::Main Functions::Rainbow Measurement::Cell Multiple Rainbow Measurement::MRM Live Parameters::MRM Sweep Live Parameters FGV.gvi
  Rainbow Measurement Setup::Main Functions::Rainbow Measurement::Cell Multiple Rainbow Measurement::MRM Data Array::MRM Array Replace If it Exists.gvi
  Rainbow Measurement Setup::Side Functions::Utilities::Progress Handling::Progress General Calculator.gvi
  Rainbow Measurement Setup::Side Functions::Utilities::Progress Handling::Progress FGV.gvi
  Rainbow Measurement Setup::Side Functions::Instrument Control::Thorlabs Motors::Movement::KCube Move to 0 or Home.gvi
  Rainbow Measurement Setup::Side Functions::Instrument Control::Arduino::XZ Stage Arduino::XZ Y Safe Approach and Retract.gvi
diagram:
  # This SubVI Takes the specified Parameters both for the sweep types and for the keithley electrical sweep and performs all the measurements while storing them on their
  # corresponding clusters, before outputing all the information within the Full IV Curve Data array.
  case ($"Error In") {
    frame Error, Default {
      w1 = $"Error In"
      w2 = $"Instrument Control Mega Cluster In"
      w3 = $"MRM Mega Cluster In"
    }
    frame No Error {
      Property Node(instance in=$"MRM Mega Cluster In") -> ("MRM Data Array"=w4, instance out=w5)
      s1 = $"Instrument Control Mega Cluster In"  # shift register
      s2 = $"Error In"  # shift register
      s3 = 0  # shift register
      for (N -> w6) (iteration -> i1) {
        w7 = each element of w4
        Property Node(instance in=w7) -> ("SRM Mega Cluster:Rainbow Sweep Parameters SRM"=w9, "SRM Mega Cluster"=w10, "Cell Label"=w11, instance out=w12)
        call "FGV Cancel Prompts until Finished Routine.gvi"(Error In=s2, FGV Instructions="Reset State") -> (Error Out=w13)
        call "MRM Move To Cell Safely.gvi"(Instrument Control Mega Cluster In=s1, Misc Data Mega Cluster In=$"Misc Data Mega Cluster In", Error In=w13, Cell Label=w11) -> (Instrument Control Mega Cluster Out=w14, Error Out=w15)
        call "Rainbow Sweep Param Generator.gvi"(Rainbow Sweep Parameters=w9, Error In=w15) -> (Rainbow Sweep Parameters Array=w16, Error Out=w17)
        call "Keithley Set Constant Parameters.gvi"(Instrument Control Mega Cluster In=w14, SRM Mega Cluster In=w10, Error In=w17) -> (Instrument Control Mega Cluster Out=w18, SRM Mega Cluster Out=w19, Error Out=w20)
        call "Dividing Wavelength Calibration Data FGV.gvi"(Div Wavelength FGV Instructions="Read Loaded Data", Error In=w20) -> (Dividing Wavelength Calibration Data Out=w21, Error Out=w22)
        s4 = w22  # shift register
        s5 = w18  # shift register
        s6 = "IV Full Raw Data.gtype"[] []  # shift register
        s7 = s3  # shift register
        s8 = w19  # shift register
        for (N -> w23) (iteration -> i2) {
          w24 = each element of w16
          Property Node(instance in=w24) -> ("Dividing Wavelength Array"=w25, "Rainbow Sweep Types"=w26)
          call "SRM Extract Correct Calibration Data.gvi"(LPC Mega Cluster In=$"LPC Mega Cluster In", Rainbow Sweep Type=w26, Error In=s4) -> (Extracted Light Power Calibration Data=w27, Error Out=w28)
          s9 = w28  # shift register
          s10 = s5  # shift register
          s11 = "IV Single Measurement.gtype"[] []  # shift register
          s12 = s7  # shift register
          s13 = s8  # shift register
          for (N -> w29) (iteration -> i3) {
            w30 = each element of w25
            w31 = "SRM Sweep Live Parameters.gtype" {"Current Wavelength (nm)"=0, "Rainbow Sweep Types"="Red Sweep Closing", "Finished Measurement?"=TRUE}
            Property Node(instance in=w31, "Current Wavelength (nm)"=w30, "Rainbow Sweep Types"=w26, "Finished Measurement?"=FALSE)
            Multiply(w6, w29, w23) -> w32
            call "FGV Global Abort.gvi"(Global Abort Instructions="Read Current State", Error In=s9) -> (Local Abort Out=w33, Global Abort Out=w34, Error Out=w35)
            call "KCube Dividing Wavelength Translator.gvi"(Dividing Wavelength=w30, Instrument Control Mega Cluster In=s10, Dividing Wavelength Calibration Data In=w21, Error In=w35, Rainbow Sweep Types=w26) -> (Instrument Control Mega Cluster Out=w36, Error Out=w37)
            call "SRM Extract Measured Power.gvi"(Dividing Wavelength In=w30, Light Power Calibration Data In=w27, SRM Mega Cluster In=s13, Error In=w37) -> (IV Single Measurement Out=w38, Error Out=w39)
            call "Keithley Sweep Subroutine.gvi"(Instrument Control Mega Cluster In=w36, SRM Mega Cluster In=s13, IV Single Measurement In=w38, Error In=w39) -> (Instrument Control Mega Cluster Out=w40, SRM Mega Cluster Out=w41, IV Single Measurement Out=w42, Error Out=w43)
            call "IV to IJV Data.gvi"(SRM Mega Cluster In=w41, IV Single Measurement In=w42, Error In=w43) -> (SRM Mega Cluster Out=w44, IV Single Measurement Out=w45, Error Out=w46)
            call "MRM Sweep Live Parameters FGV.gvi"(FGV Instructions="Read State", Error In=w46) -> (MRM sweep live parameters FGV cluster out=w47, Error Out=w48)
            Property Node(instance in=w47) -> ("All Cell Measurements"=w49, instance out=w50)
            Insert Into Array(inArray=s11, index0=i3, new=w45) -> w51
            Array Index(array=w49) -> (out0[i1]=w52)
            Property Node(instance in=w52, "IV Single Measurement Array"=w51, "Measured Cell"=w11) -> (instance out=w53)
            call "MRM Array Replace If it Exists.gvi"(All Cell Measurements In=w49, Array Index=i1, New Element=w53, Error In=w48) -> (All Cell Measurements Out=w54, Error Out=w55)
            Property Node(instance in=w50, "All Cell Measurements"=w54) -> (instance out=w56)
            call "MRM Sweep Live Parameters FGV.gvi"(FGV Instructions="Set State", MRM sweep live parameters FGV Cluster In=w56, Error In=w55) -> (Error Out=w57)
            call "Progress General Calculator.gvi"(Starting Value=40, Ending Value=80, Number Of Steps=w32, Current Step=s12, Error In=w57) -> (Current Progress=w58, Error Out=w59)
            call "Progress FGV.gvi"(FGV Instructions="Set State", Progress In=w58, Error In=w59) -> (Error Out=w60)
            Increment(x=s12) -> w61
            Logical Or(w33, w34) -> w62
            Wait Until Next Multiple(multiple to wait=10)
            next s9 = w60
            next s10 = w40
            next s11 = w51
            next s12 = w61
            next s13 = w44
            stop if w62
          }
          call "MRM Sweep Live Parameters FGV.gvi"(FGV Instructions="Read State", Error In=s9) -> (MRM sweep live parameters FGV cluster out=w63, Error Out=w64)
          Property Node(instance in=w63) -> ("All Cell Measurements"=w65, instance out=w66)
          Array Index(array=w65) -> (out0[i1]=w67)
          Property Node(instance in="IV Full Raw Data.gtype" {all zero or empty}, "IV Raw Data Array"=s11, "Rainbow Sweep Types"=w26) -> (instance out=w68)
          Insert Into Array(inArray=s6, index0=i2, new=w68) -> w69
          Property Node(instance in=w67, "Full IV Data Array"=w69, "Measured Cell"=w11) -> (instance out=w70)
          Replace Array Subset(inArray=w65, index=i1, new=w70) -> w71
          $"output array" <- w71
          Property Node(instance in=w66, "All Cell Measurements"=w71, "Refresh now"=TRUE) -> (instance out=w72)
          call "MRM Sweep Live Parameters FGV.gvi"(FGV Instructions="Set State", MRM sweep live parameters FGV Cluster In=w72, Error In=w64) -> (Error Out=w73)
          call "KCube Move to 0 or Home.gvi"(Instrument Control Mega Cluster In=s10, Error In=w73) -> (Instrument Control Mega Cluster Out=w74, Error Out=w75)
          call "XZ Y Safe Approach and Retract.gvi"(Instrument Control Mega Cluster In=w74, Error In=w75, Approach Operation="Retract", Misc Data Mega Cluster=$"Misc Data Mega Cluster In") -> (Instrument Control Mega Cluster Out=w76, Error Out=w77)
          next s4 = w77
          next s5 = w76
          next s6 = w69
          next s7 = s12
          next s8 = s13
          stop if w62
        }
        call "KCube Move to 0 or Home.gvi"(Instrument Control Mega Cluster In=s5, Error In=s4) -> (Instrument Control Mega Cluster Out=w78, Error Out=w79)
        call "XZ Y Safe Approach and Retract.gvi"(Instrument Control Mega Cluster In=w78, Error In=w79, Approach Operation="Retract") -> (Instrument Control Mega Cluster Out=w80, Error Out=w81)
        Property Node(instance in=s8, "Full IV Curve Raw Data"=s6) -> (instance out=w82)
        Property Node(instance in=w12, "SRM Mega Cluster"=w82) -> (instance out=w83)
        append w83 to w8
        next s1 = w80
        next s2 = w81
        next s3 = s7
        stop if w62
      }
      Property Node(instance in=w5, "MRM Data Array"=w8) -> (instance out=w3)
      w1 = s2
      w2 = s1
    }
  }
  $"Instrument Control Mega Cluster Out" <- w2
  $"Error Out" <- w1
  $"MRM Mega Cluster Out" <- w3
