vi "Multiple Rainbow Measurement Subroutine.gvi"   [LabVIEW NXG 5.0.0]
inputs:
  "Error In": error
  "Instrument Control Mega Cluster In": "Instrument Control Mega Cluster.gtype"
  "Misc Data Mega Cluster In": "Misc Data Mega Cluster.gtype"
  "LPC Mega Cluster In": "LPC Mega Cluster.gtype"
  "MRM Mega Cluster In": "MRM Mega Cluster.gtype" = {"MRM Specific Parameters"={"Max (V)"=1.2, "Min (V)"=-0.5, "V Points"=100, "Curr Range (A)"=0, "Sweep Dir"=FALSE, "Current Avg"=3, "Max (A)"=0.1, "Integration Time"=0.5, "Cell Area (m^2)"=8e-06, "Autorange"=TRUE, "Full Spctr Ref"=TRUE}, "Cell Selector"={FALSE, FALSE, FALSE, FALSE, FALSE, FALSE, FALSE, FALSE, FALSE, FALSE, FALSE, FALSE, FALSE, FALSE, FALSE, FALSE, FALSE, FALSE, FALSE, FALSE, FALSE, FALSE, FALSE, FALSE, FALSE, FALSE, FALSE, FALSE}, "Cells to Measure Array"=[], "Rainbow Sweep Parameters MRM"={0, 900, 400, 1, 1, 0}, "MRM Data Array"=[]}
  "Stand Alone?": bool
  "Instruction Queue In": Queue<"Queue Instructions Control.gtype">
outputs:
  "Error Out": error
  "Instruction Queue Out": Queue<"Queue Instructions Control.gtype">
  "Instrument Control Mega Cluster Out": "Instrument Control Mega Cluster.gtype"
  "Misc Data Mega Cluster Out": "Misc Data Mega Cluster.gtype"
  "LPC Mega Cluster Out": "LPC Mega Cluster.gtype"
  "MRM Mega Cluster Out": "MRM Mega Cluster.gtype"
panel controls:
  "MRM Operation Control": "S_MRM Operation Control.gtype" = "New Measurement"
types:
  "Queue Instructions Control.gtype" = enum{"Undefined State", "Debug Check", "Initialize App", "Idle", "Light Power Calibration", "Rainbow Single Measurement", "Rainbow Multiple Measurement", "Light Calibration Irradiance", "Light Calibration Spectral Density", "Light Calibration Power Density", "Stand Alone Photodetector Measurement", "MSpot Spectrum Calibration", "Move XZ Stage", "Change Cell", "Update All Info Meta Cluster", "Access TXT File", "Stop App", "State 1", "State 2 ", "State 3 ", "State 4"}
  "S_MRM Operation Control.gtype" = enum{"New Measurement", "Load Measurement", "Save Measurement"}
  "Full Reference Cluster.gtype" = cluster{"Enum Reference Cluster": "Enum Control Reference Cluster.gtype", "Boolean Reference Cluster": "Boolean Control Reference Cluster.gtype", "Numeric Reference Cluster": "Numeric Control Reference Cluster.gtype", "Numeric Cluster Reference Cluster": "Numeric Cluster Reference Cluster.gtype", "Path Reference Cluster": "Path Reference Cluster.gtype", "Cluster Reference Cluster": "Cluster Reference Cluster.gtype", "XZ Stage Controls Reference Cluster": "XZ Stage Controls Reference Cluster.gtype"}
  "Cell Naming Cluster.gtype" = cluster{"Cell Label": string, "Sample Prefix": string, "Author Initials": string, "Current Date": string, "Batch Name": string}
  T1 = cluster{"X Coordinate (mm)": f64, "Z Coordinate (mm)": f64}
  T2 = cluster{"X Coordinate (mm)": f64, "Z Coordinate (mm)": f64, "Vertical Spacing (mm)": f64}
  "XZ All Position Cluster.gtype" = cluster{"Diffusor Coordinates": T1, "Photodetector Coordinates": T1, "Cell R.01 Coordinates": T2}
  T3 = cluster{"Thorlabs Motor Serial Number File Path": path, "Default Data Saving Location": path}
  "Misc Data Mega Cluster.gtype" = cluster{"Full Reference Cluster": "Full Reference Cluster.gtype", "Cell Naming Cluster": "Cell Naming Cluster.gtype", "All XZ Position Cluster": "XZ All Position Cluster.gtype", "All Paths": T3}
  "Instrument Coms Info.gtype" = cluster{"Arduino Coms Info": "Arduino Detection cluster control.gtype", "Photodetector Names": string[], "Keythley Address": "VISA Instr", "Photodetector Detected?": bool, "Thorlabs Motors Detected?": bool, "Keithley Detected?": bool, "Thorlabs Motors Serial Number": "Thorlabs Motors Serial Number In.gtype", "Photodetector IVI session": "Ivi IviDefault", "Flame ID": string, "Flame Detected?": bool, "Flame Wrapper ID": u64}
  "Debugging Cluster.gtype" = cluster{"Debugging mode?": bool, "Initialize App": bool, "Insturment Debugging": "Insturment Debugging Cluster.gtype"}
  "Instrument Control Mega Cluster.gtype" = cluster{"Instruments Coms Info": "Instrument Coms Info.gtype", "Debugging Cluster": "Debugging Cluster.gtype"}
  "Raibow Sweep Selector.gtype" = enum{"Red Sweep", "Blue Sweep", "Full Sweep Red First", "Full Sweep Blue First"}
  "Rainbow Sweep Param Selector.gtype" = cluster{"Raibow Sweep Selector": "Raibow Sweep Selector.gtype", "Max Wavelength (nm)": f64, "Min Wavelength (nm)": f64, "Wavelength Step (nm)": f64, "Rainbow Sweep Type Selector": "Rainbow Sweep Type Selector.gtype"}
  "Light power Calibration Parameters.gtype" = cluster{"Powermeter Averages": u32, "Photodtctr Area (m^2)": f64, "Only Full Spectrum": bool}
  T4 = cluster{"Dividing Wavelength Array": f64[], "Measured Power Array": f64[], "Power Density Array": f64[]}
  "Rainbow Sweep Types.gtype" = enum{"Red Sweep Closing", "Red Sweep Opening", "Blue Sweep Closing", "Blue Sweep Opening"}
  "Light Power Calibration Data.gtype" = cluster{"Single Light Calibration": T4, "Rainbow Sweep Types": "Rainbow Sweep Types.gtype", "Total Light Power Density (W/m^2)": f64}
  "LPC Mega Cluster.gtype" = cluster{"Rainbow Sweep Parameters LPC": "Rainbow Sweep Param Selector.gtype", "LPC Specific Parameters": "Light power Calibration Parameters.gtype", "Light Power Calibration Data": "Light Power Calibration Data.gtype"[]}
  "MRM Specific Parameters.gtype" = cluster{"Max (V)": f64, "Min (V)": f64, "V Points": u32, "Curr Range (A)": f64, "Sweep Dir": bool, "Current Avg": u32, "Max (A)": f64, "Integration Time": f64, "Cell Area (m^2)": f64, "Autorange": bool, "Full Spctr Ref": bool}
  T5 = cluster{"L.01": bool, "R.01": bool, "L.02": bool, "R.02": bool, "L.03": bool, "R.03": bool, "L.04": bool, "R.04": bool, "L.05": bool, "R.05": bool, "L.06": bool, "R.06": bool, "L.07": bool, "R.07": bool, "L.08": bool, "R.08": bool, "L.09": bool, "R.09": bool, "L.10": bool, "R.10": bool, "L.11": bool, "R.11": bool, "L.12": bool, "R.12": bool}
  "MRM Cell Selector.gtype" = cluster{"All": bool, "Left": bool, "Right": bool, "Cell Cluster": T5, "Reset": bool}
  "XZ Stage Cell.gtype" = enum{"L.01", "L.02", "L.03", "L.04", "L.05", "L.06", "L.07", "L.08", "L.09", "L.10", "L.11", "L.12", "R.01", "R.02", "R.03", "R.04", "R.05", "R.06", "R.07", "R.08", "R.09", "R.10", "R.11", "R.12"}
  "Selected Cells Array.gtype" = "XZ Stage Cell.gtype"[]
  T6 = enum{"L.01", "L.02", "L.03", "L.04", "L.05", "L.06", "L.07", "L.08", "L.09", "L.10", "L.11", "L.12", "R.01", "R.02", "R.03", "R.04", "R.05", "R.06", "R.07", "R.08", "R.09", "R.10", "R.11", "R.12"}
  "MRM Full Data From SRM Cluster.gtype" = cluster{"SRM Mega Cluster": "SRM Mega Cluster.gtype", "Cell Label": T6}
  "MRM Mega Cluster.gtype" = cluster{"MRM Specific Parameters": "MRM Specific Parameters.gtype", "Cell Selector": "MRM Cell Selector.gtype", "Cells to Measure Array": "Selected Cells Array.gtype", "Rainbow Sweep Parameters MRM": "Rainbow Sweep Param Selector.gtype", "MRM Data Array": "MRM Full Data From SRM Cluster.gtype"[]}
  "XZ Coordinate Cluster In.gtype" = cluster{"X Coordinate (mm)": f64, "Z Coordinate (mm)": f64}
uses:
  Rainbow Measurement Setup::Main Functions::Rainbow Measurement::Cell Multiple Rainbow Measurement::MRM Operation FGV.gvi
  Rainbow Measurement Setup::Main Functions::Rainbow Measurement::Cell Multiple Rainbow Measurement::MRM Data Array::MRM Data Array Initialize.gvi
  Rainbow Measurement Setup::Main Functions::Instruction Queue::Current State::FGV Current State.gvi
  Rainbow Measurement Setup::Side Functions::Global Abort::FGV Global Abort.gvi
  Rainbow Measurement Setup::Main Functions::Rainbow Measurement::Cell Single Rainbow Measurement::S_MRM Start Calculator.gvi
  Rainbow Measurement Setup::Main Functions::Rainbow Measurement::Cell Multiple Rainbow Measurement::LPC MRM Check::MRM Check Light Power Data.gvi
  Rainbow Measurement Setup::Side Functions::Instrument Control::Thorlabs Motors::Dividing Wavelength Control::Dividing Wavelength Calibration Data FGV.gvi
  Rainbow Measurement Setup::Side Functions::Instrument Control::Debug Cluster Instrument Extractor.gvi
  Rainbow Measurement Setup::Main Functions::One Time Calibrations::Beam Power Density::Specific Detect Instruments Subroutine.gvi
  Rainbow Measurement Setup::Side Functions::Instrument Control::Thorlabs Motors::Movement::KCube Move to 0 or Home.gvi
  Rainbow Measurement Setup::Side Functions::Instrument Control::Arduino::XZ Stage Arduino::XZ Stage Initialize And Home.gvi
  Rainbow Measurement Setup::Side Functions::Instrument Control::Keithley::Keithley Initialize Subroutine.gvi
  Rainbow Measurement Setup::Main Functions::Rainbow Measurement::Cell Multiple Rainbow Measurement::MRM Rainbow Sweep.gvi
  Rainbow Measurement Setup::Side Functions::Instrument Control::Thorlabs Motors::Movement::KCube Motors Close.gvi
  Rainbow Measurement Setup::Side Functions::Instrument Control::Arduino::XZ Stage Arduino::XZ Stage Move to Position.gvi
  Rainbow Measurement Setup::Side Functions::Instrument Control::Arduino::XZ Stage Arduino::XZ Stage Close Coms.gvi
  Rainbow Measurement Setup::Side Functions::Instrument Control::Keithley::Keithley Close Subroutine.gvi
  Rainbow Measurement Setup::Main Functions::Rainbow Measurement::Cell Multiple Rainbow Measurement::MRM IV Parameters Calculator.gvi
  Rainbow Measurement Setup::Main Functions::Rainbow Measurement::Cell Single Rainbow Measurement::SRM Live Parameters::SRM Sweep Live Parameters FGV.gvi
  Rainbow Measurement Setup::Main Functions::Rainbow Measurement::Cell Multiple Rainbow Measurement::Plotting::MRM Sweep Refined Data FGV.gvi
  Rainbow Measurement Setup::Main Functions::Rainbow Measurement::Cell Single Rainbow Measurement::File Handling::SRM Save Graphs Prompt.gvi
  Rainbow Measurement Setup::Main Functions::Rainbow Measurement::Cell Multiple Rainbow Measurement::File Handling::MRM file handling.gvi
  Rainbow Measurement Setup::Main Functions::Rainbow Measurement::Cell Single Rainbow Measurement::File Handling::SRM Load Prompt.gvi
  Rainbow Measurement Setup::Side Functions::Messages And Prompts::General Simple Prompt.gvi
  Rainbow Measurement Setup::Main Functions::Rainbow Measurement::Cell Single Rainbow Measurement::LPC Check::New Light Calibration Enqueue.gvi
  Rainbow Measurement Setup::Main Functions::Rainbow Measurement::Single Multiple Measurement Utilities::FGV Last Measurement Type.gvi
  Rainbow Measurement Setup::Side Functions::Utilities::Progress Handling::Progress FGV.gvi
diagram:
  # This SubVI Measures the Light power for each motor position for each sweep type and outputs the data so that it can be plotted
  # on the main window for checking and for calibration purposes
  case ($"Error In") {
    frame Error, Default {
      w1 = $"Error In"
      w2 = $"Instruction Queue In"
      w3 = $"Instrument Control Mega Cluster In"
      w4 = $"MRM Mega Cluster In"
      w5 = $"Misc Data Mega Cluster In"
      w6 = $"LPC Mega Cluster In"
    }
    frame No Error {
      call "MRM Operation FGV.gvi"(FGV Instructions="Read State", Error In=$"Error In") -> (MRM Operation Control Out=w7, Error Out=w8)
      Select(s=$"Stand Alone?", t=$"MRM Operation Control", f=w7) -> w9
      call "MRM Data Array Initialize.gvi"(MRM Mega Cluster In=$"MRM Mega Cluster In", Error In=w8, MRM Operation FGV=w7) -> (MRM Mega Cluster Out=w10, Error Out=w11)
      call "FGV Current State.gvi"(Current State Instructions="Set Current State and Substate", Current State="Rainbow Multiple Measurement", Current Substate="", Error In=w11) -> (Error Out=w12)
      s1 = w12  # shift register
      s2 = "Start App"  # shift register
      s2.prev1 = uninitialised  # shift register
      s3 = $"Instruction Queue In"  # shift register
      s4 = $"Instrument Control Mega Cluster In"  # shift register
      s5 = $"Misc Data Mega Cluster In"  # shift register
      s6 = $"LPC Mega Cluster In"  # shift register
      s7 = w10  # shift register
      while {
        call "FGV Global Abort.gvi"(Global Abort Instructions="Read Current State", Error In=s1) -> (Local Abort Out=w13, Global Abort Out=w14, Error Out=w15)
        Is Not Equal(x=s2, y="Stop App") -> w16
        Logical And(w16, w13) -> w17
        Select(s=w17, t="Close Coms", f=s2) -> w18
        case (w18) {
          frame "Start App", Default {
            call "FGV Current State.gvi"(Current State Instructions="Set Current Substate", Current Substate="Starting Multiple Cell Measurement", Error In=w15) -> (Error Out=w19)
            w20 = "Load Light Power Calibration"
            w21 = default
            w22 = s3
            w23 = s7
            w24 = s4
            w25 = s6
            w26 = s5
          }
          frame "Load Light Power Calibration" {
            call "S_MRM Start Calculator.gvi"(Rainbow Measurement Operation Control=w9, Stand Alone?=$"Stand Alone?") -> (Desired State=w27)
            call "MRM Check Light Power Data.gvi"(MRM Mega Cluster In=s7, Misc Data Mega Cluster In=s5, LPC Mega Cluster In=s6, Error In=w15, Input State=w27) -> (MRM Mega Cluster Out=w23, LPC Mega Cluster Out=w25, Next State=w20, Error Out=w19)
            w21 = default
            w22 = s3
            w24 = s4
            w26 = s5
          }
          frame "Detect Instruments" {
            call "FGV Current State.gvi"(Current State Instructions="Set Current Substate", Current Substate="Detecting Instruments", Error In=w15) -> (Error Out=w28)
            call "Dividing Wavelength Calibration Data FGV.gvi"(Div Wavelength FGV Instructions="Load Data", Error In=w28) -> (Error Out=w29)
            call "Debug Cluster Instrument Extractor.gvi"(Instrument Control Mega Cluster In=s4, Error In=w29) -> (Instrument Control Mega Cluster Out=w30, Instruments to Detect=w31, Error Out=w32)
            call "Specific Detect Instruments Subroutine.gvi"(Instrument Control Mega Cluster In=w30, Error In=w32, Instruments To Detect Array=w31, Stand Alone?=$"Stand Alone?") -> (Instrument Control Mega Cluster Out=w24, Error Out=w19)
            w20 = "Initialize Instruments"
            w21 = default
            w22 = s3
            w23 = s7
            w25 = s6
            w26 = s5
          }
          frame "Initialize Instruments" {
            call "FGV Current State.gvi"(Current State Instructions="Set Current Substate", Current Substate="Initializing Instruments", Error In=w15) -> (Error Out=w33)
            call "KCube Move to 0 or Home.gvi"(Instrument Control Mega Cluster In=s4, Error In=w33) -> (Instrument Control Mega Cluster Out=w34, Error Out=w35)
            call "XZ Stage Initialize And Home.gvi"(Instrument Control Mega Cluster In=w34, Error In=w35) -> (Instrument Control Mega Cluster Out=w36, Error Out=w37)
            call "Keithley Initialize Subroutine.gvi"(Instrument Control Mega Cluster In=w36, Error In=w37) -> (Instrument Control Mega Cluster Out=w24, Error Out=w19)
            w20 = "Rainbow Sweep"
            w21 = default
            w22 = s3
            w23 = s7
            w25 = s6
            w26 = s5
          }
          frame "Rainbow Sweep" {
            call "FGV Current State.gvi"(Current State Instructions="Set Current Substate", Current Substate="Acquiring Spectra", Error In=w15) -> (Error Out=w38)
            call "MRM Rainbow Sweep.gvi"(Instrument Control Mega Cluster In=s4, MRM Mega Cluster In=s7, LPC Mega Cluster In=s6, Error In=w38) -> (Instrument Control Mega Cluster Out=w24, MRM Mega Cluster Out=w23, Error Out=w19)
            w20 = "Close Coms"
            w21 = default
            w22 = s3
            w25 = s6
            w26 = s5
          }
          frame "Close Coms" {
            Select(s=w13, t="Stop App", f="Process IV Data") -> w20
            call "FGV Current State.gvi"(Current State Instructions="Set Current Substate", Current Substate="Closing Coms", Error In=w15) -> (Error Out=w39)
            call "KCube Motors Close.gvi"(Instrument Control Mega Cluster In=s4, Error In=w39) -> (Instrument Control Mega Cluster Out=w40, Error Out=w41)
            call "XZ Stage Move to Position.gvi"(Instrument Control Mega Cluster In=w40, Error In=w41, XZ Coordinate Cluster In="XZ Coordinate Cluster In.gtype" {all zero or empty}) -> (Instrument Control Mega Cluster Out=w42, Error Out=w43)
            call "XZ Stage Close Coms.gvi"(Instrument Control Mega Cluster In=w42, Error In=w43) -> (Instrument Control Mega Cluster Out=w44, Error Out=w45)
            call "Keithley Close Subroutine.gvi"(Instrument Control Mega Cluster In=w44, Error In=w45) -> (Instrument Control Mega Cluster Out=w24, Error Out=w19)
            w21 = default
            w22 = s3
            w23 = s7
            w25 = s6
            w26 = s5
          }
          frame "Process IV Data" {
            call "MRM IV Parameters Calculator.gvi"(MRM Mega Cluster In=s7, Error In=w15) -> (MRM Mega Cluster Out=w23, SRM sweep live parameters FGV Cluster Out=w46, Error Out=w47)
            call "SRM Sweep Live Parameters FGV.gvi"(FGV Instructions="Read State", SRM sweep live parameters FGV Cluster In=w46, Error In=w47) -> (Error Out=w48)
            call "MRM Sweep Refined Data FGV.gvi"(MRM Mega Cluster In=w23, Error In=w48, FGV Instructions="Set State") -> (Error Out=w49)
            call "SRM Save Graphs Prompt.gvi"(Previous State=s2.prev1, Error In=w49) -> (Desired State=w20, Error Out=w19)
            w21 = default
            w22 = s3
            w24 = s4
            w25 = s6
            w26 = s5
          }
          frame "Load Measurement" {
            call "FGV Current State.gvi"(Current State Instructions="Set Current Substate", Current Substate="Loading Calibration", Error In=w15) -> (Error Out=w50)
            call "MRM file handling.gvi"(MRM Mega Cluster In=s7, Misc Data Mega Cluster In=s5, Error In=w50, Modify File Operation="Load TXT") -> (MRM Mega Cluster Out=w23, Boolean Handler Out=w51, Loaded Files=w52, Error Out=w53)
            call "SRM Load Prompt.gvi"(Boolean Handler In=w51, Loaded Files=w52, Error In=w53) -> (Desired State=w20, Error Out=w19)
            w21 = default
            w22 = s3
            w24 = s4
            w25 = s6
            w26 = s5
          }
          frame "Save Graphs" {
            call "FGV Current State.gvi"(Current State Instructions="Set Current Substate", Current Substate="Saving Graphs", Error In=w15) -> (Error Out=w54)
            call "MRM file handling.gvi"(MRM Mega Cluster In=s7, Misc Data Mega Cluster In=s5, Error In=w54, Modify File Operation="Save TXT") -> (MRM Mega Cluster Out=w23, Error Out=w55)
            w56 = "Your Measurement Files Have been saved\npropperly on your personal data folder."
            call "General Simple Prompt.gvi"(Prompt Message=w56, Okay Button Message="Perfect Thanks :)", Error In=w55, Prompt?=TRUE) -> (Error Out=w19)
            w20 = "Stop App"
            w21 = default
            w22 = s3
            w24 = s4
            w25 = s6
            w26 = s5
          }
          frame "Enqueue Light Calibration" {
            call "New Light Calibration Enqueue.gvi"(Queue In=s3, Misc Data Mega Cluster In=s5, Error In=w15) -> (Queue Out=w22, Error Out=w19)
            w20 = "Stop App"
            w21 = default
            w23 = s7
            w24 = s4
            w25 = s6
            w26 = s5
          }
          frame "Stop App" {
            call "FGV Last Measurement Type.gvi"(FGV Instructions="Set State", Last Measurement Type="Rainbow Multiple Measurement", Error In=w15) -> (Error Out=w57)
            call "FGV Current State.gvi"(Current State Instructions="Set Current Substate", Current Substate="Stopping Apps", Error In=w57) -> (Error Out=w19)
            w20 = "Start App"
            w21 = TRUE
            w22 = s3
            w23 = s7
            w24 = s4
            w25 = s6
            w26 = s5
          }
        }
        call "Progress FGV.gvi"(FGV Instructions="Set State", Progress In=0, Error In=w19) -> (Error Out=w58)
        Logical Or(w14, w58, w21) -> w59
        next s1 = w58
        next s2 = w20
        next s3 = w22
        next s4 = w24
        next s5 = w26
        next s6 = w25
        next s7 = w23
        stop if w59
      }
      w1 = s1
      w2 = s3
      w3 = s4
      w4 = s7
      w5 = s5
      w6 = s6
    }
  }
  $"Instruction Queue Out" <- w2
  $"Instrument Control Mega Cluster Out" <- w3
  $"Misc Data Mega Cluster Out" <- w5
  $"LPC Mega Cluster Out" <- w6
  $"MRM Mega Cluster Out" <- w4
  $"Error Out" <- w1
