vi "MRM Sweep Refined FGV Read Handler.gvi"   [LabVIEW NXG 5.0.0]
inputs:
  "Misc Data Mega Cluster In": "Misc Data Mega Cluster.gtype"
  "IV Multi Cell Refined Plot Data Out": T13[]
  "Error In": error
outputs:
  "Misc Data Mega Cluster Out": "Misc Data Mega Cluster.gtype"
  "IV Extracted Parameters Plot": T1
  "Error Out": error
types:
  T1 = cluster{"Dividing Wavelength (nm)": f64[], "Element 2": f64[]}
  "Full Reference Cluster.gtype" = cluster{"Enum Reference Cluster": "Enum Control Reference Cluster.gtype", "Boolean Reference Cluster": "Boolean Control Reference Cluster.gtype", "Numeric Reference Cluster": "Numeric Control Reference Cluster.gtype", "Numeric Cluster Reference Cluster": "Numeric Cluster Reference Cluster.gtype", "Path Reference Cluster": "Path Reference Cluster.gtype", "Cluster Reference Cluster": "Cluster Reference Cluster.gtype", "XZ Stage Controls Reference Cluster": "XZ Stage Controls Reference Cluster.gtype"}
  "Cell Naming Cluster.gtype" = cluster{"Cell Label": string, "Sample Prefix": string, "Author Initials": string, "Current Date": string, "Batch Name": string}
  T2 = cluster{"X Coordinate (mm)": f64, "Z Coordinate (mm)": f64}
  T3 = cluster{"X Coordinate (mm)": f64, "Z Coordinate (mm)": f64, "Vertical Spacing (mm)": f64}
  "XZ All Position Cluster.gtype" = cluster{"Diffusor Coordinates": T2, "Photodetector Coordinates": T2, "Cell R.01 Coordinates": T3}
  T4 = cluster{"Thorlabs Motor Serial Number File Path": path, "Default Data Saving Location": path}
  "Misc Data Mega Cluster.gtype" = cluster{"Full Reference Cluster": "Full Reference Cluster.gtype", "Cell Naming Cluster": "Cell Naming Cluster.gtype", "All XZ Position Cluster": "XZ All Position Cluster.gtype", "All Paths": T4}
  T5 = cluster{"Dividing Wavelength (nm)": f64[], "Efficiency (%)": f64[]}
  T6 = cluster{"Dividing Wavelength (nm)": f64[], "Jsc (A/m^2)": f64[]}
  T7 = cluster{"Dividing Wavelength (nm)": f64[], "Voc (V)": f64[]}
  T8 = cluster{"Dividing Wavelength (nm)": f64[], "Light Power Density (W/m^2)": f64[]}
  T9 = cluster{"Dividing Wavelength (nm)": f64[], "FF (%)": f64[]}
  T10 = cluster{"Dividing Wavelength (nm)": f64[], "Rs (Ω · m^2)": f64[]}
  T11 = cluster{"Dividing Wavelength (nm)": f64[], "Rsh (Ω · m^2)": f64[]}
  "Rainbow Sweep Types.gtype" = enum{"Red Sweep Closing", "Red Sweep Opening", "Blue Sweep Closing", "Blue Sweep Opening"}
  "SRM IV Refined Data Plot.gtype" = cluster{"Efficiency Plot": T5, "Jsc Plot": T6, "Voc Plot": T7, "Light Power Density Plot": T8, "FF Plot": T9, "Rs Plot": T10, "Rsh Plot": T11, "Rainbow Sweep Types": "Rainbow Sweep Types.gtype", "Total Light Power Density (W/m^2)": f64}
  T12 = enum{"L.01", "L.02", "L.03", "L.04", "L.05", "L.06", "L.07", "L.08", "L.09", "L.10", "L.11", "L.12", "R.01", "R.02", "R.03", "R.04", "R.05", "R.06", "R.07", "R.08", "R.09", "R.10", "R.11", "R.12"}
  T13 = cluster{"IV Full Data To Plot": "SRM IV Refined Data Plot.gtype"[], "Cell Label": T12}
diagram:
  # This SubVI Takes all the sweep types and scans for the selected one, It also scans both for the selected Cell, and once it finds it
  # it outputs the selected data to the IV Extracted Parameters plot so that it can be correctly
  # plotted.
  case ($"Error In") {
    frame Error, Default {
      w1 = default
      w2 = $"Error In"
      w3 = $"Misc Data Mega Cluster In"
    }
    frame No Error {
      Property Node(instance in=$"Misc Data Mega Cluster In") -> ("Full Reference Cluster:Cluster Reference Cluster:SRM Refined Plot Rainbow Sweep Types"=w4, "Full Reference Cluster:Enum Reference Cluster:SRM Plot Parameter Selector Ref"=w5, "Full Reference Cluster:Numeric Reference Cluster:SRM Light Power Density Ref"=w6, "Full Reference Cluster:Cluster Reference Cluster:MRM Cell Refined Plot Selector ref"=w7, instance out=w3)
      Property Node(instance in=w7, error in=$"Error In") -> ("Value"=w8, error out=w9)
      Property Node(instance in=w5, error in=w9) -> ("Value"=w10, error out=w11)
      Property Node(instance in=w4, error in=w11) -> ("Value"=w12, error out=w13)
      s1 = w13  # shift register
      for {
        w14 = each element of $"IV Multi Cell Refined Plot Data Out"
        Property Node(instance in=w14) -> ("Cell Label"=w16, "IV Full Data To Plot"=w17)
        Format Into String(errIn=s1, w16) -> (outString=w18, errOut=w19)
        Is Equal(x=w8, y=w18) -> w20
        w15 = w17 if w20
        next s1 = w19
        stop if w20
      }
      s2 = s1  # shift register
      for {
        w21 = each element of w15
        Property Node(instance in=w21) -> ("Rainbow Sweep Types"=w24, "Total Light Power Density (W/m^2)"=w25, instance out=w26)
        Format Into String(w24) -> w27
        Is Equal(x=w27, y=w12) -> w28
        w22 = w26 if w28
        w23 = w25 if w28
      }
      case (w10) {
        frame "Efficiency (%)", Default {
          Property Node(instance in=w22) -> ("Efficiency Plot"=w1)
        }
        frame "Jsc (A / m^2)" {
          Property Node(instance in=w22) -> ("Jsc Plot"=w1)
        }
        frame "Voc (V)" {
          Property Node(instance in=w22) -> ("Voc Plot"=w1)
        }
        frame "Light Power Density (W/m^2)" {
          Property Node(instance in=w22) -> ("Light Power Density Plot"=w1)
        }
        frame "FF (%)" {
          Property Node(instance in=w22) -> ("FF Plot"=w1)
        }
        frame "Rs (Ω · m^2)" {
          Property Node(instance in=w22) -> ("Rs Plot"=w1)
        }
        frame "Rsh (Ω · m^2)" {
          Property Node(instance in=w22) -> ("Rsh Plot"=w1)
        }
      }
      Property Node(instance in=w6, "Value"=w23, error in=s2) -> (error out=w2)
    }
  }
  $"IV Extracted Parameters Plot" <- w1
  $"Error Out" <- w2
  $"Misc Data Mega Cluster Out" <- w3
