vi "MRM Sweep Refined FGV Set State.gvi"   [LabVIEW NXG 5.0.0]
inputs:
  "Misc Data Mega Cluster In": "Misc Data Mega Cluster.gtype"
  "MRM Mega Cluster In": "MRM Mega Cluster.gtype" = {"MRM Specific Parameters"={"Max (V)"=1.2, "Min (V)"=-0.5, "V Points"=100, "Curr Range (A)"=0, "Sweep Dir"=FALSE, "Current Avg"=3, "Max (A)"=0.1, "Integration Time"=0.5, "Cell Area (m^2)"=8e-06, "Autorange"=TRUE, "Full Spctr Ref"=TRUE}, "Cell Selector"={FALSE, FALSE, FALSE, FALSE, FALSE, FALSE, FALSE, FALSE, FALSE, FALSE, FALSE, FALSE, FALSE, FALSE, FALSE, FALSE, FALSE, FALSE, FALSE, FALSE, FALSE, FALSE, FALSE, FALSE, FALSE, FALSE, FALSE, FALSE}, "Cells to Measure Array"=[], "Rainbow Sweep Parameters MRM"={0, 900, 400, 1, 1, 0}, "MRM Data Array"=[]}
  "Error In": error
outputs:
  "Misc Data Mega Cluster Out": "Misc Data Mega Cluster.gtype"
  "IV Multi Cell Refined Plot Data Out": T10[]
  "Error Out": error
types:
  "MRM Specific Parameters.gtype" = cluster{"Max (V)": f64, "Min (V)": f64, "V Points": u32, "Curr Range (A)": f64, "Sweep Dir": bool, "Current Avg": u32, "Max (A)": f64, "Integration Time": f64, "Cell Area (m^2)": f64, "Autorange": bool, "Full Spctr Ref": bool}
  T1 = cluster{"L.01": bool, "R.01": bool, "L.02": bool, "R.02": bool, "L.03": bool, "R.03": bool, "L.04": bool, "R.04": bool, "L.05": bool, "R.05": bool, "L.06": bool, "R.06": bool, "L.07": bool, "R.07": bool, "L.08": bool, "R.08": bool, "L.09": bool, "R.09": bool, "L.10": bool, "R.10": bool, "L.11": bool, "R.11": bool, "L.12": bool, "R.12": bool}
  "MRM Cell Selector.gtype" = cluster{"All": bool, "Left": bool, "Right": bool, "Cell Cluster": T1, "Reset": bool}
  "XZ Stage Cell.gtype" = enum{"L.01", "L.02", "L.03", "L.04", "L.05", "L.06", "L.07", "L.08", "L.09", "L.10", "L.11", "L.12", "R.01", "R.02", "R.03", "R.04", "R.05", "R.06", "R.07", "R.08", "R.09", "R.10", "R.11", "R.12"}
  "Selected Cells Array.gtype" = "XZ Stage Cell.gtype"[]
  "Raibow Sweep Selector.gtype" = enum{"Red Sweep", "Blue Sweep", "Full Sweep Red First", "Full Sweep Blue First"}
  "Rainbow Sweep Param Selector.gtype" = cluster{"Raibow Sweep Selector": "Raibow Sweep Selector.gtype", "Max Wavelength (nm)": f64, "Min Wavelength (nm)": f64, "Wavelength Step (nm)": f64, "Rainbow Sweep Type Selector": "Rainbow Sweep Type Selector.gtype"}
  T2 = enum{"L.01", "L.02", "L.03", "L.04", "L.05", "L.06", "L.07", "L.08", "L.09", "L.10", "L.11", "L.12", "R.01", "R.02", "R.03", "R.04", "R.05", "R.06", "R.07", "R.08", "R.09", "R.10", "R.11", "R.12"}
  "MRM Full Data From SRM Cluster.gtype" = cluster{"SRM Mega Cluster": "SRM Mega Cluster.gtype", "Cell Label": T2}
  "MRM Mega Cluster.gtype" = cluster{"MRM Specific Parameters": "MRM Specific Parameters.gtype", "Cell Selector": "MRM Cell Selector.gtype", "Cells to Measure Array": "Selected Cells Array.gtype", "Rainbow Sweep Parameters MRM": "Rainbow Sweep Param Selector.gtype", "MRM Data Array": "MRM Full Data From SRM Cluster.gtype"[]}
  T3 = cluster{"Dividing Wavelength (nm)": f64[], "Efficiency (%)": f64[]}
  T4 = cluster{"Dividing Wavelength (nm)": f64[], "Jsc (A/m^2)": f64[]}
  T5 = cluster{"Dividing Wavelength (nm)": f64[], "Voc (V)": f64[]}
  T6 = cluster{"Dividing Wavelength (nm)": f64[], "Light Power Density (W/m^2)": f64[]}
  T7 = cluster{"Dividing Wavelength (nm)": f64[], "FF (%)": f64[]}
  T8 = cluster{"Dividing Wavelength (nm)": f64[], "Rs (Ω · m^2)": f64[]}
  T9 = cluster{"Dividing Wavelength (nm)": f64[], "Rsh (Ω · m^2)": f64[]}
  "Rainbow Sweep Types.gtype" = enum{"Red Sweep Closing", "Red Sweep Opening", "Blue Sweep Closing", "Blue Sweep Opening"}
  "SRM IV Refined Data Plot.gtype" = cluster{"Efficiency Plot": T3, "Jsc Plot": T4, "Voc Plot": T5, "Light Power Density Plot": T6, "FF Plot": T7, "Rs Plot": T8, "Rsh Plot": T9, "Rainbow Sweep Types": "Rainbow Sweep Types.gtype", "Total Light Power Density (W/m^2)": f64}
  T10 = cluster{"IV Full Data To Plot": "SRM IV Refined Data Plot.gtype"[], "Cell Label": T2}
  "Full Reference Cluster.gtype" = cluster{"Enum Reference Cluster": "Enum Control Reference Cluster.gtype", "Boolean Reference Cluster": "Boolean Control Reference Cluster.gtype", "Numeric Reference Cluster": "Numeric Control Reference Cluster.gtype", "Numeric Cluster Reference Cluster": "Numeric Cluster Reference Cluster.gtype", "Path Reference Cluster": "Path Reference Cluster.gtype", "Cluster Reference Cluster": "Cluster Reference Cluster.gtype", "XZ Stage Controls Reference Cluster": "XZ Stage Controls Reference Cluster.gtype"}
  "Cell Naming Cluster.gtype" = cluster{"Cell Label": string, "Sample Prefix": string, "Author Initials": string, "Current Date": string, "Batch Name": string}
  T11 = cluster{"X Coordinate (mm)": f64, "Z Coordinate (mm)": f64}
  T12 = cluster{"X Coordinate (mm)": f64, "Z Coordinate (mm)": f64, "Vertical Spacing (mm)": f64}
  "XZ All Position Cluster.gtype" = cluster{"Diffusor Coordinates": T11, "Photodetector Coordinates": T11, "Cell R.01 Coordinates": T12}
  T13 = cluster{"Thorlabs Motor Serial Number File Path": path, "Default Data Saving Location": path}
  "Misc Data Mega Cluster.gtype" = cluster{"Full Reference Cluster": "Full Reference Cluster.gtype", "Cell Naming Cluster": "Cell Naming Cluster.gtype", "All XZ Position Cluster": "XZ All Position Cluster.gtype", "All Paths": T13}
uses:
  Rainbow Measurement Setup::Main Functions::Rainbow Measurement::Cell Single Rainbow Measurement::Plotting::SRM Refined Data Graph Adapter.gvi
diagram:
  # This SubVI takes the IV Data and extracts the values of the rainbow sweep types
  # to set the Combobox values to all the available sweep types
  case ($"Error In") {
    frame Error, Default {
      w1 = default
      w2 = $"Error In"
      w3 = $"Misc Data Mega Cluster In"
    }
    frame No Error {
      Property Node(instance in=$"MRM Mega Cluster In") -> ("MRM Data Array"=w4)
      s1 = $"Error In"  # shift register
      s2 = $"Misc Data Mega Cluster In"  # shift register
      for {
        w5 = each element of w4
        Property Node(instance in=w5) -> ("SRM Mega Cluster:SRM Full IV data Array"=w7, "Cell Label"=w8)
        call "SRM Refined Data Graph Adapter.gvi"(IV Full Data Cluster Array In=w7, Error In=s1) -> (IV Full Data To Plot=w9, Error Out=w10)
        s3 = w10  # shift register
        for {
          w11 = each element of w7
          Property Node(instance in=w11) -> ("Rainbow Sweep Types"=w13)
          Format Into String(w13) -> w14
          append w14 to w12
        }
        Property Node(instance in=s2) -> ("Full Reference Cluster:Cluster Reference Cluster:SRM Refined Plot Rainbow Sweep Types"=w15, instance out=w16)
        Format Into String(errIn=s3, w8) -> (outString=w17, errOut=w18)
        Property Node(instance in=w15, "Items"=w12, "ValueSignaling"=w14, error in=w18) -> (error out=w19)
        Property Node(instance in=T10 {all zero or empty}, "IV Full Data To Plot"=w9, "Cell Label"=w8) -> (instance out=w20)
        append w20 to w1
        append w17 to w6
        next s1 = w19
        next s2 = w16
      }
      Property Node(instance in=s2) -> ("Full Reference Cluster:Cluster Reference Cluster:MRM Cell Refined Plot Selector ref"=w21, "Full Reference Cluster:Cluster Reference Cluster:MRM Current Raw Cell Plot"=w22, instance out=w3)
      Property Node(instance in=w22, "Items"=w6, "ValueSignaling"=w17) -> (error out=w23)
      Property Node(instance in=w21, "Items"=w6, "ValueSignaling"=w17, error in=w23) -> (error out=w2)
    }
  }
  $"Misc Data Mega Cluster Out" <- w3
  $"IV Multi Cell Refined Plot Data Out" <- w1
  $"Error Out" <- w2
