vi "SRM Load Prompt.gvi"   [LabVIEW NXG 5.0.0]
inputs:
  "Found Any Folder?": bool
  "Found Files within each Folder?": bool
  "Error In": error
  "Canceled Loading?": bool
  "Loaded Files": string[]
  "Duplicate Measurement Folders?": bool
outputs:
  "Desired State": "SRM States.gtype"
  "Error Out": error
types:
  "SRM States.gtype" = enum{"Start App", "Load Light Power Calibration", "Detect Instruments", "Initialize Instruments", "Rainbow Sweep", "Close Coms", "Process IV Data", "Load Measurement", "Save Graphs", "Enqueue Light Calibration", "Stop App"}
diagram:
  # This SubVI Prompts the user in case it does not find any measurement file and asks if . It also checks if the loading process got cancelled
  # and if it did it poompts the user accordingly. It also tells the user the files that have been loaded
  case ($"Error In") {
    frame Error, Default {
      w1 = $"Error In"
      w2 = "Stop App"
    }
    frame No Error {
      Logical And($"Found Any Folder?", not $"Canceled Loading?") -> w3
      case (w3) {
        frame False { }
        frame True {
          w4 = "Your Files have been succesfully\nloaded. They are the Following:\n\n"
          s1 = w4  # shift register
          for {
            w5 = each element of $"Loaded Files"
            Concatenate Strings(s1, w5, "\r\n") -> w6
            next s1 = w6
          }
          Concatenate Strings(s1, "\nThey Might take a while to appear, please be patient.") -> w7
          One Button Dialog(button name ("OK")="Okay Thanks :)", message=w7)
        }
      }
      case ($"Canceled Loading?") {
        frame False {
          w8 = "Process IV Data"
        }
        frame True {
          Select(s=$"Canceled Loading?", t="Stop App", f="Process IV Data") -> w8
          w9 = "I Cannot load any file if you do \nnot specify a propper path ¯\\_(ツ)_/¯"
          One Button Dialog(button name ("OK")="Oops, Sorry", message=w9)
        }
      }
      case ($"Found Files within each Folder?") {
        frame True {
          w10 = w8
        }
        frame False {
          Select(s=$"Found Files within each Folder?", t="Stop App", f=w8) -> w10
          w11 = "Some of the folders you provided seem to be empty, please make sure to delete all empty folders before trying to load a measurement."
          One Button Dialog(button name ("OK")="Oops, Sorry", message=w11)
        }
      }
      case ($"Duplicate Measurement Folders?") {
        frame False {
          w2 = w10
        }
        frame True {
          Select(s=$"Duplicate Measurement Folders?", t="Stop App", f=w10) -> w2
          w12 = "It seems that you have duplicate folders, that meaning that for one cell label you have multiple times the same sweep type. Please make sure to only have one type of sweep for each cell"
          One Button Dialog(button name ("OK")="Oops, Sorry", message=w12)
        }
      }
      w1 = $"Error In"
    }
  }
  $"Error Out" <- w1
  $"Desired State" <- w2
