vi "SRM file handling.gvi"   [LabVIEW NXG 5.0.0]
inputs:
  "Error In": error
  "Misc Data Mega Cluster In": "Misc Data Mega Cluster.gtype"
  "SRM Mega Cluster In": "SRM Mega Cluster.gtype"
  "Modify File Operation": "Modify File Operation.gtype" = "Save TXT"
outputs:
  "Error Out": error
  "SRM Mega Cluster Out": "SRM Mega Cluster.gtype"
  "Boolean Handler Out": "SRM Load Boolean Handler.gtype"
  "Loaded Files": string[]
panel controls:
  "LPC Mega Cluster In": "LPC Mega Cluster.gtype"
panel indicators:
  "Misc Data Mega Cluster Out": "Misc Data Mega Cluster.gtype"
types:
  "Modify File Operation.gtype" = enum{"Save TXT", "Load TXT"}
  "SRM Load Boolean Handler.gtype" = cluster{"Canceled Loading?": bool, "Found Any Folder?": bool, "Found Files Within all Folders?": bool, "Duplicate Measurement Files?": bool}
  "Full Reference Cluster.gtype" = cluster{"Enum Reference Cluster": "Enum Control Reference Cluster.gtype", "Boolean Reference Cluster": "Boolean Control Reference Cluster.gtype", "Numeric Reference Cluster": "Numeric Control Reference Cluster.gtype", "Numeric Cluster Reference Cluster": "Numeric Cluster Reference Cluster.gtype", "Path Reference Cluster": "Path Reference Cluster.gtype", "Cluster Reference Cluster": "Cluster Reference Cluster.gtype", "XZ Stage Controls Reference Cluster": "XZ Stage Controls Reference Cluster.gtype"}
  "Cell Naming Cluster.gtype" = cluster{"Cell Label": string, "Sample Prefix": string, "Author Initials": string, "Current Date": string, "Batch Name": string}
  T1 = cluster{"X Coordinate (mm)": f64, "Z Coordinate (mm)": f64}
  T2 = cluster{"X Coordinate (mm)": f64, "Z Coordinate (mm)": f64, "Vertical Spacing (mm)": f64}
  "XZ All Position Cluster.gtype" = cluster{"Diffusor Coordinates": T1, "Photodetector Coordinates": T1, "Cell R.01 Coordinates": T2}
  T3 = cluster{"Thorlabs Motor Serial Number File Path": path, "Default Data Saving Location": path}
  "Misc Data Mega Cluster.gtype" = cluster{"Full Reference Cluster": "Full Reference Cluster.gtype", "Cell Naming Cluster": "Cell Naming Cluster.gtype", "All XZ Position Cluster": "XZ All Position Cluster.gtype", "All Paths": T3}
  "SRM Specific Parameters.gtype" = cluster{"Max (V)": f64, "Min (V)": f64, "V Points": u32, "Current Range (A)": f64, "Autorange": bool, "Sweep Dir": bool, "Current Averages": u32, "Max (A)": f64, "Integration Time": f64, "Cell Area (m^2)": f64, "Full Spctr Ref": bool}
  "Raibow Sweep Selector.gtype" = enum{"Red Sweep", "Blue Sweep", "Full Sweep Red First", "Full Sweep Blue First"}
  "Rainbow Sweep Param Selector.gtype" = cluster{"Raibow Sweep Selector": "Raibow Sweep Selector.gtype", "Max Wavelength (nm)": f64, "Min Wavelength (nm)": f64, "Wavelength Step (nm)": f64, "Rainbow Sweep Type Selector": "Rainbow Sweep Type Selector.gtype"}
  "Rainbow Sweep Types.gtype" = enum{"Red Sweep Closing", "Red Sweep Opening", "Blue Sweep Closing", "Blue Sweep Opening"}
  "IV Full Data Cluster.gtype" = cluster{"IV Measurements Array": "IV Single Measurement.gtype"[], "Rainbow Sweep Types": "Rainbow Sweep Types.gtype", "IV Refined Data": "IV Refined Full Sweep Data.gtype"}
  "IV Full Raw Data.gtype" = cluster{"Rainbow Sweep Types": "Rainbow Sweep Types.gtype", "IV Raw Data Array": "IV Single Measurement.gtype"[]}
  "SRM Mega Cluster.gtype" = cluster{"SRM Specific Parameters": "SRM Specific Parameters.gtype", "Rainbow Sweep Parameters SRM": "Rainbow Sweep Param Selector.gtype", "SRM Full IV data Array": "IV Full Data Cluster.gtype"[], "Full IV Curve Raw Data": "IV Full Raw Data.gtype"[]}
  "Light power Calibration Parameters.gtype" = cluster{"Powermeter Averages": u32, "Photodtctr Area (m^2)": f64}
  T4 = cluster{"Dividing Wavelength Array": f64[], "Measured Power Array": f64[], "Power Density Array": f64[]}
  "Light Power Calibration Data.gtype" = cluster{"Single Light Calibration": T4, "Rainbow Sweep Types": "Rainbow Sweep Types.gtype", "Total Light Power Density": f64}
  "LPC Mega Cluster.gtype" = cluster{"Rainbow Sweep Parameters LPC": "Rainbow Sweep Param Selector.gtype", "LPC Specific Parameters": "Light power Calibration Parameters.gtype", "Light Power Calibration Data": "Light Power Calibration Data.gtype"[]}
  "IV Single Measurement.gtype" = cluster{"Voltage": f64[], "Current": f64[], "Current Density": f64[], "Dividing Wavelength": f64, "Light Power Density": f64, "Total Light Power Density": f64}
uses:
  Rainbow Measurement Setup::Side Functions::Messages And Prompts::Select path prompt.gvi
  Rainbow Measurement Setup::Side Functions::Path Manipulation::File_FolderName Scan For Sweep.gvi
  Rainbow Measurement Setup::Main Functions::Rainbow Measurement::Cell Single Rainbow Measurement::SRM Extract Correct Calibration Data.gvi
  Rainbow Measurement Setup::Main Functions::Modify TXT file::Modify Measurement TXT File.gvi
  Rainbow Measurement Setup::Main Functions::Rainbow Measurement::Cell Single Rainbow Measurement::File Handling::SRM Header Info Extractor.gvi
  Rainbow Measurement Setup::Side Functions::Utilities::Array Detect Duplicates.gvi
  Rainbow Measurement Setup::Side Functions::Messages And Prompts::FGV Repeat Operation for all following files.gvi
diagram:
  w1 = $"LPC Mega Cluster In"
  # This subVI Handles the Saving of all the Single Rainbow Measurement files. It can both save and load the files from a specified folder and to the user folder respectively
  case ($"Error In") {
    frame Error, Default {
      w2 = $"Error In"
      w3 = default
      w4 = default
      w5 = $"SRM Mega Cluster In"
      w6 = $"Misc Data Mega Cluster In"
    }
    frame No Error {
      case ($"Modify File Operation") {
        frame "Load TXT" {
          w14 = "Please Select the folder with the Rainbow Measurement Files you want to Load. "
          w15 = "Please select the cell folder within the device you want to analyze (i.e. L12)"
          call "Select path prompt.gvi"(Main Message=w14, Sub message=w15, Error In=$"Error In", Cancel Available?=TRUE) -> (New Path=w16, Cancelled?=w17, Error Out=w18)
          case (w17) {
            frame True {
              w12 = default
              w7 = w18
              w9 = TRUE
              w3 = default
              w8 = TRUE
              w10 = default
              w11 = default
            }
            frame False {
              List Folder(error in=w18, path=w16) -> (error out=w19, folder names=w20, path out=w21)
              s1 = w19  # shift register
              s2 = 0  # shift register
              s3 = "IV Full Raw Data.gtype"[] []  # shift register
              for {
                w22 = each element of w20
                Build Path(base path=w21, name or relative path=w22) -> (appended path=w26)
                Search And Replace String(error in (no error)=s1, input string=w22, search string="Raw IV Curves") -> (error out=w27, number of replacements=w28)
                call "File_FolderName Scan For Sweep.gvi"(FileName/FolderName In=w22, Error In=w27) -> (Is File/Folder sweep type?=w29, Sweep Type=w30, Error Out=w31)
                Is Not Equal To 0(x=w28) -> w32
                Logical And(w32, w29) -> w33
                case (w33) {
                  frame False, Default {
                    w34 = s2
                    w35 = s3
                    w36 = w31
                    w37 = default
                    w38 = "Red Sweep Closing"
                    w39 = default
                  }
                  frame True {
                    call "SRM Extract Correct Calibration Data.gvi"(LPC Mega Cluster In=w1, Rainbow Sweep Type=w30, Error In=w31) -> (Extracted Light Power Calibration Data=w40, Error Out=w41)
                    Array Index(array=s3) -> (out0[s2]=w42)
                    Property Node(instance in=w42) -> ("IV Raw Data Array"=w43)
                    List Folder(error in=w41, path=w26) -> (error out=w44, file names=w45, path out=w46)
                    s4 = w44  # shift register
                    s5 = w43  # shift register
                    s6 = 0  # shift register
                    for {
                      w47 = each element of w45
                      Build Path(base path=w46, name or relative path=w47) -> (appended path=w49)
                      Search And Replace String(input string=w47, search string=".txt") -> (number of replacements=w50)
                      Is Not Equal To 0(x=w50) -> w51
                      case (w51) {
                        frame False, Default {
                          w52 = s4
                          w53 = s5
                          w54 = s6
                          w55 = default
                        }
                        frame True {
                          Increment(x=s6) -> w54
                          Property Node(instance in=w40) -> ("Total Light Power Density"=w56)
                          call "Modify Measurement TXT File.gvi"(Filename to load/save=w49, Modify File Operation="Load TXT", Error In=s4, Measurement File Type="Single Cell Rainbow Raw") -> (Loaded Data=w57, Header Data=w58, Error Out=w59)
                          Array Index(array=w57) -> (out0[_, 0]=w60, out1[_, 1]=w61, out2[_, 2]=w62)
                          call "SRM Header Info Extractor.gvi"(Header Data=w58, Error In=w59) -> (Dividing Wavelength=w63, Light Power=w64, Error Out=w52)
                          Property Node(instance in="IV Single Measurement.gtype" {all zero or empty}, "Voltage"=w60, "Current"=w61, "Current Density"=w62, "Dividing Wavelength"=w63, "Light Power Density"=w64, "Total Light Power Density"=w56) -> (instance out=w65)
                          Insert Into Array(inArray=s5, index0=s6, new=w65) -> w53
                          w55 = TRUE
                        }
                      }
                      append w55 to w48
                      next s4 = w52
                      next s5 = w53
                      next s6 = w54
                    }
                    Or Array Elements(Boolean array=w48) -> (logical OR=w39)
                    Property Node(instance in=w42, "IV Raw Data Array"=s5, "Rainbow Sweep Types"=w30) -> (instance out=w66)
                    Insert Into Array(inArray=s3, new=w66) -> w35
                    Increment(x=s2) -> w34
                    w36 = s4
                    w37 = TRUE
                    w38 = w30
                  }
                }
                append w37 to w23
                append w22 to w3 if w33
                append w38 to w24 if w33
                append w39 to w25
                next s1 = w36
                next s2 = w34
                next s3 = w35
              }
              Or Array Elements(Boolean array=w23) -> (logical OR=w8)
              Or Array Elements(Boolean array=w25) -> (logical OR=w11)
              call "Array Detect Duplicates.gvi"(Array In=w24, Error In=s1) -> (Repeated?=w10, Error Out=w7)
              w12 = s3
              w9 = default
            }
          }
          w13 = $"SRM Mega Cluster In"
          w6 = $"Misc Data Mega Cluster In"
        }
        frame "Save TXT", Default {
          Property Node(instance in=$"SRM Mega Cluster In") -> ("SRM Full IV data Array"=w67, instance out=w13)
          s7 = $"Error In"  # shift register
          s8 = $"Misc Data Mega Cluster In"  # shift register
          for {
            w68 = each element of w67
            Property Node(instance in=w68) -> ("IV Measurements Array"=w69, "Rainbow Sweep Types"=w70, "IV Refined Data"=w71)
            Property Node(instance in=$"Misc Data Mega Cluster In") -> ("Cell Naming Cluster:Sample Prefix"=w72)
            s9 = s7  # shift register
            s10 = s8  # shift register
            for {
              w73 = each element of w69
              Property Node(instance in=w73) -> ("Voltage"=w74, "Current"=w75, "Current Density"=w76, "Dividing Wavelength"=w77, "Light Power Density"=w78)
              Format Into String(formatString="%d", errIn=s9, w77) -> (outString=w79, errOut=w80)
              Concatenate Strings(w72, ".", w79, "nm") -> w81
              Property Node(instance in=s10, "Cell Naming Cluster:Sample Prefix"=w81) -> (instance out=w82)
              Build Array(w74, w75, w76) -> w83
              Transpose 2D Array(2D array=w83) -> (transposed array=w84)
              Concatenate Strings(" Dividing Wavelength (nm) = ", w79, "  Light Power Density (W/m^2) = ") -> w85
              Format Into String(initString=w85, errIn=w80, w78) -> (outString=w86, errOut=w87)
              call "Modify Measurement TXT File.gvi"(Variable Header Info=w86, Rainbow Sweep Types=w70, Misc Data Mega Cluster In=w82, Modify File Operation="Save TXT", Data To Save=w84, Error In=w87, Measurement File Type="Single Cell Rainbow Raw") -> (Error Out=w88, Misc Data Mega Cluster Out=w89)
              next s9 = w88
              next s10 = w89
            }
            Property Node(instance in=w71) -> ("Dividing Wavelength (nm)"=w90, "Light Power (W)"=w91, "Jsc (A/m^2)"=w92, "Voc (V)"=w93, "FF (%)"=w94, "Efficiency (%)"=w95, "Rs (Ω/m^2)"=w96, "Rsh (Ω/m^2)"=w97)
            Build Array(w90, w91, w92, w93, w94, w95, w96, w97) -> w98
            Transpose 2D Array(2D array=w98) -> (transposed array=w99)
            call "Modify Measurement TXT File.gvi"(Rainbow Sweep Types=w70, Misc Data Mega Cluster In=s10, Modify File Operation="Save TXT", Data To Save=w99, Error In=s9, Measurement File Type="Single Cell Rainbow Refined") -> (Error Out=w100, Misc Data Mega Cluster Out=w101)
            next s7 = w100
            next s8 = w101
          }
          w7 = s7
          w8 = default
          w9 = default
          w3 = default
          w10 = default
          w11 = default
          w12 = default
          w6 = s8
        }
      }
      call "FGV Repeat Operation for all following files.gvi"(FGV Instructions="Reset State", Error In=w7) -> (Error Out=w2)
      Property Node(instance in="SRM Load Boolean Handler.gtype" {all zero or empty}, "Canceled Loading?"=w9, "Found Any Folder?"=w8, "Found Files Within all Folders?"=w11, "Duplicate Measurement Files?"=w10) -> (instance out=w4)
      Property Node(instance in=w13, "Full IV Curve Raw Data"=w12) -> (instance out=w5)
    }
  }
  $"Misc Data Mega Cluster Out" <- w6
  $"Error Out" <- w2
  $"Boolean Handler Out" <- w4
  $"SRM Mega Cluster Out" <- w5
  $"Loaded Files" <- w3
