vi "FF and Efficiency.gvi"   [LabVIEW NXG 5.0.0]
inputs:
  "Error In": error
  "IV Sweep Data In": "IV Refined Single Sweep Data.gtype"
  "IV Single Measurement": "IV Single Measurement.gtype"
  "Full Spectrum Reference?": bool
outputs:
  "Error Out": error
  "IV Sweep Data Out": "IV Refined Single Sweep Data.gtype"
types:
  "IV Refined Single Sweep Data.gtype" = cluster{"Rs (Ω/m^2)": f64, "Rsh (Ω/m^2)": f64, "Jsc (A/m^2)": f64, "Voc (V)": f64, "FF (%)": f64, "Efficiency (%)": f64, "Dividing Wavelength (nm)": f64, "Light Power Density (W/m^2)": f64, "Total Light Power Density (W/m^2)": f64}
  "IV Single Measurement.gtype" = cluster{"Voltage (V)": f64[], "Current (A)": f64[], "Current Density (A/m^2)": f64[], "Dividing Wavelength (nm)": f64, "Light Power Density (W/m^2)": f64, "Total Light Power Density (W/m^2)": f64}
diagram:
  # This SubVI Calculates the point of maximum generated power
  # and calculates the filling factor taking into account the previously
  # calculated Jsc and Voc.
  case ($"Error In") {
    frame Error, Default {
      w1 = $"Error In"
      w2 = $"IV Sweep Data In"
    }
    frame No Error {
      Property Node(instance in=$"IV Single Measurement") -> ("Voltage (V)"=w3, "Current Density (A/m^2)"=w4, "Total Light Power Density (W/m^2)"=w5, "Light Power Density (W/m^2)"=w6)
      Property Node(instance in=$"IV Sweep Data In") -> ("Voc (V)"=w7, "Jsc (A/m^2)"=w8, instance out=w9)
      Multiply(w7, w8) -> w10
      Absolute Value(x=w10) -> w11
      Multiply(w3, w4) -> w12
      Array Max And Min(array=w12) -> (min value=w13)
      Absolute Value(x=w13) -> w14
      Multiply(w14, 100) -> w15
      Divide(x=w15, y=w11) -> w16
      In Range And Coerce(lower limit=0, upper limit=100, x=w16) -> (In Range?=w17, coerced(x)=w18)
      Select(s=w17, t=w18, f=0) -> w19
      Multiply(w3, w4) -> w20
      Array Max And Min(array=w20) -> (min value=w21)
      Absolute Value(x=w21) -> w22
      case ($"Full Spectrum Reference?") {
        frame False, Default {
          Divide(x=w22, y=w6) -> w23
        }
        frame True {
          Divide(x=w22, y=w5) -> w23
        }
      }
      Multiply(w23, 100) -> w24
      Property Node(instance in=w9, "FF (%)"=w19, "Efficiency (%)"=w24, "Total Light Power Density (W/m^2)"=w5, "Light Power Density (W/m^2)"=w6) -> (instance out=w2)
      w1 = $"Error In"
    }
  }
  $"Error Out" <- w1
  $"IV Sweep Data Out" <- w2
