vi "Jsc and Voc.gvi"   [LabVIEW NXG 5.0.0]
inputs:
  "Error In": error
  "IV Single Measurement": "IV Single Measurement.gtype"
  "Points For Average": i32
outputs:
  "Error Out": error
  "IV Sweep Data Out": "IV Refined Single Sweep Data.gtype"
types:
  "IV Refined Single Sweep Data.gtype" = cluster{"Rs (Ω · m^2)": f64, "Rsh (Ω · m^2)": f64, "Jsc (A/m^2)": f64, "Voc (V)": f64, "FF (%)": f64, "Efficiency (%)": f64, "Dividing Wavelength (nm)": f64, "Light Power Density (W/m^2)": f64, "Total Light Power Density (W/m^2)": f64}
  T1 = cluster{"Isc (A)": f64, "Voc (V)": f64, "FF (%)": f64, "Rs (Ω)": f64, "Rsh (Ω)": f64}
  "IV Single Measurement.gtype" = cluster{"Voltage (V)": f64[], "Current (A)": f64[], "Current Density (A/m^2)": f64[], "Dividing Wavelength (nm)": f64, "Light Power Density (W/m^2)": f64, "Total Light Power Density (W/m^2)": f64, "Smart Sweep Data": T1}
uses:
  Rainbow Measurement Setup::Side Functions::Messages And Prompts::FGV Cancel Prompts until Finished Routine.gvi
  Rainbow Measurement Setup::Side Functions::Utilities::Array Operations::Find Closest In Array.gvi
  NI::Analysis::Fitting::Linear Fit.gvi
diagram:
  # This SubVI Takes the Voltage and the current data arrays and searches for the places where they cross both the x and the y axis. If found within tolerance we then obtain the surrounding
  # points for average and we perform a linear fit around those points to extract the parameters of the fitting line around those regions. With the parameters we extract the intersection points
  # for the Jsc and the Voc and we also extract the slopes for the Rs and the Rsh
  case ($"Error In") {
    frame Error, Default {
      w1 = $"Error In"
      w2 = default
    }
    frame No Error {
      Property Node(instance in=$"IV Single Measurement") -> ("Voltage (V)"=w3, "Current Density (A/m^2)"=w4, "Dividing Wavelength (nm)"=w5, "Light Power Density (W/m^2)"=w6)
      call "FGV Cancel Prompts until Finished Routine.gvi"(Error In=$"Error In", FGV Instructions="Read State") -> (Prompt? Out=w7, Error Out=w8)
      Array Max And Min(array=w3) -> (max value=w9, min value=w10)
      Subtract(x=w9, y=w10) -> w11
      Divide(x=w11, y=6) -> w12
      call "Find Closest In Array.gvi"(Array In=w3, Desired Value=0, Tolerance=w12, Error In=w8) -> (Closest Value Index=w13, Within Tolerance?=w14, Error Out=w15)
      Array Max And Min(array=w4) -> (max value=w16, min value=w17)
      Subtract(x=w16, y=w17) -> w18
      Divide(x=w18, y=6) -> w19
      call "Find Closest In Array.gvi"(Array In=w4, Desired Value=0, Tolerance=w19, Error In=w15) -> (Closest Value Index=w20, Within Tolerance?=w21, Error Out=w22)
      To Double Precision Float(number=$"Points For Average") -> w23
      To Double Precision Float(number=2) -> w24
      Divide(x=w23, y=w24) -> w25
      Round Toward Negative Infinity(x=w25) -> w26
      To Signed 32 Bit Integer(number=w26) -> w27
      Array Size(array=w3) -> (size(s)=w28)
      Add(w20, w27) -> w29
      Is Greater(x=w28, y=w29) -> w30
      Subtract(x=w20, y=w27) -> w31
      Is Greater Than 0(x=w31) -> w32
      Logical And(w30, w32) -> w33
      Array Size(array=w4) -> (size(s)=w34)
      Add(w13, w27) -> w35
      Is Greater(x=w34, y=w35) -> w36
      Subtract(x=w13, y=w27) -> w37
      Is Greater Than 0(x=w37) -> w38
      Logical And(w36, w38) -> w39
      Is Greater Than 0(x=w20) -> w40
      Is Greater Than 0(x=w13) -> w41
      Logical And(w33, w40, w39, w41, w14, w21) -> w42
      case (w42) {
        frame False, Default {
          w47 = "There have been some problems with the calculations of the Jsc and the Voc:"
          Concatenate Strings(w47, "\r", "\r") -> w48
          w49 = "The amount of points close to the J=0 region is insuficient. Try Extending the Electrical Sweep Range."
          Concatenate Strings(w49, "\r", "\r") -> w50
          Select(s=w33, t="", f=w50) -> w51
          w52 = "The amount of points close to the V=0 region is insuficient. Try Extending the Electrical Sweep Range."
          Concatenate Strings(w52, "\r", "\r") -> w53
          Select(s=w39, t="", f=w53) -> w54
          Logical And(w21, w40) -> w55
          w56 = "Could not find a point where J = 0 A. (J<0.01 A) Please make sure that the selected max and min Voltages are correct."
          Concatenate Strings(w56, "\r", "\r") -> w57
          Select(s=w55, t="", f=w57) -> w58
          Logical And(w14, w41) -> w59
          w60 = "Could not find a point where V = 0 V. (V<0.2 V) Please make sure that the selected max and min Voltages are correct."
          Concatenate Strings(w60, "\r", "\r") -> w61
          Select(s=w59, t="", f=w61) -> w62
          Concatenate Strings(w48, w51, w54, w58, w62) -> w63
          case (w7) {
            frame False, Default {
              w1 = w22
            }
            frame True {
              Two Button Dialog(F button name ("Cancel")="Okay you can stop\ntelling me this, thanks.", T button name ("OK")="Okay Sorry", message=w63) -> (T Button?=w64)
              call "FGV Cancel Prompts until Finished Routine.gvi"(Error In=w22, FGV Instructions="Set State", Prompt? In=w64) -> (Error Out=w1)
            }
          }
          w43 = default
          w44 = default
          w45 = default
          w46 = default
        }
        frame True {
          # w20: Voc Index
          # w3: Voltage Values
          Subtract(x=w20, y=w27) -> w65
          Array Subset(array=w4, index0=w65, length0=$"Points For Average") -> w66
          Array Subset(array=w3, index0=w65, length0=$"Points For Average") -> w67
          call "Linear Fit.gvi"(method="Least Square"(0), y=w66, x=w67, error in=w22) -> (slope=w68, intercept=w69, error out=w70)
          Reciprocal(x=w68) -> w71
          In Range And Coerce(lower limit=-0.001, upper limit=1000000, x=w71) -> (coerced(x)=w43)
          # w13: Jsc Index
          # w4: Current Density Values
          Subtract(x=w13, y=w27) -> w72
          Array Subset(array=w4, index0=w72, length0=$"Points For Average") -> w73
          Array Subset(array=w3, index0=w72, length0=$"Points For Average") -> w74
          call "Linear Fit.gvi"(method="Least Square"(0), y=w73, x=w74, error in=w70) -> (slope=w75, intercept=w44, error out=w1)
          Reciprocal(x=w75) -> w76
          In Range And Coerce(lower limit=-0.001, upper limit=1000000, x=w76) -> (coerced(x)=w46)
          Negate(x=w69) -> w77
          Divide(x=w77, y=w68) -> w45
        }
      }
      Property Node(instance in="IV Refined Single Sweep Data.gtype" {all zero or empty}, "Rs (Ω · m^2)"=w43, "Rsh (Ω · m^2)"=w46, "Jsc (A/m^2)"=w44, "Voc (V)"=w45, "Dividing Wavelength (nm)"=w5, "Light Power Density (W/m^2)"=w6) -> (instance out=w2)
    }
  }
  $"IV Sweep Data Out" <- w2
  $"Error Out" <- w1
