vi "SRM IV Parameters Calculator.gvi"   [LabVIEW NXG 5.0.0]
inputs:
  "Error In": error
  "SRM Mega Cluster In": "SRM Mega Cluster.gtype"
outputs:
  "Error Out": error
  "SRM Mega Cluster Out": "SRM Mega Cluster.gtype"
  "SRM sweep live parameters FGV Cluster Out": "SRM Sweep Live Parameters FGV Cluster.gtype"
types:
  "SRM Specific Parameters.gtype" = cluster{"Max (V)": f64, "Min (V)": f64, "V Points": u32, "Current Range (A)": f64, "Autorange": bool, "Sweep Dir": bool, "Current Averages": u32, "Max (A)": f64, "Integration Time": f64, "Cell Area (m^2)": f64}
  "Raibow Sweep Selector.gtype" = enum{"Red Sweep", "Blue Sweep", "Full Sweep Red First", "Full Sweep Blue First"}
  "Rainbow Sweep Param Selector.gtype" = cluster{"Raibow Sweep Selector": "Raibow Sweep Selector.gtype", "Max Wavelength (nm)": f64, "Min Wavelength (nm)": f64, "Wavelength Step (nm)": f64, "Rainbow Sweep Type Selector": "Rainbow Sweep Type Selector.gtype"}
  "Rainbow Sweep Types.gtype" = enum{"Red Sweep Closing", "Red Sweep Opening", "Blue Sweep Closing", "Blue Sweep Opening"}
  "IV Full Data Cluster.gtype" = cluster{"IV Measurements Array": "IV Single Measurement.gtype"[], "Rainbow Sweep Types": "Rainbow Sweep Types.gtype", "IV Refined Data": "IV Refined Full Sweep Data.gtype"}
  "IV Full Raw Data.gtype" = cluster{"Rainbow Sweep Types": "Rainbow Sweep Types.gtype", "IV Raw Data Array": "IV Single Measurement.gtype"[]}
  "SRM Mega Cluster.gtype" = cluster{"SRM Specific Parameters": "SRM Specific Parameters.gtype", "Rainbow Sweep Parameters SRM": "Rainbow Sweep Param Selector.gtype", "SRM Full IV data Array": "IV Full Data Cluster.gtype"[], "Full IV Curve Raw Data": "IV Full Raw Data.gtype"[]}
  "IV Single Measurement.gtype" = cluster{"Voltage": f64[], "Current": f64[], "Current Density": f64[], "Dividing Wavelength": f64, "Light Power": f64, "Total Light Power": f64}
  "SRM Single Plot Cluster.gtype" = cluster{"Voltage": f64[], "Current Density": f64[]}
  "SRM Sweep Live Parameters.gtype" = cluster{"Current Wavelength (nm)": f64, "Rainbow Sweep Types": "Rainbow Sweep Types.gtype", "Finished Measurement?": bool}
  "SRM Sweep Live Parameters FGV Cluster.gtype" = cluster{"IV Single Measurement Array": "IV Single Measurement.gtype"[], "SRM Sweep type combo box selction": string, "IV Single Measurement Plot Array": "SRM Single Plot Cluster.gtype"[], "SRM Live Parameters": "SRM Sweep Live Parameters.gtype", "Counter": i32, "Full IV Data Array": "IV Full Raw Data.gtype"[], "Combobox Reference": "ComboBoxSelector reference", "Refresh now": bool, "Graph Reference": "Graph reference"}
  "IV Refined Full Sweep Data.gtype" = cluster{"Rs (Ω/m^2)": f64[], "Rsh (Ω/m^2)": f64[], "Jsc (A/m^2)": f64[], "Voc (V)": f64[], "FF (%)": f64[], "Efficiency (%)": f64[], "Dividing Wavelength (nm)": f64[], "Light Power (W)": f64[]}
uses:
  Rainbow Measurement Setup::Main Functions::Rainbow Measurement::Cell Single Rainbow Measurement::IV Calculations::Jsc and Voc.gvi
  Rainbow Measurement Setup::Main Functions::Rainbow Measurement::Cell Single Rainbow Measurement::IV Calculations::FF and Efficiency.gvi
diagram:
  # This SubVI takes raw IV Data in and transforms it into computed
  # IV Sweep data with all the calculated parameters. Then it stores it all
  # into an array with all the information so that it can be later saved and processed
  case ($"Error In") {
    frame Error, Default {
      w1 = $"Error In"
      w2 = $"SRM Mega Cluster In"
      w3 = default
    }
    frame No Error {
      Property Node(instance in=$"SRM Mega Cluster In") -> ("Full IV Curve Raw Data"=w4, instance out=w5)
      w6 = "SRM Sweep Live Parameters FGV Cluster.gtype" {all zero or empty}
      Property Node(instance in=w6, "Full IV Data Array"=w4, "Refresh now"=TRUE, "SRM Live Parameters:Finished Measurement?"=TRUE) -> (instance out=w3)
      s1 = $"Error In"  # shift register
      s2 = w5  # shift register
      for {
        w7 = each element of w4
        Property Node(instance in=w7) -> ("Rainbow Sweep Types"=w9, "IV Raw Data Array"=w10)
        s3 = s1  # shift register
        for {
          w11 = each element of w10
          call "Jsc and Voc.gvi"(IV Single Measurement=w11, Points For Average=5, Error In=s3) -> (IV Sweep Data Out=w20, Error Out=w21)
          call "FF and Efficiency.gvi"(IV Sweep Data In=w20, IV Single Measurement=w11, Error In=w21) -> (IV Sweep Data Out=w22, Error Out=w23)
          Property Node(instance in=w22) -> ("Rs (Ω/m^2)"=w24, "Rsh (Ω/m^2)"=w25, "Jsc (A/m^2)"=w26, "Voc (V)"=w27, "FF (%)"=w28, "Efficiency (%)"=w29, "Dividing Wavelength"=w30, "Light Power"=w31)
          append w31 to w12
          append w30 to w13
          append w29 to w14
          append w28 to w15
          append w27 to w16
          append w26 to w17
          append w25 to w18
          append w24 to w19
          next s3 = w23
        }
        Property Node(instance in="IV Refined Full Sweep Data.gtype" {all zero or empty}, "Rs (Ω/m^2)"=w19, "Rsh (Ω/m^2)"=w18, "Jsc (A/m^2)"=w17, "Voc (V)"=w16, "FF (%)"=w15, "Efficiency (%)"=w14, "Dividing Wavelength (nm)"=w13, "Light Power (W)"=w12) -> (instance out=w32)
        Property Node(instance in="IV Full Data Cluster.gtype" {all zero or empty}, "IV Measurements Array"=w10, "Rainbow Sweep Types"=w9, "IV Refined Data"=w32) -> (instance out=w33)
        append w33 to w8
        next s1 = s3
      }
      Property Node(instance in=s2, "SRM Full IV data Array"=w8) -> (instance out=w2)
      w1 = s1
    }
  }
  $"SRM sweep live parameters FGV Cluster Out" <- w3
  $"Error Out" <- w1
  $"SRM Mega Cluster Out" <- w2
