vi "New Light Calibration Enqueue.gvi"   [LabVIEW NXG 5.0.0]
inputs:
  "Queue In": Queue<"Queue Instructions Control.gtype">
  "Error In": error
  "Misc Data Mega Cluster In": "Misc Data Mega Cluster.gtype"
outputs:
  "Queue Out": Queue<"Queue Instructions Control.gtype">
  "Error Out": error
types:
  "Queue Instructions Control.gtype" = enum{"Undefined State", "Debug Check", "Initialize App", "Idle", "Light Power Calibration", "Rainbow Single Measurement", "Light Calibration Irradiance", "Light Calibration Spectral Density", "Light Calibration Power Density", "Stand Alone Photodetector Measurement", "MSpot Spectrum Calibration", "Move XZ Stage", "Change Cell", "Update All Info Meta Cluster", "Access TXT File", "Stop App"}
  "Full Reference Cluster.gtype" = cluster{"Enum Reference Cluster": "Enum Control Reference Cluster.gtype", "Boolean Reference Cluster": "Boolean Control Reference Cluster.gtype", "Numeric Reference Cluster": "Numeric Control Reference Cluster.gtype", "Numeric Cluster Reference Cluster": "Numeric Cluster Reference Cluster.gtype", "Path Reference Cluster": "Path Reference Cluster.gtype", "Cluster Reference Cluster": "Cluster Reference Cluster.gtype", "XZ Stage Controls Reference Cluster": "XZ Stage Controls Reference Cluster.gtype"}
  "Cell Naming Cluster.gtype" = cluster{"Cell Label": string, "Sample Prefix": string, "Author Initials": string, "Current Date": string, "Batch Name": string}
  T1 = cluster{"X Coordinate (mm)": f64, "Z Coordinate (mm)": f64}
  T2 = cluster{"X Coordinate (mm)": f64, "Z Coordinate (mm)": f64, "Vertical Spacing (mm)": f64}
  "XZ All Position Cluster.gtype" = cluster{"Diffusor Coordinates": T1, "Photodetector Coordinates": T1, "Cell R.01 Coordinates": T2}
  T3 = cluster{"Thorlabs Motor Serial Number File Path": path, "Default Data Saving Location": path}
  "Misc Data Mega Cluster.gtype" = cluster{"Full Reference Cluster": "Full Reference Cluster.gtype", "Cell Naming Cluster": "Cell Naming Cluster.gtype", "All XZ Position Cluster": "XZ All Position Cluster.gtype", "All Paths": T3}
uses:
  Rainbow Measurement Setup::Side Functions::Utilities::Time Related Operations::Wait ms.gvi
diagram:
  case ($"Error In") {
    frame Error, Default {
      w1 = $"Queue In"
      w2 = $"Error In"
    }
    frame No Error {
      Property Node(instance in=$"Misc Data Mega Cluster In") -> ("Full Reference Cluster:Enum Reference Cluster:Rainbow Measurement tab"=w3)
      Enqueue Element(element="Light Power Calibration", error in=$"Error In", queue=$"Queue In") -> (error out=w4, queue out=w1)
      Property Node(instance in=w3, "ValueSignaling"=0, error in=w4) -> (error out=w5)
      call "Wait ms.gvi"(Error In=w5, Milliseconds to Wait=250) -> (Error Out=w2)
    }
  }
  $"Queue Out" <- w1
  $"Error Out" <- w2
