vi "SRM Wrong Calibration Files Prompt.gvi"   [LabVIEW NXG 5.0.0]
inputs:
  "Error In": error
  "Rainbow Sweep Param Selector In": "Rainbow Sweep Param Selector.gtype" = {0, 1100, 300, 1, 1, 0}
  "Light Power Calibration Data In": "Light Power Calibration Data.gtype"
outputs:
  "Error Out": error
  "Rainbow Sweep Parameters Selector Out": "Rainbow Sweep Param Selector.gtype"
  "Cancelled Measurement?": bool
panel indicators:
  "Light Power Calibration Data Out": "Light Power Calibration Data.gtype"
types:
  "Raibow Sweep Selector.gtype" = enum{"Red Sweep", "Blue Sweep", "Full Sweep Red First", "Full Sweep Blue First"}
  T1 = enum{"Red Sweep Closing", "Red Sweep Opening", "Red Sweep Both Ways"}
  T2 = enum{"Blue Sweep Opening", "Blue Sweep Closing", "Blue Sweep Both Ways"}
  "Rainbow Sweep Type Selector.gtype" = cluster{"Red Sweep Mode": T1, "Blue Sweep Mode": T2}
  "Rainbow Sweep Param Selector.gtype" = cluster{"Raibow Sweep Selector": "Raibow Sweep Selector.gtype", "Max Wavelength (nm)": f64, "Min Wavelength (nm)": f64, "Wavelength Step (nm)": f64, "Rainbow Sweep Type Selector": "Rainbow Sweep Type Selector.gtype"}
  T3 = cluster{"Dividing Wavelength Array": f64[], "Measured Power Array": f64[]}
  "Rainbow Sweep Types.gtype" = enum{"Red Sweep Closing", "Red Sweep Opening", "Blue Sweep Closing", "Blue Sweep Opening"}
  "Light Power Calibration Data.gtype" = cluster{"Single Light Calibration": T3, "Rainbow Sweep Types": "Rainbow Sweep Types.gtype"}
uses:
  Rainbow Measurement Setup::Side Functions::Utilities::Array Parameters Calculation.gvi
  Rainbow Measurement Setup::Main Functions::Rainbow Measurement::Cell Single Rainbow Measurement::LPC Check::SRM Sweep parameter Mismatch.gvi
  Rainbow Measurement Setup::Main Functions::Rainbow Measurement::Cell Single Rainbow Measurement::LPC Check::SRM Rainbow Parameter Rewritter.gvi
diagram:
  case ($"Error In") {
    frame Error, Default {
      w1 = $"Error In"
      w2 = $"Light Power Calibration Data In"
      w3 = $"Rainbow Sweep Param Selector In"
      w4 = default
    }
    frame No Error {
      Property Node(instance in=$"Light Power Calibration Data In") -> ("Single Light Calibration:Dividing Wavelength Array"=w5, "Rainbow Sweep Types"=w6, instance out=w7)
      Property Node(instance in=$"Rainbow Sweep Param Selector In") -> ("Wavelength Step (nm)"=w8, "Max Wavelength (nm)"=w9, "Min Wavelength (nm)"=w10, instance out=w11)
      call "Array Parameters Calculation.gvi"(Input Array 1D=w5, Range Value 1=w9, Range Value 2=w10, Error In=$"Error In") -> (Constant Steps?=w12, Step Value=w13, In Range?=w14, Error Out=w15)
      Is Equal(x=w13, y=w8) -> w16
      Logical And(w16, w14, w12) -> w17
      call "SRM Sweep parameter Mismatch.gvi"(Wavelength Step (nm)=w13, Mismatch?=w17, Rainbow Sweep Types=w6, Wavelenght Array=w5, Error In=w15, Wavelength Step Equal?=w16, In Range?=w14, Constant Steps?=w12) -> (Desired Operation=w18, Error Out=w19)
      call "SRM Rainbow Parameter Rewritter.gvi"(Light Power Calibration Data In=w7, Rainbow Sweep Parameters Selector In=w11, Desired Operation=w18, Error In=w19) -> (Light Power Calibration Data Out=w2, Rainbow Sweep Parameters Selector Out=w3, Cancelled Measurement?=w4, Error Out=w1)
    }
  }
  $"Light Power Calibration Data Out" <- w2
  $"Rainbow Sweep Parameters Selector Out" <- w3
  $"Cancelled Measurement?" <- w4
  $"Error Out" <- w1
