vi "SRM FGV Read Handler.gvi"   [LabVIEW NXG 5.0.0]
inputs:
  "SRM sweep live parameters FGV Cluster In": "SRM Sweep Live Parameters FGV Cluster.gtype"
  "Error In": error
outputs:
  "SRM sweep live parameters FGV Cluster Out": "SRM Sweep Live Parameters FGV Cluster.gtype"
  "Error Out": error
types:
  "IV Single Measurement.gtype" = cluster{"Voltage": f64[], "Current": f64[], "Current Density": f64[], "Dividing Wavelength": f64, "Light Power": f64}
  "SRM Single Plot Cluster.gtype" = cluster{"Voltage": f64[], "Current Density": f64[]}
  "Rainbow Sweep Types.gtype" = enum{"Red Sweep Closing", "Red Sweep Opening", "Blue Sweep Closing", "Blue Sweep Opening"}
  "SRM Sweep Live Parameters.gtype" = cluster{"Current Wavelength (nm)": f64, "Rainbow Sweep Types": "Rainbow Sweep Types.gtype", "Finished Measurement?": bool}
  "IV Full Raw Data.gtype" = cluster{"Rainbow Sweep Types": "Rainbow Sweep Types.gtype", "IV Raw Data Array": "IV Single Measurement.gtype"[]}
  "SRM Sweep Live Parameters FGV Cluster.gtype" = cluster{"IV Single Measurement Array": "IV Single Measurement.gtype"[], "SRM Sweep type combo box selction": string, "IV Single Measurement Plot Array": "SRM Single Plot Cluster.gtype"[], "SRM Live Parameters": "SRM Sweep Live Parameters.gtype", "Counter": i32, "Full IV Data Array": "IV Full Raw Data.gtype"[], "Combobox Reference": "ComboBoxSelector reference", "Graph Reference": "Graph reference", "Refresh now": bool}
uses:
  Rainbow Measurement Setup::Main Functions::Rainbow Measurement::Cell Single Rainbow Measurement::Plotting::SRM Raw Data Graph Adapter.gvi
diagram:
  # This SubVI Takes care of selecting the right set of data to plot from the SRM Sweep Raw Data and it also sets both the name of the available plots and the dividing wavelength that corresponds to each and
  # every plot within the graph. It does so every now and then to prevent being too wasteful on resources.
  case ($"Error In") {
    frame Error, Default {
      w1 = $"Error In"
      w2 = $"SRM sweep live parameters FGV Cluster In"
    }
    frame No Error {
      Property Node(instance in=$"SRM sweep live parameters FGV Cluster In") -> ("Graph Reference"=w3, "Combobox Reference"=w4, "SRM Live Parameters:Finished Measurement?"=w5, "Full IV Data Array"=w6, "Counter"=w7, "SRM Sweep type combo box selction"=w8, "IV Single Measurement Plot Array"=w9, "IV Single Measurement Array"=w10, "Refresh now"=w11, instance out=w12)
      Not(x=w5) -> w13
      Property Node(instance in=w4, "Disabled"=w13, error in=$"Error In") -> ("Value"=w14, error out=w15, instance out=w16)
      Is Not Equal(x=w14, y=w8) -> w17
      Logical Or(w17, w11) -> w18
      case (w18) {
        frame False, Default {
          w19 = w9
          w20 = w15
          w21 = w10
          w22 = w16
        }
        frame True {
          for {
            w23 = each element of w6
            Property Node(instance in=w23) -> ("Rainbow Sweep Types"=w24, "IV Raw Data Array"=w25)
            Format Into String(w24) -> w26
            Is Equal(x=w14, y=w26) -> w27
            w21 = w25 if w27
          }
          call "SRM Raw Data Graph Adapter.gvi"(IV Raw Data Array=w21, Error In=w15) -> (IV Plot Out=w19, Error Out=w20)
          w22 = w16
        }
      }
      Increment(x=w7) -> w28
      Is Greater(x=w28, y=50) -> w29
      Logical Or(w29, w17, w11) -> w30
      case (w30) {
        frame False, Default {
          w1 = w20
          w31 = w28
        }
        frame True {
          s1 = w20  # shift register
          for (iteration -> i1) {
            w32 = each element of w21
            Property Node(instance in=w3, "ActivePlot"=i1, error in=s1) -> ("Plot"=w33, error out=w34)
            Property Node(instance in=w32) -> ("Dividing Wavelength"=w35)
            Format Into String(formatString="%d", w35) -> w36
            Concatenate Strings(w36, " nm") -> w37
            Property Node(instance in=w33, "Name"=w37, error in=w34) -> (error out=w38, instance out=w39)
            next s1 = w38
          }
          for {
            w40 = each element of w6
            Property Node(instance in=w40) -> ("Rainbow Sweep Types"=w42)
            Format Into String(w42) -> w43
            append w43 to w41
          }
          Property Node(instance in=w22, "Items"=w41, error in=s1) -> (error out=w1)
          w31 = 0
        }
      }
      Property Node(instance in=w12, "Counter"=w31, "SRM Sweep type combo box selction"=w14, "IV Single Measurement Plot Array"=w19) -> (instance out=w2)
    }
  }
  $"SRM sweep live parameters FGV Cluster Out" <- w2
  $"Error Out" <- w1
