vi "SRM Sweep Refined FGV Read Handler.gvi"   [LabVIEW NXG 5.0.0]
inputs:
  "Full Reference Cluster In": "Full Reference Cluster.gtype"
  "IV Refined Data Plot": "SRM IV Refined Data Plot.gtype"[]
  "Error In": error
outputs:
  "Full Reference Cluster Out": "Full Reference Cluster.gtype"
  "IV Extracted Parameters Plot": T8
  "Error Out": error
types:
  T1 = cluster{"Dividing Wavelength (nm)": f64[], "Efficiency (%)": f64[]}
  T2 = cluster{"Dividing Wavelength (nm)": f64[], "Jsc (A/m^2)": f64[]}
  T3 = cluster{"Dividing Wavelength (nm)": f64[], "Voc (V)": f64[]}
  T4 = cluster{"Dividing Wavelength (nm)": f64[], "Light Power Density (W/m^2)": f64[]}
  T5 = cluster{"Dividing Wavelength (nm)": f64[], "FF (%)": f64[]}
  T6 = cluster{"Dividing Wavelength (nm)": f64[], "Rs (Ω/m^2)": f64[]}
  T7 = cluster{"Dividing Wavelength (nm)": f64[], "Rsh (Ω/m^2)": f64[]}
  "Rainbow Sweep Types.gtype" = enum{"Red Sweep Closing", "Red Sweep Opening", "Blue Sweep Closing", "Blue Sweep Opening"}
  "SRM IV Refined Data Plot.gtype" = cluster{"Efficiency Plot": T1, "Jsc Plot": T2, "Voc Plot": T3, "Light Power Density Plot": T4, "FF Plot": T5, "Rs Plot": T6, "Rsh Plot": T7, "Rainbow Sweep Types": "Rainbow Sweep Types.gtype", "Total Light Power Density (W/m^2)": f64}
  T8 = cluster{"Dividing Wavelength (nm)": f64[], "Element 2": f64[]}
  "Enum Control Reference Cluster.gtype" = cluster{"Main Tab": "TabControl reference", "Rainbow Measurement tab": "TabControl reference", "Configuration tab": "TabControl reference", "Light Calibration tab": "TabControl reference", "Current State": "EnumSelector reference", "SRM Plot Parameter Selector Ref": "EnumSelector reference"}
  "Boolean Control Reference Cluster.gtype" = cluster{"Custom date": "CheckBox reference", "Label Info Missing Error": "BooleanControl reference"}
  "Numeric Control Reference Cluster.gtype" = cluster{"Beam Power Density": "IntensityGraph reference"[][], "Irradiance Calibration": "Graph reference"[], "SRM Light Power Density Ref": "NumericTextBoxDouble reference"}
  "Numeric Cluster Reference Cluster.gtype" = cluster{"LPC Parameters Ref": "Cluster reference", "Sweep Live Parameters LPC ref": "Cluster reference"}
  "Path Reference Cluster.gtype" = cluster{"Calibration Files Path": "PathSelector reference", "Default Data Saving Location": "PathSelector reference"}
  "Cluster Reference Cluster.gtype" = cluster{"Light Power Calibration": "Graph reference", "Rainbow Sweep Parameters RSM": "Cluster reference", "Rainbow Sweep Param Selector MSpot": "Cluster reference", "MSpot Spectrum Calibration Parameters": "Cluster reference", "SRM Raw Plot Rainbow Sweep Selector": "ComboBoxSelector reference", "SRM Refined Plot Rainbow Sweep Types": "ComboBoxSelector reference", "SRM Specific Parameters": "Cluster reference", "Label Info Error Label": "StringControl reference", "Sample Comments": "StringControl reference", "Cell Number": "StringControl reference", "Author Initials": "ComboBoxSelector reference", "Batch Name": "StringControl reference", "Sweep Live Parameters RSM": "Cluster reference", "Rainbow Sweep Parameters LPC": "Cluster reference", "XZ All Position Cluster": "Cluster reference", "State": "StringControl reference", "Current Substate": "StringControl reference", "Substate": "StringControl reference", "Current Date": "StringControl reference", "Sample Prefix": "StringControl reference", "IV Extracted Parameter Plot ": "Graph reference", "Light Power Calibration Data Ref": "ArrayViewer reference", "IV Plot Out Ref": "Graph reference"}
  "XZ Stage Controls Reference Cluster.gtype" = cluster{"Custom Position": "BooleanControl reference", "Set Position": "BooleanControl reference", "XZ Stage Active": "BooleanControl reference", "Release XZ Stage": "BooleanControl reference", "XZ Coordinates": "Cluster reference", "Activate XZ Stage": "BooleanControl reference", "XZ Stage Cell Reference": "EnumSelector reference"}
  "Full Reference Cluster.gtype" = cluster{"Enum Reference Cluster": "Enum Control Reference Cluster.gtype", "Boolean Reference Cluster": "Boolean Control Reference Cluster.gtype", "Numeric Reference Cluster": "Numeric Control Reference Cluster.gtype", "Numeric Cluster Reference Cluster": "Numeric Cluster Reference Cluster.gtype", "Path Reference Cluster": "Path Reference Cluster.gtype", "Cluster Reference Cluster": "Cluster Reference Cluster.gtype", "XZ Stage Controls Reference Cluster": "XZ Stage Controls Reference Cluster.gtype"}
diagram:
  # This SubVI Takes all the sweep types and scans for the selected one, and once it finds it
  # it outputs the selected data to the IV Extracted Parameters plot so that it can be correctly
  # plotted.
  case ($"Error In") {
    frame Error, Default {
      w1 = default
      w2 = $"Error In"
      w3 = $"Full Reference Cluster In"
    }
    frame No Error {
      Property Node(instance in=$"Full Reference Cluster In") -> ("Cluster Reference Cluster:SRM Refined Plot Rainbow Sweep Types"=w4, "Enum Reference Cluster:SRM Plot Parameter Selector Ref"=w5, "Numeric Reference Cluster:SRM Light Power Density Ref"=w6, instance out=w3)
      Property Node(instance in=w5, error in=$"Error In") -> ("Value"=w7, error out=w8)
      Property Node(instance in=w4, error in=w8) -> ("Value"=w9, error out=w10)
      s1 = w10  # shift register
      for {
        w11 = each element of $"IV Refined Data Plot"
        Property Node(instance in=w11) -> ("Rainbow Sweep Types"=w14, "Total Light Power Density (W/m^2)"=w15, instance out=w16)
        Format Into String(w14) -> w17
        Is Equal(x=w17, y=w9) -> w18
        w12 = w16 if w18
        w13 = w15 if w18
      }
      case (w7) {
        frame "Efficiency (%)", Default {
          Property Node(instance in=w12) -> ("Efficiency Plot"=w1)
        }
        frame "Jsc (A / m^2)" {
          Property Node(instance in=w12) -> ("Jsc Plot"=w1)
        }
        frame "Voc (V)" {
          Property Node(instance in=w12) -> ("Voc Plot"=w1)
        }
        frame "Light Power Density (W/m^2)" {
          Property Node(instance in=w12) -> ("Light Power Density Plot"=w1)
        }
        frame "FF (%)" {
          Property Node(instance in=w12) -> ("FF Plot"=w1)
        }
        frame "Rs (Ω · m^2)" {
          Property Node(instance in=w12) -> ("Rs Plot"=w1)
        }
        frame "Rsh (Ω · m^2)" {
          Property Node(instance in=w12) -> ("Rsh Plot"=w1)
        }
      }
      Property Node(instance in=w6, "Value"=w13, error in=s1) -> (error out=w2)
    }
  }
  $"Full Reference Cluster Out" <- w3
  $"IV Extracted Parameters Plot" <- w1
  $"Error Out" <- w2
