vi "SRM Extract Correct Calibration Data.gvi"   [LabVIEW NXG 5.0.0]
inputs:
  "LPC Mega Cluster In": "LPC Mega Cluster.gtype"
  "Rainbow Sweep Type": "Rainbow Sweep Types.gtype" = "Red Sweep Closing"
  "Error In": error
outputs:
  "Error Out": error
  "Extracted Light Power Calibration Data": "Light Power Calibration Data.gtype"
types:
  T1 = cluster{"Dividing Wavelength Array": f64[], "Measured Power Array": f64[]}
  "Rainbow Sweep Types.gtype" = enum{"Red Sweep Closing", "Red Sweep Opening", "Blue Sweep Closing", "Blue Sweep Opening"}
  "Light Power Calibration Data.gtype" = cluster{"Single Light Calibration": T1, "Rainbow Sweep Types": "Rainbow Sweep Types.gtype", "Total Light Power": f64}
  "Raibow Sweep Selector.gtype" = enum{"Red Sweep", "Blue Sweep", "Full Sweep Red First", "Full Sweep Blue First"}
  "Rainbow Sweep Param Selector.gtype" = cluster{"Raibow Sweep Selector": "Raibow Sweep Selector.gtype", "Max Wavelength (nm)": f64, "Min Wavelength (nm)": f64, "Wavelength Step (nm)": f64, "Rainbow Sweep Type Selector": "Rainbow Sweep Type Selector.gtype"}
  "Light power Calibration Parameters.gtype" = cluster{"Powermeter Averages": f64}
  "LPC Mega Cluster.gtype" = cluster{"Rainbow Sweep Parameters LPC": "Rainbow Sweep Param Selector.gtype", "LPC Specific Parameters": "Light power Calibration Parameters.gtype", "Light Power Calibration Data": "Light Power Calibration Data.gtype"[]}
diagram:
  # This subVI Extracts the LIght power calibration data that
  # matches the current desired sweep type, for the IV calculations
  case ($"Error In") {
    frame Error {
      w1 = "Light Power Calibration Data.gtype" {all zero or empty}
      w2 = $"Error In"
    }
    frame No Error {
      Property Node(instance in=$"LPC Mega Cluster In") -> ("Light Power Calibration Data"=w3)
      for {
        w4 = each element of w3
        Property Node(instance in=w4) -> ("Rainbow Sweep Types"=w5)
        Is Equal(x=w5, y=$"Rainbow Sweep Type") -> w6
        w1 = w4 if w6
        stop if w6
      }
      w2 = $"Error In"
    }
  }
  $"Error Out" <- w2
  $"Extracted Light Power Calibration Data" <- w1
