vi "SRM Extract Measured Power.gvi"   [LabVIEW NXG 5.0.0]
inputs:
  "Error In": error
  "Dividing Wavelength In": f64
  "Light Power Calibration Data In": "Light Power Calibration Data.gtype"
outputs:
  "Error Out": error
  "IV Single Measurement Out": "IV Single Measurement.gtype"
types:
  T1 = cluster{"Dividing Wavelength Array": f64[], "Measured Power Array": f64[]}
  "Rainbow Sweep Types.gtype" = enum{"Red Sweep Closing", "Red Sweep Opening", "Blue Sweep Closing", "Blue Sweep Opening"}
  "Light Power Calibration Data.gtype" = cluster{"Single Light Calibration": T1, "Rainbow Sweep Types": "Rainbow Sweep Types.gtype", "Total Light Power": f64}
  "IV Single Measurement.gtype" = cluster{"Voltage": f64[], "Current": f64[], "Current Density": f64[], "Dividing Wavelength": f64, "Light Power": f64, "Total Light Power": f64}
uses:
  Rainbow Measurement Setup::Side Functions::Messages And Prompts::FGV Cancel Prompts until Finished Routine.gvi
  Rainbow Measurement Setup::Side Functions::Utilities::Find Closest In Array.gvi
diagram:
  # This SubVI Finds the closest value to the
  # desired dividing wavelength and outputs
  # both the closest value and the power of the
  # beam at that measured value and stores them within
  # the IV Sweep Data Cluster
  # It also prompts the user in case the Dividing wavelength is
  # too far from the calibration one
  case ($"Error In") {
    frame Error, Default {
      w1 = $"Error In"
      w2 = "IV Single Measurement.gtype" {all zero or empty}
    }
    frame No Error {
      Property Node(instance in=$"Light Power Calibration Data In") -> ("Single Light Calibration:Dividing Wavelength Array"=w3, "Single Light Calibration:Measured Power Array"=w4, "Total Light Power"=w5)
      call "FGV Cancel Prompts until Finished Routine.gvi"(Error In=$"Error In", FGV Instructions="Read State") -> (Prompt? Out=w6, Error Out=w7)
      call "Find Closest In Array.gvi"(Array In=w3, Desired Value=$"Dividing Wavelength In", Tolerance=10, Error In=w7) -> (Closest Value Index=w8, Closest Value=w9, Within Tolerance?=w10, Error Out=w11)
      Array Index(array=w4) -> (out0[w8]=w12)
      Property Node(instance in="IV Single Measurement.gtype" {all zero or empty}, "Light Power"=w12, "Dividing Wavelength"=w9, "Total Light Power"=w5) -> (instance out=w2)
      Logical And(w6, not w10) -> w13
      case (w13) {
        frame True {
          w14 = """There has been some sort of problem with the calibration file
please reset the software. If the error persists contact Martí.
Error message: Error on the SRM Rainbow Sweep. Dividing 
wavelength not close enough to calibration div Wav."""
          Two Button Dialog(F button name ("Cancel")="Okay Do not ask\nme again please.", T button name ("OK")="Okay I'll do that.", message=w14) -> (T Button?=w15)
          call "FGV Cancel Prompts until Finished Routine.gvi"(Error In=w11, FGV Instructions="Set State", Prompt? In=w15) -> (Error Out=w1)
        }
        frame False {
          w1 = w11
        }
      }
    }
  }
  $"IV Single Measurement Out" <- w2
  $"Error Out" <- w1
