vi "SRM Sweep Live Parameters Extractor.gvi"   [LabVIEW NXG 5.0.0]
inputs:
  "Error In": error
  "SRM sweep live parameters Previous State": "SRM Sweep Live Parameters FGV Cluster.gtype"
  "SRM sweep live parameters New State": "SRM Sweep Live Parameters FGV Cluster.gtype"
outputs:
  "Error Out": error
  "SRM sweep live parameters Out": "SRM Sweep Live Parameters FGV Cluster.gtype"
types:
  "IV Single Measurement.gtype" = cluster{"Voltage": f64[], "Current": f64[], "Current Density": f64[], "Dividing Wavelength": f64, "Light Power": f64}
  "SRM Single Plot Cluster.gtype" = cluster{"Voltage": f64[], "Current Density": f64[]}
  "Rainbow Sweep Types.gtype" = enum{"Red Sweep Closing", "Red Sweep Opening", "Blue Sweep Closing", "Blue Sweep Opening"}
  "SRM Sweep Live Parameters.gtype" = cluster{"Current Wavelength (nm)": f64, "Rainbow Sweep Types": "Rainbow Sweep Types.gtype", "Finished Measurement?": bool}
  "IV Full Raw Data.gtype" = cluster{"Rainbow Sweep Types": "Rainbow Sweep Types.gtype", "IV Raw Data Array": "IV Single Measurement.gtype"[]}
  "SRM Sweep Live Parameters FGV Cluster.gtype" = cluster{"IV Single Measurement Array": "IV Single Measurement.gtype"[], "SRM Sweep type combo box selction": string, "IV Single Measurement Plot Array": "SRM Single Plot Cluster.gtype"[], "SRM Live Parameters": "SRM Sweep Live Parameters.gtype", "Counter": i32, "Full IV Data Array": "IV Full Raw Data.gtype"[], "Combobox Reference": "ComboBoxSelector reference", "Refresh now": bool, "Graph Reference": "Graph reference"}
uses:
  Rainbow Measurement Setup::Main Functions::Rainbow Measurement::Cell Single Rainbow Measurement::Plotting::SRM Raw Data Graph Adapter.gvi
diagram:
  # This SubVI Checks if the input cluster has some empty values and for each empty value it keeps the value it had before.
  # Otherwise it changes to the new value
  case ($"Error In") {
    frame Error, Default {
      w1 = $"Error In"
      w2 = $"SRM sweep live parameters Previous State"
    }
    frame No Error {
      Property Node(instance in=$"SRM sweep live parameters Previous State") -> ("Full IV Data Array"=w3, "IV Single Measurement Array"=w4, "SRM Live Parameters"=w5, "Combobox Reference"=w6, "Graph Reference"=w7, instance out=w8)
      Property Node(instance in=$"SRM sweep live parameters New State") -> ("Full IV Data Array"=w9, "IV Single Measurement Array"=w10, "SRM Live Parameters"=w11, "Combobox Reference"=w12, "Graph Reference"=w13, "Refresh now"=w14)
      Is Empty Array(array=w9) -> w15
      Select(s=w15, t=w3, f=w9) -> w16
      Is Empty Array(array=w10) -> w17
      Select(s=w17, t=w4, f=w10) -> w18
      Is Not A Number Or Path Or Refnum(number=w12) -> w19
      Select(s=w19, t=w6, f=w12) -> w20
      Is Not A Number Or Path Or Refnum(number=w13) -> w21
      Select(s=w21, t=w7, f=w13) -> w22
      call "SRM Raw Data Graph Adapter.gvi"(IV Raw Data Array=w18, Error In=$"Error In") -> (IV Plot Out=w23, Error Out=w24)
      Property Node(instance in=w11) -> ("Current Wavelength (nm)"=w25)
      Is Equal To 0(x=w25) -> w26
      Select(s=w26, t=w5, f=w11) -> w27
      case (w14) {
        frame False, Default {
          w1 = w24
          w28 = default
        }
        frame True {
          for {
            w29 = each element of w16
            Property Node(instance in=w29) -> ("Rainbow Sweep Types"=w30)
            Format Into String(w30) -> w31
          }
          Property Node(instance in=w20, "Value"=w31, error in=w24) -> (error out=w1)
          w28 = w14
        }
      }
      Property Node(instance in=w8, "Full IV Data Array"=w16, "IV Single Measurement Array"=w18, "IV Single Measurement Plot Array"=w23, "SRM Live Parameters"=w27, "Combobox Reference"=w20, "Graph Reference"=w22, "Refresh now"=w28) -> (instance out=w2)
    }
  }
  $"Error Out" <- w1
  $"SRM sweep live parameters Out" <- w2
