vi "Single Rainbow Measurement Subroutine.gvi"   [LabVIEW NXG 5.0.0]
inputs:
  "Error In": error
  "Instruction Queue In": Queue<"Queue Instructions Control.gtype">
  "Stand Alone?": bool
  "Debugging Cluster In": "Debugging Cluster.gtype"
  "Instrument Coms Info In": "Instrument Coms Info.gtype"
  "Default Data Saving Location": path
  "Cell Naming Cluster": "Cell Naming Cluster.gtype"
  "Full Reference Cluster": "Full Reference Cluster.gtype"
  "Rainbow Sweep Param Selector": "Rainbow Sweep Param Selector.gtype" = {0, 1100, 300, 1, 1, 0}
  "SRM Specific Parameters": "SRM Specific Parameters.gtype"
  "Light Power Calibration Data": "Light Power Calibration Data.gtype"[]
  "XZ All Position Cluster": "XZ All Position Cluster.gtype" = {188, 30, 39, 70, 146, 32.6, 0}
outputs:
  "Error Out": error
  "Instuments Coms Info Out": "Instrument Coms Info.gtype"
  "Debugging Cluster Out": "Debugging Cluster.gtype"
  "Instruction Queue Out": Queue<"Queue Instructions Control.gtype">
  "FulL IV data Cluster": "IV Full Data Cluster.gtype"[]
  "SRM Rainbow Parameters": "Rainbow Sweep Param Selector.gtype"
panel controls:
  "SRM Operation Control": "SRM Operation Control.gtype" = "New Measurement"
types:
  "Insturment Debugging Cluster.gtype" = cluster{"Keithley": bool, "Arduinos": bool, "Thorlabs Motors": bool, "Photodetector": bool, "Flame Spectr": bool}
  "Debugging Cluster.gtype" = cluster{"Debugging mode?": bool, "Initialize App": bool, "Insturment Debugging": "Insturment Debugging Cluster.gtype"}
  T1 = cluster{"Element 1": "VISA Instr", "Element 2": string}
  "Arduino Detection cluster control.gtype" = cluster{"XZ Stage Arduino Address": "VISA Instr", "XZ Stage Arduino Detected?": bool, "Multiplexer Arduino Detected?": bool, "Multiplexer Arduino Address": "VISA Instr", "Arduinos List": T1[], "XZ Stage Log": string, "Multiplexer Log": string}
  "Thorlabs Motors Serial Number In.gtype" = cluster{"Thorlabs Blue Motor": string, "Thorlabs Red Motor": string, "Blue Motor Homed?": bool, "Red Motor Homed?": bool}
  "Instrument Coms Info.gtype" = cluster{"Arduino Coms Info": "Arduino Detection cluster control.gtype", "Photodetector Names": string[], "Keythley Address": "VISA Instr", "Photodetector Detected?": bool, "Thorlabs Motors Detected?": bool, "Keithley Detected?": bool, "Thorlabs Motors Serial Number": "Thorlabs Motors Serial Number In.gtype", "Photodetector IVI session": "Ivi IviDefault", "Flame ID": string, "Flame Detected?": bool, "Flame Wrapper ID": u64}
  "Cell Naming Cluster.gtype" = cluster{"Cell Label": string, "Sample Prefix": string, "Author Initials": string, "Current Date": string, "Batch Name": string}
  "Raibow Sweep Selector.gtype" = enum{"Red Sweep", "Blue Sweep", "Full Sweep Red First", "Full Sweep Blue First"}
  T2 = enum{"Red Sweep Closing", "Red Sweep Opening", "Red Sweep Both Ways"}
  T3 = enum{"Blue Sweep Opening", "Blue Sweep Closing", "Blue Sweep Both Ways"}
  "Rainbow Sweep Type Selector.gtype" = cluster{"Red Sweep Mode": T2, "Blue Sweep Mode": T3}
  "Rainbow Sweep Param Selector.gtype" = cluster{"Raibow Sweep Selector": "Raibow Sweep Selector.gtype", "Max Wavelength (nm)": f64, "Min Wavelength (nm)": f64, "Wavelength Step (nm)": f64, "Rainbow Sweep Type Selector": "Rainbow Sweep Type Selector.gtype"}
  "Queue Instructions Control.gtype" = enum{"Undefined State", "Debug Check", "Initialize App", "Idle", "Light Power Calibration", "Rainbow Single Measurement", "Light Calibration Irradiance", "Light Calibration Spectral Density", "Light Calibration Power Density", "MSpot Spectrum Calibration", "Move XZ Stage", "Update All Info Meta Cluster", "Access TXT File", "Stop App"}
  T4 = cluster{"Dividing Wavelength Array": f64[], "Measured Power Array": f64[]}
  "Rainbow Sweep Types.gtype" = enum{"Red Sweep Closing", "Red Sweep Opening", "Blue Sweep Closing", "Blue Sweep Opening"}
  "Light Power Calibration Data.gtype" = cluster{"Single Light Calibration": T4, "Rainbow Sweep Types": "Rainbow Sweep Types.gtype"}
  "IV Single Measurement.gtype" = cluster{"Voltage": f64[], "Current": f64[], "Current Density": f64[], "Dividing Wavelength": f64, "Light Power": f64}
  "IV Refined Full Sweep Data.gtype" = cluster{"Rs (Ω/m^2)": f64[], "Rsh (Ω/m^2)": f64[], "Jsc (A/m^2)": f64[], "Voc (V)": f64[], "FF (%)": f64[], "Efficiency (%)": f64[], "Dividing Wavelength (nm)": f64[], "Light Power (W)": f64[]}
  "IV Full Data Cluster.gtype" = cluster{"IV Measurements Array": "IV Single Measurement.gtype"[], "Rainbow Sweep Types": "Rainbow Sweep Types.gtype", "IV Refined Data": "IV Refined Full Sweep Data.gtype"}
  "SRM Specific Parameters.gtype" = cluster{"Max (V)": f64, "Min (V)": f64, "V Points": u32, "Current Range (A)": f64, "Autorange": bool, "Sweep Dir": bool, "Current Averages": u32, "Max (A)": f64, "Integration Time": f64, "Cell Area (m^2)": f64}
  "SRM Operation Control.gtype" = enum{"New Measurement", "Load Measurement", "Save Measurement"}
  T5 = cluster{"X Coordinate (mm)": f64, "Z Coordinate (mm)": f64}
  T6 = cluster{"X Coordinate (mm)": f64, "Z Coordinate (mm)": f64, "Vertical Spacing (mm)": f64}
  "XZ All Position Cluster.gtype" = cluster{"Diffusor Coordinates": T5, "Photodetector Coordinates": T5, "Cell R.01 Coordinates": T6}
  "Enum Control Reference Cluster.gtype" = cluster{"Main Tab": "TabControl reference", "Rainbow Measurement tab": "TabControl reference", "Configuration tab": "TabControl reference", "Light Calibration tab": "TabControl reference", "SRM Plot Parameter Selector": "EnumSelector reference"}
  "Boolean Control Reference Cluster.gtype" = cluster{"Custem date": "CheckBox reference", "Label Info Missing Error": "BooleanControl reference"}
  "Numeric Control Reference Cluster.gtype" = cluster{"Beam Power Density": "IntensityGraph reference"[][], "Irradiance Calibration": "Graph reference"[]}
  "Numeric Cluster Reference Cluster.gtype" = cluster{"LPC Parameters": "Cluster reference", "Sweep Live Parameters LPC": "Cluster reference"}
  "Path Reference Cluster.gtype" = cluster{"Calibration Files Path": "PathSelector reference", "Default Data Saving Location": "PathSelector reference"}
  "Cluster Reference Cluster.gtype" = cluster{"Light Power Calibration": "Graph reference", "Light Power Calibration Data": "ArrayViewer reference", "Rainbow Sweep Parameters RSM": "Cluster reference", "Rainbow Sweep Param Selector MSpot": "Cluster reference", "MSpot Spectrum Calibration Parameters": "Cluster reference", "SRM Raw Plot Rainbow Sweep Selector": "ComboBoxSelector reference", "SRM Refined Plot Rainbow Sweep Types": "ComboBoxSelector reference", "SRM Specific Parameters": "Cluster reference", "Label Info Error Label": "StringControl reference", "Sample Comments": "StringControl reference", "Cell Number": "StringControl reference", "Author Initials": "ComboBoxSelector reference", "Batch Name": "StringControl reference", "IV Plot Out ": "Graph reference", "Sweep Live Parameters RSM": "Cluster reference", "Rainbow Sweep Parameters LPC": "Cluster reference", "XZ All Position Cluster": "Cluster reference"}
  "XZ Stage Controls Reference Cluster.gtype" = cluster{"Cell Label": "EnumSelector reference", "Custom Position": "BooleanControl reference", "Set Position": "BooleanControl reference", "XZ Stage Active": "BooleanControl reference", "Release XZ Stage": "BooleanControl reference", "XZ Coordinates": "Cluster reference", "Activate XZ Stage": "BooleanControl reference"}
  "Full Reference Cluster.gtype" = cluster{"Enum Reference Cluster": "Enum Control Reference Cluster.gtype", "Boolean Reference Cluster": "Boolean Control Reference Cluster.gtype", "Numeric Reference Cluster": "Numeric Control Reference Cluster.gtype", "Numeric Cluster Reference Cluster": "Numeric Cluster Reference Cluster.gtype", "Path Reference Cluster": "Path Reference Cluster.gtype", "Cluster Reference Cluster": "Cluster Reference Cluster.gtype", "XZ Stage Controls Reference Cluster": "XZ Stage Controls Reference Cluster.gtype"}
  "IV Full Raw Data.gtype" = cluster{"Rainbow Sweep Types": "Rainbow Sweep Types.gtype", "IV Raw Data Array": "IV Single Measurement.gtype"[]}
  "SRM Single Plot Cluster.gtype" = cluster{"Voltage": f64[], "Current Density": f64[]}
  "SRM Sweep Live Parameters.gtype" = cluster{"Current Wavelength (nm)": f64, "Rainbow Sweep Types": "Rainbow Sweep Types.gtype", "Finished Measurement?": bool}
  "SRM Sweep Live Parameters FGV Cluster.gtype" = cluster{"IV Single Measurement Array": "IV Single Measurement.gtype"[], "SRM Sweep type combo box selction": string, "IV Single Measurement Plot Array": "SRM Single Plot Cluster.gtype"[], "SRM Live Parameters": "SRM Sweep Live Parameters.gtype", "Counter": i32, "Full IV Data Array": "IV Full Raw Data.gtype"[], "Combobox Reference": "ComboBoxSelector reference", "Refresh now": bool, "Graph Reference": "Graph reference"}
uses:
  Rainbow Measurement Setup::Main Functions::Rainbow Measurement::Cell Single Rainbow Measurement::SRM Operation FGV.gvi
  Rainbow Measurement Setup::Main Functions::Instruction Queue::Current State::FGV Current State.gvi
  Rainbow Measurement Setup::Side Functions::Global Abort::FGV Global Abort.gvi
  Rainbow Measurement Setup::Main Functions::Rainbow Measurement::Cell Single Rainbow Measurement::SRM Start Calculator.gvi
  Rainbow Measurement Setup::Main Functions::Rainbow Measurement::Cell Single Rainbow Measurement::LPC Check::SRM Check Light Power Data.gvi
  Rainbow Measurement Setup::Side Functions::Instrument Control::Thorlabs Motors::Dividing Wavelength Control::Dividing Wavelength Calibration Data FGV.gvi
  Rainbow Measurement Setup::Side Functions::Instrument Control::Debug Cluster Instrument Extractor.gvi
  Rainbow Measurement Setup::Main Functions::One Time Calibrations::Beam Power Density::Specific Detect Instruments Subroutine.gvi
  Rainbow Measurement Setup::Side Functions::Instrument Control::Thorlabs Motors::Movement::KCube Move to 0 or Home.gvi
  Rainbow Measurement Setup::Side Functions::Instrument Control::Arduino::XZ Stage Arduino::XZ Stage Initialize And Home.gvi
  Rainbow Measurement Setup::Side Functions::Instrument Control::Arduino::XZ Stage Arduino::XZ Stage Move to Position.gvi
  Rainbow Measurement Setup::Side Functions::Instrument Control::Keithley::Keithley Initialize Subroutine.gvi
  Rainbow Measurement Setup::Main Functions::Rainbow Measurement::Cell Single Rainbow Measurement::SRM Rainbow Sweep.gvi
  Rainbow Measurement Setup::Side Functions::Instrument Control::Thorlabs Motors::Movement::KCube Motors Close.gvi
  Rainbow Measurement Setup::Side Functions::Instrument Control::Keithley::Keithley Close Subroutine.gvi
  Rainbow Measurement Setup::Main Functions::Rainbow Measurement::Cell Single Rainbow Measurement::IV Calculations::SRM IV Parameters Calculator.gvi
  Rainbow Measurement Setup::Main Functions::Rainbow Measurement::Cell Single Rainbow Measurement::SRM Live Parameters::SRM Sweep Live Parameters FGV.gvi
  Rainbow Measurement Setup::Main Functions::Rainbow Measurement::Cell Single Rainbow Measurement::Plotting::SRM Sweep Refined Data FGV.gvi
  Rainbow Measurement Setup::Main Functions::Rainbow Measurement::Cell Single Rainbow Measurement::File Handling::SRM Save Graphs Prompt.gvi
  Rainbow Measurement Setup::Main Functions::Rainbow Measurement::Cell Single Rainbow Measurement::File Handling::SRM file handling.gvi
  Rainbow Measurement Setup::Main Functions::Rainbow Measurement::Cell Single Rainbow Measurement::File Handling::SRM Load Prompt.gvi
  Rainbow Measurement Setup::Side Functions::Messages And Prompts::General Simple Prompt.gvi
  Rainbow Measurement Setup::Side Functions::Utilities::Wait ms.gvi
  Rainbow Measurement Setup::Side Functions::Utilities::Progress Handling::Progress FGV.gvi
diagram:
  # This SubVI Measures the Light power for each motor position for each sweep type and outputs the data so that it can be plotted
  # on the main window for checking and for calibration purposes
  case ($"Error In") {
    frame Error, Default {
      w1 = $"Error In"
      w2 = $"Instrument Coms Info In"
      w3 = $"Debugging Cluster In"
      w4 = $"Instruction Queue In"
      w5 = default
      w6 = $"Rainbow Sweep Param Selector"
    }
    frame No Error {
      call "SRM Operation FGV.gvi"(FGV Instructions="Read State", Error In=$"Error In") -> (SRM Operation Control Out=w7, Error Out=w8)
      Select(s=$"Stand Alone?", t=$"SRM Operation Control", f=w7) -> w9
      call "FGV Current State.gvi"(Current State Instructions="Set Current State and Substate", Current State="Rainbow Single Measurement", Current Substate="", Error In=w8) -> (Error Out=w10)
      s1 = w10  # shift register
      s2 = "Start App"  # shift register
      s2.prev1 = uninitialised  # shift register
      s3 = $"Debugging Cluster In"  # shift register
      s4 = $"Instrument Coms Info In"  # shift register
      s5 = $"Instruction Queue In"  # shift register
      s6 = $"Rainbow Sweep Param Selector"  # shift register
      s7 = "IV Full Raw Data.gtype"[] []  # shift register
      s8 = "IV Full Data Cluster.gtype"[] []  # shift register
      while {
        call "FGV Global Abort.gvi"(Global Abort Instructions="Read Current State", Error In=s1) -> (Local Abort Out=w11, Global Abort Out=w12, Error Out=w13)
        Is Not Equal(x=s2, y="Stop App") -> w14
        Logical And(w14, w11) -> w15
        Select(s=w15, t="Close Coms", f=s2) -> w16
        case (w16) {
          frame "Start App", Default {
            w26 = "Load Light Power Calibration"  # SRM States
            call "FGV Current State.gvi"(Current State Instructions="Set Current Substate", Current Substate="Starting Light Power Calibration", Error In=w13) -> (Error Out=w17)
            w18 = w26
            w19 = default
            w20 = s3
            w21 = s4
            w22 = s5
            w23 = s6
            w24 = s7
            w25 = s8
          }
          frame "Load Light Power Calibration" {
            call "SRM Start Calculator.gvi"(SRM Operation Control=w9, Stand Alone?=$"Stand Alone?") -> (Desired State=w27)
            call "SRM Check Light Power Data.gvi"(Light Power Calibration Data In=$"Light Power Calibration Data", Rainbow Sweep Param Selector In=s6, Input State=w27, Full Reference Cluster=$"Full Reference Cluster", Error In=w13) -> (Rainbow Sweep Param Selector Out=w23, Next State=w18, Error Out=w17)
            w19 = default
            w20 = s3
            w21 = s4
            w22 = s5
            w24 = s7
            w25 = s8
          }
          frame "Detect Instruments" {
            w28 = "Initialize Instruments"  # SRM States
            call "FGV Current State.gvi"(Current State Instructions="Set Current Substate", Current Substate="Detecting Instruments", Error In=w13) -> (Error Out=w29)
            call "Dividing Wavelength Calibration Data FGV.gvi"(Div Wavelength FGV Instructions="Load Data", Error In=w29) -> (Error Out=w30)
            call "Debug Cluster Instrument Extractor.gvi"(Debugging Cluster In=s3, Error In=w30) -> (Debuging Cluster Out=w20, Instruments to Detect=w31, Error Out=w32)
            call "Specific Detect Instruments Subroutine.gvi"(Instrument Coms Info In=s4, Error In=w32, Instruments To Detect Array=w31, Stand Alone?=$"Stand Alone?") -> (Instrument Coms Info Out=w21, Error Out=w17)
            w18 = w28
            w19 = default
            w22 = s5
            w23 = s6
            w24 = s7
            w25 = s8
          }
          frame "Initialize Instruments" {
            Property Node(instance in=$"XZ All Position Cluster") -> ("Cell R.01 Coordinates:X Coordinate (mm)"=w33, "Cell R.01 Coordinates:Z Coordinate (mm)"=w34)
            Build Cluster(w33, w34) -> w35
            call "FGV Current State.gvi"(Current State Instructions="Set Current Substate", Current Substate="Initializing Instruments", Error In=w13) -> (Error Out=w36)
            call "KCube Move to 0 or Home.gvi"(Instrument Coms Info In=s4, Debugging Cluster In=s3, Error In=w36) -> (Instrument Coms Info Out=w37, Debugging Cluster Out=w38, Error Out=w39)
            call "XZ Stage Initialize And Home.gvi"(Instrument Coms Info In=w37, Debugging Cluster In=w38, Error In=w39) -> (Instrument Coms Info Out=w40, Debugging Cluster Out=w41, Error Out=w42)
            call "XZ Stage Move to Position.gvi"(Instrument Coms Info In=w40, Debugging Cluster In=w41, Error In=w42, XZ Coordinate Cluster In=w35) -> (Instrument Coms Info Out=w43, Debugging Cluster Out=w44, Error Out=w45)
            call "Keithley Initialize Subroutine.gvi"(Instrument Coms Info In=w43, Debugging Cluster In=w44, Error In=w45) -> (Instrument Coms Info Out=w21, Debugging Cluster Out=w20, Error Out=w17)
            w18 = "Rainbow Sweep"
            w19 = default
            w22 = s5
            w23 = s6
            w24 = s7
            w25 = s8
          }
          frame "Rainbow Sweep" {
            call "FGV Current State.gvi"(Current State Instructions="Set Current Substate", Current Substate="Acquiring Spectra", Error In=w13) -> (Error Out=w46)
            call "SRM Rainbow Sweep.gvi"(Instrument Coms Info In=s4, Debugging Cluster In=s3, SRM Specific Parameters=$"SRM Specific Parameters", Rainbow Sweep Param Selector=s6, Light Power Calibration Data=$"Light Power Calibration Data", Error In=w46) -> (Instrument Coms Info Out=w21, Debugging Cluster Out=w20, Full IV Curve Raw Data=w24, Error Out=w17)
            w18 = "Close Coms"
            w19 = default
            w22 = s5
            w23 = s6
            w25 = s8
          }
          frame "Close Coms" {
            Select(s=w11, t="Stop App", f="Process IV Data") -> w18
            call "FGV Current State.gvi"(Current State Instructions="Set Current Substate", Current Substate="Closing Coms", Error In=w13) -> (Error Out=w47)
            call "KCube Motors Close.gvi"(Instrument Coms Info In=s4, Error In=w47) -> (Instrument Coms Info Out=w48, Error Out=w49)
            call "Keithley Close Subroutine.gvi"(Instrument Coms Info In=w48, Debugging Cluster In=s3, Error In=w49) -> (Instrument Coms Info Out=w21, Debugging Cluster Out=w20, Error Out=w17)
            w19 = default
            w22 = s5
            w23 = s6
            w24 = s7
            w25 = s8
          }
          frame "Process IV Data" {
            call "SRM IV Parameters Calculator.gvi"(IV Raw Data Array=s7, Error In=w13) -> (IV Full Data Cluster Array=w25, Error Out=w50)
            w51 = "SRM Sweep Live Parameters FGV Cluster.gtype" {all zero or empty}
            Property Node(instance in=w51, "Full IV Data Array"=s7, "Refresh now"=TRUE) -> (instance out=w52)
            call "SRM Sweep Live Parameters FGV.gvi"(FGV Instructions="Read State", SRM sweep live parameters FGV Cluster In=w52, Error In=w50) -> (Error Out=w53)
            call "SRM Sweep Refined Data FGV.gvi"(IV Full Data Cluster Array In=w25, Error In=w53, FGV Instructions="Set State") -> (Error Out=w54)
            call "SRM Save Graphs Prompt.gvi"(Previous State=s2.prev1, Error In=w54) -> (Desired State=w18, Error Out=w17)
            w19 = default
            w20 = s3
            w21 = s4
            w22 = s5
            w23 = s6
            w24 = s7
          }
          frame "Load Measurement" {
            call "FGV Current State.gvi"(Current State Instructions="Set Current Substate", Current Substate="Loading Calibration", Error In=w13) -> (Error Out=w55)
            call "SRM file handling.gvi"(Default Data Saving Location=$"Default Data Saving Location", Modify File Operation="Load TXT", Error In=w55) -> (Duplicate Measurement Files?=w56, Found Files Within all Folders?=w57, IV Full Raw Data Out=w24, Found Any Folder?=w58, Loaded Files=w59, Error Out=w60, Canceled Loading?=w61)
            call "SRM Load Prompt.gvi"(Duplicate Measurement Folders?=w56, Found Any Folder?=w58, Found Files within each Folder?=w57, Loaded Files=w59, Error In=w60, Canceled Loading?=w61) -> (Desired State=w18, Error Out=w17)
            w19 = default
            w20 = s3
            w21 = s4
            w22 = s5
            w23 = s6
            w25 = s8
          }
          frame "Save Graphs" {
            call "FGV Current State.gvi"(Current State Instructions="Set Current Substate", Current Substate="Saving Graphs", Error In=w13) -> (Error Out=w62)
            w63 = "Your Measurement Files Have been saved\npropperly on your personal data folder."
            call "General Simple Prompt.gvi"(Prompt Message=w63, Okay Button Message="Perfect Thanks :)", Error In=w62, Prompt?=TRUE) -> (Error Out=w64)
            call "SRM file handling.gvi"(Default Data Saving Location=$"Default Data Saving Location", IV Full Data Cluster=s8, Modify File Operation="Save TXT", Error In=w64, Cell Naming Cluster=$"Cell Naming Cluster") -> (Error Out=w17)
            w18 = "Stop App"
            w19 = default
            w20 = s3
            w21 = s4
            w22 = s5
            w23 = s6
            w24 = s7
            w25 = s8
          }
          frame "Enqueue Light Calibration" {
            w65 = "Stop App"  # SRM States
            Property Node(instance in=$"Full Reference Cluster") -> ("Enum Reference Cluster:Rainbow Measurement tab"=w66)
            Enqueue Element(element="Light Power Calibration", error in=w13, queue=s5) -> (error out=w67, queue out=w22)
            Property Node(instance in=w66, "ValueSignaling"=0, error in=w67) -> (error out=w68)
            call "Wait ms.gvi"(Error In=w68, Milliseconds to Wait=250) -> (Error Out=w17)
            w18 = w65
            w19 = default
            w20 = s3
            w21 = s4
            w23 = s6
            w24 = s7
            w25 = s8
          }
          frame "Stop App" {
            w69 = "Start App"  # SRM States
            call "FGV Current State.gvi"(Current State Instructions="Set Current Substate", Current Substate="Stopping Apps", Error In=w13) -> (Error Out=w17)
            w18 = w69
            w19 = TRUE
            w20 = s3
            w21 = s4
            w22 = s5
            w23 = s6
            w24 = s7
            w25 = s8
          }
        }
        call "Progress FGV.gvi"(FGV Instructions="Set State", Progress In=0, Error In=w17) -> (Error Out=w70)
        Logical Or(w12, w70, w19) -> w71
        next s1 = w70
        next s2 = w18
        next s3 = w20
        next s4 = w21
        next s5 = w22
        next s6 = w23
        next s7 = w24
        next s8 = w25
        stop if w71
      }
      w1 = s1
      w2 = s4
      w3 = s3
      w4 = s5
      w5 = s8
      w6 = s6
    }
  }
  $"Instruction Queue Out" <- w4
  $"SRM Rainbow Parameters" <- w6
  $"FulL IV data Cluster" <- w5
  $"Instuments Coms Info Out" <- w2
  $"Debugging Cluster Out" <- w3
  $"Error Out" <- w1
