vi "Light Calibration file handling.gvi"   [LabVIEW NXG 5.0.0]
inputs:
  "Error In": error
  "Default Data Saving Location": path
  "Modify File Operation": "Modify File Operation.gtype" = "Save TXT"
  "Light Power Calibration Data In": "Light Power Calibration Data.gtype"[]
  "Cell Naming Cluster": "Cell Naming Cluster.gtype"
outputs:
  "Error Out": error
  "Light Power Calibration Data Out": "Light Power Calibration Data.gtype"[]
  "Found Any File?": bool
  "Canceled Loading?": bool
  "Loaded Files": string[]
  "Duplicate Calibration Files?": bool
types:
  "Modify File Operation.gtype" = enum{"Save TXT", "Load TXT"}
  T1 = cluster{"Dividing Wavelength Array": f64[], "Measured Power Array": f64[]}
  "Rainbow Sweep Types.gtype" = enum{"Red Sweep Closing", "Red Sweep Opening", "Blue Sweep Closing", "Blue Sweep Opening"}
  "Light Power Calibration Data.gtype" = cluster{"Single Light Calibration": T1, "Rainbow Sweep Types": "Rainbow Sweep Types.gtype"}
  "Cell Naming Cluster.gtype" = cluster{"Cell Label": string, "Sample Prefix": string, "Author Initials": string, "Current Date": string, "Batch Name": string}
uses:
  Rainbow Measurement Setup::Side Functions::Messages And Prompts::Select path prompt.gvi
  Rainbow Measurement Setup::Side Functions::Path Manipulation::File_FolderName Scan For Sweep.gvi
  Rainbow Measurement Setup::Main Functions::Modify TXT file::Modify Measurement TXT File.gvi
  Rainbow Measurement Setup::Side Functions::Utilities::Array Detect Duplicates.gvi
  Rainbow Measurement Setup::Side Functions::Messages And Prompts::FGV Repeat Operation for all following files.gvi
diagram:
  # This subVI Handles the Saving of all the Light Power Calibration Spectra Calibration Files. It can both save and load the files from a specified folder and to the user folder respectively
  case ($"Error In") {
    frame Error, Default {
      w1 = $"Error In"
      w2 = default
      w3 = $"Light Power Calibration Data In"
      w4 = default
      w5 = default
      w6 = default
    }
    frame No Error {
      case ($"Modify File Operation") {
        frame "Load TXT" {
          w8 = "Please Select the folder with all the Light Power Calibration Files you want to Load. "
          w9 = "(All available Calibration  Files Will be Loaded Automatically)"
          call "Select path prompt.gvi"(Main Message=w8, Sub message=w9, Error In=$"Error In", Cancel Available?=TRUE) -> (New Path=w10, Cancelled?=w11, Error Out=w12)
          case (w11) {
            frame True {
              w3 = default
              w7 = w12
              w4 = TRUE
              w5 = default
              w2 = TRUE
              w6 = default
            }
            frame False {
              List Folder(error in=w12, path=w10) -> (error out=w13, file names=w14, path out=w15)
              s1 = w13  # shift register
              s2 = 0  # shift register
              s3 = "Light Power Calibration Data.gtype"[] []  # shift register
              for {
                w16 = each element of w14
                Build Path(base path=w15, name or relative path=w16) -> (appended path=w19)
                Search And Replace String(error in (no error)=s1, input string=w16, search string="Power_Calibration") -> (error out=w20, number of replacements=w21)
                call "File_FolderName Scan For Sweep.gvi"(FileName/FolderName In=w16, Error In=w20) -> (Is File/Folder sweep type?=w22, Sweep Type=w23, Error Out=w24)
                Is Not Equal To 0(x=w21) -> w25
                Logical And(w25, w22) -> w26
                case (w26) {
                  frame False, Default {
                    w27 = s2
                    w28 = s3
                    w29 = w24
                    w30 = default
                    w31 = "Red Sweep Closing"
                  }
                  frame True {
                    Array Index(array=s3) -> (out0[s2]=w32)
                    call "Modify Measurement TXT File.gvi"(Filename to load/save=w19, Modify File Operation=$"Modify File Operation", Error In=w24, Measurement File Type="Light Calibration Power") -> (Loaded Data=w33, Error Out=w29)
                    Array Index(array=w33) -> (out0[_, 0]=w34, out1[_, 1]=w35)
                    Property Node(instance in=w32, "Single Light Calibration:Dividing Wavelength Array"=w34, "Single Light Calibration:Measured Power Array"=w35, "Rainbow Sweep Types"=w23) -> (instance out=w36)
                    Insert Into Array(inArray=s3, new=w36) -> w28
                    Increment(x=s2) -> w27
                    w30 = TRUE
                    w31 = w23
                  }
                }
                append w30 to w17
                append w16 to w5 if w26
                append w31 to w18 if w26
                next s1 = w29
                next s2 = w27
                next s3 = w28
              }
              Or Array Elements(Boolean array=w17) -> (logical OR=w2)
              call "Array Detect Duplicates.gvi"(Array In=w18, Error In=s1) -> (Repeated?=w6, Error Out=w7)
              w3 = s3
              w4 = default
            }
          }
        }
        frame "Save TXT", Default {
          s4 = $"Error In"  # shift register
          for {
            w37 = each element of $"Light Power Calibration Data In"
            Property Node(instance in=w37) -> ("Single Light Calibration"=w38, "Rainbow Sweep Types"=w39)
            Property Node(instance in=w38) -> ("Dividing Wavelength Array"=w40, "Measured Power Array"=w41)
            Build Array(w40, w41) -> w42
            Transpose 2D Array(2D array=w42) -> (transposed array=w43)
            call "Modify Measurement TXT File.gvi"(Rainbow Sweep Types=w39, Default Data Saving Location=$"Default Data Saving Location", Modify File Operation=$"Modify File Operation", Data To Save=w43, Error In=s4, Cell Naming Cluster=$"Cell Naming Cluster", Measurement File Type="Light Calibration Power") -> (Error Out=w44)
            next s4 = w44
          }
          w7 = s4
          w2 = default
          w3 = $"Light Power Calibration Data In"
          w4 = default
          w5 = default
          w6 = default
        }
      }
      call "FGV Repeat Operation for all following files.gvi"(FGV Instructions="Reset State", Error In=w7) -> (Error Out=w1)
    }
  }
  $"Found Any File?" <- w2
  $"Light Power Calibration Data Out" <- w3
  $"Loaded Files" <- w5
  $"Canceled Loading?" <- w4
  $"Error Out" <- w1
  $"Duplicate Calibration Files?" <- w6
