vi "Light Power Calibration Load Prompt.gvi"   [LabVIEW NXG 5.0.0]
inputs:
  "Found Any File?": bool
  "Stand Alone": bool
  "Error In": error
  "Canceled Loading?": bool
  "Loaded Files": string[]
  "Duplicate Calibration Files?": bool
  "Full Light Power Calibration Data Array": "Light Power Calibration Data.gtype"[]
outputs:
  "Desired State": "Light Power Calibration States.gtype"
  "Error Out": error
types:
  "Light Power Calibration States.gtype" = enum{"Start App", "Detect Instruments", "Initialize Instruments", "Rainbow Sweep", "Close Coms", "Load Calibration", "Save Graphs", "Stop App"}
  T1 = cluster{"Dividing Wavelength Array": f64[], "Measured Power Array": f64[]}
  "Rainbow Sweep Types.gtype" = enum{"Red Sweep Closing", "Red Sweep Opening", "Blue Sweep Closing", "Blue Sweep Opening"}
  "Light Power Calibration Data.gtype" = cluster{"Single Light Calibration": T1, "Rainbow Sweep Types": "Rainbow Sweep Types.gtype"}
uses:
  Rainbow Measurement Setup::Side Functions::Graphing::Multiple Page Graph Adapter.gvi
  Rainbow Measurement Setup::Main Functions::Rainbow Measurement::Light Power Calibration::Light Calibration Live Parameters FGV.gvi
diagram:
  # This SubVI Prompts the user in case it does not find any calibration file and asks if it
  # wants to perform a new calibration. It also checks if the loading process got cancelled
  # and if it did it poompts the user accordingly. It also tells the user the files that have been loaded.
  # It also prompts the user in case there are any duplicate files because that would lead to an error
  # when loading the files afterwards.
  # It also updates the graph on the GUI If everything went alright.
  case ($"Error In") {
    frame Error, Default {
      w1 = $"Error In"
      w2 = "Stop App"
    }
    frame No Error {
      Logical And($"Found Any File?", not $"Canceled Loading?") -> w3
      case (w3) {
        frame False { }
        frame True {
          w4 = "Your Files have been succesfully\nloaded. They are the Following:\n\n"
          s1 = w4  # shift register
          for {
            w5 = each element of $"Loaded Files"
            Concatenate Strings(s1, w5, "\r\n") -> w6
            next s1 = w6
          }
          w7 = "\nRemember: This means you can only \nperform these types of sweeps!"
          Concatenate Strings(s1, w7) -> w8
          One Button Dialog(button name ("OK")="Okay Thanks :)", message=w8)
        }
      }
      Logical And($"Found Any File?", not $"Canceled Loading?", not $"Duplicate Calibration Files?") -> w9
      case (w9) {
        frame False, Default {
          w1 = $"Error In"
        }
        frame True {
          call "Multiple Page Graph Adapter.gvi"(Full Data Array=$"Full Light Power Calibration Data Array", Error In=$"Error In") -> (Output Bundled Data=w10, Output Graph Ready Data=w11, Error Out=w12)
          call "Light Calibration Live Parameters FGV.gvi"(FGV Instructions="Set State", Output Graph Ready Data=w11, Error In=w12, Graph Bundled data=w10) -> (Error Out=w1)
        }
      }
      case ($"Found Any File?") {
        frame False, Default {
          Select(s=$"Stand Alone", t="Detect Instruments", f="Initialize Instruments") -> w14
          w15 = "I could not find any Light Power calibration file\non the specified folder. \nDo you want to perform a new calibration?"
          Two Button Dialog(F button name ("Cancel")="Nah, I'm feeling lazy", T button name ("OK")="Okay, let's do it", message=w15) -> (T Button?=w16)
          Select(s=w16, t=w14, f="Stop App") -> w13
        }
        frame True {
          w13 = "Stop App"
        }
      }
      case ($"Canceled Loading?") {
        frame False {
          w17 = w13
        }
        frame True {
          Select(s=$"Canceled Loading?", t="Stop App", f=w13) -> w17
          w18 = "I Cannot load any file if you do \nnot specify a propper path ¯\\_(ツ)_/¯"
          One Button Dialog(button name ("OK")="Oops, Sorry", message=w18)
        }
      }
      case ($"Duplicate Calibration Files?") {
        frame False {
          w2 = w17
        }
        frame True {
          Select(s=$"Duplicate Calibration Files?", t="Stop App", f=w17) -> w2
          w19 = """It looks like you have more than one light power calibration file for the 
same sweep type. Please make sure you only have one file for each type
of light power calibraton file (for example one file for the red sweep 
opening and one file for the blue sweep closing) within each device folder."""
          One Button Dialog(button name ("OK")="Oops, Sorry", message=w19)
        }
      }
    }
  }
  $"Error Out" <- w1
  $"Desired State" <- w2
