vi "Light Calibration Live Parameters FGV.gvi"   [LabVIEW NXG 5.0.0]
inputs:
  "Error In": error
  "FGV Instructions": "General FGV Instructions.gtype" = "Read State", required
  "Light Calibration Live Parameters In": "LPC Sweep Live Parameters.gtype"
  "Graph Bundled data": T1[]
  "Output Graph Ready Data": cluster{"Element 1": f64[], "Element 2": f64[]}[]
  "Full Reference Cluster": "Full Reference Cluster.gtype"
outputs:
  "Error Out": error
  "Light Calibration Parameters Out": "LPC Sweep Live Parameters.gtype"
  "Light Power Calibration Graph Out": cluster{"Wavelength": f64[], "Power": f64[]}[]
types:
  "General FGV Instructions.gtype" = enum{"Read State", "Set State", "Reset State"}
  "Rainbow Sweep Types.gtype" = enum{"Red Sweep Closing", "Red Sweep Opening", "Blue Sweep Closing", "Blue Sweep Opening"}
  "LPC Sweep Live Parameters.gtype" = cluster{"Light Power (W) ": f64, "Current Wavelength (nm)": f64, "Rainbow Sweep Types": "Rainbow Sweep Types.gtype"}
  T1 = cluster{"Element 1": f64[], "Element 2": f64[], "Element 3": "Rainbow Sweep Types.gtype"}
  "Enum Control Reference Cluster.gtype" = cluster{"Main Tab": "TabControl reference", "Rainbow Measurement tab": "TabControl reference", "Configuration tab": "TabControl reference", "Light Calibration tab": "TabControl reference", "SRM Plot Parameter Selector": "EnumSelector reference"}
  "Boolean Control Reference Cluster.gtype" = cluster{"Custem date": "CheckBox reference", "Label Info Missing Error": "BooleanControl reference"}
  "Numeric Control Reference Cluster.gtype" = cluster{"Beam Power Density": "IntensityGraph reference"[][], "Irradiance Calibration": "Graph reference"[]}
  "Numeric Cluster Reference Cluster.gtype" = cluster{"LPC Parameters": "Cluster reference", "Sweep Live Parameters LPC": "Cluster reference"}
  "Path Reference Cluster.gtype" = cluster{"Calibration Files Path": "PathSelector reference", "Default Data Saving Location": "PathSelector reference"}
  "Cluster Reference Cluster.gtype" = cluster{"Light Power Calibration": "Graph reference", "Light Power Calibration Data": "ArrayViewer reference", "Rainbow Sweep Parameters RSM": "Cluster reference", "Rainbow Sweep Param Selector MSpot": "Cluster reference", "MSpot Spectrum Calibration Parameters": "Cluster reference", "SRM Raw Plot Rainbow Sweep Selector": "ComboBoxSelector reference", "SRM Refined Plot Rainbow Sweep Types": "ComboBoxSelector reference", "SRM Specific Parameters": "Cluster reference", "XZ All Position Cluster": "Cluster reference", "Label Info Error Label": "StringControl reference", "Sample Comments": "StringControl reference", "Cell Number": "StringControl reference", "Author Initials": "ComboBoxSelector reference", "Batch Name": "StringControl reference", "IV Plot Out ": "Graph reference", "Sweep Live Parameters RSM": "Cluster reference"}
  "Full Reference Cluster.gtype" = cluster{"Enum Reference Cluster": "Enum Control Reference Cluster.gtype", "Boolean Reference Cluster": "Boolean Control Reference Cluster.gtype", "Numeric Reference Cluster": "Numeric Control Reference Cluster.gtype", "Numeric Cluster Reference Cluster": "Numeric Cluster Reference Cluster.gtype", "Path Reference Cluster": "Path Reference Cluster.gtype", "Cluster Reference Cluster": "Cluster Reference Cluster.gtype"}
diagram:
  case ($"Error In") {
    frame Error, Default {
      w1 = $"Error In"
    }
    frame No Error {
      s1 = uninitialised  # shift register
      s2 = uninitialised  # shift register
      s3 = uninitialised  # shift register
      s4 = $"Error In"  # shift register
      s5 = uninitialised  # shift register
      s6 = uninitialised  # shift register
      while {
        case ($"FGV Instructions") {
          frame "Read State", Default {
            Increment(x=s6) -> w8
            Property Node(instance in=$"Full Reference Cluster") -> ("Cluster Reference Cluster:Light Power Calibration"=w9)
            Is Greater(x=w8, y=50) -> w10
            case (w10) {
              frame False, Default {
                w5 = s4
                w4 = w9
                w7 = w8
              }
              frame True {
                s7 = s4  # shift register
                for (iteration -> i1) {
                  w11 = each element of s5
                  Property Node(instance in=w9, "ActivePlot"=i1, error in=s7) -> ("Plot"=w12, error out=w13)
                  Property Node(instance in=w11) -> ("Element 3"=w14)
                  Format Into String(w14) -> w15
                  Property Node(instance in=w12, "Name"=w15, error in=w13) -> (error out=w16, instance out=w4)
                  next s7 = w16
                }
                w5 = s7
                w7 = 0
              }
            }
            $"Light Calibration Parameters Out" <- s1
            $"Light Power Calibration Graph Out" <- s2
            w2 = s1
            w3 = s2
            w6 = s5
          }
          frame "Set State" {
            Is Empty Array(array=$"Graph Bundled data") -> w17
            Select(s=w17, t=s5, f=$"Graph Bundled data") -> w6
            Is Empty Array(array=$"Output Graph Ready Data") -> w18
            Select(s=w18, t=s2, f=$"Output Graph Ready Data") -> w3
            w2 = $"Light Calibration Live Parameters In"
            w4 = s3
            w5 = s4
            w7 = s6
          }
          frame "Reset State" {
            w2 = "LPC Sweep Live Parameters.gtype" {all zero or empty}
            w3 = cluster{"Wavelength": f64[], "Power": f64[]}[] []
            w4 = s3
            w5 = s4
            w6 = T1[] []
            w7 = 0
          }
        }
        next s1 = w2
        next s2 = w3
        next s3 = w4
        next s4 = w5
        next s5 = w6
        next s6 = w7
        stop if TRUE
      }
      w1 = s4
    }
  }
  $"Error Out" <- w1
