vi "Light Power Calibration Operation Translator.gvi"   [LabVIEW NXG 5.0.0]
inputs:
  "Error In": error
  "New Light Power Calibration": bool
  "Load Light Power Calibration": bool
  "Save Light Power Calibration": bool
outputs:
  "Error Out": error
  "Light Power Operation Control": "Light Power Operation Control.gtype"
types:
  "Light Power Operation Control.gtype" = enum{"Save Calibration", "Load Calibration", "New Calibration"}
diagram:
  # This SubVI Checks which button has been pressed and
  # decides the operation that needs to be done.
  # If more than one button was pressed it prompts the user
  # to not press so many buttons at the same time
  case ($"Error In") {
    frame Error, Default {
      w1 = $"Error In"
      w2 = "Load Calibration"
    }
    frame No Error {
      Logical And($"Save Light Power Calibration", $"New Light Power Calibration") -> w3
      Logical And($"New Light Power Calibration", $"Load Light Power Calibration") -> w4
      Logical And($"Save Light Power Calibration", $"Load Light Power Calibration") -> w5
      Logical Or(w3, w4, w5) -> w6
      case (w6) {
        frame False, Default {
          Select(s=$"Save Light Power Calibration", t="Save Calibration", f="Load Calibration") -> w7
          Select(s=$"New Light Power Calibration", t="New Calibration", f=w7) -> w2
        }
        frame True {
          w8 = "Please do not Press all the buttons\nat once, otherwise I do not know what\nyou want me to do first :("
          w9 = "Oh, sorry I will press them\none by one, while waiting for\nyou to finish."
          One Button Dialog(button name ("OK")=w9, message=w8)
          w2 = "Load Calibration"
        }
      }
      w1 = $"Error In"
    }
  }
  $"Error Out" <- w1
  $"Light Power Operation Control" <- w2
