vi "Light Power Calibration Sweep.gvi"   [LabVIEW NXG 5.0.0]
inputs:
  "Error In": error
  "Instrument Control Mega Cluster In": "Instrument Control Mega Cluster.gtype"
  "LPC Mega Cluster In": "LPC Mega Cluster.gtype"
outputs:
  "Error Out": error
  "LPC Mega Cluster Out": "LPC Mega Cluster.gtype"
  "Instrument Control Mega Cluster Out": "Instrument Control Mega Cluster.gtype"
types:
  "Instrument Coms Info.gtype" = cluster{"Arduino Coms Info": "Arduino Detection cluster control.gtype", "Photodetector Names": string[], "Keythley Address": "VISA Instr", "Photodetector Detected?": bool, "Thorlabs Motors Detected?": bool, "Keithley Detected?": bool, "Thorlabs Motors Serial Number": "Thorlabs Motors Serial Number In.gtype", "Photodetector IVI session": "Ivi IviDefault", "Flame ID": string, "Flame Detected?": bool, "Flame Wrapper ID": u64}
  "Debugging Cluster.gtype" = cluster{"Debugging mode?": bool, "Initialize App": bool, "Insturment Debugging": "Insturment Debugging Cluster.gtype"}
  "Instrument Control Mega Cluster.gtype" = cluster{"Instruments Coms Info": "Instrument Coms Info.gtype", "Debugging Cluster": "Debugging Cluster.gtype"}
  "Raibow Sweep Selector.gtype" = enum{"Red Sweep", "Blue Sweep", "Full Sweep Red First", "Full Sweep Blue First"}
  "Rainbow Sweep Param Selector.gtype" = cluster{"Raibow Sweep Selector": "Raibow Sweep Selector.gtype", "Max Wavelength (nm)": f64, "Min Wavelength (nm)": f64, "Wavelength Step (nm)": f64, "Rainbow Sweep Type Selector": "Rainbow Sweep Type Selector.gtype"}
  "Light power Calibration Parameters.gtype" = cluster{"Powermeter Averages": u32, "Photodtctr Area (m^2)": f64}
  T1 = cluster{"Dividing Wavelength Array": f64[], "Measured Power Array": f64[], "Power Density Array": f64[]}
  "Rainbow Sweep Types.gtype" = enum{"Red Sweep Closing", "Red Sweep Opening", "Blue Sweep Closing", "Blue Sweep Opening"}
  "Light Power Calibration Data.gtype" = cluster{"Single Light Calibration": T1, "Rainbow Sweep Types": "Rainbow Sweep Types.gtype", "Total Light Power Density": f64}
  "LPC Mega Cluster.gtype" = cluster{"Rainbow Sweep Parameters LPC": "Rainbow Sweep Param Selector.gtype", "LPC Specific Parameters": "Light power Calibration Parameters.gtype", "Light Power Calibration Data": "Light Power Calibration Data.gtype"[]}
  "LPC Sweep Live Parameters.gtype" = cluster{"Light Power (W) ": f64, "Current Wavelength (nm)": f64, "Rainbow Sweep Types": "Rainbow Sweep Types.gtype"}
uses:
  Rainbow Measurement Setup::Side Functions::Messages And Prompts::FGV Cancel Prompts until Finished Routine.gvi
  Rainbow Measurement Setup::Side Functions::Instrument Control::Photodetector::Photodetector Measure Power.gvi
  Rainbow Measurement Setup::Side Functions::Rainbow Sweep::Rainbow Sweep Param Generator.gvi
  Rainbow Measurement Setup::Side Functions::Instrument Control::Thorlabs Motors::Dividing Wavelength Control::Dividing Wavelength Calibration Data FGV.gvi
  Rainbow Measurement Setup::Side Functions::Global Abort::FGV Global Abort.gvi
  Rainbow Measurement Setup::Side Functions::Instrument Control::Thorlabs Motors::Dividing Wavelength Control::KCube Dividing Wavelength Translator.gvi
  Rainbow Measurement Setup::Side Functions::Utilities::Wait ms.gvi
  Rainbow Measurement Setup::Side Functions::Graphing::Multiple Page Graph Adapter.gvi
  Rainbow Measurement Setup::Main Functions::Rainbow Measurement::Light Power Calibration::Light Calibration Live Parameters FGV.gvi
  Rainbow Measurement Setup::Side Functions::Utilities::Progress Handling::Progress General Calculator.gvi
  Rainbow Measurement Setup::Side Functions::Utilities::Progress Handling::Progress FGV.gvi
  Rainbow Measurement Setup::Side Functions::Instrument Control::Thorlabs Motors::Movement::KCube Move to 0 or Home.gvi
diagram:
  # This SubVI Performs a sweep moving the motors and measuring the power that reaches the detector and then it stores everything on an array so that it can be later saved.
  case ($"Error In") {
    frame Error, Default {
      w1 = $"Error In"
      w2 = $"Instrument Control Mega Cluster In"
      w3 = $"LPC Mega Cluster In"
    }
    frame No Error {
      Property Node(instance in=$"LPC Mega Cluster In") -> ("Rainbow Sweep Parameters LPC"=w4, "LPC Specific Parameters:Photodtctr Area (m^2)"=w5, instance out=w6)
      call "FGV Cancel Prompts until Finished Routine.gvi"(Error In=$"Error In", FGV Instructions="Reset State") -> (Error Out=w7)
      call "Photodetector Measure Power.gvi"(Instrument Control Mega Cluster In=$"Instrument Control Mega Cluster In", Error In=w7) -> (Instrument Control Mega Cluster Out=w8, Measured Power=w9, Error Out=w10)
      call "Rainbow Sweep Param Generator.gvi"(Rainbow Sweep Parameters=w4, Error In=w10) -> (Rainbow Sweep Parameters Array=w11, Error Out=w12)
      Property Node(instance in=w8) -> ("Debugging Cluster:Insturment Debugging:Photodetector"=w13, "Debugging Cluster:Debugging mode?"=w14, instance out=w15)
      Array Size(array=w11) -> (size(s)=w16)
      Initialize Array(element="Light Power Calibration Data.gtype" {all zero or empty}, size=w16) -> w17
      call "Dividing Wavelength Calibration Data FGV.gvi"(Div Wavelength FGV Instructions="Read Loaded Data", Error In=w12) -> (Dividing Wavelength Calibration Data Out=w18, Error Out=w19)
      Logical And[output inverted](not w13, w14) -> w20
      Property Node(instance in=w4) -> ("Wavelength Step (nm)"=w21)
      Multiply(w21, 1000) -> w22
      Select(s=w20, t=w22, f=1) -> w23
      s1 = w19  # shift register
      s2 = w15  # shift register
      s3 = w17  # shift register
      s4 = 0  # shift register
      for (N -> w24) (iteration -> i1) {
        w25 = each element of w11
        Property Node(instance in=w25) -> ("Dividing Wavelength Array"=w26, "Rainbow Sweep Types"=w27)
        s5 = s1  # shift register
        s6 = s2  # shift register
        s7 = s4  # shift register
        s8 = s3  # shift register
        for (N -> w28) {
          w29 = each element of w26
          Increment(x=s7) -> w30
          Multiply(w28, w24) -> w31
          call "FGV Global Abort.gvi"(Global Abort Instructions="Read Current State", Error In=s5) -> (Local Abort Out=w32, Global Abort Out=w33, Error Out=w34)
          call "KCube Dividing Wavelength Translator.gvi"(Dividing Wavelength=w29, Instrument Control Mega Cluster In=s6, Dividing Wavelength Calibration Data In=w18, Error In=w34, Rainbow Sweep Types=w27) -> (Real Dividing Wavelength=w35, Instrument Control Mega Cluster Out=w36, Error Out=w37)
          call "Wait ms.gvi"(Error In=w37, Milliseconds to Wait=w23) -> (Error Out=w38)
          call "Photodetector Measure Power.gvi"(Instrument Control Mega Cluster In=w36, Error In=w38) -> (Instrument Control Mega Cluster Out=w39, Measured Power=w40, Error Out=w41)
          Property Node(instance in="LPC Sweep Live Parameters.gtype" {all zero or empty}, "Light Power (W) "=w40, "Current Wavelength (nm)"=w35, "Rainbow Sweep Types"=w27) -> (instance out=w42)
          Array Index(array=s8) -> (out0[i1]=w43)
          Property Node(instance in=w43) -> ("Single Light Calibration"=w44, instance out=w45)
          Property Node(instance in=w44) -> ("Dividing Wavelength Array"=w46, "Measured Power Array"=w47, "Power Density Array"=w48, instance out=w49)
          Build Array(w46, w35) -> w50
          Build Array(w47, w40) -> w51
          Divide(x=w40, y=w5) -> w52
          Build Array(w48, w52) -> w53
          Property Node(instance in=w49, "Dividing Wavelength Array"=w50, "Measured Power Array"=w51, "Power Density Array"=w53) -> (instance out=w54)
          Property Node(instance in=w45, "Single Light Calibration"=w54, "Rainbow Sweep Types"=w27, "Total Light Power Density"=w9) -> (instance out=w55)
          Replace Array Subset(inArray=s8, index=i1, new=w55) -> w56
          call "Multiple Page Graph Adapter.gvi"(Full Data Array=w56, Error In=w41) -> (Output Bundled Data=w57, Output Graph Ready Data=w58, Error Out=w59)
          call "Light Calibration Live Parameters FGV.gvi"(FGV Instructions="Set State", Light Calibration Live Parameters In=w42, Output Graph Ready Data=w58, Error In=w59, Graph Bundled data=w57) -> (Error Out=w60)
          call "Progress General Calculator.gvi"(Starting Value=40, Ending Value=80, Number Of Steps=w31, Current Step=s7, Error In=w60) -> (Current Progress=w61, Error Out=w62)
          call "Progress FGV.gvi"(FGV Instructions="Set State", Progress In=w61, Error In=w62) -> (Error Out=w63)
          Logical Or(w32, w33) -> w64
          next s5 = w63
          next s6 = w39
          next s7 = w30
          next s8 = w56
          stop if w64
        }
        call "Multiple Page Graph Adapter.gvi"(Full Data Array=s8, Error In=s5) -> (Output Bundled Data=w65, Output Graph Ready Data=w66, Error Out=w67)
        call "Light Calibration Live Parameters FGV.gvi"(FGV Instructions="Set State", Light Calibration Live Parameters In=w42, Output Graph Ready Data=w66, Error In=w67, Graph Bundled data=w65) -> (Error Out=w68)
        call "KCube Move to 0 or Home.gvi"(Instrument Control Mega Cluster In=s6, Error In=w68) -> (Instrument Control Mega Cluster Out=w69, Error Out=w70)
        next s1 = w70
        next s2 = w69
        next s3 = s8
        next s4 = s7
        stop if w64
      }
      Property Node(instance in=w6, "Light Power Calibration Data"=s3) -> (instance out=w3)
      call "Multiple Page Graph Adapter.gvi"(Full Data Array=s3, Error In=s1) -> (Output Bundled Data=w71, Output Graph Ready Data=w72, Error Out=w73)
      call "Light Calibration Live Parameters FGV.gvi"(FGV Instructions="Set State", Light Calibration Live Parameters In=w42, Output Graph Ready Data=w72, Error In=w73, Graph Bundled data=w71) -> (Error Out=w74)
      call "KCube Move to 0 or Home.gvi"(Instrument Control Mega Cluster In=s2, Error In=w74) -> (Instrument Control Mega Cluster Out=w2, Error Out=w1)
    }
  }
  $"LPC Mega Cluster Out" <- w3
  $"Instrument Control Mega Cluster Out" <- w2
  $"Error Out" <- w1
