vi "Enable and Disable XZ Controls.gvi"   [LabVIEW NXG 5.0.0]
inputs:
  "Misc Data Mega Cluster In": "Misc Data Mega Cluster.gtype"
  "Error In": error
  "Activate Arduino?": bool
outputs:
  "Misc Data Mega Cluster Out": "Misc Data Mega Cluster.gtype"
  "Error Out": error
types:
  "Full Reference Cluster.gtype" = cluster{"Enum Reference Cluster": "Enum Control Reference Cluster.gtype", "Boolean Reference Cluster": "Boolean Control Reference Cluster.gtype", "Numeric Reference Cluster": "Numeric Control Reference Cluster.gtype", "Numeric Cluster Reference Cluster": "Numeric Cluster Reference Cluster.gtype", "Path Reference Cluster": "Path Reference Cluster.gtype", "Cluster Reference Cluster": "Cluster Reference Cluster.gtype", "XZ Stage Controls Reference Cluster": "XZ Stage Controls Reference Cluster.gtype"}
  "Cell Naming Cluster.gtype" = cluster{"Cell Label": string, "Sample Prefix": string, "Author Initials": string, "Current Date": string, "Batch Name": string}
  T1 = cluster{"X Coordinate (mm)": f64, "Z Coordinate (mm)": f64}
  T2 = cluster{"X Coordinate (mm)": f64, "Z Coordinate (mm)": f64, "Vertical Spacing (mm)": f64}
  "XZ All Position Cluster.gtype" = cluster{"Diffusor Coordinates": T1, "Photodetector Coordinates": T1, "Cell R.01 Coordinates": T2}
  T3 = cluster{"Thorlabs Motor Serial Number File Path": path, "Default Data Saving Location": path}
  "Misc Data Mega Cluster.gtype" = cluster{"Full Reference Cluster": "Full Reference Cluster.gtype", "Cell Naming Cluster": "Cell Naming Cluster.gtype", "All XZ Position Cluster": "XZ All Position Cluster.gtype", "All Paths": T3}
diagram:
  case ($"Error In") {
    frame Error, Default {
      w1 = $"Misc Data Mega Cluster In"
      w2 = $"Error In"
    }
    frame No Error {
      case ($"Activate Arduino?") {
        frame True {
          Property Node(instance in=$"Misc Data Mega Cluster In") -> ("Full Reference Cluster:XZ Stage Controls Reference Cluster:XZ Stage Active"=w3, "Full Reference Cluster:XZ Stage Controls Reference Cluster:Activate XZ Stage"=w4, "Full Reference Cluster:XZ Stage Controls Reference Cluster:Set Position"=w5, "Full Reference Cluster:XZ Stage Controls Reference Cluster:XZ Stage Cell Reference"=w6, "Full Reference Cluster:XZ Stage Controls Reference Cluster:Release XZ Stage"=w7, "Full Reference Cluster:XZ Stage Controls Reference Cluster:XZ Coordinates"=w8, "Full Reference Cluster:XZ Stage Controls Reference Cluster:Custom Position"=w9, instance out=w1)
          Property Node(instance in=w3, "Value"=TRUE, error in=$"Error In") -> (error out=w10)
          Property Node(instance in=w4, "Disabled"=TRUE, error in=w10) -> (error out=w11)
          Property Node(instance in=w5, "Disabled"=FALSE, error in=w11) -> (error out=w12)
          Property Node(instance in=w6, "Disabled"=FALSE, error in=w12) -> (error out=w13)
          Property Node(instance in=w7, "Disabled"=FALSE, error in=w13) -> (error out=w14)
          Property Node(instance in=w9, "Disabled"=FALSE, error in=w14) -> ("Value"=w15, error out=w16)
          Not(x=w15) -> w17
          Property Node(instance in=w8, "Disabled"=w17, error in=w16) -> (error out=w2)
        }
        frame False {
          Property Node(instance in=$"Misc Data Mega Cluster In") -> ("Full Reference Cluster:XZ Stage Controls Reference Cluster:XZ Stage Active"=w18, "Full Reference Cluster:XZ Stage Controls Reference Cluster:Activate XZ Stage"=w19, "Full Reference Cluster:XZ Stage Controls Reference Cluster:Set Position"=w20, "Full Reference Cluster:XZ Stage Controls Reference Cluster:XZ Stage Cell Reference"=w21, "Full Reference Cluster:XZ Stage Controls Reference Cluster:Release XZ Stage"=w22, "Full Reference Cluster:XZ Stage Controls Reference Cluster:XZ Coordinates"=w23, "Full Reference Cluster:XZ Stage Controls Reference Cluster:Custom Position"=w24, instance out=w1)
          Property Node(instance in=w18, "Value"=FALSE, error in=$"Error In") -> (error out=w25)
          Property Node(instance in=w19, "Disabled"=FALSE, error in=w25) -> (error out=w26)
          Property Node(instance in=w20, "Disabled"=TRUE, error in=w26) -> (error out=w27)
          Property Node(instance in=w21, "Disabled"=TRUE, error in=w27) -> (error out=w28)
          Property Node(instance in=w22, "Disabled"=TRUE, error in=w28) -> (error out=w29)
          Property Node(instance in=w23, "Disabled"=TRUE, error in=w29) -> (error out=w30)
          Property Node(instance in=w24, "Disabled"=TRUE, error in=w30) -> (error out=w2)
        }
      }
    }
  }
  $"Error Out" <- w2
  $"Misc Data Mega Cluster Out" <- w1
