vi "XZ Locking Movement Subroutine.gvi"   [LabVIEW NXG 5.0.0]
inputs:
  "Error In": error
outputs:
  "Error Out": error
panel controls:
  "X position": f64
  "Z position": f64
  "Skip to Next Cell": bool
  "Custom Position": bool
  "R.01 Reference Coordinates": "R.01 Reference Coordinates.gtype" = {"X coordinate R.01"=145.3, "Z coordinate R.01"=2.5, "Vertical Spacing"=0}
  "Carriage Arduino Address": "VISA Instr"
  "Cell Label": T1 = "L.01"
  "Set Postion": bool
  "Release Arduino": bool
  "Keithley Enable Output": bool
  "Instrument Coms Info": "Instrument Coms Info.gtype"
  "Debugging Cluster In": "Debugging Cluster.gtype"
  "Full Reference Cluster": "Full Reference Cluster.gtype"
panel indicators:
  "XZ Carriage Arduino Log": string
  "Carriage Active": bool
types:
  "R.01 Reference Coordinates.gtype" = cluster{"X coordinate R.01": f64, "Z coordinate R.01": f64, "Vertical Spacing": f64}
  T1 = enum{"L.01", "L.02", "L.03", "L.04", "L.05", "L.06", "L.07", "L.08", "L.09", "L.10", "L.11", "L.12", "R.01", "R.02", "R.03", "R.04", "R.05", "R.06", "R.07", "R.08", "R.09", "R.10", "R.11", "R.12"}
  T2 = cluster{"Element 1": "VISA Instr", "Element 2": string}
  "Arduino Detection cluster control.gtype" = cluster{"XZ Stage Arduino Address": "VISA Instr", "XZ Stage Arduino Detected?": bool, "Multiplexer Arduino Detected?": bool, "Multiplexer Arduino Address": "VISA Instr", "Arduinos List": T2[], "XZ Stage Log": string, "Multiplexer Log": string}
  "Thorlabs Motors Serial Number In.gtype" = cluster{"Thorlabs Blue Motor": string, "Thorlabs Red Motor": string, "Blue Motor Homed?": bool, "Red Motor Homed?": bool}
  "Instrument Coms Info.gtype" = cluster{"Arduino Coms Info": "Arduino Detection cluster control.gtype", "Photodetector Names": string[], "Keythley Address": "VISA Instr", "Photodetector Detected?": bool, "Thorlabs Motors Detected?": bool, "Keithley Detected?": bool, "Thorlabs Motors Serial Number": "Thorlabs Motors Serial Number In.gtype", "Photodetector IVI session": "Ivi IviDefault", "Flame ID": string, "Flame Detected?": bool, "Flame Wrapper ID": u64}
  "Insturment Debugging Cluster.gtype" = cluster{"Keithley": bool, "Arduinos": bool, "Thorlabs Motors": bool, "Photodetector": bool, "Flame Spectr": bool}
  "Debugging Cluster.gtype" = cluster{"Debugging mode?": bool, "Initialize App": bool, "Insturment Debugging": "Insturment Debugging Cluster.gtype"}
  "Enum Control Reference Cluster.gtype" = cluster{"Main Tab": "TabControl reference", "Rainbow Measurement tab": "TabControl reference", "Configuration tab": "TabControl reference", "Light Calibration tab": "TabControl reference", "SRM Plot Parameter Selector": "EnumSelector reference"}
  "Boolean Control Reference Cluster.gtype" = cluster{"Custem date": "CheckBox reference", "Label Info Missing Error": "BooleanControl reference"}
  "Numeric Control Reference Cluster.gtype" = cluster{"Beam Power Density": "IntensityGraph reference"[][], "Irradiance Calibration": "Graph reference"[]}
  "Numeric Cluster Reference Cluster.gtype" = cluster{"LPC Parameters": "Cluster reference", "Sweep Live Parameters LPC": "Cluster reference"}
  "Path Reference Cluster.gtype" = cluster{"Calibration Files Path": "PathSelector reference", "Default Data Saving Location": "PathSelector reference"}
  "Cluster Reference Cluster.gtype" = cluster{"Light Power Calibration": "Graph reference", "Light Power Calibration Data": "ArrayViewer reference", "Rainbow Sweep Parameters RSM": "Cluster reference", "Rainbow Sweep Param Selector MSpot": "Cluster reference", "MSpot Spectrum Calibration Parameters": "Cluster reference", "SRM Raw Plot Rainbow Sweep Selector": "ComboBoxSelector reference", "SRM Refined Plot Rainbow Sweep Types": "ComboBoxSelector reference", "SRM Specific Parameters": "Cluster reference", "XZ All Position Cluster": "Cluster reference", "Label Info Error Label": "StringControl reference", "Sample Comments": "StringControl reference", "Cell Number": "StringControl reference", "Author Initials": "ComboBoxSelector reference", "Batch Name": "StringControl reference", "IV Plot Out ": "Graph reference", "Sweep Live Parameters RSM": "Cluster reference"}
  "XZ Stage Controls Reference Cluster.gtype" = cluster{"Cell Label": "EnumSelector reference", "Z Position": "NumericTextBoxDouble reference", "X Position": "NumericTextBoxDouble reference", "Activate XZ Stage": "BooleanControl reference", "Custom Position": "BooleanControl reference", "Set Position": "BooleanControl reference", "XZ Stage Active": "BooleanControl reference", "Release XZ Stage": "BooleanControl reference"}
  "Full Reference Cluster.gtype" = cluster{"Enum Reference Cluster": "Enum Control Reference Cluster.gtype", "Boolean Reference Cluster": "Boolean Control Reference Cluster.gtype", "Numeric Reference Cluster": "Numeric Control Reference Cluster.gtype", "Numeric Cluster Reference Cluster": "Numeric Cluster Reference Cluster.gtype", "Path Reference Cluster": "Path Reference Cluster.gtype", "Cluster Reference Cluster": "Cluster Reference Cluster.gtype", "XZ Stage Controls Reference Cluster": "XZ Stage Controls Reference Cluster.gtype"}
uses:
  Rainbow Measurement Setup::Main Functions::Instruction Queue::Current State::FGV Current State.gvi
  Rainbow Measurement Setup::Side Functions::Instrument Control::Arduino::XZ Stage Arduino::XZ Stage Initialize And Home.gvi
  EQE_Measuring_Setup_NanOpto::SubVis::FGV::Current State FGV.gvi
  EQE_Measuring_Setup_NanOpto::SubVis::Main Sub Functions::Move Arduino Initialize Subroutine.gvi
  EQE_Measuring_Setup_NanOpto::SubVis::Instrument Control::Arduinos::XZ Carriage Arduino::XZ Carriage Arduino Homing Sequence.gvi
  EQE_Measuring_Setup_NanOpto::SubVis::Instrument Control::Arduinos::XZ Carriage Arduino::XZ Carriage Label to Coordinate.gvi
  EQE_Measuring_Setup_NanOpto::SubVis::Instrument Control::Arduinos::XZ Carriage Arduino::XZ Coordinate to Gcode command.gvi
  EQE_Measuring_Setup_NanOpto::SubVis::Instrument Control::Arduinos::XZ Carriage Arduino::XZ Carriage Arduino Move to location.gvi
  EQE_Measuring_Setup_NanOpto::SubVis::Main Sub Functions::Global Abort::Global Abort.gvi
  EQE_Measuring_Setup_NanOpto::SubVis::Main Sub Functions::Move Arduino Close Subroutine.gvi
diagram:
  case ($"Error In") {
    frame Error, Default {
      w1 = $"Error In"
    }
    frame No Error {
      Property Node(instance in=$"Full Reference Cluster") -> ("XZ Stage Controls Reference Cluster:XZ Stage Active"=w2, instance out=w3)
      call "FGV Current State.gvi"(Current State Instructions="Set Current State", Current State="Move XZ Stage", Error In=$"Error In") -> (Error Out=w4)
      call "XZ Stage Initialize And Home.gvi"(Instrument Coms Info In=$"Instrument Coms Info", Debugging Cluster In=$"Debugging Cluster In", Error In=w4) -> (Error Out=w5)
      Property Node(instance in=w2, "Value"=TRUE, error in=w5) -> (error out=w6)
      while {
        Property Node(instance in=w3) -> ("Enum Reference Cluster:Main Tab"=w7, "Enum Reference Cluster:Configuration tab"=w8)
        Property Node(instance in=w7, error in=w6)
        Property Node(instance in=w8)
        stop if _
      }
      w1 = _
    }
  }
  $"Error Out" <- w1
  call "Current State FGV.gvi"(Instruction Current State FGV="Set current State", Crrent State="Move Arduino") -> (Error Out=w9)
  call "Move Arduino Initialize Subroutine.gvi"(Carriage Arduino Address=$"Carriage Arduino Address", XZ Carriage Arduino Log=$"XZ Carriage Arduino Log", Carriage Active=$"Carriage Active", Error Out_2=w9) -> (XZ Carriage Arduino Open Visa Session In=w10, XZ Carriage Arduino Log In=w11, XZ Carriage Arduino Log_2=w12, Carriage Active_2=w13, Error In=w14)
  call "XZ Carriage Arduino Homing Sequence.gvi"(XZ Carriage Arduino Open Visa Session In=w10, XZ Carriage Arduino Log In=w11, Error In=w14) -> (XZ Carriage Arduino Open Visa Session Out=w15, XZ Carriage Arduino Log Out=w16, Error Out=w17)
  s1 = 0  # shift register
  while {
    case ($"Set Postion") {
      frame False, Default {
        Increment(x=s1) -> w21
        w18 = w15
        w19 = w16
        w20 = w17
      }
      frame True {
        case ($"Custom Position") {
          frame False, Default {
            Format Into String($"Cell Label") -> w24
            call "XZ Carriage Label to Coordinate.gvi"(Cell Label=w24, R.01 Reference Coordinates=$"R.01 Reference Coordinates", Error In=w17) -> (Gcode Instruction Out=w22, Error Out=w23)
          }
          frame True {
            call "XZ Coordinate to Gcode command.gvi"(X position=$"X position", Z position=$"Z position") -> (Input Command=w22)
            w23 = w17
          }
        }
        call "XZ Carriage Arduino Move to location.gvi"(XZ Carriage Arduino open Visa session In=w15, XZ Carriage Arduino Log In=w16, Input Command=w22, Error In=w23) -> (XZ Carriage Arduino open Visa Session Out=w18, XZ Carriage Arduino Log Out=w19, Error Out=w20)
        w21 = 0
      }
    }
    $"XZ Carriage Arduino Log" <- w19
    Is Greater(x=w21, y=120) -> w25
    call "Global Abort.gvi"(Instruction="Read Abort State") -> (Local Abort State=w26, Global Abort State=w27)
    Logical Or(w25, $"Release Arduino", w26, w27) -> w28
    Wait Until Next Multiple(multiple to wait=500)
    next s1 = w21
    stop if w28
  }
  call "Move Arduino Close Subroutine.gvi"(Input_2=w18, Input_3=w20) -> (Carriage Active=w29)
  $"Carriage Active" <- w29
  $"Carriage Active" <- w13
  $"XZ Carriage Arduino Log" <- w12
