vi "Main Window.gvi"   [LabVIEW NXG 5.0.0]
panel controls:
  "Main Tab": i32
  "Light Calibration Tab": i32
  "New Spectrum Calibration": bool
  "Load Spectrum Calibration": bool
  "Save Spectrum Calibration": bool
  "Configuration Tab": i32
  "Abort Button": bool
  "Exit App Button": bool
  "Debugging Cluster": "Debugging Cluster.gtype"
  "Rainbow Measurement tab": i32
  "Instrument Coms Info": "Instrument Coms Info.gtype"
  "Rainbow Sweep Param Selector MSpot": "Rainbow Sweep Param Selector.gtype" = {0, 1100, 300, 1, 1, 0}
  "Check Dividing Wavelength Calibration": bool
  "New Dividing Wavelength Calibration": bool
  "Load Dividing Wavelength Calibration": bool
  "Desired MSpot Calibration Operation": "Calibration Operation Control.gtype" = "Check Calibration"
  "MSpot Sperctrum Calibration Parameters": "MSpot Spectrum Calibration Parameters.gtype" = {"Min Position (mm)"=0, "Max Position (mm)"=50, "Position step size (mm)"=0.1, "Manual Spectra?"=FALSE, "Flame Integration Time (us)"=1000, "Flame Scans to Average"=1000}
  "New Light Power Calibration": bool
  "Load Light Power Calibration": bool
  "Save Light Power Calibration": bool
  "Rainbow Sweep Parameters LPC": "Rainbow Sweep Param Selector.gtype" = {0, 900, 400, 1, 1, 0}
  "Default Data Saving Location": path = path "D:\\Rainbow Measurements"
  "Light Power Calibration Data": "Light Power Calibration Data.gtype"[]
  "Custom date": bool
  "Author Initials": string
  "Batch Name": string
  "Cell Number": string
  "Sample Comments": string
  "Label Info Error Label": string
  "Label Info Missing Error": bool
  "Acquire Single Rainbow Button": bool
  "Save Single Measurement": bool
  "Rainbow Sweep Parameters SRM": "Rainbow Sweep Param Selector.gtype" = {0, 771, 334, 10, 1, 0}
  "LPC Parameters": "Light power Calibration Parameters.gtype" = {"Powermeter Averages"=3, "Photodtctr Area (m^2)"=5.543e-05, "Only Full Spectrum"=TRUE}
  "SRM Raw Plot Rainbow Sweep Selector": string
  "SRM Refined Plot Rainbow Sweep Types": string
  "Save Coordinates": bool
  "Main Tab": i32 = 1
  "SRM Plot Parameter Selector": "SRM Refined Plot Parameter Selector.gtype" = "Efficiency (%)"
  "SRM Specific Parameters": "SRM Specific Parameters.gtype" = {"Max (V)"=1, "Min (V)"=-0.2, "V Points"=100, "Current Range (A)"=0.1, "Autorange"=TRUE, "Sweep Dir"=FALSE, "Current Averages"=3, "Max (A)"=0.1, "Integration Time"=0.5, "Cell Area (m^2)"=8e-06, "Full Spctr Ref"=TRUE}
  "Full Reference Cluster": "Full Reference Cluster.gtype"
  "Full Beam Multispectral Data Array": "Full MSpot Multispectral Data.gtype"[]
  "Activate XZ Stage": bool
  "Set Postion": bool
  "Release XZ Stage": bool
  "XZ Stage Active": bool
  "XZ Stage Cell": "XZ Stage Cell.gtype" = "L.01"
  "Custom Position": bool
  "Acquire Multiple Rainbow Button": bool
  "Load Multiple Measurement": bool
  "Save Multiple Measurement": bool
  "Rainbow Sweep Parameters MRM": "Rainbow Sweep Param Selector.gtype" = {0, 450, 400, 50, 1, 0}
  "MRM Current Raw Cell Plot": string
  "MRM Specific Parameters": "MRM Specific Parameters.gtype" = {"Max (V)"=1, "Min (V)"=-0.2, "V Points"=100, "Curr Range (A)"=0.1, "Sweep Dir"=FALSE, "Current Avg"=3, "Max (A)"=1, "Integration Time"=0.5, "Cell Area (m^2)"=8e-06, "Autorange"=TRUE, "Full Spctr Ref"=TRUE}
  "XZ All Position Cluster": "XZ All Position Cluster.gtype" = {159.5, 31, 30.5, 13.5, 64, 31.4, 71.8, 27.7, 5.6, 26, 26.5}
  "XZ Coordinate": "XZ Coordinate Cluster In.gtype"
  "Misc Data Mega Cluster": "Misc Data Mega Cluster.gtype" = {"Full Reference Cluster"={1062207609, 1064304771, 1072693300, 1073741877, 1076887617, 1130365029, 1095762042, 1101004830, 1068498977, 1070596139, 1131413606, 1086324756, 1110442052, 1090519118, 1082130516, 1085276177, 1099956252, 1091567722, 1089470535, 1097859206, 1104150570, 1105199151, 1080033357, 1058013265, 1053818947, 1066401818, 1055916107, 1113587792, 1118830682, 1124073567, 1125122144, 1123024990, 1126170721, 1129316452, 1128267875, 1078984777, 1107296312, 1133510760, 1136656523, 1134559337, 1135607919, 1138753677, 1137705100, 1060110451, 1120927836, 1117782105, 1115684949, 1112539212, 1116733527, 1119879259, 1121976413, 1132462183}, "Cell Naming Cluster"={"Cell Label"="", "Sample Prefix"="tawet.210527.teaete.", "Author Initials"="tawet", "Current Date"="210527", "Batch Name"="teaete"}, "All XZ Position Cluster"={188.7, 31, 37, 40.9, 67.3, 40.9, 101, 27.5, 5.5, 31, 31.7}, "All Paths"={"Thorlabs Motor Serial Number File Path"=path "", "Default Data Saving Location"=path "D:\\Rainbow Measurements"}}
  "Instrument Control Mega Cluster": "Instrument Control Mega Cluster.gtype"
  "MSpot Mega Cluster": "MSpot Mega Cluster.gtype"
  "LPC Mega Cluster": "LPC Mega Cluster.gtype"
  "SRM Mega Cluster": "SRM Mega Cluster.gtype"
  "Photodetector Start Measurement": bool
  "Load Dividing Wavelength Fitted Data": bool
  "Set Cell": bool
  "Desired Cell": "XZ Stage Cell.gtype" = "L.01"
  "Cell to Measure": "XZ Stage Cell.gtype" = "L.01"
  "Rainbow Sweep Param Selector Beam PD": "Rainbow Sweep Param Selector.gtype" = {0, 1100, 300, 1, 1, 0}
  "Load Single Measurement": bool
  "MRM Cell Selector": "MRM Cell Selector.gtype"
  "MRM Mega Cluster": "MRM Mega Cluster.gtype" = {"MRM Specific Parameters"={"Max (V)"=1.2, "Min (V)"=-0.5, "V Points"=100, "Curr Range (A)"=0, "Sweep Dir"=FALSE, "Current Avg"=3, "Max (A)"=0.1, "Integration Time"=0.5, "Cell Area (m^2)"=8e-06, "Autorange"=TRUE, "Full Spctr Ref"=TRUE}, "Cell Selector"={FALSE, FALSE, FALSE, FALSE, FALSE, FALSE, FALSE, FALSE, FALSE, FALSE, FALSE, FALSE, FALSE, FALSE, FALSE, FALSE, FALSE, FALSE, FALSE, FALSE, FALSE, FALSE, FALSE, FALSE, FALSE, FALSE, FALSE, FALSE}, "Cells to Measure Array"=[], "Rainbow Sweep Parameters MRM"={0, 900, 400, 1, 1, 0}, "MRM Data Array"=[]}
  "MRM Cell Refined Plot Selector": string
  "MRM Raw Plot Rainbow Sweep Selector": string
  "Mask Calibration Start Measurement": bool
panel indicators:
  "Irradiance Calibration": f64[]
  "Current State": "Queue Instructions Control.gtype"
  "Current Sub State": string
  "Beam Power Density": f64[][]
  "Path Where the Calibration Files Will Be Stored (Can't Be Changed)": path
  "Light Power Calibration": cluster{"Wavelength": f64[], "Power": f64[]}[]
  "Current Date": string
  "Progress %": f64
  "Progress counter": f64
  "State": string
  "Substate": string
  "IV Plot Out": "SRM Single Plot Cluster.gtype"[]
  "SRM Full IV data Array": "IV Full Data Cluster.gtype"[]
  "IV Extracted Parameter Plot": T5
  "Sweep Live Parameters LPC": "LPC Sweep Live Parameters.gtype"
  "Sweep Live Parameters SRM": "SRM Sweep Live Parameters.gtype"
  "IV Plot Out Multiple": "SRM Single Plot Cluster.gtype"[]
  "Sample Prefix": string
  "Start": bool
  "SRM Light Power Density (W/m^2)": f64
  "Error Out": error
types:
  "Queue Instructions Control.gtype" = enum{"Undefined State", "Debug Check", "Initialize App", "Idle", "Light Power Calibration", "Rainbow Single Measurement", "Rainbow Multiple Measurement", "Light Calibration Irradiance", "Light Calibration Spectral Density", "Light Calibration Power Density", "Stand Alone Photodetector Measurement", "MSpot Spectrum Calibration", "Move XZ Stage", "Mask Calibration", "Change Cell", "Update All Info Meta Cluster", "Access TXT File", "Stop App", "State 2 ", "State 3 ", "State 4"}
  "Insturment Debugging Cluster.gtype" = cluster{"Keithley": bool, "Arduinos": bool, "Thorlabs Motors": bool, "Photodetector": bool, "Flame Spectr": bool}
  "Debugging Cluster.gtype" = cluster{"Debugging mode?": bool, "Initialize App": bool, "Insturment Debugging": "Insturment Debugging Cluster.gtype"}
  T1 = cluster{"Element 1": "VISA Instr", "Element 2": string}
  "Arduino Detection cluster control.gtype" = cluster{"XZ Stage Arduino Address": "VISA Instr", "XZ Stage Arduino Detected?": bool, "Multiplexer Arduino Detected?": bool, "Multiplexer Arduino Address": "VISA Instr", "Arduinos List": T1[], "XZ Stage Log": string, "Multiplexer Log": string, "XZ Homed?": bool}
  "Thorlabs Motors Serial Number In.gtype" = cluster{"Thorlabs Blue Motor": string, "Thorlabs Red Motor": string, "Blue Motor Homed?": bool, "Red Motor Homed?": bool}
  "Instrument Coms Info.gtype" = cluster{"Arduino Coms Info": "Arduino Detection cluster control.gtype", "Photodetector Names": string[], "Keythley Address": "VISA Instr", "Photodetector Detected?": bool, "Thorlabs Motors Detected?": bool, "Keithley Detected?": bool, "Thorlabs Motors Serial Number": "Thorlabs Motors Serial Number In.gtype", "Photodetector IVI session": "Ivi IviDefault", "Flame ID": string, "Flame Detected?": bool, "Flame Wrapper ID": u64}
  "Raibow Sweep Selector.gtype" = enum{"Red Sweep", "Blue Sweep", "Full Sweep Red First", "Full Sweep Blue First"}
  T2 = enum{"Red Sweep Closing", "Red Sweep Opening", "Red Sweep Both Ways"}
  T3 = enum{"Blue Sweep Opening", "Blue Sweep Closing", "Blue Sweep Both Ways"}
  "Rainbow Sweep Type Selector.gtype" = cluster{"Red Sweep Mode": T2, "Blue Sweep Mode": T3}
  "Rainbow Sweep Param Selector.gtype" = cluster{"Raibow Sweep Selector": "Raibow Sweep Selector.gtype", "Max Wavelength (nm)": f64, "Min Wavelength (nm)": f64, "Wavelength Step (nm)": f64, "Rainbow Sweep Type Selector": "Rainbow Sweep Type Selector.gtype"}
  "Calibration Operation Control.gtype" = enum{"Check Calibration", "Load Calibration", "New Calibration", "Load Fityc Data"}
  "MSpot Spectrum Calibration Parameters.gtype" = cluster{"Min Position (mm)": f64, "Max Position (mm)": f64, "Position step size (mm)": f64, "Manual Spectra?": bool, "Flame Integration Time (us)": f64, "Flame Scans to Average": u32}
  T4 = cluster{"Dividing Wavelength Array": f64[], "Measured Power Array": f64[], "Power Density Array": f64[]}
  "Rainbow Sweep Types.gtype" = enum{"Red Sweep Closing", "Red Sweep Opening", "Blue Sweep Closing", "Blue Sweep Opening"}
  "Light Power Calibration Data.gtype" = cluster{"Single Light Calibration": T4, "Rainbow Sweep Types": "Rainbow Sweep Types.gtype", "Total Light Power Density (W/m^2)": f64}
  "SRM Single Plot Cluster.gtype" = cluster{"Voltage (V)": f64[], "Current Density (A/m^2)": f64[]}
  "Light power Calibration Parameters.gtype" = cluster{"Powermeter Averages": u32, "Photodtctr Area (m^2)": f64, "Only Full Spectrum": bool}
  "IV Single Measurement.gtype" = cluster{"Voltage (V)": f64[], "Current (A)": f64[], "Current Density (A/m^2)": f64[], "Dividing Wavelength (nm)": f64, "Light Power Density (W/m^2)": f64, "Total Light Power Density (W/m^2)": f64}
  "IV Refined Full Sweep Data.gtype" = cluster{"Rs (Ω · m^2)": f64[], "Rsh (Ω · m^2)": f64[], "Jsc (A/m^2)": f64[], "Voc (V)": f64[], "FF (%)": f64[], "Efficiency (%)": f64[], "Dividing Wavelength (nm)": f64[], "Light Power Density (W/m^2)": f64[]}
  "IV Full Data Cluster.gtype" = cluster{"IV Measurements Array": "IV Single Measurement.gtype"[], "Rainbow Sweep Types": "Rainbow Sweep Types.gtype", "IV Refined Data": "IV Refined Full Sweep Data.gtype", "Total Light Power Density (W/m^2)": f64}
  T5 = cluster{"Dividing Wavelength (nm)": f64[], "Element 2": f64[]}
  "LPC Sweep Live Parameters.gtype" = cluster{"Light Power Density (W/m^2) ": f64, "Current Wavelength (nm)": f64, "Rainbow Sweep Types": "Rainbow Sweep Types.gtype"}
  "SRM Refined Plot Parameter Selector.gtype" = enum{"Efficiency (%)", "Jsc (A / m^2)", "Voc (V)", "Light Power Density (W/m^2)", "FF (%)", "Rs (Ω · m^2)", "Rsh (Ω · m^2)"}
  "SRM Specific Parameters.gtype" = cluster{"Max (V)": f64, "Min (V)": f64, "V Points": u32, "Current Range (A)": f64, "Autorange": bool, "Sweep Dir": bool, "Current Averages": u32, "Max (A)": f64, "Integration Time": f64, "Cell Area (m^2)": f64, "Full Spctr Ref": bool}
  "Enum Control Reference Cluster.gtype" = cluster{"Main Tab": "TabControl reference", "Rainbow Measurement tab": "TabControl reference", "Configuration tab": "TabControl reference", "Light Calibration tab": "TabControl reference", "SRM Plot Parameter Selector Ref": "EnumSelector reference", "Current State Ref": "EnumSelector reference"}
  "Boolean Control Reference Cluster.gtype" = cluster{"Custom date": "CheckBox reference", "Label Info Missing Error": "BooleanControl reference"}
  "Numeric Control Reference Cluster.gtype" = cluster{"Beam Power Density": "IntensityGraph reference"[][], "Irradiance Calibration": "Graph reference"[], "SRM Light Power Density Ref": "NumericTextBoxDouble reference"}
  "Numeric Cluster Reference Cluster.gtype" = cluster{"LPC Parameters Ref": "Cluster reference", "Sweep Live Parameters LPC ref": "Cluster reference"}
  "Path Reference Cluster.gtype" = cluster{"Calibration Files Path": "PathSelector reference", "Default Data Saving Location": "PathSelector reference"}
  "Cluster Reference Cluster.gtype" = cluster{"Light Power Calibration": "Graph reference", "Rainbow Sweep Parameters RSM": "Cluster reference", "Rainbow Sweep Param Selector MSpot": "Cluster reference", "MSpot Spectrum Calibration Parameters": "Cluster reference", "SRM Raw Plot Rainbow Sweep Selector": "ComboBoxSelector reference", "SRM Refined Plot Rainbow Sweep Types": "ComboBoxSelector reference", "SRM Specific Parameters": "Cluster reference", "Label Info Error Label": "StringControl reference", "Sample Comments": "StringControl reference", "Cell Number": "StringControl reference", "Author Initials": "ComboBoxSelector reference", "Batch Name": "StringControl reference", "Sweep Live Parameters RSM": "Cluster reference", "Rainbow Sweep Parameters LPC": "Cluster reference", "State": "StringControl reference", "Current Substate": "StringControl reference", "Substate": "StringControl reference", "Current Date": "StringControl reference", "Sample Prefix": "StringControl reference", "IV Extracted Parameter Plot ": "Graph reference", "Light Power Calibration Data Ref": "ArrayViewer reference", "IV Plot Out Ref": "Graph reference", "MRM Cell Selector Ref": "Cluster reference", "IV Plot Out Multiple Reference": "Graph reference", "Rainbow Sweep Parameters MRM Ref": "Cluster reference", "MRM Specific Parameters Ref": "Cluster reference", "MRM Cell Refined Plot Selector ref": "ComboBoxSelector reference", "MRM Current Raw Cell Plot": "ComboBoxSelector reference", "MRM Raw Plot Rainbow Sweep Relector Ref": "ComboBoxSelector reference", "XZ All Position Cluster Ref": "Cluster reference"}
  "XZ Stage Controls Reference Cluster.gtype" = cluster{"Custom Position": "BooleanControl reference", "Set Position": "BooleanControl reference", "XZ Stage Active": "BooleanControl reference", "Release XZ Stage": "BooleanControl reference", "XZ Coordinates": "Cluster reference", "Activate XZ Stage": "BooleanControl reference", "XZ Stage Cell Reference": "EnumSelector reference"}
  "Full Reference Cluster.gtype" = cluster{"Enum Reference Cluster": "Enum Control Reference Cluster.gtype", "Boolean Reference Cluster": "Boolean Control Reference Cluster.gtype", "Numeric Reference Cluster": "Numeric Control Reference Cluster.gtype", "Numeric Cluster Reference Cluster": "Numeric Cluster Reference Cluster.gtype", "Path Reference Cluster": "Path Reference Cluster.gtype", "Cluster Reference Cluster": "Cluster Reference Cluster.gtype", "XZ Stage Controls Reference Cluster": "XZ Stage Controls Reference Cluster.gtype"}
  "SRM Sweep Live Parameters.gtype" = cluster{"Current Wavelength (nm)": f64, "Rainbow Sweep Types": "Rainbow Sweep Types.gtype", "Finished Measurement?": bool}
  "MSpot Spectrum Data.gtype" = cluster{"M Spot Spectrum": cluster{"Wavelength": f64[], "Counts": f64[]}, "Blue Motor Position (mm)": f64, "Red Motor Position (mm)": f64, "Dividing Wavelength (nm)": f64}
  "Full MSpot Multispectral Data.gtype" = cluster{"MSpot Spectrum Data Array": "MSpot Spectrum Data.gtype"[], "Rainbow Sweep Types": "Rainbow Sweep Types.gtype"}
  "XZ Stage Cell.gtype" = enum{"L.01", "L.02", "L.03", "L.04", "L.05", "L.06", "L.07", "L.08", "L.09", "L.10", "L.11", "L.12", "R.01", "R.02", "R.03", "R.04", "R.05", "R.06", "R.07", "R.08", "R.09", "R.10", "R.11", "R.12"}
  "MRM Specific Parameters.gtype" = cluster{"Max (V)": f64, "Min (V)": f64, "V Points": u32, "Curr Range (A)": f64, "Sweep Dir": bool, "Current Avg": u32, "Max (A)": f64, "Integration Time": f64, "Cell Area (m^2)": f64, "Autorange": bool, "Full Spctr Ref": bool}
  T6 = cluster{"X Coordinate (mm)": f64, "Z Coordinate (mm)": f64, "Aprch Distance (mm)": f64}
  T7 = cluster{"X Coordinate (mm)": f64, "Z Coordinate (mm)": f64, "Vertical Spacing (mm)": f64, "Aprch Distance (mm)": f64, "Aprch Dstnc L.12 (mm)": f64}
  "XZ All Position Cluster.gtype" = cluster{"Diffusor Coordinates": T6, "Photodetector Coordinates": T6, "Cell R.01 Coordinates": T7}
  "XZ Coordinate Cluster In.gtype" = cluster{"X Coordinate (mm)": f64, "Z Coordinate (mm)": f64}
  "Cell Naming Cluster.gtype" = cluster{"Cell Label": string, "Sample Prefix": string, "Author Initials": string, "Current Date": string, "Batch Name": string}
  T8 = cluster{"Thorlabs Motor Serial Number File Path": path, "Default Data Saving Location": path}
  "Misc Data Mega Cluster.gtype" = cluster{"Full Reference Cluster": "Full Reference Cluster.gtype", "Cell Naming Cluster": "Cell Naming Cluster.gtype", "All XZ Position Cluster": "XZ All Position Cluster.gtype", "All Paths": T8}
  "Instrument Control Mega Cluster.gtype" = cluster{"Instruments Coms Info": "Instrument Coms Info.gtype", "Debugging Cluster": "Debugging Cluster.gtype"}
  "MSpot Mega Cluster.gtype" = cluster{"Rainbow Sweep Parameters MSpot": "Rainbow Sweep Param Selector.gtype", "MSpot Sperctrum Calibration Parameters": "MSpot Spectrum Calibration Parameters.gtype", "Full Beam Multispectral Data Array": "Full MSpot Multispectral Data.gtype"[]}
  "LPC Mega Cluster.gtype" = cluster{"Rainbow Sweep Parameters LPC": "Rainbow Sweep Param Selector.gtype", "LPC Specific Parameters": "Light power Calibration Parameters.gtype", "Light Power Calibration Data": "Light Power Calibration Data.gtype"[]}
  "IV Full Raw Data.gtype" = cluster{"Rainbow Sweep Types": "Rainbow Sweep Types.gtype", "IV Raw Data Array": "IV Single Measurement.gtype"[]}
  "SRM Mega Cluster.gtype" = cluster{"SRM Specific Parameters": "SRM Specific Parameters.gtype", "Rainbow Sweep Parameters SRM": "Rainbow Sweep Param Selector.gtype", "SRM Full IV data Array": "IV Full Data Cluster.gtype"[], "Full IV Curve Raw Data": "IV Full Raw Data.gtype"[]}
  T9 = cluster{"L.01": bool, "R.01": bool, "L.02": bool, "R.02": bool, "L.03": bool, "R.03": bool, "L.04": bool, "R.04": bool, "L.05": bool, "R.05": bool, "L.06": bool, "R.06": bool, "L.07": bool, "R.07": bool, "L.08": bool, "R.08": bool, "L.09": bool, "R.09": bool, "L.10": bool, "R.10": bool, "L.11": bool, "R.11": bool, "L.12": bool, "R.12": bool}
  "MRM Cell Selector.gtype" = cluster{"All": bool, "Left": bool, "Right": bool, "Cell Cluster": T9, "Reset": bool}
  "Selected Cells Array.gtype" = "XZ Stage Cell.gtype"[]
  T10 = enum{"L.01", "L.02", "L.03", "L.04", "L.05", "L.06", "L.07", "L.08", "L.09", "L.10", "L.11", "L.12", "R.01", "R.02", "R.03", "R.04", "R.05", "R.06", "R.07", "R.08", "R.09", "R.10", "R.11", "R.12"}
  "MRM Full Data From SRM Cluster.gtype" = cluster{"SRM Mega Cluster": "SRM Mega Cluster.gtype", "Cell Label": T10}
  "MRM Mega Cluster.gtype" = cluster{"MRM Specific Parameters": "MRM Specific Parameters.gtype", "Cell Selector": "MRM Cell Selector.gtype", "Cells to Measure Array": "Selected Cells Array.gtype", "Rainbow Sweep Parameters MRM": "Rainbow Sweep Param Selector.gtype", "MRM Data Array": "MRM Full Data From SRM Cluster.gtype"[]}
uses:
  Rainbow Measurement Setup::Side Functions::Global Abort::FGV Global Abort.gvi
  Rainbow Measurement Setup::Main Functions::Instruction Queue::Current State::FGV Current State.gvi
  Rainbow Measurement Setup::Main Functions::Debugging::Debugging Prompt.gvi
  Rainbow Measurement Setup::Main Functions::Initialize App::Initialize app subroutine.gvi
  Rainbow Measurement Setup::Side Functions::Utilities::Progress Handling::Progress FGV.gvi
  Rainbow Measurement Setup::Main Functions::One Time Calibrations::MSpot Spectrum::MSpot Spectrum Calibration Subroutine.gvi
  Rainbow Measurement Setup::Main Functions::Rainbow Measurement::Light Power Calibration::Light Power Calibration Subroutine.gvi
  Rainbow Measurement Setup::Main Functions::XZ Stage Movements::XZ Locking Movement Subroutine.gvi
  Rainbow Measurement Setup::Side Functions::Instrument Control::Arduino::Multiplexer Arduino::Mux Set Cell Subroutine.gvi
  Rainbow Measurement Setup::Side Functions::Instrument Control::Photodetector::Photodetector Stand Alone Subroutine.gvi
  Rainbow Measurement Setup::Main Functions::One Time Calibrations::MSpot Spectrum::Mask calibration::Mask Calibration Subroutine Debug Check.gvi
  Rainbow Measurement Setup::Main Functions::Rainbow Measurement::Cell Single Rainbow Measurement::Single Rainbow Measurement Subroutine.gvi
  Rainbow Measurement Setup::Main Functions::Rainbow Measurement::Cell Multiple Rainbow Measurement::Multiple Rainbow Measurement Subroutine.gvi
  NI::G Core::Error::Is Error.gvi
  Rainbow Measurement Setup::Side Functions::Global Abort::Global Abort Sequence.gvi
  Rainbow Measurement Setup::Side Functions::Timeout Subroutines::Timeout Sequence.gvi
  Rainbow Measurement Setup::Side Functions::Timeout Subroutines::Timeout Read FGV Data Subroutine.gvi
  Rainbow Measurement Setup::Side Functions::Exit App Sequence.gvi
  Rainbow Measurement Setup::Main Functions::Instruction Queue::Check Queue And Label.gvi
  Rainbow Measurement Setup::Main Functions::Instruction Queue::Conditional Enqueue.gvi
  Rainbow Measurement Setup::Main Functions::One Time Calibrations::MSpot Spectrum::MSpot Calibration Operation Translator.gvi
  Rainbow Measurement Setup::Side Functions::Sample Naming::Sample Name Checkup Subroutine.gvi
  Rainbow Measurement Setup::Side Functions::Sample Naming::Sample Prefix FGV.gvi
  Rainbow Measurement Setup::Main Functions::Rainbow Measurement::Light Power Calibration::Light Power Calibration Operation Translator.gvi
  Rainbow Measurement Setup::Main Functions::Rainbow Measurement::Cell Single Rainbow Measurement::SRM Operation Translator.gvi
  Rainbow Measurement Setup::Main Functions::Rainbow Measurement::Cell Multiple Rainbow Measurement::MRM Cell Selector::MRM Check any cell selected.gvi
  Rainbow Measurement Setup::Main Functions::Rainbow Measurement::Cell Multiple Rainbow Measurement::MRM Operation Translator.gvi
  Rainbow Measurement Setup::Side Functions::Instrument Control::Arduino::XZ Stage Arduino::XZ Move Requisites.gvi
  Rainbow Measurement Setup::Side Functions::Timeout Subroutines::Update Controls Subroutine.gvi
  Rainbow Measurement Setup::Side Functions::Instrument Control::Arduino::Multiplexer Arduino::Set Cell Requisites.gvi
  Rainbow Measurement Setup::Side Functions::Provisional Cell Selection FGV.gvi
  Rainbow Measurement Setup::Main Functions::Rainbow Measurement::Cell Multiple Rainbow Measurement::MRM Cell Selector::MRM Cell Updater.gvi
  Rainbow Measurement Setup::Side Functions::Timeout Subroutines::Update MRM Controls.gvi
  NI::G Core::Error::Multiplex Errors.gvi
  NI::G Core::Error::Display Error.gvi
diagram:
  case (TRUE) {
    frame False, Default {
      w1 = no error
    }
    frame True {
      Property Node(instance in=reference to "Start", "ValueSignaling"=TRUE) -> (error out=w1)
      Property Node(instance in="Enum Control Reference Cluster.gtype" {all zero or empty}, "Main Tab"=reference to "Main Tab", "Rainbow Measurement tab"=reference to "Rainbow Measurement tab", "Configuration tab"=reference to "Configuration Tab", "Light Calibration tab"=reference to "Light Calibration Tab", "SRM Plot Parameter Selector Ref"=reference to "SRM Plot Parameter Selector", "Current State Ref"=reference to "Current State") -> (instance out=w2)
      w3 = "Boolean Control Reference Cluster.gtype" {all zero or empty}
      Property Node(instance in=w3, "Custom date"=reference to "Custom date", "Label Info Missing Error"=reference to "Label Info Missing Error") -> (instance out=w4)
      w5 = "Numeric Control Reference Cluster.gtype" {all zero or empty}
      Property Node(instance in=w5, "Beam Power Density"=reference to "Beam Power Density", "Irradiance Calibration"=reference to "Irradiance Calibration", "SRM Light Power Density Ref"=reference to "SRM Light Power Density (W/m^2)") -> (instance out=w6)
      w7 = "Numeric Cluster Reference Cluster.gtype" {all zero or empty}
      Property Node(instance in=w7, "LPC Parameters Ref"=reference to "LPC Parameters", "Sweep Live Parameters LPC ref"=reference to "Sweep Live Parameters LPC") -> (instance out=w8)
      w9 = reference to "Path Where the Calibration Files Will Be Stored (Can't Be Changed)"
      Property Node(instance in="Path Reference Cluster.gtype" {all zero or empty}, "Calibration Files Path"=w9, "Default Data Saving Location"=reference to "Default Data Saving Location") -> (instance out=w10)
      Property Node(instance in="Cluster Reference Cluster.gtype" {all zero or empty}, "Light Power Calibration"=reference to "Light Power Calibration", "Light Power Calibration Data Ref"=reference to "Light Power Calibration Data", "Rainbow Sweep Parameters LPC"=reference to "Rainbow Sweep Parameters LPC", "Rainbow Sweep Parameters RSM"=reference to "Rainbow Sweep Parameters SRM", "Rainbow Sweep Param Selector MSpot"=reference to "Rainbow Sweep Param Selector MSpot", "MSpot Spectrum Calibration Parameters"=reference to "MSpot Sperctrum Calibration Parameters", "SRM Raw Plot Rainbow Sweep Selector"=reference to "SRM Raw Plot Rainbow Sweep Selector", "SRM Refined Plot Rainbow Sweep Types"=reference to "SRM Refined Plot Rainbow Sweep Types", "SRM Specific Parameters"=reference to "SRM Specific Parameters", "Sweep Live Parameters RSM"=reference to "Sweep Live Parameters SRM", "XZ All Position Cluster Ref"=reference to "XZ All Position Cluster", "Label Info Error Label"=reference to "Label Info Error Label", "Sample Comments"=reference to "Sample Comments", "Cell Number"=reference to "Cell Number", "Author Initials"=reference to "Author Initials", "Batch Name"=reference to "Batch Name", "IV Plot Out Ref"=reference to "IV Plot Out", "State"=reference to "State", "Current Substate"=reference to "Current Sub State", "Substate"=reference to "Substate", "Current Date"=reference to "Current Date", "Sample Prefix"=reference to "Sample Prefix", "IV Extracted Parameter Plot "=reference to "IV Extracted Parameter Plot", "MRM Cell Selector Ref"=reference to "MRM Cell Selector", "IV Plot Out Multiple Reference"=reference to "IV Plot Out Multiple", "Rainbow Sweep Parameters MRM Ref"=reference to "Rainbow Sweep Parameters MRM", "MRM Specific Parameters Ref"=reference to "MRM Specific Parameters", "MRM Cell Refined Plot Selector ref"=reference to "MRM Cell Refined Plot Selector", "MRM Current Raw Cell Plot"=reference to "MRM Current Raw Cell Plot", "MRM Raw Plot Rainbow Sweep Relector Ref"=reference to "MRM Raw Plot Rainbow Sweep Selector") -> (instance out=w11)
      w12 = "XZ Stage Controls Reference Cluster.gtype" {all zero or empty}
      Property Node(instance in=w12, "XZ Stage Cell Reference"=reference to "XZ Stage Cell", "XZ Coordinates"=reference to "XZ Coordinate", "Custom Position"=reference to "Custom Position", "Set Position"=reference to "Set Postion", "XZ Stage Active"=reference to "XZ Stage Active", "Release XZ Stage"=reference to "Release XZ Stage", "Activate XZ Stage"=reference to "Activate XZ Stage") -> (instance out=w13)
      Property Node(instance in="Full Reference Cluster.gtype" {all zero or empty}, "Enum Reference Cluster"=w2, "Boolean Reference Cluster"=w4, "Numeric Reference Cluster"=w6, "Numeric Cluster Reference Cluster"=w8, "Path Reference Cluster"=w10, "Cluster Reference Cluster"=w11, "XZ Stage Controls Reference Cluster"=w13) -> (instance out=w14)
      Property Node(instance in=$"Misc Data Mega Cluster", "Full Reference Cluster"=w14) -> (instance out=w15)
      $"Misc Data Mega Cluster" <- w15
    }
  }
  call "FGV Global Abort.gvi"(Global Abort Instructions="Reset State", Error In=w1) -> (Error Out=w16)
  call "FGV Current State.gvi"(Current State Instructions="Set Current State and Substate", Current State="Undefined State", Current Substate="Starting Up", Error In=w16) -> (Error Out=w17)
  Obtain Queue(create if not found=TRUE, element data type="Queue Instructions Control.gtype" "Undefined State", error in=w17, name="Instruction Queue") -> (error out=w18, queue out=w19)
  Enqueue Element(element="Debug Check", error in=w18, queue=w19) -> (error out=w20, queue out=w21)
  # This is the main window it takes instructions from the main pannel introduced by the user and
  # performs the corresponding necessary actions
  s1 = w21  # shift register
  s2 = w20  # shift register
  while {
    # This is the consumer loop, it takes enqueued instructions and performs the ne required actions
    case (s2) {
      frame Error, Default {
        w22 = s2
        w23 = s1
        w24 = TRUE
      }
      frame No Error {
        Dequeue Element(error in=s2, queue=s1) -> (element=w25, error out=w26, queue out=w27)
        case (w25) {
          frame "Undefined State", Default {
            w22 = w26
            w23 = w27
            w24 = default
          }
          frame "Debug Check" {
            call "Debugging Prompt.gvi"(Instrument Control Mega Cluster In=$"Instrument Control Mega Cluster", Error In=w26) -> (Instrument Control Mega Cluster Out=w28, Error Out=w29)
            Enqueue Element(element="Initialize App", error in=w29, queue=w27) -> (error out=w22, queue out=w23)
            $"Instrument Control Mega Cluster" <- w28
            w24 = default
          }
          frame "Initialize App" {
            call "Initialize app subroutine.gvi"(Instrument Control Mega Cluster In=$"Instrument Control Mega Cluster", Misc Data Mega Cluster In=$"Misc Data Mega Cluster", Error In=w26) -> (Instrument Control Mega Cluster Out=w30, Misc Data Mega Cluster Out=w31, Error Out=w32)
            $"Instrument Control Mega Cluster" <- w30
            $"Misc Data Mega Cluster" <- w31
            Enqueue Element(element="Idle", error in=w32, queue=w27) -> (error out=w22, queue out=w23)
            w24 = default
          }
          frame "Idle" {
            call "FGV Global Abort.gvi"(Global Abort Instructions="Reset State", Error In=w26) -> (Error Out=w33)
            call "FGV Current State.gvi"(Current State Instructions="Set Current State and Substate", Current State="Idle", Current Substate="Idle", Error In=w33) -> (Error Out=w34)
            call "Progress FGV.gvi"(FGV Instructions="Reset State", Error In=w34) -> (Error Out=w22)
            w23 = w27
            w24 = default
          }
          frame "MSpot Spectrum Calibration" {
            call "MSpot Spectrum Calibration Subroutine.gvi"(Instrument Control Mega Cluster In=$"Instrument Control Mega Cluster", Misc Data Mega Cluster In=$"Misc Data Mega Cluster", MSpot Mega Cluster In=$"MSpot Mega Cluster", Error In=w26) -> (Instrument Control Mega Cluster Out=w35, Misc Data Mega Cluster Out=w36, MSpot Mega Cluster Out=w37, Error Out=w38)
            $"Instrument Control Mega Cluster" <- w35
            $"Misc Data Mega Cluster" <- w36
            $"MSpot Mega Cluster" <- w37
            Enqueue Element(element="Idle", error in=w38, queue=w27) -> (error out=w22, queue out=w23)
            w24 = default
          }
          frame "Light Power Calibration" {
            call "Light Power Calibration Subroutine.gvi"(Instrument Control Mega Cluster In=$"Instrument Control Mega Cluster", Misc Data Mega Cluster In=$"Misc Data Mega Cluster", LPC Mega Cluster In=$"LPC Mega Cluster", Error In=w26) -> (Instrument Control Mega Cluster Out=w39, Misc Data Mega Cluster Out=w40, LPC Mega Cluster Out=w41, Error Out=w42)
            $"Instrument Control Mega Cluster" <- w39
            $"Misc Data Mega Cluster" <- w40
            $"LPC Mega Cluster" <- w41
            Enqueue Element(element="Idle", error in=w42, queue=w27) -> (error out=w22, queue out=w23)
            w24 = default
          }
          frame "Move XZ Stage" {
            call "XZ Locking Movement Subroutine.gvi"(Instrument Control Mega Cluster In=$"Instrument Control Mega Cluster", Misc Data Mega Cluster In=$"Misc Data Mega Cluster", Error In=w26) -> (Instrument Control Mega Cluster Out=w43, Error Out=w44)
            Enqueue Element(element="Idle", error in=w44, queue=w27) -> (error out=w22, queue out=w23)
            $"Instrument Control Mega Cluster" <- w43
            w24 = default
          }
          frame "Change Cell" {
            call "Mux Set Cell Subroutine.gvi"(Instrument Control Mega Cluster In=$"Instrument Control Mega Cluster", Desired Cell=$"Desired Cell", Error In=w26) -> (Instrument Control Mega Cluster Out=w45, Error Out=w46)
            Enqueue Element(element="Idle", error in=w46, queue=w27) -> (error out=w22, queue out=w23)
            $"Instrument Control Mega Cluster" <- w45
            w24 = default
          }
          frame "Stand Alone Photodetector Measurement" {
            call "Photodetector Stand Alone Subroutine.gvi"(Instrument Control Mega Cluster In=$"Instrument Control Mega Cluster", Error In=w26) -> (Error Out=w47)
            Enqueue Element(element="Idle", error in=w47, queue=w27) -> (error out=w22, queue out=w23)
            w24 = default
          }
          frame "Mask Calibration" {
            call "Mask Calibration Subroutine Debug Check.gvi"(Instrument Control Mega Cluster In=$"Instrument Control Mega Cluster", Error In=w26) -> (Error Out=w22)
            w23 = w27
            w24 = default
          }
          frame "Rainbow Single Measurement" {
            call "Single Rainbow Measurement Subroutine.gvi"(Instruction Queue In=w27, Instrument Control Mega Cluster In=$"Instrument Control Mega Cluster", Misc Data Mega Cluster In=$"Misc Data Mega Cluster", LPC Mega Cluster In=$"LPC Mega Cluster", SRM Mega Cluster In=$"SRM Mega Cluster", Error In=w26, Stand Alone?=FALSE) -> (Instruction Queue Out=w48, Instrument Control Mega Cluster Out=w49, Misc Data Mega Cluster Out=w50, LPC Mega Cluster Out=w51, SRM Mega Cluster Out=w52, Error Out=w53)
            $"Instrument Control Mega Cluster" <- w49
            $"Misc Data Mega Cluster" <- w50
            $"LPC Mega Cluster" <- w51
            Enqueue Element(element="Idle", error in=w53, queue=w48) -> (error out=w22, queue out=w23)
            $"SRM Mega Cluster" <- w52
            w24 = default
          }
          frame "Rainbow Multiple Measurement" {
            call "Multiple Rainbow Measurement Subroutine.gvi"(Instruction Queue In=w27, Instrument Control Mega Cluster In=$"Instrument Control Mega Cluster", Misc Data Mega Cluster In=$"Misc Data Mega Cluster", LPC Mega Cluster In=$"LPC Mega Cluster", MRM Mega Cluster In=$"MRM Mega Cluster", Error In=w26) -> (Instruction Queue Out=w54, Instrument Control Mega Cluster Out=w55, Misc Data Mega Cluster Out=w56, LPC Mega Cluster Out=w57, MRM Mega Cluster Out=w58, Error Out=w59)
            $"Instrument Control Mega Cluster" <- w55
            $"Misc Data Mega Cluster" <- w56
            $"LPC Mega Cluster" <- w57
            Enqueue Element(element="Idle", error in=w59, queue=w54) -> (error out=w22, queue out=w23)
            $"MRM Mega Cluster" <- w58
            w24 = default
          }
          frame "Stop App" {
            call "FGV Current State.gvi"(Current State Instructions="Set Current State and Substate", Current State="Stop App", Current Substate="Bye Bye :D", Error In=w26) -> (Error Out=w22)
            w23 = w27
            w24 = TRUE
          }
        }
      }
    }
    call "Is Error.gvi"(error in=w22) -> (error?=w60)
    Logical Or(w60, w24) -> w61
    call "FGV Global Abort.gvi"(Global Abort Instructions="Set State", Global Abort=w61, Error In=w22) -> (Error Out=w62)
    next s1 = w23
    next s2 = w62
    stop if w61
  }
  s3 = w21  # shift register
  s4 = w20  # shift register
  while {
    event (timeout = 100) {
      on "Timeout" {
        call "FGV Global Abort.gvi"(Global Abort Instructions="Read Current State", Error In=s4) -> (Global Abort Out=w66, Error Out=w67)
        Preview Queue Element(error in=w67, queue=s3, timeout in ms=100) -> (element=w68, error out=w63, queue out=w64)
        Is Equal(x=w68, y="Stop App") -> w69
        Logical Or(w69, w66) -> w65
      }
      on "Abort Button" Value changed {
        call "Global Abort Sequence.gvi"(Queue In=s3, Global Abort=$"Abort Button", Error In=s4) -> (Queue Out=w64, Error Out=w63)
        w65 = default
      }
    }
    next s3 = w64
    next s4 = w63
    stop if w65
  }
  Enqueue Element(element="Stop App", error in=s4, queue=s3) -> (error out=w70)
  s5 = w21  # shift register
  s6 = w20  # shift register
  while {
    # This is the producer loop that takes the commands and if possible enqueues them so that the
    # slave loop can perform the corresponding actions
    event (timeout = 100) {
      on "Timeout" {
        call "Progress FGV.gvi"(FGV Instructions="Read State", Error In=s6) -> (Progress Out=w74, Error Out=w75)
        call "Timeout Sequence.gvi"(Queue In=s5, Misc Data Mega Cluster In=$"Misc Data Mega Cluster", Error In=w75) -> (Stop App?=w73, Queue Out=w71, Misc Data Mega Cluster Out=w76, Error Out=w77)
        call "Timeout Read FGV Data Subroutine.gvi"(Misc Data Mega Cluster In=w76, Error In=w77) -> (Misc Data Mega Cluster Out=w78, Error Out=w72)
        $"Misc Data Mega Cluster" <- w78
        $"Progress %" <- w74
        $"Progress counter" <- w74
      }
      on "Exit App Button" Value changed {
        call "Exit App Sequence.gvi"(Queue In=s5, Exit App=$"Exit App Button", Error In=s6) -> (Queue Out=w71, Error Out=w72)
        w73 = default
      }
      on "Check Dividing Wavelength Calibration" Value changed; "Load Dividing Wavelength Calibration" Value changed; "Load Dividing Wavelength Fitted Data" Value changed; "New Dividing Wavelength Calibration" Value changed {
        call "Check Queue And Label.gvi"(Error In=s6) -> (Proceed to enqueue=w79, Error Out=w80)
        call "Conditional Enqueue.gvi"(Queue In=s5, Queue Instruction In="MSpot Spectrum Calibration", Error Out=w80, Equeue?=w79) -> (Queue Out=w71, Error In=w81)
        call "MSpot Calibration Operation Translator.gvi"(Load Dividing Wavelength Fitted Data=$"Load Dividing Wavelength Fitted Data", Check Dividing Wavelength Calibration=$"Check Dividing Wavelength Calibration", New Dividing Wavelength Calibration=$"New Dividing Wavelength Calibration", Load Dividing Wavelength Calibration=$"Load Dividing Wavelength Calibration", Error In=w81) -> (Error Out=w72)
        w73 = default
      }
      on "Author Initials" Value changed; "Batch Name" Value changed; "Cell Number" Value changed; "Current Date" Value changed; "Custom date" Value changed; "Main Tab" Value changed; "Rainbow Measurement tab" Value changed; "Sample Comments" Value changed; "Sample Prefix" Value changed {
        call "Sample Name Checkup Subroutine.gvi"(Misc Data Mega Cluster In=$"Misc Data Mega Cluster", Error In=s6) -> (Misc Data Mega Cluster Out=w82, Error Out=w83)
        $"Misc Data Mega Cluster" <- w82
        call "Sample Prefix FGV.gvi"(FGV Instructions="Set State", Misc Data Mega Cluster=w82, Error In=w83) -> (Error Out=w72)
        w71 = s5
        w73 = default
      }
      on "New Light Power Calibration" Value changed; "Save Light Power Calibration" Value changed {
        call "Check Queue And Label.gvi"(Label Info Missing Error=$"Label Info Missing Error", Label Info Error Label=$"Label Info Error Label", Error In=s6, Is Label Necessary?=TRUE) -> (Proceed to enqueue=w84, Error Out=w85)
        call "Conditional Enqueue.gvi"(Queue In=s5, Queue Instruction In="Light Power Calibration", Error Out=w85, Equeue?=w84) -> (Queue Out=w71, Error In=w86)
        call "Light Power Calibration Operation Translator.gvi"(New Light Power Calibration=$"New Light Power Calibration", Load Light Power Calibration=FALSE, Save Light Power Calibration=$"Save Light Power Calibration", Error In=w86) -> (Error Out=w72)
        w73 = default
      }
      on "Load Light Power Calibration" Value changed {
        call "Check Queue And Label.gvi"(Label Info Missing Error=$"Label Info Missing Error", Label Info Error Label=$"Label Info Error Label", Error In=s6, Is Label Necessary?=FALSE) -> (Proceed to enqueue=w87, Error Out=w88)
        call "Conditional Enqueue.gvi"(Queue In=s5, Queue Instruction In="Light Power Calibration", Error Out=w88, Equeue?=w87) -> (Queue Out=w71, Error In=w89)
        call "Light Power Calibration Operation Translator.gvi"(New Light Power Calibration=FALSE, Load Light Power Calibration=$"Load Light Power Calibration", Save Light Power Calibration=FALSE, Error In=w89) -> (Error Out=w72)
        w73 = default
      }
      on "Acquire Single Rainbow Button" Value changed; "Save Single Measurement" Value changed {
        call "Check Queue And Label.gvi"(Label Info Missing Error=$"Label Info Missing Error", Label Info Error Label=$"Label Info Error Label", Error In=s6, Is Label Necessary?=TRUE) -> (Proceed to enqueue=w90, Error Out=w91)
        call "Conditional Enqueue.gvi"(Queue In=s5, Queue Instruction In="Rainbow Single Measurement", Error Out=w91, Equeue?=w90) -> (Queue Out=w71, Error In=w92)
        call "SRM Operation Translator.gvi"(Acquire Single Rainbow Button=$"Acquire Single Rainbow Button", Load Single Measurement=FALSE, Save Single Measurement=$"Save Single Measurement", Error In=w92) -> (Error Out=w72)
        w73 = default
      }
      on "Acquire Multiple Rainbow Button" Value changed; "Save Multiple Measurement" Value changed {
        call "Check Queue And Label.gvi"(Label Info Missing Error=$"Label Info Missing Error", Label Info Error Label=$"Label Info Error Label", Error In=s6, Is Label Necessary?=TRUE) -> (Proceed to enqueue=w93, Error Out=w94)
        call "MRM Check any cell selected.gvi"(MRM Mega Cluster=$"MRM Mega Cluster", Proceed to enqueue In=w93, Error In=w94) -> (Proceed to enqueue Out=w95, Error Out=w96)
        call "Conditional Enqueue.gvi"(Queue In=s5, Queue Instruction In="Rainbow Multiple Measurement", Error Out=w96, Equeue?=w95) -> (Queue Out=w71, Error In=w97)
        call "MRM Operation Translator.gvi"(Acquire Multiple Rainbow Button=$"Acquire Multiple Rainbow Button", Load Multiple Measurement=FALSE, Save Multiple Measurement=$"Save Multiple Measurement", Error In=w97) -> (Error Out=w72)
        w73 = default
      }
      on "Load Single Measurement" Value changed {
        call "Check Queue And Label.gvi"(Label Info Missing Error=$"Label Info Missing Error", Label Info Error Label=$"Label Info Error Label", Error In=s6, Is Label Necessary?=FALSE) -> (Proceed to enqueue=w98, Error Out=w99)
        call "Conditional Enqueue.gvi"(Queue In=s5, Queue Instruction In="Rainbow Single Measurement", Error Out=w99, Equeue?=w98) -> (Queue Out=w71, Error In=w100)
        call "SRM Operation Translator.gvi"(Acquire Single Rainbow Button=FALSE, Load Single Measurement=$"Load Single Measurement", Save Single Measurement=FALSE, Error In=w100) -> (Error Out=w72)
        w73 = default
      }
      on "Load Multiple Measurement" Value changed {
        call "Check Queue And Label.gvi"(Label Info Missing Error=$"Label Info Missing Error", Label Info Error Label=$"Label Info Error Label", Error In=s6, Is Label Necessary?=FALSE) -> (Proceed to enqueue=w101, Error Out=w102)
        call "Conditional Enqueue.gvi"(Queue In=s5, Queue Instruction In="Rainbow Multiple Measurement", Error Out=w102, Equeue?=w101) -> (Queue Out=w71, Error In=w103)
        call "SRM Operation Translator.gvi"(Acquire Single Rainbow Button=FALSE, Load Single Measurement=$"Load Multiple Measurement", Save Single Measurement=FALSE, Error In=w103) -> (Error Out=w72)
        w73 = default
      }
      on "Activate XZ Stage" Value changed {
        call "XZ Move Requisites.gvi"(Queue In=s5, Activate XZ Stage=$"Activate XZ Stage", Instrument Control Mega Cluster=$"Instrument Control Mega Cluster", Error In=s6) -> (Queue Out=w71, Error Out=w72)
        w73 = default
      }
      on "LPC Parameters" Value changed; "MSpot Sperctrum Calibration Parameters" Value changed; "Rainbow Sweep Param Selector MSpot" Value changed; "Rainbow Sweep Parameters LPC" Value changed; "Rainbow Sweep Parameters MRM" Value changed; "Rainbow Sweep Parameters SRM" Value changed; "SRM Specific Parameters" Value changed; "Start" Value changed; "XZ All Position Cluster" Value changed {
        call "Update Controls Subroutine.gvi"(Misc Data Mega Cluster In=$"Misc Data Mega Cluster", MSpot Mega Cluster In=$"MSpot Mega Cluster", LPC Mega Cluster In=$"LPC Mega Cluster", SRM Mega Cluster In=$"SRM Mega Cluster", MRM Mega Cluster In=$"MRM Mega Cluster", Error In=s6) -> (Misc Data Mega Cluster Out=w104, MSpot Mega Cluster Out=w105, LPC Mega Cluster Out=w106, SRM Mega Cluster Out=w107, MRM Mega Cluster Out=w108, Error Out=w72)
        $"Misc Data Mega Cluster" <- w104
        $"MSpot Mega Cluster" <- w105
        $"MRM Mega Cluster" <- w108
        $"LPC Mega Cluster" <- w106
        $"SRM Mega Cluster" <- w107
        w71 = s5
        w73 = default
      }
      on "Photodetector Start Measurement" Value changed {
        call "Check Queue And Label.gvi"(Error In=s6) -> (Proceed to enqueue=w109, Error Out=w110)
        call "Conditional Enqueue.gvi"(Queue In=s5, Queue Instruction In="Stand Alone Photodetector Measurement", Error Out=w110, Equeue?=w109) -> (Queue Out=w71, Error In=w72)
        w73 = default
      }
      on "Set Cell" Value changed {
        call "Set Cell Requisites.gvi"(Queue In=s5, Set Cell=$"Set Cell", Instrument Control Mega Cluster=$"Instrument Control Mega Cluster", Error In=s6) -> (Queue Out=w71, Error Out=w72)
        w73 = default
      }
      on "Cell to Measure" Value changed {
        call "Provisional Cell Selection FGV.gvi"(FGV Instructions="Set State", XZ Stage Cell=$"Cell to Measure", Error In=s6) -> (Error Out=w72)
        w71 = s5
        w73 = default
      }
      on "MRM Cell Selector" Value changed {
        call "MRM Cell Updater.gvi"(Misc Data Mega Cluster In=$"Misc Data Mega Cluster", Error In=s6) -> (Error Out=w111)
        call "Update MRM Controls.gvi"(Misc Data Mega Cluster In=$"Misc Data Mega Cluster", MRM Mega Cluster In=$"MRM Mega Cluster", Error In=w111) -> (MRM Mega Cluster Out=w112, Error Out=w72)
        $"MRM Mega Cluster" <- w112
        w71 = s5
        w73 = default
      }
      on "Mask Calibration Start Measurement" Value changed {
        call "Check Queue And Label.gvi"(Error In=s6) -> (Proceed to enqueue=w113, Error Out=w114)
        call "Conditional Enqueue.gvi"(Queue In=s5, Queue Instruction In="Mask Calibration", Error Out=w114, Equeue?=w113) -> (Queue Out=w71, Error In=w72)
        w73 = default
      }
    }
    call "Is Error.gvi"(error in=w72) -> (error?=w115)
    Logical Or(w115, w73) -> w116
    next s5 = w71
    next s6 = w72
    stop if w116
  }
  Enqueue Element(element="Stop App", error in=s6, queue=s5) -> (error out=w117)
  call "Multiplex Errors.gvi"(error in 1=w117, error in 2=s2, error in 3=w70) -> (error out=w118)
  Flush Queue(error in=w118, queue=s1) -> (error out=w119, queue out=w120)
  Release Queue(error in=w119, queue=w120) -> (error out=w121)
  case (w121) {
    frame Error, Default {
      # In case there is an error
      # put out an error handler
      call "Display Error.gvi"(error in=w121)
      $"Error Out" <- w121
    }
    frame No Error { }
  }
