vi "Multiple Page Graph Adapter.gvi"   [LabVIEW NXG 5.0.0]
inputs:
  "Error In": error
  "Input XY data Multi Page": f64[][][]
  "Full Data Array": "Light Power Calibration Data.gtype"[]
outputs:
  "Error Out": error
  "Output Bundled Data": T1[]
  "Output Graph Ready Data": cluster{"Element 1": f64[], "Element 2": f64[]}[]
types:
  "Rainbow Sweep Types.gtype" = enum{"Red Sweep Closing", "Red Sweep Opening", "Blue Sweep Closing", "Blue Sweep Opening"}
  T1 = cluster{"Element 1": f64[], "Element 2": f64[], "Element 3": "Rainbow Sweep Types.gtype"}
  T2 = cluster{"Dividing Wavelength Array": f64[], "Measured Power Array": f64[]}
  "Light Power Calibration Data.gtype" = cluster{"Single Light Calibration": T2, "Rainbow Sweep Types": "Rainbow Sweep Types.gtype"}
diagram:
  # This SubVI Takes a 3 dimensional array as an input and outputs
  # graph multicurve plot data so that it can be easily represented.
  case ($"Error In") {
    frame Error, Default {
      w1 = $"Error In"
      w2 = default
      w3 = default
    }
    frame No Error {
      for (iteration -> i1) {
        w4 = each element of $"Input XY data Multi Page"
        Array Index(array=w4) -> (out0[_, 0]=w5, out1[_, 1]=w6)
        for {
          w7 = each element of w5
          w8 = each element of w6
          Is Not Equal To 0(x=w7) -> w11
          append w7 to w9 if w11
          append w8 to w10 if w11
        }
        Build Cluster(w9, w10) -> w12
        Array Index(array=$"Full Data Array") -> (out0[i1]=w13)
        Property Node(instance in=w13) -> ("Rainbow Sweep Types"=w14)
        Build Cluster(w9, w10, w14) -> w15
        append w15 to w2
        append w12 to w3
      }
      w1 = $"Error In"
    }
  }
  $"Error Out" <- w1
  $"Output Graph Ready Data" <- w3
  $"Output Bundled Data" <- w2
