vi "Arduino Detector.gvi"   [LabVIEW NXG 5.0.0]
inputs:
  "Error In": error
outputs:
  "Error Out": error
  "Arduino Detection info Out": "Arduino Detection cluster control.gtype"
panel indicators:
  "Found Resources": string[]
  "Visa Log": string
types:
  T1 = cluster{"Element 1": "VISA Instr", "Element 2": string}
  "Arduino Detection cluster control.gtype" = cluster{"XZ Stage Arduino Address": "VISA Instr", "XZ Stage Arduino Detected?": bool, "Multiplexer Arduino Detected?": bool, "Multiplexer Arduino Address": "VISA Instr", "Arduinos List": T1[], "XZ Stage Log": string, "Multiplexer Log": string, "XZ Homed?": bool}
uses:
  NI::VISA::Find Resource (Search Resources).gvi
  Rainbow Measurement Setup::Main Functions::Instruction Queue::Current State::FGV Current State.gvi
  Rainbow Measurement Setup::Side Functions::Global Abort::FGV Global Abort.gvi
  NI::VISA::Open (Instr).gvi
  NI::VISA::Clear (Instr).gvi
  NI::VISA::Read (Instr, String).gvi
  NI::VISA::Close (Instr).gvi
  NI::G Core::Error::Clear Error Cluster.gvi
diagram:
  # This loop scans all the VISA found sources and queries them in search for the arduino VISA addresses.
  # Once it finds the desired arduino it outputs the address into the Predefined cluster and the program finishes.
  case ($"Error In") {
    frame Error, Default {
      w1 = $"Error In"
      w2 = default
    }
    frame No Error {
      call "Find Resource (Search Resources).gvi"() -> (found resources=w3)
      $"Found Resources" <- w3
      call "FGV Current State.gvi"(Current State Instructions="Set Current Substate", Current Substate="Detecting Arduinos", Error In=$"Error In") -> (Error Out=w4)
      s1 = ""  # shift register
      for {
        w5 = each element of w3
        call "FGV Global Abort.gvi"(Global Abort Instructions="Read Current State", Error In=w4) -> (Global Abort Out=w11, Error Out=w12)
        Search And Replace String(error in (no error)=w12, input string=w5, search string="ASRL") -> (error out=w13, number of replacements=w14)
        Is Not Equal To 0(x=w14) -> w15
        case (w15) {
          frame False, Default {
            w16 = w13
            w17 = ""
            w18 = ""
          }
          frame True {
            call "Open (Instr).gvi"(resource name=w5, error in=w13, open timeout=300) -> (session out=w19, error out=w20)
            call "Clear (Instr).gvi"(session in=w19, error in=w20) -> (session out=w21, error out=w22)
            call "Read (Instr, String).gvi"(session in=w21, error in=w22, byte count=100) -> (session out=w18, error out=w23, read buffer=w17)
            call "Close (Instr).gvi"(session in=w18, error in=w23) -> (error out=w24)
            call "Clear Error Cluster.gvi"(error in=w24) -> (error out=w16)
          }
        }
        Concatenate Strings(w17, s1, "\r") -> w25
        $"Visa Log" <- s1
        Search And Replace String(error in (no error)=w16, input string=w17, search string="Arduin") -> (error out=w26, number of replacements=w27)
        Search And Replace String(error in (no error)=w26, input string=w17, search string="XYZ") -> (error out=w28, number of replacements=w29)
        Is Not Equal To 0(x=w29) -> w30
        Search And Replace String(error in (no error)=w28, input string=w17, search string="Multiplex") -> (error out=w1, number of replacements=w31)
        Is Not Equal To 0(x=w31) -> w32
        Build Cluster(w18, w17) -> w33
        Is Not Equal To 0(x=w27) -> w34
        Logical And(w34, w15) -> w35
        append w33 to w6 if w35
        append w30 to w7
        append w32 to w8
        w9 = w18 if w30
        w10 = w18 if w32
        next s1 = w25
        stop if w11
      }
      $"Visa Log" <- s1
      Or Array Elements(Boolean array=w7) -> (logical OR=w36)
      Or Array Elements(Boolean array=w8) -> (logical OR=w37)
      Logical And(w36, w37) -> w38
      Logical Or(w38, w11)
      w39 = "Arduino Detection cluster control.gtype" {all zero or empty}
      Property Node(instance in=w39, "XZ Stage Arduino Address"=w9, "XZ Stage Arduino Detected?"=w36, "Multiplexer Arduino Detected?"=w37, "Multiplexer Arduino Address"=w10, "Arduinos List"=w6) -> (instance out=w2)
    }
  }
  $"Arduino Detection info Out" <- w2
  $"Error Out" <- w1
