vi "Set Cell Low level.gvi"   [LabVIEW NXG 5.0.0]
inputs:
  "Error In": error
  "Instrument Control Mega Cluster In": "Instrument Control Mega Cluster.gtype"
  "Cell Label": string
outputs:
  "Error Out": error
  "Instrument Control Mega Cluster Out": "Instrument Control Mega Cluster.gtype"
panel indicators:
  "Arduino Multiplexer Log": string
types:
  "Instrument Coms Info.gtype" = cluster{"Arduino Coms Info": "Arduino Detection cluster control.gtype", "Photodetector Names": string[], "Keythley Address": "VISA Instr", "Photodetector Detected?": bool, "Thorlabs Motors Detected?": bool, "Keithley Detected?": bool, "Thorlabs Motors Serial Number": "Thorlabs Motors Serial Number In.gtype", "Photodetector IVI session": "Ivi IviDefault", "Flame ID": string, "Flame Detected?": bool, "Flame Wrapper ID": u64}
  "Debugging Cluster.gtype" = cluster{"Debugging mode?": bool, "Initialize App": bool, "Insturment Debugging": "Insturment Debugging Cluster.gtype"}
  "Instrument Control Mega Cluster.gtype" = cluster{"Instruments Coms Info": "Instrument Coms Info.gtype", "Debugging Cluster": "Debugging Cluster.gtype"}
uses:
  NI::VISA::Open (Instr).gvi
  NI::VISA::Read (Instr, String).gvi
  NI::VISA::Write (Instr, String).gvi
  Rainbow Measurement Setup::Side Functions::Instrument Control::Arduino::XZ Stage Arduino::Low Level::XZ Stage Read Serial.gvi
  NI::VISA::Close (Instr).gvi
diagram:
  # This subVI Sets the desired cell in the arduino demultiplexer by writting the cell label on the arduino.
  # The possible cell labels are L or R followed by a dot and then two digits from 01 to 12 (i.e. L.08)
  case ($"Error In") {
    frame Error, Default {
      w1 = $"Error In"
      w2 = $"Instrument Control Mega Cluster In"
    }
    frame No Error {
      Property Node(instance in=$"Instrument Control Mega Cluster In") -> ("Instruments Coms Info:Arduino Coms Info:Multiplexer Arduino Detected?"=w3, instance out=w4)
      case (w3) {
        frame False, Default {
          w5 = "Multiplexer arduino not detected :(\nYou might have to restart the software\nfor this problem to be fixed."
          One Button Dialog(button name ("OK")="Okay I'll try", message=w5)
          w2 = w4
          w1 = $"Error In"
        }
        frame True {
          Property Node(instance in=w4) -> ("Instruments Coms Info:Arduino Coms Info:Multiplexer Arduino Address"=w6, "Instruments Coms Info:Arduino Coms Info:Multiplexer Log"=w7, instance out=w8)
          call "Open (Instr).gvi"(resource name=w6, error in=$"Error In", open timeout=1000) -> (session out=w9, error out=w10)
          call "Read (Instr, String).gvi"(session in=w9, error in=w10, byte count=50) -> (session out=w11, error out=w12)
          call "Write (Instr, String).gvi"(session in=w11, error in=w12, write buffer=$"Cell Label") -> (session out=w13, error out=w14)
          s1 = w14  # shift register
          s2 = w13  # shift register
          s3 = w7  # shift register
          while (iteration -> i1) {
            call "XZ Stage Read Serial.gvi"(XZ Carriage Arduino open Visa session In=s2, Error In=s1) -> (XZ Carriage Arduino open Visa session Out=w15, Read Output=w16, Error Out=w17)
            Concatenate Strings(s3, w16) -> w18
            $"Arduino Multiplexer Log" <- w18
            Is Empty String Or Path(string/path=w16) -> w19
            Is Greater(x=i1, y=5) -> w20
            Logical Or(w20, not w19) -> w21
            Wait Until Next Multiple(multiple to wait=50)
            next s1 = w17
            next s2 = w15
            next s3 = w18
            stop if w21
          }
          call "Close (Instr).gvi"(session in=s2, error in=s1) -> (error out=w1)
          Property Node(instance in=w8, "Instruments Coms Info:Arduino Coms Info:Multiplexer Log"=s3) -> (instance out=w2)
        }
      }
    }
  }
  $"Error Out" <- w1
  $"Instrument Control Mega Cluster Out" <- w2
