vi "XZ Stage Home Sequence.gvi"   [LabVIEW NXG 5.0.0]
inputs:
  "Error In": error
  "XZ Carriage Arduino Open Visa Session In": "VISA Instr"
  "XZ Carriage Arduino Log In": string
outputs:
  "Error Out": error
  "XZ Carriage Arduino Open Visa Session Out": "VISA Instr"
  "XZ Carriage Arduino Log Out": string
panel controls:
  "Abort Homing": bool
panel indicators:
  "XZ Carriage Arduino Log While": string
uses:
  Rainbow Measurement Setup::Main Functions::Instruction Queue::Current State::FGV Current State.gvi
  Rainbow Measurement Setup::Side Functions::Global Abort::FGV Global Abort.gvi
  Rainbow Measurement Setup::Side Functions::Instrument Control::Arduino::XZ Stage Arduino::Low Level::XZ Stage Homing Low Level.gvi
diagram:
  # This SubVI tries to home the arduino using the XZ Stage Homing Low level SubVI. If it the homing fails
  # it prompts the user to reconnect everything and if it keeps failing it gives the user the oportunity to continue
  # without homing for testing purposes only.
  case ($"Error In") {
    frame Error, Default {
      w1 = $"Error In"
      w2 = $"XZ Carriage Arduino Open Visa Session In"
      w3 = $"XZ Carriage Arduino Log In"
    }
    frame No Error {
      call "FGV Current State.gvi"(Current State Instructions="Set Current Substate", Current Substate="Homing XZ Stage", Error In=$"Error In") -> (Error Out=w4)
      s1 = w4  # shift register
      s2 = $"XZ Carriage Arduino Open Visa Session In"  # shift register
      s3 = $"XZ Carriage Arduino Log In"  # shift register
      while (iteration -> i1) {
        call "FGV Global Abort.gvi"(Global Abort Instructions="Read Current State", Error In=s1) -> (Local Abort Out=w5, Global Abort Out=w6, Error Out=w7)
        call "XZ Stage Homing Low Level.gvi"(XZ Carriage Arduino open Visa session In=s2, XZ Carriage Arduino Log In=s3, Error In=w7) -> (Homed?=w8, XZ Carriage Arduino open Visa Session Out=w9, XZ Carriage Arduino Log Out=w10, Error Out=w11)
        $"XZ Carriage Arduino Log While" <- w10
        Is Greater Or Equal(x=i1, y=1) -> w12
        case (w8) {
          frame True {
            w13 = TRUE
            w14 = w11
          }
          frame False {
            case (w12) {
              frame True {
                w15 = """The arduino Could not home
propperly, please make sure 
that the motors can move freely
and that the motor power supply 
is correctly connected"""
                Two Button Dialog(F button name ("Cancel")="Okay I will connect everything", T button name ("OK")="Continue without homing\n(TESTING ONLY!!!)", message=w15) -> (T Button?=w13)
              }
              frame False {
                w16 = """The arduino Could not home
propperly, please make sure 
that the motors can move freely
and that the motor power supply 
is correctly connected"""
                One Button Dialog(button name ("OK")="Okay I will make sure\neverything is allright", message=w16)
                w13 = default
              }
            }
            w14 = w11
          }
        }
        Logical Or(w13, $"Abort Homing", w5, w6) -> w17
        Wait Until Next Multiple(multiple to wait=50)
        next s1 = w14
        next s2 = w9
        next s3 = w10
        stop if w17
      }
      w1 = s1
      w2 = s2
      w3 = s3
    }
  }
  $"XZ Carriage Arduino Open Visa Session Out" <- w2
  $"XZ Carriage Arduino Log Out" <- w3
  $"Error Out" <- w1
