vi "XZ Stage Homing Low Level.gvi"   [LabVIEW NXG 5.0.0]
inputs:
  "Error In": error
  "XZ Carriage Arduino open Visa session In": "VISA Instr"
  "XZ Carriage Arduino Log In": string
outputs:
  "Error Out": error
  "XZ Carriage Arduino open Visa Session Out": "VISA Instr"
  "XZ Carriage Arduino Log Out": string
  "Homed?": bool
panel controls:
  "Abort Homing": bool
panel indicators:
  "Log While Homing": string
uses:
  NI::VISA::Write (Instr, String).gvi
  NI::VISA::Read (Instr, String).gvi
diagram:
  # This SubVI Writes the Homing Command for the Arduino (G28) and then reads the bytes at port (whenever available)
  # checking for an answer. The arduino either responds Homed or Failed and we set the Homed boolean accordingly.
  # If after 60 reads (30 s) the arduino has not homed we abort the process.
  case ($"Error In") {
    frame Error, Default {
      w1 = $"Error In"
      w2 = $"XZ Carriage Arduino open Visa session In"
      w3 = $"XZ Carriage Arduino Log In"
      w4 = default
    }
    frame No Error {
      Concatenate Strings("G28", "\r\n") -> w5
      call "Write (Instr, String).gvi"(session in=$"XZ Carriage Arduino open Visa session In", error in=$"Error In", write buffer=w5) -> (session out=w6, error out=w7)
      s1 = w7  # shift register
      s2 = $"XZ Carriage Arduino Log In"  # shift register
      while (iteration -> i1) {
        Property Node(instance in=w6, error in=s1) -> ("ASRL Bytes at Port"=w8, error out=w9, instance out=w10)
        Is Not Equal To 0(x=w8) -> w11
        case (w11) {
          frame False, Default {
            w12 = ""
            w2 = w10
            w13 = w9
          }
          frame True {
            call "Read (Instr, String).gvi"(session in=w10, error in=w9, byte count=w8) -> (session out=w2, error out=w13, read buffer=w12)
          }
        }
        Concatenate Strings(s2, w12) -> w14
        $"Log While Homing" <- w14
        Search And Replace String(input string=w12, search string="Failed") -> (number of replacements=w15)
        Is Not Equal To 0(x=w15) -> w16
        Not(x=w16) -> w4
        Search And Replace String(input string=w12, search string="Homed") -> (number of replacements=w17)
        Is Not Equal To 0(x=w17) -> w18
        Is Greater(x=i1, y=60) -> w19
        Logical Or(w18, w19, w16, $"Abort Homing", w13) -> w20
        Wait Until Next Multiple(multiple to wait=500)
        next s1 = w13
        next s2 = w14
        stop if w20
      }
      w1 = s1
      w3 = s2
    }
  }
  $"XZ Carriage Arduino open Visa Session Out" <- w2
  $"Error Out" <- w1
  $"XZ Carriage Arduino Log Out" <- w3
  $"Homed?" <- w4
