vi "XZ Stage Initialize.gvi"   [LabVIEW NXG 5.0.0]
inputs:
  "Error In": error
  "XZ Carriage Arduino Adress In": "VISA Instr"
outputs:
  "Error Out": error
  "XZ Carriage Arduino Visa Session Out": "VISA Instr"
  "XZ Carriage Arduino Log": string
uses:
  Rainbow Measurement Setup::Main Functions::Instruction Queue::Current State::FGV Current State.gvi
  NI::VISA::Open (Instr).gvi
  NI::VISA::Read (Instr, String).gvi
  Rainbow Measurement Setup::Side Functions::Global Abort::FGV Global Abort.gvi
diagram:
  # This SubVI initializes the XZ Stage Arduino basically reading on the serial so that
  # the welcome message can be flushed.
  case ($"Error In") {
    frame Error, Default {
      w1 = $"Error In"
      w2 = default
      w3 = $"XZ Carriage Arduino Adress In"
    }
    frame No Error {
      call "FGV Current State.gvi"(Current State Instructions="Set Current Substate", Current Substate="Initializing XZ Stage", Error In=$"Error In") -> (Error Out=w4)
      call "Open (Instr).gvi"(resource name=$"XZ Carriage Arduino Adress In", error in=w4, access mode="VISA Defaults"(0), open timeout=1000) -> (session out=w5, error out=w6)
      s1 = ""  # shift register
      while (iteration -> i1) {
        Wait Until Next Multiple(multiple to wait=100)
        Property Node(instance in=w5, error in=w6) -> ("ASRL Bytes at Port"=w7, error out=w8, instance out=w9)
        call "Read (Instr, String).gvi"(session in=w9, error in=w8, byte count=w7) -> (session out=w3, error out=w10, read buffer=w11)
        Concatenate Strings(s1, w11) -> w12
        call "FGV Global Abort.gvi"(Global Abort Instructions="Read Current State", Error In=w10) -> (Local Abort Out=w13, Global Abort Out=w14, Error Out=w1)
        Is Greater(x=i1, y=50) -> w15
        Logical Or(w13, w14, w15) -> w16
        next s1 = w12
        stop if w16
      }
      w2 = s1
    }
  }
  $"XZ Carriage Arduino Visa Session Out" <- w3
  $"Error Out" <- w1
  $"XZ Carriage Arduino Log" <- w2
