vi "XZ Stage Move To Location.gvi"   [LabVIEW NXG 5.0.0]
inputs:
  "Error In": error
  "XZ Carriage Arduino open Visa session In": "VISA Instr"
  "XZ Carriage Arduino Log In": string
  "Input Command": string = "G1 X100 Z100"
outputs:
  "Error Out": error
  "XZ Carriage Arduino open Visa Session Out": "VISA Instr"
  "XZ Carriage Arduino Log Out": string
uses:
  Rainbow Measurement Setup::Main Functions::Instruction Queue::Current State::FGV Current State.gvi
  NI::VISA::Write (Instr, String).gvi
  Rainbow Measurement Setup::Side Functions::Utilities::Time Related Operations::Wait ms.gvi
  Rainbow Measurement Setup::Side Functions::Global Abort::FGV Global Abort.gvi
  Rainbow Measurement Setup::Side Functions::Instrument Control::Arduino::XZ Stage Arduino::Low Level::XZ Stage Read Serial.gvi
  Rainbow Measurement Setup::Side Functions::Instrument Control::Arduino::XZ Stage Arduino::Low Level::XZ Stage Moved Check.gvi
  Rainbow Measurement Setup::Side Functions::Error Handling::Misc Error Eraser.gvi
  Rainbow Measurement Setup::Side Functions::Instrument Control::Arduino::XZ Stage Arduino::Low Level::XZ Stage Movement Failed Prompt.gvi
diagram:
  # This SubVI Sends a command to the XZ stage arduino to move it to a specified location and It waits for the arduino to respond.
  # If the arduino responds with Moved the operation is successful and it continues on without errors. If the arduino responds with
  #  coordinate out of range it prompts the user accordingly. If the arduino just does not respond the reading stops and the software
  #  attempts to write the command again up to 5 times. If the movement has failed after 5 times the software prompts the user
  #  recommending to connect everything
  # correctly and restarting the software.
  case ($"Error In") {
    frame Error, Default {
      w1 = $"Error In"
      w2 = $"XZ Carriage Arduino open Visa session In"
      w3 = $"XZ Carriage Arduino Log In"
    }
    frame No Error {
      Is Empty String Or Path(string/path=$"Input Command") -> w4
      case (w4) {
        frame True {
          w5 = "Tried to move the XZ Stage but\nthe movement command was empty!"
          One Button Dialog(button name ("OK")="Oh sorry I will\nsee what went wrong", message=w5)
          w1 = $"Error In"
          w2 = $"XZ Carriage Arduino open Visa session In"
          w3 = $"XZ Carriage Arduino Log In"
        }
        frame False {
          call "FGV Current State.gvi"(Current State Instructions="Set Current Substate", Current Substate="Moving XZ Stage", Error In=$"Error In") -> (Error Out=w6)
          Concatenate Strings($"Input Command", "\r\n") -> w7
          s1 = $"XZ Carriage Arduino open Visa session In"  # shift register
          s2 = w6  # shift register
          s3 = $"XZ Carriage Arduino Log In"  # shift register
          while (iteration -> i1) {
            call "Write (Instr, String).gvi"(session in=s1, error in=s2, write buffer=w7) -> (session out=w8, error out=w9)
            call "Wait ms.gvi"(Error In=w9) -> (Error Out=w10)
            s4 = w8  # shift register
            s5 = w10  # shift register
            s6 = s3  # shift register
            while (iteration -> i2) {
              call "FGV Global Abort.gvi"(Global Abort Instructions="Read Current State", Error In=s5) -> (Local Abort Out=w13, Global Abort Out=w14, Error Out=w15)
              call "XZ Stage Read Serial.gvi"(XZ Carriage Arduino open Visa session In=s4, Error In=w15) -> (XZ Carriage Arduino open Visa session Out=w16, Read Output=w17, Error Out=w18)
              Logical Or(w13, w14) -> w19
              call "XZ Stage Moved Check.gvi"(Serial Read=w17, Global Abort?=w19, XZ Stage Log In=s6, Error In=w18, Loop Iteration=i2) -> (Stop Loop?=w20, Moved?=w21, Coordinate Out Of Range?=w22, XZ Stage Log Out=w23, Error Out=w24)
              Wait Until Next Multiple(multiple to wait=100)
              append w21 to w11
              append w22 to w12
              next s4 = w16
              next s5 = w24
              next s6 = w23
              stop if w20
            }
            call "Misc Error Eraser.gvi"(Error In=s5) -> (Error Out=w25)
            call "XZ Stage Movement Failed Prompt.gvi"(Coordinate Out Of Range?=w12, Moved?=w11, Error In=w25, Loop Iterations=i1) -> (Stop Loop?=w26, Error Out=w27)
            Logical Or(w26, w19) -> w28
            next s1 = s4
            next s2 = w27
            next s3 = s6
            stop if w28
          }
          w1 = s2
          w2 = s1
          w3 = s3
        }
      }
    }
  }
  $"XZ Carriage Arduino open Visa Session Out" <- w2
  $"Error Out" <- w1
  $"XZ Carriage Arduino Log Out" <- w3
