vi "XZ Stage Label to Coordinates.gvi"   [LabVIEW NXG 5.0.0]
inputs:
  "Error In": error
  "Cell Label": string
  "Misc Data Mega Cluster In": "Misc Data Mega Cluster.gtype"
outputs:
  "Error Out": error
  "Gcode Instruction Out": string
  "XZ Coordinate Out": "XZ Coordinate Cluster In.gtype"
panel indicators:
  "X coordinate out": f64
  "Z coordinate out": f64
types:
  "XZ Coordinate Cluster In.gtype" = cluster{"X Coordinate (mm)": f64, "Z Coordinate (mm)": f64}
  "Full Reference Cluster.gtype" = cluster{"Enum Reference Cluster": "Enum Control Reference Cluster.gtype", "Boolean Reference Cluster": "Boolean Control Reference Cluster.gtype", "Numeric Reference Cluster": "Numeric Control Reference Cluster.gtype", "Numeric Cluster Reference Cluster": "Numeric Cluster Reference Cluster.gtype", "Path Reference Cluster": "Path Reference Cluster.gtype", "Cluster Reference Cluster": "Cluster Reference Cluster.gtype", "XZ Stage Controls Reference Cluster": "XZ Stage Controls Reference Cluster.gtype"}
  "Cell Naming Cluster.gtype" = cluster{"Cell Label": string, "Sample Prefix": string, "Author Initials": string, "Current Date": string, "Batch Name": string}
  T1 = cluster{"X Coordinate (mm)": f64, "Z Coordinate (mm)": f64}
  T2 = cluster{"X Coordinate (mm)": f64, "Z Coordinate (mm)": f64, "Vertical Spacing (mm)": f64}
  "XZ All Position Cluster.gtype" = cluster{"Diffusor Coordinates": T1, "Photodetector Coordinates": T1, "Cell R.01 Coordinates": T2, "Approach Distance (mm)": f64}
  T3 = cluster{"Thorlabs Motor Serial Number File Path": path, "Default Data Saving Location": path}
  "Misc Data Mega Cluster.gtype" = cluster{"Full Reference Cluster": "Full Reference Cluster.gtype", "Cell Naming Cluster": "Cell Naming Cluster.gtype", "All XZ Position Cluster": "XZ All Position Cluster.gtype", "All Paths": T3}
diagram:
  # This subVI Takes a cell label (i.e L.03) and converts it into the gcode command for the XZ Stage needed to move to that specific location.
  case ($"Error In") {
    frame Error, Default {
      w1 = $"Error In"
      w2 = default
      w3 = default
      w4 = default
      w5 = default
    }
    frame No Error {
      Property Node(instance in=$"Misc Data Mega Cluster In") -> ("All XZ Position Cluster:Cell R.01 Coordinates"=w6)
      String Length(string=$"Cell Label") -> (length=w7)
      Is Equal(x=w7, y=4) -> w8
      Search And Replace String(error in (no error)=$"Error In", input string=$"Cell Label", search string="R.") -> (error out=w9, number of replacements=w10)
      Is Not Equal To 0(x=w10) -> w11
      Search And Replace String(error in (no error)=w9, input string=$"Cell Label", search string="L.") -> (error out=w1, number of replacements=w12)
      Is Not Equal To 0(x=w12) -> w13
      Logical Exclusive Or(w11, w13) -> w14
      Logical And(w8, w14) -> w15
      case (w15) {
        frame False, Default {
          Wait Until Next Multiple(multiple to wait=1000)
          w16 = """There was a problem reading
the cell labels on XZ Carriage 
label to Coordinate. Please contact
Martí (minusmages@hotmail.com)
because this error is not supposed
to happen, like, ever."""
          One Button Dialog(button name ("OK")="Okay, but who is Martí?", message=w16)
          w2 = default
          w3 = default
          w4 = default
          w5 = default
        }
        frame True {
          String Subset(offset (0)=2, string=$"Cell Label") -> w17
          Decimal String To Number(string=w17) -> (number=w18)
          Property Node(instance in=w6) -> ("X Coordinate (mm)"=w19, "Z Coordinate (mm)"=w20, "Vertical Spacing (mm)"=w21)
          In Range And Coerce(lower limit=1, upper limit=13, x=w18) -> (In Range?=w22)
          case (w22) {
            frame True {
              Decrement(x=w18) -> w23
              To Double Precision Float(number=w23) -> w24
              Multiply(w24, 5.08) -> w25
              Add(w25, w19) -> w4
            }
            frame False {
              w26 = "Cell out of range,\nthere is no R.13\nthe range is from\n1 to 12"
              One Button Dialog(button name ("OK")="Oh, sorry", message=w26)
              w4 = w19
            }
          }
          String Subset(length (rest)=1, string=$"Cell Label") -> w27
          case (w27) {
            frame "", Default {
              w28 = """There was a problem reading
the cell labels on XZ Carriage 
label to Coordinate. Please contact
Martí (minusmages@hotmail.com)
because this error is not supposed
to happen, like, ever."""
              One Button Dialog(button name ("OK")="Okay, but who is Martí?", message=w28)
              w3 = w20
            }
            frame "L" {
              Add(w20, w21) -> w3
            }
            frame "R" {
              w3 = w20
            }
          }
          Property Node(instance in="XZ Coordinate Cluster In.gtype" {all zero or empty}, "X Coordinate (mm)"=w4, "Z Coordinate (mm)"=w3) -> (instance out=w5)
          Number To Fractional String(number=w3, precision (6)=2, use system decimal point (T)=FALSE) -> (F-format string=w29)
          Number To Fractional String(number=w4, precision (6)=2, use system decimal point (T)=FALSE) -> (F-format string=w30)
          Concatenate Strings("G1 X", w30, " Z", w29) -> w2
        }
      }
    }
  }
  $"XZ Coordinate Out" <- w5
  $"Gcode Instruction Out" <- w2
  $"X coordinate out" <- w4
  $"Error Out" <- w1
  $"Z coordinate out" <- w3
