vi "XZ Stage Move to Position.gvi"   [LabVIEW NXG 5.0.0]
inputs:
  "Instrument Control Mega Cluster In": "Instrument Control Mega Cluster.gtype"
  "Error In": error
  "XZ Coordinate Cluster In": "XZ Coordinate Cluster In.gtype"
outputs:
  "Instrument Control Mega Cluster Out": "Instrument Control Mega Cluster.gtype"
  "Error Out": error
types:
  "XZ Coordinate Cluster In.gtype" = cluster{"X Coordinate (mm)": f64, "Z Coordinate (mm)": f64}
  "Instrument Coms Info.gtype" = cluster{"Arduino Coms Info": "Arduino Detection cluster control.gtype", "Photodetector Names": string[], "Keythley Address": "VISA Instr", "Photodetector Detected?": bool, "Thorlabs Motors Detected?": bool, "Keithley Detected?": bool, "Thorlabs Motors Serial Number": "Thorlabs Motors Serial Number In.gtype", "Photodetector IVI session": "Ivi IviDefault", "Flame ID": string, "Flame Detected?": bool, "Flame Wrapper ID": u64}
  "Debugging Cluster.gtype" = cluster{"Debugging mode?": bool, "Initialize App": bool, "Insturment Debugging": "Insturment Debugging Cluster.gtype"}
  "Instrument Control Mega Cluster.gtype" = cluster{"Instruments Coms Info": "Instrument Coms Info.gtype", "Debugging Cluster": "Debugging Cluster.gtype"}
uses:
  Rainbow Measurement Setup::Main Functions::Instruction Queue::Current State::FGV Current State.gvi
  Rainbow Measurement Setup::Side Functions::Instrument Control::Arduino::XZ Stage Arduino::Low Level::XZ Stage Coordinate to Gcode.gvi
  Rainbow Measurement Setup::Side Functions::Instrument Control::Arduino::XZ Stage Arduino::Low Level::XZ Stage Move To Location.gvi
diagram:
  # This SubVI Initializes the XZ stage and homes it while appending the log onto the Instrument Coms Info Cluster
  # It also checks the debugging cluster to see if we want to use the Arduinos or not
  case ($"Error In") {
    frame Error, Default {
      w1 = $"Error In"
      w2 = $"Instrument Control Mega Cluster In"
    }
    frame No Error {
      Property Node(instance in=$"Instrument Control Mega Cluster In") -> ("Debugging Cluster:Debugging mode?"=w3, "Debugging Cluster:Insturment Debugging:Arduinos"=w4, instance out=w5)
      Logical And[output inverted](w3, not w4) -> w6
      case (w6) {
        frame False, Default {
          w1 = $"Error In"
          w2 = w5
        }
        frame True {
          Property Node(instance in=w5) -> ("Instruments Coms Info:Arduino Coms Info:XZ Stage Arduino Address"=w7, "Instruments Coms Info:Arduino Coms Info:XZ Stage Log"=w8, instance out=w9)
          call "FGV Current State.gvi"(Current State Instructions="Set Current Substate", Current Substate="Moving Arduino XZ Stage", Error In=$"Error In") -> (Error Out=w10)
          call "XZ Stage Coordinate to Gcode.gvi"(XZ Coordinate Cluster In=$"XZ Coordinate Cluster In", Error In=w10) -> (Gcode Instruction=w11, Error Out=w12)
          call "XZ Stage Move To Location.gvi"(XZ Carriage Arduino open Visa session In=w7, XZ Carriage Arduino Log In=w8, Error In=w12, Input Command=w11) -> (XZ Carriage Arduino Log Out=w13, Error Out=w1)
          Property Node(instance in=w9, "Instruments Coms Info:Arduino Coms Info:XZ Stage Log"=w13) -> (instance out=w2)
        }
      }
    }
  }
  $"Instrument Control Mega Cluster Out" <- w2
  $"Error Out" <- w1
