vi "Debug Cluster Instrument Extractor.gvi"   [LabVIEW NXG 5.0.0]
inputs:
  "Error In": error
  "Debugging Cluster In": "Debugging Cluster.gtype"
outputs:
  "Error Out": error
  "Debuging Cluster Out": "Debugging Cluster.gtype"
  "Instruments to Detect": "Instruments To Detect control.gtype"[]
types:
  "Insturment Debugging Cluster.gtype" = cluster{"Keithley": bool, "Arduinos": bool, "Thorlabs Motors": bool, "Photodetector": bool, "Flame Spectr": bool}
  "Debugging Cluster.gtype" = cluster{"Debugging mode?": bool, "Initialize App": bool, "Insturment Debugging": "Insturment Debugging Cluster.gtype"}
  "Instruments To Detect control.gtype" = enum{"Photodetector", "Keithley", "Arduinos", "Thorlabs Motors", "Flame Spectr"}
uses:
  Rainbow Measurement Setup::Side Functions::Instrument Control::Instruction Extractor Instruments to Detect.gvi
diagram:
  # This SubVI reads the debugging state of each instrument and appends it or not
  # depending on what the user has specified to detect and initialize.
  case ($"Error In") {
    frame Error, Default {
      w1 = $"Error In"
      w2 = "Instruments To Detect control.gtype"[] []
      w3 = $"Debugging Cluster In"
    }
    frame No Error {
      Property Node(instance in=$"Debugging Cluster In") -> ("Debugging mode?"=w4, "Insturment Debugging"=w5, instance out=w3)
      w6 = ["Keithley", "Arduinos", "Thorlabs Motors", "Photodetector", "Flame Spectr"]
      Property Node(instance in=w5) -> ("Keithley"=w7, "Arduinos"=w8, "Thorlabs Motors"=w9, "Photodetector"=w10, "Flame Spectr"=w11)
      Build Array(w7, w8, w9, w10, w11) -> w12
      for {
        w13 = each element of w12
        w14 = each element of w6
        append w14 to w15 if w13
      }
      call "Instruction Extractor Instruments to Detect.gvi"(Instruments To Detect control="Photodetector", Error In=$"Error In") -> (Instruments To Detect Array=w16, Error Out=w1)
      Select(s=w4, t=w15, f=w16) -> w2
    }
  }
  $"Error Out" <- w1
  $"Instruments to Detect" <- w2
  $"Debuging Cluster Out" <- w3
