vi "Flame Close.gvi"   [LabVIEW NXG 5.0.0]
inputs:
  "Error In": error
  "Instrument Control Mega Cluster In": "Instrument Control Mega Cluster.gtype"
outputs:
  "Error Out": error
  "Instrument Control Mega Cluster Out": "Instrument Control Mega Cluster.gtype"
types:
  "Instrument Coms Info.gtype" = cluster{"Arduino Coms Info": "Arduino Detection cluster control.gtype", "Photodetector Names": string[], "Keythley Address": "VISA Instr", "Photodetector Detected?": bool, "Thorlabs Motors Detected?": bool, "Keithley Detected?": bool, "Thorlabs Motors Serial Number": "Thorlabs Motors Serial Number In.gtype", "Photodetector IVI session": "Ivi IviDefault", "Flame ID": string, "Flame Detected?": bool, "Flame Wrapper ID": u64}
  "Debugging Cluster.gtype" = cluster{"Debugging mode?": bool, "Initialize App": bool, "Insturment Debugging": "Insturment Debugging Cluster.gtype"}
  "Instrument Control Mega Cluster.gtype" = cluster{"Instruments Coms Info": "Instrument Coms Info.gtype", "Debugging Cluster": "Debugging Cluster.gtype"}
uses:
  Shared::Wrapper::Wrapper_closeAllSpectrometers.gvi
  Shared::Wrapper::Wrapper_Destroy.gvi
diagram:
  # This subVI Checks if there is an open coms channel
  # with the Flame Spectrometer and if there is it
  # Closes the comunications with the Spectrometer
  case ($"Error In") {
    frame Error, Default {
      w1 = $"Error In"
      w2 = $"Instrument Control Mega Cluster In"
    }
    frame No Error {
      Property Node(instance in=$"Instrument Control Mega Cluster In") -> ("Debugging Cluster:Debugging mode?"=w3, "Debugging Cluster:Insturment Debugging:Flame Spectr"=w4, "Instruments Coms Info:Flame Wrapper ID"=w5, instance out=w2)
      Is Equal To 0(x=w5) -> w6
      Logical And(w3, not w4) -> w7
      Logical Or(w6, w7) -> w8
      case (w8) {
        frame True {
          w1 = $"Error In"
        }
        frame False {
          call "Wrapper_closeAllSpectrometers.gvi"(Wrapper In=w5, Error In=$"Error In") -> (Wrapper Out=w9, Error Out=w10)
          call "Wrapper_Destroy.gvi"(Wrapper In=w9, Error In=w10) -> (Error Out=w1)
        }
      }
    }
  }
  $"Instrument Control Mega Cluster Out" <- w2
  $"Error Out" <- w1
