vi "Flame Detector.gvi"   [LabVIEW NXG 5.0.0]
inputs:
  "Error In": error
outputs:
  "Error Out": error
  "Spectrometer Name": string
  "Spectrometer Connected?": bool
uses:
  Shared::Wrapper::Wrapper_Create.gvi
  Shared::Wrapper::Wrapper_openAllSpectrometers.gvi
  Shared::Wrapper::Wrapper_getName.gvi
  Shared::Wrapper::Wrapper_closeAllSpectrometers.gvi
  Shared::Wrapper::Wrapper_Destroy.gvi
diagram:
  # This SubVI tries to detect the Flame spectrometer or any spectrometer by ocean optics
  # and if it can't or if there is more than one connected it asks the user to connect only one.
  case ($"Error In") {
    frame Error, Default {
      w1 = $"Error In"
      w2 = ""
      w3 = default
    }
    frame No Error {
      while {
        call "Wrapper_Create.gvi"(Error In=$"Error In") -> (Wrapper Out=w4, Error Out=w5)
        call "Wrapper_openAllSpectrometers.gvi"(Wrapper In=w4, Error In=w5) -> (Wrapper Out=w6, Number of Spectrometers=w7, Error Out=w8)
        Is Equal(x=1, y=w7) -> w9
        case (w9) {
          frame False, Default {
            Number To Decimal String(number=w7) -> (decimal integer string=w13)
            w14 = "Please make sure you have connected\nexactly one Spectrometer. The current \nnumber of connected spectrometers is:\n"
            Concatenate Strings(w14, w13) -> w15
            w16 = "I do not want to use any spectrometer. \n(Some features will be disabled)"
            Two Button Dialog(F button name ("Cancel")=w16, T button name ("OK")="Okay I will connect them.", message=w15) -> (T Button?=w17)
            Not(x=w17) -> w12
            w2 = ""
            w10 = w8
            w11 = w6
            w3 = default
          }
          frame True {
            call "Wrapper_getName.gvi"(Wrapper In=w6, Error In=w8) -> (Wrapper Out=w11, Spectrometer Name=w2, Error Out=w10)
            w12 = TRUE
            w3 = TRUE
          }
        }
        call "Wrapper_closeAllSpectrometers.gvi"(Wrapper In=w11, Error In=w10) -> (Wrapper Out=w18, Error Out=w19)
        call "Wrapper_Destroy.gvi"(Wrapper In=w18, Error In=w19) -> (Error Out=w1)
        Wait Until Next Multiple(multiple to wait=100)
        stop if w12
      }
    }
  }
  $"Spectrometer Connected?" <- w3
  $"Spectrometer Name" <- w2
  $"Error Out" <- w1
