vi "Flame Get Spectra.gvi"   [LabVIEW NXG 5.0.0]
inputs:
  "Error In": error
  "Instrument Control Mega Cluster In": "Instrument Control Mega Cluster.gtype"
outputs:
  "Error Out": error
  "Instrument Control Mega Cluster Out": "Instrument Control Mega Cluster.gtype"
  "Beam Spectrum": cluster{"Wavelength": f64[], "Counts": f64[]}
types:
  "Instrument Coms Info.gtype" = cluster{"Arduino Coms Info": "Arduino Detection cluster control.gtype", "Photodetector Names": string[], "Keythley Address": "VISA Instr", "Photodetector Detected?": bool, "Thorlabs Motors Detected?": bool, "Keithley Detected?": bool, "Thorlabs Motors Serial Number": "Thorlabs Motors Serial Number In.gtype", "Photodetector IVI session": "Ivi IviDefault", "Flame ID": string, "Flame Detected?": bool, "Flame Wrapper ID": u64}
  "Debugging Cluster.gtype" = cluster{"Debugging mode?": bool, "Initialize App": bool, "Insturment Debugging": "Insturment Debugging Cluster.gtype"}
  "Instrument Control Mega Cluster.gtype" = cluster{"Instruments Coms Info": "Instrument Coms Info.gtype", "Debugging Cluster": "Debugging Cluster.gtype"}
uses:
  Shared::Wrapper::Wrapper_getWavelengths.gvi
  Shared::Wrapper::Wrapper_getSpectrum.gvi
diagram:
  # This SubVI Takes a spectrum, if the debugging allows it to do so and stores it within a cluster so that it can be later used.
  # Unless the Wrapper ID is empty.
  case ($"Error In") {
    frame Error, Default {
      w4 = cluster{"Wavelength": f64[], "Counts": f64[]} {all zero or empty}
      w1 = $"Error In"
      w2 = w4
      w3 = $"Instrument Control Mega Cluster In"
    }
    frame No Error {
      Property Node(instance in=$"Instrument Control Mega Cluster In") -> ("Debugging Cluster:Debugging mode?"=w5, "Debugging Cluster:Insturment Debugging:Flame Spectr"=w6, instance out=w7)
      Logical And[output inverted](w5, not w6) -> w8
      case (w8) {
        frame False, Default {
          w9 = cluster{"Wavelength": f64[], "Counts": f64[]} {all zero or empty}
          w1 = $"Error In"
          w2 = w9
          w3 = w7
        }
        frame True {
          Property Node(instance in=w7) -> ("Instruments Coms Info:Flame Wrapper ID"=w10, instance out=w3)
          Is Not Equal To 0(x=w10) -> w11
          case (w11) {
            frame False, Default {
              w12 = cluster{"Wavelength": f64[], "Counts": f64[]} {all zero or empty}
              w2 = w12
              w1 = $"Error In"
            }
            frame True {
              call "Wrapper_getWavelengths.gvi"(Wrapper In=w10, Error In=$"Error In") -> (Wrapper Out=w13, WL Values=w14, Error Out=w15)
              call "Wrapper_getSpectrum.gvi"(Wrapper In=w13, Error In=w15) -> (Spectrum Values=w16, Error Out=w1)
              w17 = cluster{"Wavelength": f64[], "Counts": f64[]} {all zero or empty}
              Property Node(instance in=w17, "Wavelength"=w14, "Counts"=w16) -> (instance out=w2)
            }
          }
        }
      }
    }
  }
  $"Instrument Control Mega Cluster Out" <- w3
  $"Beam Spectrum" <- w2
  $"Error Out" <- w1
