vi "Flame Initialize.gvi"   [LabVIEW NXG 5.0.0]
inputs:
  "Error In": error
  "Instrument Control Mega Cluster In": "Instrument Control Mega Cluster.gtype"
outputs:
  "Error Out": error
  "Instrument Control Mega Cluster Out": "Instrument Control Mega Cluster.gtype"
types:
  "Instrument Coms Info.gtype" = cluster{"Arduino Coms Info": "Arduino Detection cluster control.gtype", "Photodetector Names": string[], "Keythley Address": "VISA Instr", "Photodetector Detected?": bool, "Thorlabs Motors Detected?": bool, "Keithley Detected?": bool, "Thorlabs Motors Serial Number": "Thorlabs Motors Serial Number In.gtype", "Photodetector IVI session": "Ivi IviDefault", "Flame ID": string, "Flame Detected?": bool, "Flame Wrapper ID": u64}
  "Debugging Cluster.gtype" = cluster{"Debugging mode?": bool, "Initialize App": bool, "Insturment Debugging": "Insturment Debugging Cluster.gtype"}
  "Instrument Control Mega Cluster.gtype" = cluster{"Instruments Coms Info": "Instrument Coms Info.gtype", "Debugging Cluster": "Debugging Cluster.gtype"}
uses:
  Shared::Wrapper::Wrapper_Create.gvi
  Shared::Wrapper::Wrapper_openAllSpectrometers.gvi
  Shared::Wrapper::Wrapper_closeAllSpectrometers.gvi
  Shared::Wrapper::Wrapper_Destroy.gvi
  Shared::Wrapper::Wrapper_getName.gvi
diagram:
  # This SubVI Initializes the flame in case the debugging allows it to do so. It first checks the number of spectrometers connected
  # and if it is exactly one it passes on the wrapper ID number but if it is less than one or more than one it destroys the instances and
  # prompts again to connect the spectrometer. In case it fails repeated times it gives the option to proceed without the spectrometer
  # at your own risk.
  case ($"Error In") {
    frame Error, Default {
      w1 = $"Error In"
      w2 = $"Instrument Control Mega Cluster In"
    }
    frame No Error {
      Property Node(instance in=$"Instrument Control Mega Cluster In") -> ("Debugging Cluster:Debugging mode?"=w3, "Debugging Cluster:Insturment Debugging:Flame Spectr"=w4, instance out=w5)
      Logical And[output inverted](w3, not w4) -> w6
      case (w6) {
        frame False, Default {
          w1 = $"Error In"
          w2 = w5
        }
        frame True {
          s1 = $"Error In"  # shift register
          while (iteration -> i1) {
            call "Wrapper_Create.gvi"(Error In=s1) -> (Wrapper Out=w7, Error Out=w8)
            call "Wrapper_openAllSpectrometers.gvi"(Wrapper In=w7, Error In=w8) -> (Wrapper Out=w9, Number of Spectrometers=w10, Error Out=w11)
            Is Greater(x=i1, y=3) -> w12
            Is Equal(x=1, y=w10) -> w13
            case (w13) {
              frame False, Default {
                call "Wrapper_closeAllSpectrometers.gvi"(Wrapper In=w9, Error In=w11) -> (Wrapper Out=w19, Error Out=w20)
                call "Wrapper_Destroy.gvi"(Wrapper In=w19, Error In=w20) -> (Error Out=w15)
                case (w12) {
                  frame True {
                    Number To Decimal String(number=w10) -> (decimal integer string=w21)
                    w22 = """It seems you are having problems with 
connecting the spectrometer.
Please make sure you have connected
exactly one Spectrometer. The current 
number of connected spectrometers is:
"""
                    w23 = """Do you want to try to proceed
without the spectrometer connected?
(CAUTION!!! Some functionalities might be 
compromized or the software can completely
crash all together!!!)"""
                    Concatenate Strings(w22, w21, "\r", w23) -> w24
                    Two Button Dialog(F button name ("Cancel")="Yes I know What I'm Doing!  B)", T button name ("OK")="Okay I will connect them.", message=w24) -> (T Button?=w25)
                    Not(x=w25) -> w17
                  }
                  frame False {
                    Number To Decimal String(number=w10) -> (decimal integer string=w26)
                    w27 = "Please make sure you have connected\nexactly one Spectrometer. The current \nnumber of connected spectrometers is:\n"
                    Concatenate Strings(w27, w26) -> w28
                    One Button Dialog(button name ("OK")="Okay I will connect them.", message=w28)
                    w17 = FALSE
                  }
                }
                w14 = ""
                w16 = default
                w18 = default
              }
              frame True {
                call "Wrapper_getName.gvi"(Wrapper In=w9, Error In=w11) -> (Wrapper Out=w16, Spectrometer Name=w14, Error Out=w15)
                w17 = TRUE
                w18 = TRUE
              }
            }
            Wait Until Next Multiple(multiple to wait=100)
            next s1 = w15
            stop if w17
          }
          Property Node(instance in=w5, "Instruments Coms Info:Flame Wrapper ID"=w16, "Instruments Coms Info:Flame ID"=w14) -> (instance out=w2)
          w1 = s1
        }
      }
    }
  }
  $"Instrument Control Mega Cluster Out" <- w2
  $"Error Out" <- w1
