vi "Fast Smart Sweep.gvi"   [LabVIEW NXG 5.0.0]
inputs:
  "Error In": error
  "VISA resource name in": "VISA Instr"
  "Fast Sweep Parameters In": "Fast Sweep Parameters.gtype"
outputs:
  "Error Out": error
  "VISA resource name Out": "VISA Instr"
  "Fast Sweep Parameters Out": "Fast Sweep Parameters.gtype"
types:
  T1 = cluster{"Sweep Direction": bool, "Min Voltage (V)": f64, "Max Voltage (V)": f64, "Measurement Speed (1 PLC)": f64, "Sweep Points": u32}
  T2 = cluster{"Current Array (A)": f64[], "Voltage Array (V)": f64[], "Isc (A)": f64}
  "Fast Sweep Parameters.gtype" = cluster{"Parameters": T1, "Data": T2}
uses:
  Rainbow Measurement Setup::Side Functions::Instrument Control::Keithley::Fast Sweep::Rough Isc Measurement.gvi
  Rainbow Measurement Setup::Side Functions::Instrument Control::Keithley::Fast Sweep::Fast Sweep Subroutine.gvi
diagram:
  case ($"Error In") {
    frame Error, Default {
      w1 = $"Error In"
      w2 = $"VISA resource name in"
      w3 = $"Fast Sweep Parameters In"
    }
    frame No Error {
      call "Rough Isc Measurement.gvi"(VISA resource name=$"VISA resource name in", Fast Sweep Mega Cluster In=$"Fast Sweep Parameters In", Error In=$"Error In") -> (VISA resource name out=w4, Fast Sweep Mega Cluster Out=w5, Error Out=w6)
      call "Fast Sweep Subroutine.gvi"(VISA resource name in=w4, Fast Sweep Mega Cluster In=w5, Error In=w6) -> (VISA resource name out=w2, Fast Sweep Mega Cluster Out=w3, Error Out=w1)
    }
  }
  $"VISA resource name Out" <- w2
  $"Fast Sweep Parameters Out" <- w3
  $"Error Out" <- w1
