vi "Fast Sweep Subroutine.gvi"   [LabVIEW NXG 5.0.0]
inputs:
  "Fast Sweep Parameters In": "Fast Sweep Parameters.gtype"
  "VISA resource name in": "VISA Instr"
  "Error In": error
outputs:
  "Fast Sweep Parameters Out": "Fast Sweep Parameters.gtype"
  "VISA resource name out": "VISA Instr"
  "Error Out": error
types:
  T1 = cluster{"Sweep Direction": bool, "Min Voltage (V)": f64, "Max Voltage (V)": f64, "Measurement Speed (1 PLC)": f64, "Sweep Points": u32}
  T2 = cluster{"Current Array (A)": f64[], "Voltage Array (V)": f64[], "Isc (A)": f64}
  "Fast Sweep Parameters.gtype" = cluster{"Parameters": T1, "Data": T2}
uses:
  Rainbow Measurement Setup::Side Functions::Instrument Control::Keithley::Fast Sweep::Rough Isc Measurement.gvi
  Rainbow Measurement Setup::Side Functions::Instrument Control::Keithley::Fast Sweep::Sweep.gvi
  Labview_NXG_Keithley_SMU_2450_2460_2461::Utility::Reset.gvi
diagram:
  call "Rough Isc Measurement.gvi"(VISA resource name=$"VISA resource name in", Fast Sweep Mega Cluster In=$"Fast Sweep Parameters In", Error In=$"Error In") -> (VISA resource name out=w1, Fast Sweep Mega Cluster Out=w2, Error Out=w3)
  call "Sweep.gvi"(VISA resource name in=w1, Fast Sweep Mega Cluster In=w2, Error In=w3) -> (VISA resource name out=w4, Fast Sweep Mega Cluster Out=w5, Error Out=w6)
  $"Fast Sweep Parameters Out" <- w5
  call "Reset.gvi"(VISA resource name=w4, error in (no error)=w6) -> (VISA resource name out=w7, error out=w8)
  $"VISA resource name out" <- w7
  $"Error Out" <- w8
