vi "Fast Sweep Test.gvi"   [LabVIEW NXG 5.0.0]
inputs:
  "Error In": error
outputs:
  "Error Out": error
panel controls:
  "VISA resource name": "VISA Instr"
  "Fast Sweep Parameters In": "Fast Sweep Parameters.gtype" = {"Parameters"={"Sweep Direction"=FALSE, "Min Voltage (V)"=-0.2, "Max Voltage (V)"=1, "Measurement Speed (1 PLC)"=1, "Sweep Points"=50}, "Data"={"Current Array (A)"=[], "Voltage Array (V)"=[], "Isc (A)"=0}}
  "High Speed?": bool
panel indicators:
  "Graph": cluster{"Element 1": f64[], "Element 2": f64[]}
  "Sweep Time (ms)": u32
  "Fast Sweep Parameters Out": "Fast Sweep Parameters.gtype"
types:
  T1 = cluster{"Sweep Direction": bool, "Min Voltage (V)": f64, "Max Voltage (V)": f64, "Measurement Speed (1 PLC)": f64, "Sweep Points": u32}
  T2 = cluster{"Current Array (A)": f64[], "Voltage Array (V)": f64[], "Isc (A)": f64}
  "Fast Sweep Parameters.gtype" = cluster{"Parameters": T1, "Data": T2}
uses:
  Labview_NXG_Keithley_SMU_2450_2460_2461::Miscelaneous::Initialize.gvi
  Rainbow Measurement Setup::Side Functions::Instrument Control::Keithley::Fast Sweep::Full Fast Smart Sweep.gvi
  Labview_NXG_Keithley_SMU_2450_2460_2461::Miscelaneous::Close.gvi
diagram:
  case ($"Error In") {
    frame Error, Default {
      w1 = $"Error In"
      w2 = default
    }
    frame No Error {
      call "Initialize.gvi"(VISA resource name=$"VISA resource name", error in (no error)=$"Error In") -> (VISA resource name out=w3, error out=w4)
      call "Full Fast Smart Sweep.gvi"(VISA resource name in=w3, Fast Sweep Parameters In=$"Fast Sweep Parameters In", Error In=w4, High Speed?=$"High Speed?") -> (VISA resource name Out=w5, Fast Sweep Parameters Out=w2, Time Elapsed (ms)=w6, Error Out=w7)
      call "Close.gvi"(VISA resource name=w5, error in (no error)=w7) -> (error out=w1)
      $"Sweep Time (ms)" <- w6
    }
  }
  Property Node(instance in=w2) -> ("Data:Voltage Array (V)"=w8, "Data:Current Array (A)"=w9, instance out=w10)
  $"Fast Sweep Parameters Out" <- w10
  Build Cluster(w8, w9) -> w11
  $Graph <- w11
  $"Error Out" <- w1
