vi "Rough Isc Measurement.gvi"   [LabVIEW NXG 5.0.0]
inputs:
  "Error In": error
  "VISA resource name": "VISA Instr"
  "Fast Sweep Mega Cluster In": "Fast Sweep Parameters.gtype"
outputs:
  "Error Out": error
  "VISA resource name out": "VISA Instr"
  "Fast Sweep Mega Cluster Out": "Fast Sweep Parameters.gtype"
types:
  T1 = cluster{"Sweep Direction": bool, "Min Voltage (V)": f64, "Max Voltage (V)": f64, "Measurement Speed (1 PLC)": f64, "Sweep Points": u32}
  T2 = cluster{"Current Array (A)": f64[], "Voltage Array (V)": f64[], "Isc (A)": f64}
  "Fast Sweep Parameters.gtype" = cluster{"Parameters": T1, "Data": T2}
uses:
  Labview_NXG_Keithley_SMU_2450_2460_2461::Configure::Configure Measurement Range.gvi
  Labview_NXG_Keithley_SMU_2450_2460_2461::Configure::Configure Output.gvi
  Labview_NXG_Keithley_SMU_2450_2460_2461::Configure::Configure Source Function.gvi
  Labview_NXG_Keithley_SMU_2450_2460_2461::Configure::Configure Measurement Function.gvi
  Labview_NXG_Keithley_SMU_2450_2460_2461::Action Status::Enable Output.gvi
  Labview_NXG_Keithley_SMU_2450_2460_2461::Configure::Set Measurement Count.gvi
  Labview_NXG_Keithley_SMU_2450_2460_2461::Data::Make Reading and Store in Buffer.gvi
  Labview_NXG_Keithley_SMU_2450_2460_2461::Data::Read (Multiple Points).gvi
  Labview_NXG_Keithley_SMU_2450_2460_2461::Configure::Clear Buffer.gvi
  NI::Analysis::Statistics::Measures of Mean.gvi
diagram:
  # This SubVI Finds a rough value for the Voc or the Jsc in a fast manner
  case ($"Error In") {
    frame Error, Default {
      w1 = $"Error In"
      w2 = $"VISA resource name"
      w3 = $"Fast Sweep Mega Cluster In"
    }
    frame No Error {
      call "Configure Measurement Range.gvi"(VISA resource name=$"VISA resource name", Function (0: Volts)="Volts"(0), Enable Auto Range (T:Enable)=TRUE, error in (no error)=$"Error In") -> (VISA resource name out=w4, error out=w5)
      call "Configure Measurement Range.gvi"(VISA resource name=w4, Function (0: Volts)="Volts"(0), Enable Auto Range (T:Enable)=TRUE, error in (no error)=w5) -> (VISA resource name out=w6, error out=w7)
      call "Configure Output.gvi"(VISA resource name=w6, Source Level (0)=0, Source Mode (0: Voltage)="Voltage"(0), error in (no error)=w7) -> (VISA resource name out=w8, error out=w9)
      call "Configure Source Function.gvi"(VISA resource name=w8, Function (0: Volts)="Volts"(0), error in (no error)=w9) -> (VISA resource name out=w10, error out=w11)
      call "Configure Measurement Function.gvi"(VISA resource name=w10, Function (0: Volts)="Current"(1), error in (no error)=w11) -> (VISA resource name out=w12, error out=w13)
      call "Enable Output.gvi"(VISA resource name=w12, Enable Output (T: Enable)=TRUE, error in (no error)=w13) -> (VISA resource name out=w14, error out=w15)
      call "Set Measurement Count.gvi"(VISA resource name=w14, Measurement Count=10, error in (no error)=w15) -> (VISA resource name out=w16, error out=w17)
      call "Make Reading and Store in Buffer.gvi"(VISA resource name=w16, error in (no error)=w17) -> (VISA resource name out=w18, error out=w19)
      call "Read (Multiple Points).gvi"(VISA resource name=w18, End Index (1)=10, error in (no error)=w19) -> (VISA resource name out=w20, Data out=w21, error out=w22)
      Spreadsheet String To Array(array type=f64[] [], delimiter=",", format string="%s", spreadsheet string=w21) -> (array=w23)
      call "Enable Output.gvi"(VISA resource name=w20, Enable Output (T: Enable)=FALSE, error in (no error)=w22) -> (VISA resource name out=w24, error out=w25)
      call "Clear Buffer.gvi"(VISA resource name=w24, error in (no error)=w25) -> (VISA resource name out=w2, error out=w26)
      call "Measures of Mean.gvi"(x=w23, error in=w26) -> (mean value=w27, error out=w1)
      Property Node(instance in=$"Fast Sweep Mega Cluster In", "Data:Isc (A)"=w27) -> (instance out=w3)
    }
  }
  $"Fast Sweep Mega Cluster Out" <- w3
  $"Error Out" <- w1
  $"VISA resource name out" <- w2
