vi "Keithley Detection Subroutine.gvi"   [LabVIEW NXG 5.0.0]
inputs:
  "Error In": error
outputs:
  "Error Out": error
  "Detected?": bool
  "Keythley Address Out": "VISA Instr"
uses:
  NI::VISA::Find Resource (Search Resources).gvi
  NI::G Core::Error::Clear Error Cluster.gvi
diagram:
  # This subVi scans all dhe available resources in search for the keithley and if found returns its address.
  # If not found it prompts the user to connect it propperly.
  case ($"Error In") {
    frame Error, Default {
      w1 = $"Error In"
      w2 = default
      w3 = default
    }
    frame No Error {
      while (iteration -> i1) {
        call "Find Resource (Search Resources).gvi"(error in=$"Error In") -> (found resources=w4, error out=w5)
        for {
          w6 = each element of w4
          Search And Replace String(error in (no error)=w5, input string=w6, search string="2450") -> (error out=w8, number of replacements=w9)
          Is Greater Than 0(x=w9) -> w10
          append w6 to w7 if w10
        }
        Is Empty Array(array=w7) -> w11
        Array Size(array=w7) -> (size(s)=w12)
        Is Greater(x=w12, y=1) -> w13
        Logical Or(w11, w13) -> w14
        case (w14) {
          frame False, Default {
            Array Index(array=w7) -> (out0[0]=w16)
            w15 = TRUE
            w17 = w8
            w2 = TRUE
          }
          frame True {
            Wait Until Next Multiple(multiple to wait=500)
            call "Clear Error Cluster.gvi"(error in=w8) -> (error out=w17)
            w18 = """Seems like you have connected
either more than one 2450 keithley
to this computer or none at all, 
please disconnect all of them but
one, or connect at least one
and then retry."""
            One Button Dialog(button name ("OK")="Okay, sorry.", message=w18)
            w15 = FALSE
            w16 = ""
            w2 = default
          }
        }
        Type Cast(type="VISA Instr" "", x=w16) -> w3
        Is Greater(x=i1, y=5) -> w19
        case (w19) {
          frame False, Default {
            w20 = FALSE
            w1 = w17
          }
          frame True {
            w21 = """Seems you're having some trouble
connecting the keithley, do you 
want to proceed without connecting it
and hope for the best?
(WARNING: some functionalities might
be compromized, or the entire program 
can crash)"""
            Two Button Dialog(F button name ("Cancel")="Oh dear no, I'd rather ask for help", T button name ("OK")="Yes please, I like to live dangerously", message=w21) -> (T Button?=w20)
            w1 = w17
          }
        }
        Logical Or(w15, w20) -> w22
        stop if w22
      }
    }
  }
  $"Detected?" <- w2
  $"Keythley Address Out" <- w3
  $"Error Out" <- w1
