vi "Keithley Set Constant Parameters.gvi"   [LabVIEW NXG 5.0.0]
inputs:
  "Error In": error
  "Instrument Control Mega Cluster In": "Instrument Control Mega Cluster.gtype"
  "SRM Mega Cluster In": "SRM Mega Cluster.gtype"
outputs:
  "Error Out": error
  "Instrument Control Mega Cluster Out": "Instrument Control Mega Cluster.gtype"
  "SRM Mega Cluster Out": "SRM Mega Cluster.gtype"
types:
  "Instrument Coms Info.gtype" = cluster{"Arduino Coms Info": "Arduino Detection cluster control.gtype", "Photodetector Names": string[], "Keythley Address": "VISA Instr", "Photodetector Detected?": bool, "Thorlabs Motors Detected?": bool, "Keithley Detected?": bool, "Thorlabs Motors Serial Number": "Thorlabs Motors Serial Number In.gtype", "Photodetector IVI session": "Ivi IviDefault", "Flame ID": string, "Flame Detected?": bool, "Flame Wrapper ID": u64}
  "Debugging Cluster.gtype" = cluster{"Debugging mode?": bool, "Initialize App": bool, "Insturment Debugging": "Insturment Debugging Cluster.gtype"}
  "Instrument Control Mega Cluster.gtype" = cluster{"Instruments Coms Info": "Instrument Coms Info.gtype", "Debugging Cluster": "Debugging Cluster.gtype"}
  "Sweep Speed Selector.gtype" = enum{"Smart Sweep", "Fast Sweep", "Normal Sweep"}
  "SRM Specific Parameters.gtype" = cluster{"Max (V)": f64, "Min (V)": f64, "V Points": u32, "Current Range (A)": f64, "Autorange": bool, "Sweep Dir": bool, "Current Averages": u32, "Max (A)": f64, "PLC Speed": f64, "Cell Area (m^2)": f64, "Full Spctr Ref": bool, "Sweep Speed": "Sweep Speed Selector.gtype"}
  "Raibow Sweep Selector.gtype" = enum{"Red Sweep", "Blue Sweep", "Full Sweep Red First", "Full Sweep Blue First"}
  "Rainbow Sweep Param Selector.gtype" = cluster{"Raibow Sweep Selector": "Raibow Sweep Selector.gtype", "Max Wavelength (nm)": f64, "Min Wavelength (nm)": f64, "Wavelength Step (nm)": f64, "Rainbow Sweep Type Selector": "Rainbow Sweep Type Selector.gtype"}
  "Rainbow Sweep Types.gtype" = enum{"Red Sweep Closing", "Red Sweep Opening", "Blue Sweep Closing", "Blue Sweep Opening"}
  "IV Full Data Cluster.gtype" = cluster{"IV Measurements Array": "IV Single Measurement.gtype"[], "Rainbow Sweep Types": "Rainbow Sweep Types.gtype", "IV Refined Data": "IV Refined Full Sweep Data.gtype", "Total Light Power Density (W/m^2)": f64}
  "IV Full Raw Data.gtype" = cluster{"Rainbow Sweep Types": "Rainbow Sweep Types.gtype", "IV Raw Data Array": "IV Single Measurement.gtype"[]}
  "SRM Mega Cluster.gtype" = cluster{"SRM Specific Parameters": "SRM Specific Parameters.gtype", "Rainbow Sweep Parameters SRM": "Rainbow Sweep Param Selector.gtype", "SRM Full IV data Array": "IV Full Data Cluster.gtype"[], "Full IV Curve Raw Data": "IV Full Raw Data.gtype"[]}
uses:
  Rainbow Measurement Setup::Main Functions::Instruction Queue::Current State::FGV Current State.gvi
  Rainbow Measurement Setup::Side Functions::Instrument Control::Keithley::Keithley Sweep Parameters Calculator.gvi
  Labview_NXG_Keithley_SMU_2450_2460_2461::Configure::Configure Measurement Range.gvi
  Labview_NXG_Keithley_SMU_2450_2460_2461::Configure::Configure Output.gvi
  Labview_NXG_Keithley_SMU_2450_2460_2461::Configure::Configure Source Function.gvi
  Labview_NXG_Keithley_SMU_2450_2460_2461::Configure::Configure Measurement Function.gvi
  Labview_NXG_Keithley_SMU_2450_2460_2461::Configure::Configure Integration Filter.gvi
  Labview_NXG_Keithley_SMU_2450_2460_2461::Configure::Configure Linear Mode Sweep.gvi
  Rainbow Measurement Setup::Side Functions::Instrument Control::Keithley::Smart Sweep::FGV Smart Sweep Parameters.gvi
  Rainbow Measurement Setup::Side Functions::Instrument Control::Keithley::Set Keythley to Fast.gvi
diagram:
  # This SubVI Sets all the desired parameter for the keitley sweep depending on the type of sweep selected
  case ($"Error In") {
    frame Error, Default {
      w1 = $"Error In"
      w2 = $"Instrument Control Mega Cluster In"
      w3 = $"SRM Mega Cluster In"
    }
    frame No Error {
      Property Node(instance in=$"Instrument Control Mega Cluster In") -> ("Debugging Cluster:Debugging mode?"=w4, "Debugging Cluster:Insturment Debugging:Keithley"=w5, instance out=w6)
      Logical And[output inverted](w4, not w5) -> w7
      case (w7) {
        frame False, Default {
          w2 = w6
          w1 = $"Error In"
          w3 = $"SRM Mega Cluster In"
        }
        frame True {
          Property Node(instance in=w6) -> ("Instruments Coms Info:Keythley Address"=w8, instance out=w9)
          Property Node(instance in=$"SRM Mega Cluster In") -> ("SRM Specific Parameters:Sweep Speed"=w10, instance out=w11)
          call "FGV Current State.gvi"(Current State Instructions="Set Current Substate", Current Substate="Setting Keithley Parameters", Error In=$"Error In") -> (Error Out=w12)
          case (w10) {
            frame "Normal Sweep" {
              call "Keithley Sweep Parameters Calculator.gvi"(SRM Mega Cluster In=w11, Error In=w12) -> (Measurement Speed (1 PLC)=w14, SRM Mega Cluster Out=w3, Manual Range (1.0)=w15, Sweep Points=w16, Error Out=w17, Enable Auto Range (T:Enable)=w18)
              call "Configure Measurement Range.gvi"(VISA resource name=w8, Function (0: Volts)="Volts"(0), Enable Auto Range (T:Enable)=TRUE, error in (no error)=w17) -> (VISA resource name out=w19, error out=w20)
              call "Configure Measurement Range.gvi"(Manual Range (1.0)=w15, VISA resource name=w19, Function (0: Volts)="Current"(1), Enable Auto Range (T:Enable)=w18, error in (no error)=w20) -> (VISA resource name out=w21, error out=w22)
              call "Configure Output.gvi"(VISA resource name=w21, Source Mode (0: Voltage)="Voltage"(0), error in (no error)=w22) -> (VISA resource name out=w23, error out=w24)
              call "Configure Source Function.gvi"(VISA resource name=w23, Function (0: Volts)="Volts"(0), error in (no error)=w24) -> (VISA resource name out=w25, error out=w26)
              call "Configure Measurement Function.gvi"(VISA resource name=w25, Function (0: Volts)="Current"(1), error in (no error)=w26) -> (VISA resource name out=w27, error out=w28)
              call "Configure Integration Filter.gvi"(VISA resource name=w27, Function (0: Volts)="Volts"(0), Measurement Speed (1 PLC)=w14, error in (no error)=w28) -> (VISA resource name out=w29, error out=w30)
              call "Configure Linear Mode Sweep.gvi"(VISA resource name=w29, Source Mode (0: Voltage)="Voltage"(0), Sweep Points=w16, Delay (0)=0, error in (no error)=w30) -> (VISA resource name out=w13, error out=w1)
            }
            frame "Fast Sweep" {
              call "FGV Smart Sweep Parameters.gvi"(FGV Instructions="Read State", Error In=w12) -> (Smart Sweep Mega Cluster Out=w31, Error Out=w32)
              Property Node(instance in=w31) -> ("High Speed"=w33)
              case (w33) {
                frame False, Default {
                  w13 = w8
                  w1 = w32
                }
                frame True {
                  call "Set Keythley to Fast.gvi"(Visa Resource Name In=w8, Error In=w32) -> (Visa Resource Name Out=w13, Error Out=w1)
                }
              }
              w3 = w11
            }
            frame "Smart Sweep", Default {
              call "FGV Smart Sweep Parameters.gvi"(FGV Instructions="Read State", Error In=w12) -> (Smart Sweep Mega Cluster Out=w34, Error Out=w35)
              Property Node(instance in=w34) -> ("High Speed"=w36)
              case (w36) {
                frame False, Default {
                  w13 = w8
                  w1 = w35
                }
                frame True {
                  call "Set Keythley to Fast.gvi"(Visa Resource Name In=w8, Error In=w35) -> (Visa Resource Name Out=w13, Error Out=w1)
                }
              }
              w3 = w11
            }
          }
          Property Node(instance in=w9, "Instruments Coms Info:Keythley Address"=w13) -> (instance out=w2)
        }
      }
    }
  }
  $"Instrument Control Mega Cluster Out" <- w2
  $"Error Out" <- w1
  $"SRM Mega Cluster Out" <- w3
