vi "Keithley Sweep Parameters Calculator.gvi"   [LabVIEW NXG 5.0.0]
inputs:
  "SRM Parameters in": "SRM Specific Parameters.gtype" = {"Max (V)"=1.2, "Min (V)"=-0.5, "V Points"=100, "Current Range (A)"=0, "Autorange"=TRUE, "Sweep Dir"=FALSE, "Current Averages"=3, "Max (A)"=0.1, "Integration Time"=0.5, "Cell Area (m^2)"=8e-06}
  "Error In": error
outputs:
  "SRM Parameters Out": "SRM Specific Parameters.gtype"
  "Enable Auto Range (T:Enable)": bool
  "Manual Range (1.0)": f64
  "Measurement Speed (1 PLC)": f64
  "Error Out": error
  "Sweep Points": T1
types:
  "SRM Specific Parameters.gtype" = cluster{"Max (V)": f64, "Min (V)": f64, "V Points": u32, "Current Range (A)": f64, "Autorange": bool, "Sweep Dir": bool, "Current Averages": u32, "Max (A)": f64, "Integration Time": f64, "Cell Area (m^2)": f64}
  T1 = cluster{"Start ": f64, "Stop ": f64, "Number of Points (5)": u32}
uses:
  Rainbow Measurement Setup::Side Functions::Instrument Control::Keithley::Voltage Direction Calculator.gvi
  Rainbow Measurement Setup::Side Functions::Utilities::Order of Magnitude Extractor.gvi
diagram:
  # This SubVI Calculates the number of sweep points required for the
  # specified SRM parameters. It also extracts all the parameters so that
  # they can be set correctly on the keithley.
  case ($"Error Out") {
    frame Error, Default {
      w1 = default
      w2 = default
      w3 = $"Error Out"
      w4 = $"SRM Parameters in"
      w5 = default
      w6 = default
    }
    frame No Error {
      Property Node(instance in=$"SRM Parameters in") -> ("Current Range (A)"=w7, "Autorange"=w1, "Max (A)"=w8, "Integration Time"=w6, "Max (V)"=w9, "Min (V)"=w10, "V Points"=w11, "Sweep Dir"=w12, instance out=w4)
      In Range And Coerce(lower limit=1e-08, upper limit=1, x=w7) -> (coerced(x)=w13)
      Select(s=w1, t=w8, f=w13) -> w2
      call "Voltage Direction Calculator.gvi"(Max Voltage (V)=w9, Min Voltage (V)=w10, Error In=$"Error Out", Sweep Direction=w12) -> (Start=w14, End=w15, Error Out=w16)
      call "Order of Magnitude Extractor.gvi"(Number to extract order of magnitude=w13, Error In=w16) -> (Error Out=w3)
      Property Node(instance in=T1 {"Start "=1, "Stop "=0, "Number of Points (5)"=5}, "Start "=w14, "Stop "=w15, "Number of Points (5)"=w11) -> (instance out=w5)
    }
  }
  $"SRM Parameters Out" <- w4
  $"Enable Auto Range (T:Enable)" <- w1
  $"Manual Range (1.0)" <- w2
  $"Error In" <- w3
  $"Measurement Speed (1 PLC)" <- w6
  $"Sweep Points" <- w5
