vi "Keithley Sweep Subroutine.gvi"   [LabVIEW NXG 5.0.0]
inputs:
  "Error In": error
  "Instrument Control Mega Cluster In": "Instrument Control Mega Cluster.gtype"
  "SRM Mega Cluster In": "SRM Mega Cluster.gtype"
  "IV Single Measurement In": "IV Single Measurement.gtype"
outputs:
  "Error Out": error
  "Instrument Control Mega Cluster Out": "Instrument Control Mega Cluster.gtype"
  "SRM Mega Cluster Out": "SRM Mega Cluster.gtype"
  "IV Single Measurement Out": "IV Single Measurement.gtype"
types:
  T1 = cluster{"Isc (A)": f64, "Voc (V)": f64, "FF (%)": f64, "Rs (Ω)": f64, "Rsh (Ω)": f64}
  "IV Single Measurement.gtype" = cluster{"Voltage (V)": f64[], "Current (A)": f64[], "Current Density (A/m^2)": f64[], "Dividing Wavelength (nm)": f64, "Light Power Density (W/m^2)": f64, "Total Light Power Density (W/m^2)": f64, "Smart Sweep Data": T1}
  "Sweep Speed Selector.gtype" = enum{"Smart Sweep", "Fast Sweep", "Normal Sweep"}
  "SRM Specific Parameters.gtype" = cluster{"Max (V)": f64, "Min (V)": f64, "V Points": u32, "Current Range (A)": f64, "Autorange": bool, "Sweep Dir": bool, "Current Averages": u32, "Max (A)": f64, "PLC Speed": f64, "Cell Area (m^2)": f64, "Full Spctr Ref": bool, "Sweep Speed": "Sweep Speed Selector.gtype"}
  "Raibow Sweep Selector.gtype" = enum{"Red Sweep", "Blue Sweep", "Full Sweep Red First", "Full Sweep Blue First"}
  "Rainbow Sweep Param Selector.gtype" = cluster{"Raibow Sweep Selector": "Raibow Sweep Selector.gtype", "Max Wavelength (nm)": f64, "Min Wavelength (nm)": f64, "Wavelength Step (nm)": f64, "Rainbow Sweep Type Selector": "Rainbow Sweep Type Selector.gtype"}
  "Rainbow Sweep Types.gtype" = enum{"Red Sweep Closing", "Red Sweep Opening", "Blue Sweep Closing", "Blue Sweep Opening"}
  "IV Full Data Cluster.gtype" = cluster{"IV Measurements Array": "IV Single Measurement.gtype"[], "Rainbow Sweep Types": "Rainbow Sweep Types.gtype", "IV Refined Data": "IV Refined Full Sweep Data.gtype", "Total Light Power Density (W/m^2)": f64}
  "IV Full Raw Data.gtype" = cluster{"Rainbow Sweep Types": "Rainbow Sweep Types.gtype", "IV Raw Data Array": "IV Single Measurement.gtype"[]}
  "SRM Mega Cluster.gtype" = cluster{"SRM Specific Parameters": "SRM Specific Parameters.gtype", "Rainbow Sweep Parameters SRM": "Rainbow Sweep Param Selector.gtype", "SRM Full IV data Array": "IV Full Data Cluster.gtype"[], "Full IV Curve Raw Data": "IV Full Raw Data.gtype"[]}
  "Instrument Coms Info.gtype" = cluster{"Arduino Coms Info": "Arduino Detection cluster control.gtype", "Photodetector Names": string[], "Keythley Address": "VISA Instr", "Photodetector Detected?": bool, "Thorlabs Motors Detected?": bool, "Keithley Detected?": bool, "Thorlabs Motors Serial Number": "Thorlabs Motors Serial Number In.gtype", "Photodetector IVI session": "Ivi IviDefault", "Flame ID": string, "Flame Detected?": bool, "Flame Wrapper ID": u64}
  "Debugging Cluster.gtype" = cluster{"Debugging mode?": bool, "Initialize App": bool, "Insturment Debugging": "Insturment Debugging Cluster.gtype"}
  "Instrument Control Mega Cluster.gtype" = cluster{"Instruments Coms Info": "Instrument Coms Info.gtype", "Debugging Cluster": "Debugging Cluster.gtype"}
  T2 = cluster{"Sweep Direction": bool, "Min Voltage (V)": f64, "Max Voltage (V)": f64, "Measurement Speed (1 PLC)": f64, "Sweep Points": u32}
  T3 = cluster{"Current Array (A)": f64[], "Voltage Array (V)": f64[], "Isc (A)": f64}
  "Fast Sweep Parameters.gtype" = cluster{"Parameters": T2, "Data": T3}
uses:
  Rainbow Measurement Setup::Side Functions::Instrument Control::Keithley::Random IV Curve Generator.gvi
  Rainbow Measurement Setup::Main Functions::Instruction Queue::Current State::FGV Current State.gvi
  Labview_NXG_Keithley_SMU_2450_2460_2461::Configure::Clear Buffer.gvi
  Labview_NXG_Keithley_SMU_2450_2460_2461::Action Status::Enable Output.gvi
  Labview_NXG_Keithley_SMU_2450_2460_2461::Data::Low Level::Initiate.gvi
  Rainbow Measurement Setup::Side Functions::Instrument Control::Keithley::FGV Keithley timeout.gvi
  Labview_NXG_Keithley_SMU_2450_2460_2461::Data::Low Level::Wait for Operation Complete.gvi
  Labview_NXG_Keithley_SMU_2450_2460_2461::Data::Read (Multiple Points).gvi
  Rainbow Measurement Setup::Side Functions::Instrument Control::Keithley::Keithley Timeout Check.gvi
  NI::VISA::Write (Instr, String).gvi
  Rainbow Measurement Setup::Side Functions::Instrument Control::Keithley::Fast Sweep::Fast Sweep Subroutine.gvi
  Rainbow Measurement Setup::Side Functions::Instrument Control::Keithley::Smart Sweep::FGV Smart Sweep Parameters.gvi
  Rainbow Measurement Setup::Side Functions::Instrument Control::Keithley::Smart Sweep::Smart Sweep Subroutine.gvi
diagram:
  # This SubVI Initializes the Keithley Comunication In case the debugging allows it to do so
  case ($"Error In") {
    frame Error, Default {
      w1 = $"Error In"
      w2 = $"Instrument Control Mega Cluster In"
      w3 = $"IV Single Measurement In"
      w4 = $"SRM Mega Cluster In"
    }
    frame No Error {
      Property Node(instance in=$"Instrument Control Mega Cluster In") -> ("Debugging Cluster:Debugging mode?"=w5, "Debugging Cluster:Insturment Debugging:Keithley"=w6, instance out=w7)
      Logical And[output inverted](w5, not w6) -> w8
      case (w8) {
        frame False, Default {
          call "Random IV Curve Generator.gvi"(SRM Mega Cluster In=$"SRM Mega Cluster In", Intensity Constant=1, Light Intensity=-1.7, Error In=$"Error In") -> (Voltage=w9, Current=w10, Error Out=w1)
          Property Node(instance in=$"IV Single Measurement In", "Voltage (V)"=w9, "Current (A)"=w10) -> (instance out=w3)
          w2 = w7
          w4 = $"SRM Mega Cluster In"
        }
        frame True {
          # Clears all event registers and Error Queue
          Property Node(instance in=w7) -> ("Instruments Coms Info:Keythley Address"=w11, instance out=w12)
          Property Node(instance in=$"SRM Mega Cluster In") -> ("SRM Specific Parameters:Sweep Speed"=w13, instance out=w14)
          call "FGV Current State.gvi"(Current State Instructions="Set Current Substate", Current Substate="Sweeping Keithley", Error In=$"Error In") -> (Error Out=w15)
          case (w13) {
            frame "Normal Sweep" {
              Property Node(instance in=w14) -> ("SRM Specific Parameters:V Points"=w17, instance out=w4)
              call "Clear Buffer.gvi"(VISA resource name=w11, error in (no error)=w15) -> (VISA resource name out=w18, error out=w19)
              call "Enable Output.gvi"(VISA resource name=w18, Enable Output (T: Enable)=TRUE, error in (no error)=w19) -> (VISA resource name out=w20, error out=w21)
              call "Initiate.gvi"(VISA resource name=w20, error in (no error)=w21) -> (VISA resource name out=w22, error out=w23)
              call "FGV Keithley timeout.gvi"(FGV Instructions="Read State", Error In=w23) -> (Timeout in ms Out=w24, Error Out=w25)
              call "Wait for Operation Complete.gvi"(VISA resource name=w22, Timeout (10000 ms)=w24, error in (no error)=w25) -> (VISA resource name out=w26, error out=w27)
              call "Read (Multiple Points).gvi"(VISA resource name=w26, Start Index (1)=1, End Index (1)=w17, error in (no error)=w27, Buffer Elements="SOUR, READ") -> (VISA resource name out=w28, Data out=w29, error out=w30)
              Spreadsheet String To Array(array type=f64[] [], delimiter=",", format string="%s", spreadsheet string=w29) -> (array=w31)
              Decimate Array(array=w31) -> (out0=w32, out1=w33)
              Property Node(instance in=$"IV Single Measurement In", "Voltage (V)"=w32, "Current (A)"=w33) -> (instance out=w3)
              call "Keithley Timeout Check.gvi"(Error In=w30) -> (Error Out=w34)
              call "Enable Output.gvi"(VISA resource name=w28, Enable Output (T: Enable)=FALSE, error in (no error)=w34) -> (VISA resource name out=w35, error out=w36)
              call "Write (Instr, String).gvi"(session in=w35, error in=w36, write buffer="*CLS;") -> (session out=w16, error out=w1)
            }
            frame "Fast Sweep" {
              Property Node(instance in=w14) -> ("SRM Specific Parameters:Max (V)"=w37, "SRM Specific Parameters:Min (V)"=w38, "SRM Specific Parameters:V Points"=w39, "SRM Specific Parameters:Sweep Dir"=w40, "SRM Specific Parameters:PLC Speed"=w41, instance out=w4)
              Property Node(instance in="Fast Sweep Parameters.gtype" {all zero or empty}, "Parameters:Max Voltage (V)"=w37, "Parameters:Min Voltage (V)"=w38, "Parameters:Measurement Speed (1 PLC)"=w41, "Parameters:Sweep Points"=w39, "Parameters:Sweep Direction"=w40) -> (instance out=w42)
              call "Fast Sweep Subroutine.gvi"(Fast Sweep Parameters In=w42, VISA resource name in=w11, Error In=w15) -> (Fast Sweep Parameters Out=w43, VISA resource name out=w16, Error Out=w1)
              Property Node(instance in=w43) -> ("Data:Voltage Array (V)"=w44, "Data:Current Array (A)"=w45)
              Property Node(instance in=$"IV Single Measurement In", "Voltage (V)"=w44, "Current (A)"=w45) -> (instance out=w3)
            }
            frame "Smart Sweep" {
              call "FGV Smart Sweep Parameters.gvi"(FGV Instructions="Read State", Error In=w15) -> (Smart Sweep Mega Cluster Out=w46, Error Out=w47)
              call "Smart Sweep Subroutine.gvi"(Smart Sweep Mega Cluster In=w46, VISA resource name in=w11, Error In=w47) -> (Smart Sweep Mega Cluster Out=w48, VISA resource name out=w16, Error Out=w1)
              Property Node(instance in=w48) -> ("IV Data:Voltage Array (V)"=w49, "IV Data:Current Array (A)"=w50, "IV Data:Isc (A)"=w51, "IV Data:Voc (V)"=w52, "IV Data:FF (%)"=w53, "IV Data:Rs (Ω)"=w54, "IV Data:Rsh (Ω)"=w55)
              Property Node(instance in=$"IV Single Measurement In", "Voltage (V)"=w49, "Current (A)"=w50, "Smart Sweep Data:Isc (A)"=w51, "Smart Sweep Data:Voc (V)"=w52, "Smart Sweep Data:FF (%)"=w53, "Smart Sweep Data:Rs (Ω)"=w54, "Smart Sweep Data:Rsh (Ω)"=w55) -> (instance out=w3)
              w4 = w14
            }
          }
          Property Node(instance in=w12, "Instruments Coms Info:Keythley Address"=w16) -> (instance out=w2)
        }
      }
    }
  }
  $"IV Single Measurement Out" <- w3
  $"Instrument Control Mega Cluster Out" <- w2
  $"Error Out" <- w1
  $"SRM Mega Cluster Out" <- w4
