vi "Accurate Sweep VImpp.gvi"   [LabVIEW NXG 5.0.0]
inputs:
  "Error In": error
  "VISA resource name in": "VISA Instr"
  "Smart Sweep Mega Cluster In": "Smart Sweep Mega Cluster.gtype"
outputs:
  "Error Out": error
  "VISA resource name out": "VISA Instr"
  "Smart Sweep Mega Cluster Out": "Smart Sweep Mega Cluster.gtype"
types:
  T1 = cluster{"Isc Rsh Sweep Points": u32, "Voc Rs Sweep Points": u32, "VImpp Rough Sweep Points": u32, "VImpp Fine Sweep Points": u32, "Isc Rsh Sweep Direction": bool, "Voc Rs Sweep Direction": bool, "VImpp Rough Sweep Direction": bool, "VImpp Fine Sweep Direction": bool, "Isc Sweep Width (1=Voc)": f64, "Voc Sweep Height (1=Isc)": f64, "Vmpp Sweep Width Above (1=Voc)": f64, "Vmpp Sweep Width Below (1=Voc)": f64}
  T2 = cluster{"Isc (A)": f64, "Voc (V)": f64, "FF (%)": f64, "Rs (Ω)": f64, "Rsh (Ω)": f64, "Voltage Array (V)": f64[], "Current Array (A)": f64[]}
  T3 = cluster{"Rough Vmpp (V)": f64, "Rough Isc (A)": f64, "Rough Voc (V)": f64, "Rough Jmpp (V)": f64, "Averages Rough Isc (A)": u32, "Averages Rough Voc (V)": u32}
  "Smart Sweep Mega Cluster.gtype" = cluster{"Sweep Parameters": T1, "Measurement Speed (1 PLC)": f64, "High Speed": bool, "IV Data": T2, "Rough Readings": T3}
  T4 = cluster{"Start ": f64, "Stop ": f64, "Number of Points (5)": u32}
uses:
  Rainbow Measurement Setup::Side Functions::Instrument Control::Keithley::Voltage Direction Calculator.gvi
  Labview_NXG_Keithley_SMU_2450_2460_2461::Configure::Clear Buffer.gvi
  Labview_NXG_Keithley_SMU_2450_2460_2461::Configure::Configure Measurement Range.gvi
  Labview_NXG_Keithley_SMU_2450_2460_2461::Configure::Configure Source Function.gvi
  Labview_NXG_Keithley_SMU_2450_2460_2461::Configure::Configure Measurement Function.gvi
  Labview_NXG_Keithley_SMU_2450_2460_2461::Configure::Configure Integration Filter.gvi
  Labview_NXG_Keithley_SMU_2450_2460_2461::Configure::Configure Linear Mode Sweep.gvi
  Labview_NXG_Keithley_SMU_2450_2460_2461::Action Status::Enable Output.gvi
  Labview_NXG_Keithley_SMU_2450_2460_2461::Data::Low Level::Initiate.gvi
  Labview_NXG_Keithley_SMU_2450_2460_2461::Data::Low Level::Wait for Operation Complete.gvi
  Labview_NXG_Keithley_SMU_2450_2460_2461::Data::Read (Multiple Points).gvi
  NI::VISA::Write (Instr, String).gvi
diagram:
  # This SubVI performs a sweep around the previously determined rough Vmpp point to further pin down the precise Vmpp and Jmpp points
  case ($"Error In") {
    frame Error, Default {
      w1 = $"Error In"
      w2 = $"VISA resource name in"
      w3 = $"Smart Sweep Mega Cluster In"
    }
    frame No Error {
      Property Node(instance in=$"Smart Sweep Mega Cluster In") -> ("Sweep Parameters:Vmpp Sweep Width Above (1=Voc)"=w4, "Sweep Parameters:Vmpp Sweep Width Below (1=Voc)"=w5, "Measurement Speed (1 PLC)"=w6, "IV Data:Isc (A)"=w7, "Rough Readings:Rough Vmpp (V)"=w8, "Sweep Parameters:VImpp Fine Sweep Direction"=w9, "Sweep Parameters:VImpp Fine Sweep Points"=w10, instance out=w11)
      # w12: Vmpp
      Property Node(instance in=w11) -> ("IV Data:Voltage Array (V)"=w13, "IV Data:Current Array (A)"=w14, "IV Data:Isc (A)"=w15, "IV Data:Voc (V)"=w16, instance out=w17)
      Multiply(w8, w4) -> w18
      Add(w18, w8) -> w19
      Multiply(w8, w5) -> w20
      Subtract(x=w8, y=w20) -> w21
      call "Voltage Direction Calculator.gvi"(Max Voltage (V)=w19, Min Voltage (V)=w21, Error In=$"Error In", Sweep Direction=w9) -> (Start=w22, End=w23, Error Out=w24)
      Property Node(instance in=T4 {"Start "=0, "Stop "=0, "Number of Points (5)"=1}, "Start "=w22, "Stop "=w23, "Number of Points (5)"=w10) -> (instance out=w25)
      call "Clear Buffer.gvi"(VISA resource name=$"VISA resource name in", error in (no error)=w24) -> (VISA resource name out=w26, error out=w27)
      call "Configure Measurement Range.gvi"(VISA resource name=w26, Function (0: Volts)="Volts"(0), Enable Auto Range (T:Enable)=TRUE, error in (no error)=w27) -> (VISA resource name out=w28, error out=w29)
      Absolute Value(x=w7) -> w30
      Multiply(w30, 2) -> w31
      In Range And Coerce(lower limit=1e-08, upper limit=1, x=w31) -> (coerced(x)=w32)
      call "Configure Measurement Range.gvi"(Manual Range (1.0)=w32, VISA resource name=w28, Function (0: Volts)="Current"(1), Enable Auto Range (T:Enable)=FALSE, error in (no error)=w29) -> (VISA resource name out=w33, error out=w34)
      call "Configure Source Function.gvi"(VISA resource name=w33, Function (0: Volts)="Volts"(0), error in (no error)=w34) -> (VISA resource name out=w35, error out=w36)
      call "Configure Measurement Function.gvi"(VISA resource name=w35, Function (0: Volts)="Current"(1), error in (no error)=w36) -> (VISA resource name out=w37, error out=w38)
      call "Configure Integration Filter.gvi"(VISA resource name=w37, Function (0: Volts)="Current"(1), Measurement Speed (1 PLC)=w6, error in (no error)=w38) -> (VISA resource name out=w39, error out=w40)
      call "Configure Linear Mode Sweep.gvi"(VISA resource name=w39, Source Mode (0: Voltage)="Voltage"(0), Sweep Points=w25, Delay (0)=0, error in (no error)=w40, Fail Abort (T:ON)=FALSE) -> (VISA resource name out=w41, error out=w42)
      call "Enable Output.gvi"(VISA resource name=w41, Enable Output (T: Enable)=TRUE, error in (no error)=w42) -> (VISA resource name out=w43, error out=w44)
      call "Initiate.gvi"(VISA resource name=w43, error in (no error)=w44) -> (VISA resource name out=w45, error out=w46)
      call "Wait for Operation Complete.gvi"(VISA resource name=w45, Timeout (10000 ms)=60000, error in (no error)=w46) -> (VISA resource name out=w47, error out=w48)
      call "Read (Multiple Points).gvi"(VISA resource name=w47, Start Index (1)=1, End Index (1)=w10, error in (no error)=w48, Buffer Elements="SOUR, READ") -> (VISA resource name out=w49, Data out=w50, error out=w51)
      Spreadsheet String To Array(array type=f64[] [], delimiter=",", format string="%s", spreadsheet string=w50) -> (array=w52)
      Decimate Array(array=w52) -> (out0=w53, out1=w54)
      Build Array(w13, w53) -> w55
      Build Array(w14, w54) -> w56
      Multiply(w15, w16) -> w57
      Absolute Value(x=w57) -> w58
      Multiply(w53, w54) -> w59
      Array Max And Min(array=w59) -> (min index(es)=w60)
      Array Index(array=w53) -> (out0[w60]=w12)
      Array Index(array=w54) -> (out0[w60]=w61)
      # w61: Jmpp
      Multiply(w12, w61) -> w62
      Absolute Value(x=w62) -> w63
      Multiply(w63, 100) -> w64
      Divide(x=w64, y=w58) -> w65
      In Range And Coerce(lower limit=0, upper limit=100, x=w65) -> (In Range?=w66, coerced(x)=w67)
      Select(s=w66, t=w67, f=0) -> w68
      Property Node(instance in=w17, "IV Data:Voltage Array (V)"=w55, "IV Data:Current Array (A)"=w56, "IV Data:FF (%)"=w68) -> (instance out=w3)
      call "Enable Output.gvi"(VISA resource name=w49, Enable Output (T: Enable)=FALSE, error in (no error)=w51) -> (VISA resource name out=w69, error out=w70)
      call "Clear Buffer.gvi"(VISA resource name=w69, error in (no error)=w70) -> (VISA resource name out=w71, error out=w72)
      call "Write (Instr, String).gvi"(session in=w71, error in=w72, write buffer="*CLS;") -> (session out=w2, error out=w1)
    }
  }
  $"Smart Sweep Mega Cluster Out" <- w3
  $"VISA resource name out" <- w2
  $"Error Out" <- w1
