vi "Rough Fast Sweep VImpp.gvi"   [LabVIEW NXG 5.0.0]
inputs:
  "Error In": error
  "VISA resource name in": "VISA Instr"
  "Smart Sweep Mega Cluster In": "Smart Sweep Mega Cluster.gtype"
outputs:
  "Error Out": error
  "VISA resource name out": "VISA Instr"
  "Smart Sweep Mega Cluster Out": "Smart Sweep Mega Cluster.gtype"
types:
  T1 = cluster{"Isc Rsh Sweep Points": u32, "Voc Rs Sweep Points": u32, "VImpp Rough Sweep Points": u32, "VImpp Fine Sweep Points": u32, "Isc Rsh Sweep Direction": bool, "Voc Rs Sweep Direction": bool, "VImpp Rough Sweep Direction": bool, "VImpp Fine Sweep Direction": bool, "Isc Sweep Width (1=Voc)": f64, "Voc Sweep Height (1=Isc)": f64, "Vmpp Sweep Width Above (1=Voc)": f64, "Vmpp Sweep Width Below (1=Voc)": f64}
  T2 = cluster{"Isc (A)": f64, "Voc (V)": f64, "FF (%)": f64, "Rs (Ω)": f64, "Rsh (Ω)": f64, "Voltage Array (V)": f64[], "Current Array (A)": f64[]}
  T3 = cluster{"Rough Vmpp (V)": f64, "Rough Isc (A)": f64, "Rough Voc (V)": f64, "Rough Jmpp (V)": f64, "Averages Rough Isc (A)": u32, "Averages Rough Voc (V)": u32}
  "Smart Sweep Mega Cluster.gtype" = cluster{"Sweep Parameters": T1, "Measurement Speed (1 PLC)": f64, "High Speed": bool, "IV Data": T2, "Rough Readings": T3}
  T4 = cluster{"Start ": f64, "Stop ": f64, "Number of Points (5)": u32}
uses:
  Rainbow Measurement Setup::Side Functions::Instrument Control::Keithley::Voltage Direction Calculator.gvi
  Labview_NXG_Keithley_SMU_2450_2460_2461::Configure::Clear Buffer.gvi
  Labview_NXG_Keithley_SMU_2450_2460_2461::Configure::Configure Measurement Range.gvi
  Labview_NXG_Keithley_SMU_2450_2460_2461::Configure::Configure Source Function.gvi
  Labview_NXG_Keithley_SMU_2450_2460_2461::Configure::Configure Measurement Function.gvi
  Labview_NXG_Keithley_SMU_2450_2460_2461::Configure::Configure Integration Filter.gvi
  Labview_NXG_Keithley_SMU_2450_2460_2461::Configure::Configure Linear Mode Sweep.gvi
  Labview_NXG_Keithley_SMU_2450_2460_2461::Action Status::Enable Output.gvi
  Labview_NXG_Keithley_SMU_2450_2460_2461::Data::Low Level::Initiate.gvi
  Labview_NXG_Keithley_SMU_2450_2460_2461::Data::Low Level::Wait for Operation Complete.gvi
  Labview_NXG_Keithley_SMU_2450_2460_2461::Data::Read (Multiple Points).gvi
  NI::VISA::Write (Instr, String).gvi
diagram:
  # This SubVI performs a rough sweep from Jsc to Voc to roughly find a rough Vmpp value
  case ($"Error In") {
    frame Error, Default {
      w1 = $"Error In"
      w2 = $"VISA resource name in"
      w3 = $"Smart Sweep Mega Cluster In"
    }
    frame No Error {
      Property Node(instance in=$"Smart Sweep Mega Cluster In") -> ("IV Data:Voc (V)"=w4, "IV Data:Isc (A)"=w5, "Sweep Parameters:VImpp Rough Sweep Direction"=w6, "Sweep Parameters:VImpp Rough Sweep Points"=w7, "Measurement Speed (1 PLC)"=w8, instance out=w9)
      Property Node(instance in=w9) -> ("IV Data:Voltage Array (V)"=w10, "IV Data:Current Array (A)"=w11, instance out=w12)
      call "Voltage Direction Calculator.gvi"(Max Voltage (V)=w4, Min Voltage (V)=0, Error In=$"Error In", Sweep Direction=w6) -> (Start=w13, End=w14, Error Out=w15)
      Property Node(instance in=T4 {"Start "=0, "Stop "=0, "Number of Points (5)"=1}, "Start "=w13, "Stop "=w14, "Number of Points (5)"=w7) -> (instance out=w16)
      call "Clear Buffer.gvi"(VISA resource name=$"VISA resource name in", error in (no error)=w15) -> (VISA resource name out=w17, error out=w18)
      call "Configure Measurement Range.gvi"(VISA resource name=w17, Function (0: Volts)="Volts"(0), Enable Auto Range (T:Enable)=TRUE, error in (no error)=w18) -> (VISA resource name out=w19, error out=w20)
      Multiply(w5, 2) -> w21
      Absolute Value(x=w21) -> w22
      In Range And Coerce(lower limit=1e-08, upper limit=1, x=w22) -> (coerced(x)=w23)
      call "Configure Measurement Range.gvi"(Manual Range (1.0)=w23, VISA resource name=w19, Function (0: Volts)="Current"(1), Enable Auto Range (T:Enable)=FALSE, error in (no error)=w20) -> (VISA resource name out=w24, error out=w25)
      call "Configure Source Function.gvi"(VISA resource name=w24, Function (0: Volts)="Volts"(0), error in (no error)=w25) -> (VISA resource name out=w26, error out=w27)
      call "Configure Measurement Function.gvi"(VISA resource name=w26, Function (0: Volts)="Current"(1), error in (no error)=w27) -> (VISA resource name out=w28, error out=w29)
      call "Configure Integration Filter.gvi"(VISA resource name=w28, Function (0: Volts)="Current"(1), Measurement Speed (1 PLC)=w8, error in (no error)=w29) -> (VISA resource name out=w30, error out=w31)
      call "Configure Linear Mode Sweep.gvi"(VISA resource name=w30, Source Mode (0: Voltage)="Voltage"(0), Sweep Points=w16, Delay (0)=0, error in (no error)=w31, Fail Abort (T:ON)=FALSE) -> (VISA resource name out=w32, error out=w33)
      call "Enable Output.gvi"(VISA resource name=w32, Enable Output (T: Enable)=TRUE, error in (no error)=w33) -> (VISA resource name out=w34, error out=w35)
      call "Initiate.gvi"(VISA resource name=w34, error in (no error)=w35) -> (VISA resource name out=w36, error out=w37)
      call "Wait for Operation Complete.gvi"(VISA resource name=w36, Timeout (10000 ms)=60000, error in (no error)=w37) -> (VISA resource name out=w38, error out=w39)
      call "Read (Multiple Points).gvi"(VISA resource name=w38, Start Index (1)=1, End Index (1)=w7, error in (no error)=w39, Buffer Elements="SOUR, READ") -> (VISA resource name out=w40, Data out=w41, error out=w42)
      Spreadsheet String To Array(array type=f64[] [], delimiter=",", format string="%s", spreadsheet string=w41) -> (array=w43)
      Decimate Array(array=w43) -> (out0=w44, out1=w45)
      Build Array(w10, w44) -> w46
      Build Array(w11, w45) -> w47
      Multiply(w44, w45) -> w48
      Array Max And Min(array=w48) -> (min index(es)=w49)
      Array Index(array=w44) -> (out0[w49]=w50)
      Array Index(array=w45) -> (out0[w49]=w51)
      Property Node(instance in=w12, "IV Data:Voltage Array (V)"=w46, "IV Data:Current Array (A)"=w47, "Rough Readings:Rough Vmpp (V)"=w50, "Rough Readings:Rough Jmpp (V)"=w51) -> (instance out=w3)
      call "Enable Output.gvi"(VISA resource name=w40, Enable Output (T: Enable)=FALSE, error in (no error)=w42) -> (VISA resource name out=w52, error out=w53)
      call "Clear Buffer.gvi"(VISA resource name=w52, error in (no error)=w53) -> (VISA resource name out=w54, error out=w55)
      call "Write (Instr, String).gvi"(session in=w54, error in=w55, write buffer="*CLS;") -> (session out=w2, error out=w1)
    }
  }
  $"Smart Sweep Mega Cluster Out" <- w3
  $"VISA resource name out" <- w2
  $"Error Out" <- w1
