vi "Rs_Voc Rsh_Isc Accurate Sweep.gvi"   [LabVIEW NXG 5.0.0]
inputs:
  "Error In": error
  "VISA resource name in": "VISA Instr"
  "Smart Sweep Mega Cluster In": "Smart Sweep Mega Cluster.gtype"
  "Voc Jsc Operation Control": "Voc Jsc Operation Control.gtype" = "Voc"
outputs:
  "Error Out": error
  "VISA resource name out": "VISA Instr"
  "Smart Sweep Mega Cluster Out": "Smart Sweep Mega Cluster.gtype"
types:
  "Voc Jsc Operation Control.gtype" = enum{"Voc", "Isc"}
  T1 = cluster{"Isc Rsh Sweep Points": u32, "Voc Rs Sweep Points": u32, "VImpp Rough Sweep Points": u32, "VImpp Fine Sweep Points": u32, "Isc Rsh Sweep Direction": bool, "Voc Rs Sweep Direction": bool, "VImpp Rough Sweep Direction": bool, "VImpp Fine Sweep Direction": bool, "Isc Sweep Width (1=Voc)": f64, "Voc Sweep Height (1=Isc)": f64, "Vmpp Sweep Width Above (1=Voc)": f64, "Vmpp Sweep Width Below (1=Voc)": f64}
  T2 = cluster{"Isc (A)": f64, "Voc (V)": f64, "FF (%)": f64, "Rs (Ω)": f64, "Rsh (Ω)": f64, "Voltage Array (V)": f64[], "Current Array (A)": f64[]}
  T3 = cluster{"Rough Vmpp (V)": f64, "Rough Isc (A)": f64, "Rough Voc (V)": f64, "Rough Jmpp (V)": f64, "Averages Rough Isc (A)": u32, "Averages Rough Voc (V)": u32}
  "Smart Sweep Mega Cluster.gtype" = cluster{"Sweep Parameters": T1, "Measurement Speed (1 PLC)": f64, "High Speed": bool, "IV Data": T2, "Rough Readings": T3}
  T4 = cluster{"Start ": f64, "Stop ": f64, "Number of Points (5)": u32}
uses:
  Rainbow Measurement Setup::Side Functions::Instrument Control::Keithley::Voltage Direction Calculator.gvi
  Labview_NXG_Keithley_SMU_2450_2460_2461::Configure::Clear Buffer.gvi
  Labview_NXG_Keithley_SMU_2450_2460_2461::Configure::Configure Source Function.gvi
  Labview_NXG_Keithley_SMU_2450_2460_2461::Configure::Configure Measurement Range.gvi
  Labview_NXG_Keithley_SMU_2450_2460_2461::Configure::Configure Measurement Function.gvi
  Labview_NXG_Keithley_SMU_2450_2460_2461::Configure::Configure Integration Filter.gvi
  Labview_NXG_Keithley_SMU_2450_2460_2461::Configure::Configure Linear Mode Sweep.gvi
  Labview_NXG_Keithley_SMU_2450_2460_2461::Action Status::Enable Output.gvi
  Labview_NXG_Keithley_SMU_2450_2460_2461::Data::Low Level::Initiate.gvi
  Labview_NXG_Keithley_SMU_2450_2460_2461::Data::Low Level::Wait for Operation Complete.gvi
  Labview_NXG_Keithley_SMU_2450_2460_2461::Data::Read (Multiple Points).gvi
  NI::VISA::Write (Instr, String).gvi
  Rainbow Measurement Setup::Side Functions::Instrument Control::Keithley::Smart Sweep::Voc_Rs Isc_Rsh Calculator.gvi
diagram:
  # This SubVI performs a sweep around the Voc and the Jsc points to more accurately determine these two parameters as well as to determine the
  # Rs and the Rsh through the slope of the curves.
  case ($"Error In") {
    frame Error, Default {
      w1 = $"Error In"
      w2 = $"VISA resource name in"
      w3 = $"Smart Sweep Mega Cluster In"
    }
    frame No Error {
      case ($"Voc Jsc Operation Control") {
        frame "Voc", Default {
          Property Node(instance in=$"Smart Sweep Mega Cluster In") -> ("Sweep Parameters:Voc Rs Sweep Direction"=w8, "Rough Readings:Rough Isc (A)"=w9, "Measurement Speed (1 PLC)"=w10, "Sweep Parameters:Voc Rs Sweep Points"=w11, "Sweep Parameters:Voc Sweep Height (1=Isc)"=w12, "Rough Readings:Rough Voc (V)"=w13, instance out=w14)
          Property Node(instance in=w14) -> ("IV Data:Voltage Array (V)"=w15, "IV Data:Current Array (A)"=w16, instance out=w17)
          Multiply(w9, w12) -> w18
          Negate(x=w18) -> w19
          call "Voltage Direction Calculator.gvi"(Max Voltage (V)=w18, Min Voltage (V)=w19, Error In=$"Error In", Sweep Direction=w8) -> (Start=w20, End=w21, Error Out=w22)
          Property Node(instance in=T4 {"Start "=0, "Stop "=0, "Number of Points (5)"=1}, "Start "=w20, "Stop "=w21, "Number of Points (5)"=w11) -> (instance out=w23)
          Absolute Value(x=w13) -> w24
          Multiply(w24, 2) -> w25
          In Range And Coerce(lower limit=0.02, upper limit=200, x=w25) -> (coerced(x)=w26)
          call "Clear Buffer.gvi"(VISA resource name=$"VISA resource name in", error in (no error)=w22) -> (VISA resource name out=w27, error out=w28)
          call "Configure Source Function.gvi"(VISA resource name=w27, Function (0: Volts)="Current"(1), error in (no error)=w28) -> (VISA resource name out=w29, error out=w30)
          call "Configure Measurement Range.gvi"(VISA resource name=w29, Function (0: Volts)="Current"(1), Enable Auto Range (T:Enable)=TRUE, error in (no error)=w30) -> (VISA resource name out=w31, error out=w32)
          call "Configure Measurement Range.gvi"(Manual Range (1.0)=w26, VISA resource name=w31, Function (0: Volts)="Volts"(0), Enable Auto Range (T:Enable)=FALSE, error in (no error)=w32) -> (VISA resource name out=w33, error out=w34)
          call "Configure Measurement Function.gvi"(VISA resource name=w33, Function (0: Volts)="Volts"(0), error in (no error)=w34) -> (VISA resource name out=w35, error out=w36)
          call "Configure Integration Filter.gvi"(VISA resource name=w35, Function (0: Volts)="Volts"(0), Measurement Speed (1 PLC)=w10, error in (no error)=w36) -> (VISA resource name out=w37, error out=w38)
          call "Configure Linear Mode Sweep.gvi"(VISA resource name=w37, Source Mode (0: Voltage)="Current"(1), Sweep Points=w23, Delay (0)=0, error in (no error)=w38, Fail Abort (T:ON)=FALSE) -> (VISA resource name out=w39, error out=w40)
          call "Enable Output.gvi"(VISA resource name=w39, Enable Output (T: Enable)=TRUE, error in (no error)=w40) -> (VISA resource name out=w41, error out=w42)
          call "Initiate.gvi"(VISA resource name=w41, error in (no error)=w42) -> (VISA resource name out=w43, error out=w44)
          call "Wait for Operation Complete.gvi"(VISA resource name=w43, Timeout (10000 ms)=60000, error in (no error)=w44) -> (VISA resource name out=w45, error out=w46)
          call "Read (Multiple Points).gvi"(VISA resource name=w45, Start Index (1)=1, End Index (1)=w11, error in (no error)=w46, Buffer Elements="SOUR, READ") -> (VISA resource name out=w47, Data out=w48, error out=w49)
          Spreadsheet String To Array(array type=f64[] [], delimiter=",", format string="%s", spreadsheet string=w48) -> (array=w50)
          Decimate Array(array=w50) -> (out0=w7, out1=w6)
          Build Array(w15, w6) -> w51
          Build Array(w16, w7) -> w52
          Property Node(instance in=w17, "IV Data:Voltage Array (V)"=w51, "IV Data:Current Array (A)"=w52) -> (instance out=w5)
          call "Enable Output.gvi"(VISA resource name=w47, Enable Output (T: Enable)=FALSE, error in (no error)=w49) -> (VISA resource name out=w53, error out=w54)
          call "Clear Buffer.gvi"(VISA resource name=w53, error in (no error)=w54) -> (VISA resource name out=w55, error out=w56)
          call "Write (Instr, String).gvi"(session in=w55, error in=w56, write buffer="*CLS;") -> (session out=w2, error out=w4)
        }
        frame "Isc" {
          Property Node(instance in=$"Smart Sweep Mega Cluster In") -> ("Sweep Parameters:Isc Sweep Width (1=Voc)"=w57, "Rough Readings:Rough Voc (V)"=w58, "Sweep Parameters:Isc Rsh Sweep Points"=w59, "Sweep Parameters:Isc Rsh Sweep Direction"=w60, "Measurement Speed (1 PLC)"=w61, "Rough Readings:Rough Isc (A)"=w62, instance out=w63)
          Property Node(instance in=w63) -> ("IV Data:Voltage Array (V)"=w64, "IV Data:Current Array (A)"=w65, instance out=w66)
          Multiply(w58, w57) -> w67
          Negate(x=w67) -> w68
          call "Voltage Direction Calculator.gvi"(Max Voltage (V)=w67, Min Voltage (V)=w68, Error In=$"Error In", Sweep Direction=w60) -> (Start=w69, End=w70, Error Out=w71)
          Property Node(instance in=T4 {"Start "=0, "Stop "=0, "Number of Points (5)"=1}, "Start "=w69, "Stop "=w70, "Number of Points (5)"=w59) -> (instance out=w72)
          Absolute Value(x=w62) -> w73
          Multiply(w73, 2) -> w74
          In Range And Coerce(lower limit=1e-08, upper limit=1, x=w74) -> (coerced(x)=w75)
          call "Clear Buffer.gvi"(VISA resource name=$"VISA resource name in", error in (no error)=w71) -> (VISA resource name out=w76, error out=w77)
          call "Configure Source Function.gvi"(VISA resource name=w76, Function (0: Volts)="Volts"(0), error in (no error)=w77) -> (VISA resource name out=w78, error out=w79)
          call "Configure Measurement Function.gvi"(VISA resource name=w78, Function (0: Volts)="Current"(1), error in (no error)=w79) -> (VISA resource name out=w80, error out=w81)
          call "Configure Measurement Range.gvi"(VISA resource name=w80, Function (0: Volts)="Volts"(0), Enable Auto Range (T:Enable)=TRUE, error in (no error)=w81) -> (VISA resource name out=w82, error out=w83)
          call "Configure Measurement Range.gvi"(Manual Range (1.0)=w75, VISA resource name=w82, Function (0: Volts)="Current"(1), Enable Auto Range (T:Enable)=FALSE, error in (no error)=w83) -> (VISA resource name out=w84, error out=w85)
          call "Configure Integration Filter.gvi"(VISA resource name=w84, Function (0: Volts)="Current"(1), Measurement Speed (1 PLC)=w61, error in (no error)=w85) -> (VISA resource name out=w86, error out=w87)
          call "Configure Linear Mode Sweep.gvi"(VISA resource name=w86, Source Mode (0: Voltage)="Voltage"(0), Sweep Points=w72, Delay (0)=0, error in (no error)=w87, Fail Abort (T:ON)=FALSE) -> (VISA resource name out=w88, error out=w89)
          call "Enable Output.gvi"(VISA resource name=w88, Enable Output (T: Enable)=TRUE, error in (no error)=w89) -> (VISA resource name out=w90, error out=w91)
          call "Initiate.gvi"(VISA resource name=w90, error in (no error)=w91) -> (VISA resource name out=w92, error out=w93)
          call "Wait for Operation Complete.gvi"(VISA resource name=w92, Timeout (10000 ms)=60000, error in (no error)=w93) -> (VISA resource name out=w94, error out=w95)
          call "Read (Multiple Points).gvi"(VISA resource name=w94, Start Index (1)=1, End Index (1)=w59, error in (no error)=w95, Buffer Elements="SOUR, READ") -> (VISA resource name out=w96, Data out=w97, error out=w98)
          Spreadsheet String To Array(array type=f64[] [], delimiter=",", format string="%s", spreadsheet string=w97) -> (array=w99)
          Decimate Array(array=w99) -> (out0=w6, out1=w7)
          Build Array(w64, w6) -> w100
          Build Array(w65, w7) -> w101
          # w6: Voltage Data
          Property Node(instance in=w66, "IV Data:Voltage Array (V)"=w100, "IV Data:Current Array (A)"=w101) -> (instance out=w5)
          call "Enable Output.gvi"(VISA resource name=w96, Enable Output (T: Enable)=FALSE, error in (no error)=w98) -> (VISA resource name out=w102, error out=w103)
          call "Clear Buffer.gvi"(VISA resource name=w102, error in (no error)=w103) -> (VISA resource name out=w104, error out=w105)
          # w7: Current Data
          call "Write (Instr, String).gvi"(session in=w104, error in=w105, write buffer="*CLS;") -> (session out=w2, error out=w4)
        }
      }
      call "Voc_Rs Isc_Rsh Calculator.gvi"(Smart Sweep Mega Cluster In=w5, Voltage Array=w6, Current Array=w7, Error In=w4, Voc Jsc Operation Control=$"Voc Jsc Operation Control") -> (Smart Sweep Mega Cluster Out=w3, Error Out=w1)
    }
  }
  $"Smart Sweep Mega Cluster Out" <- w3
  $"Error Out" <- w1
  $"VISA resource name out" <- w2
