vi "Smart Sweep Test.gvi"   [LabVIEW NXG 5.0.0]
inputs:
  "Error In": error
outputs:
  "Error Out": error
panel controls:
  "VISA resource name": "VISA Instr"
  "Smart Sweep Mega Cluster In": "Smart Sweep Mega Cluster.gtype" = {"Sweep Parameters"={"Isc Rsh Sweep Points"=10, "Voc Rs Sweep Points"=10, "VImpp Rough Sweep Points"=20, "VImpp Fine Sweep Points"=20, "Isc Rsh Sweep Direction"=FALSE, "Voc Rs Sweep Direction"=FALSE, "VImpp Rough Sweep Direction"=FALSE, "VImpp Fine Sweep Direction"=FALSE, "Isc Sweep Width (1=Voc)"=0.1, "Voc Sweep Height (1=Isc)"=0.1, "Vmpp Sweep Width Above (1=Voc)"=0.15, "Vmpp Sweep Width Below (1=Voc)"=0.2}, "Measurement Speed (1 PLC)"=1, "High Speed"=FALSE, "IV Data"={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}, "Rough Readings"={"Rough Vmpp (V)"=0, "Rough Isc (A)"=0, "Rough Voc (V)"=0, "Rough Jmpp (V)"=0, "Averages Rough Isc (A)"=10, "Averages Rough Voc (V)"=10}}
panel indicators:
  "Smart Sweep Mega Cluster Out": "Smart Sweep Mega Cluster.gtype"
  "Graph": cluster{"Element 1": f64[], "Element 2": f64[]}[]
  "Slow Smart Sweep Time (s)": u32
  "Fast Smart Sweep Time (s)": u32
types:
  T1 = cluster{"Isc Rsh Sweep Points": u32, "Voc Rs Sweep Points": u32, "VImpp Rough Sweep Points": u32, "VImpp Fine Sweep Points": u32, "Isc Rsh Sweep Direction": bool, "Voc Rs Sweep Direction": bool, "VImpp Rough Sweep Direction": bool, "VImpp Fine Sweep Direction": bool, "Isc Sweep Width (1=Voc)": f64, "Voc Sweep Height (1=Isc)": f64, "Vmpp Sweep Width Above (1=Voc)": f64, "Vmpp Sweep Width Below (1=Voc)": f64}
  T2 = cluster{"Isc (A)": f64, "Voc (V)": f64, "FF (%)": f64, "Rs (Ω)": f64, "Rsh (Ω)": f64, "Voltage Array (V)": f64[], "Current Array (A)": f64[]}
  T3 = cluster{"Rough Vmpp (V)": f64, "Rough Isc (A)": f64, "Rough Voc (V)": f64, "Rough Jmpp (V)": f64, "Averages Rough Isc (A)": u32, "Averages Rough Voc (V)": u32}
  "Smart Sweep Mega Cluster.gtype" = cluster{"Sweep Parameters": T1, "Measurement Speed (1 PLC)": f64, "High Speed": bool, "IV Data": T2, "Rough Readings": T3}
uses:
  Labview_NXG_Keithley_SMU_2450_2460_2461::Miscelaneous::Initialize.gvi
  Rainbow Measurement Setup::Side Functions::Instrument Control::Keithley::Smart Sweep::Full Smart Sweep.gvi
  Labview_NXG_Keithley_SMU_2450_2460_2461::Miscelaneous::Close.gvi
diagram:
  case ($"Error In") {
    frame Error, Default {
      w1 = $"Error In"
      w2 = default
      w3 = default
    }
    frame No Error {
      call "Initialize.gvi"(VISA resource name=$"VISA resource name", error in (no error)=$"Error In") -> (VISA resource name out=w4, error out=w5)
      call "Full Smart Sweep.gvi"(VISA resource name in=w4, Smart Sweep Mega Cluster In=$"Smart Sweep Mega Cluster In", Error In=w5, High Speed=FALSE) -> (VISA resource name Out=w6, Smart Sweep Mega Cluster Out=w3, Elapsed Time (ms)=w7, Error Out=w8)
      Property Node(instance in=w3, "IV Data"=T2 {all zero or empty}) -> (instance out=w9)
      call "Full Smart Sweep.gvi"(VISA resource name in=w6, Smart Sweep Mega Cluster In=w9, Error In=w8, High Speed=TRUE) -> (VISA resource name Out=w10, Smart Sweep Mega Cluster Out=w2, Elapsed Time (ms)=w11, Error Out=w12)
      call "Close.gvi"(VISA resource name=w10, error in (no error)=w12) -> (error out=w1)
      $"Fast Smart Sweep Time (s)" <- w11
      $"Slow Smart Sweep Time (s)" <- w7
    }
  }
  Property Node(instance in=w2) -> ("IV Data:Voltage Array (V)"=w13, "IV Data:Current Array (A)"=w14, instance out=w15)
  $"Smart Sweep Mega Cluster Out" <- w15
  Build Cluster(w13, w14) -> w16
  Property Node(instance in=w3) -> ("IV Data:Voltage Array (V)"=w17, "IV Data:Current Array (A)"=w18)
  Build Cluster(w17, w18) -> w19
  Build Array(w16, w19) -> w20
  $Graph <- w20
  $"Error Out" <- w1
