vi "Sweep Type Comparison.gvi"   [LabVIEW NXG 5.0.0]
inputs:
  "Error In": error
outputs:
  "Error Out": error
panel controls:
  "VISA resource name": "VISA Instr"
  "Smart Sweep Mega Cluster In": "Smart Sweep Mega Cluster.gtype" = {"Sweep Parameters"={"Isc Rsh Sweep Points"=10, "VImpp Rough Sweep Points"=20, "VImpp Fine Sweep Points"=20, "Isc Sweep Width (1=Voc)"=0.1, "Voc Sweep Height (1=Isc)"=0.1, "Vmpp Sweep Width Above (1=Voc)"=0.15, "Vmpp Sweep Width Below (1=Voc)"=0.2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}, "Measurement Speed (1 PLC)"=0, "High Speed"=FALSE, "IV Data"={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}, "Rough Readings"={"Rough Vmpp (V)"=0, "Rough Isc (A)"=0, "Rough Voc (V)"=0, "Rough Jmpp (V)"=0, "Averages Rough Isc (A)"=5, "Averages Rough Voc (V)"=5}}
  "Fast Sweep Parameters In": "Fast Sweep Parameters.gtype" = {"Parameters"={"Sweep Direction"=FALSE, "Min Voltage (V)"=-0.2, "Max Voltage (V)"=1, "Measurement Speed (1 PLC)"=1, "Sweep Points"=50}, "Data"={"Current Array (A)"=[], "Voltage Array (V)"=[], "Isc (A)"=0}}
panel indicators:
  "Smart Sweep Mega Cluster Out": "Smart Sweep Mega Cluster.gtype"
  "Graph": cluster{"Element 1": f64[], "Element 2": f64[]}[]
  "Slow Smart Sweep Time (s)": u32
  "Fast Smart Sweep Time (s)": u32
  "Fast Fast Sweep": u32
  "Slow Fast Sweep Time (ms)": u32
types:
  T1 = cluster{"Isc Rsh Sweep Points": u32, "Voc Rs Sweep Points": u32, "VImpp Rough Sweep Points": u32, "VImpp Fine Sweep Points": u32, "Isc Rsh Sweep Direction": bool, "Voc Rs Sweep Direction": bool, "VImpp Rough Sweep Direction": bool, "VImpp Fine Sweep Direction": bool, "Isc Sweep Width (1=Voc)": f64, "Voc Sweep Height (1=Isc)": f64, "Vmpp Sweep Width Above (1=Voc)": f64, "Vmpp Sweep Width Below (1=Voc)": f64}
  T2 = cluster{"Isc (A)": f64, "Voc (V)": f64, "FF (%)": f64, "Rs (Ω)": f64, "Rsh (Ω)": f64, "Voltage Array (V)": f64[], "Current Array (A)": f64[]}
  T3 = cluster{"Rough Vmpp (V)": f64, "Rough Isc (A)": f64, "Rough Voc (V)": f64, "Rough Jmpp (V)": f64, "Averages Rough Isc (A)": u32, "Averages Rough Voc (V)": u32}
  "Smart Sweep Mega Cluster.gtype" = cluster{"Sweep Parameters": T1, "Measurement Speed (1 PLC)": f64, "High Speed": bool, "IV Data": T2, "Rough Readings": T3}
  T4 = cluster{"Sweep Direction": bool, "Min Voltage (V)": f64, "Max Voltage (V)": f64, "Measurement Speed (1 PLC)": f64, "Sweep Points": u32}
  T5 = cluster{"Current Array (A)": f64[], "Voltage Array (V)": f64[], "Isc (A)": f64}
  "Fast Sweep Parameters.gtype" = cluster{"Parameters": T4, "Data": T5}
uses:
  Labview_NXG_Keithley_SMU_2450_2460_2461::Miscelaneous::Initialize.gvi
  Rainbow Measurement Setup::Side Functions::Instrument Control::Keithley::Fast Sweep::Full Fast Smart Sweep.gvi
  Rainbow Measurement Setup::Side Functions::Instrument Control::Keithley::Smart Sweep::Full Smart Sweep.gvi
  Labview_NXG_Keithley_SMU_2450_2460_2461::Miscelaneous::Close.gvi
diagram:
  case ($"Error In") {
    frame Error, Default {
      w1 = $"Error In"
      w2 = default
      w3 = default
      w4 = default
      w5 = default
    }
    frame No Error {
      call "Initialize.gvi"(VISA resource name=$"VISA resource name", error in (no error)=$"Error In") -> (VISA resource name out=w6, error out=w7)
      call "Full Fast Smart Sweep.gvi"(VISA resource name in=w6, Fast Sweep Parameters In=$"Fast Sweep Parameters In", Error In=w7, High Speed?=FALSE) -> (VISA resource name Out=w8, Fast Sweep Parameters Out=w4, Time Elapsed (ms)=w9, Error Out=w10)
      call "Full Smart Sweep.gvi"(VISA resource name in=w8, Smart Sweep Mega Cluster In=$"Smart Sweep Mega Cluster In", Error In=w10, High Speed=FALSE) -> (VISA resource name Out=w11, Smart Sweep Mega Cluster Out=w3, Elapsed Time (ms)=w12, Error Out=w13)
      call "Full Fast Smart Sweep.gvi"(VISA resource name in=w11, Fast Sweep Parameters In=$"Fast Sweep Parameters In", Error In=w13, High Speed?=TRUE) -> (VISA resource name Out=w14, Fast Sweep Parameters Out=w5, Time Elapsed (ms)=w15, Error Out=w16)
      Property Node(instance in=w3, "IV Data"=T2 {all zero or empty}) -> (instance out=w17)
      call "Full Smart Sweep.gvi"(VISA resource name in=w14, Smart Sweep Mega Cluster In=w17, Error In=w16, High Speed=TRUE) -> (VISA resource name Out=w18, Smart Sweep Mega Cluster Out=w2, Elapsed Time (ms)=w19, Error Out=w20)
      call "Close.gvi"(VISA resource name=w18, error in (no error)=w20) -> (error out=w1)
      $"Fast Smart Sweep Time (s)" <- w19
      $"Fast Fast Sweep" <- w15
      $"Slow Smart Sweep Time (s)" <- w12
      $"Slow Fast Sweep Time (ms)" <- w9
    }
  }
  Property Node(instance in=w4) -> ("Data:Voltage Array (V)"=w21, "Data:Current Array (A)"=w22)
  Build Cluster(w21, w22) -> w23
  Property Node(instance in=w3) -> ("IV Data:Voltage Array (V)"=w24, "IV Data:Current Array (A)"=w25)
  Build Cluster(w24, w25) -> w26
  Property Node(instance in=w2) -> ("IV Data:Voltage Array (V)"=w27, "IV Data:Current Array (A)"=w28, instance out=w29)
  Build Cluster(w27, w28) -> w30
  Property Node(instance in=w5) -> ("Data:Voltage Array (V)"=w31, "Data:Current Array (A)"=w32)
  Build Cluster(w31, w32) -> w33
  Build Array(w30, w26, w23, w33) -> w34
  $Graph <- w34
  $"Smart Sweep Mega Cluster Out" <- w29
  $"Error Out" <- w1
