vi "Photodetector Close Coms.gvi"   [LabVIEW NXG 5.0.0]
inputs:
  "Error In": error
  "Instrument Control Mega Cluster In": "Instrument Control Mega Cluster.gtype"
outputs:
  "Error Out": error
  "Instrument Control Mega Cluster Out": "Instrument Control Mega Cluster.gtype"
types:
  "Instrument Coms Info.gtype" = cluster{"Arduino Coms Info": "Arduino Detection cluster control.gtype", "Photodetector Names": string[], "Keythley Address": "VISA Instr", "Photodetector Detected?": bool, "Thorlabs Motors Detected?": bool, "Keithley Detected?": bool, "Thorlabs Motors Serial Number": "Thorlabs Motors Serial Number In.gtype", "Photodetector IVI session": "Ivi IviDefault", "Flame ID": string, "Flame Detected?": bool, "Flame Wrapper ID": u64}
  "Debugging Cluster.gtype" = cluster{"Debugging mode?": bool, "Initialize App": bool, "Insturment Debugging": "Insturment Debugging Cluster.gtype"}
  "Instrument Control Mega Cluster.gtype" = cluster{"Instruments Coms Info": "Instrument Coms Info.gtype", "Debugging Cluster": "Debugging Cluster.gtype"}
uses:
  LabView_NXG_Thorlabs_PM100::Miscelanous::TLPM Close.gvi
diagram:
  # This subVI Checks if there is an open coms channel
  # with the photodetector and if there is it
  # Closes the comunications with the Photodetector
  case ($"Error In") {
    frame Error, Default {
      w1 = $"Error In"
      w2 = $"Instrument Control Mega Cluster In"
    }
    frame No Error {
      Property Node(instance in=$"Instrument Control Mega Cluster In") -> ("Debugging Cluster:Debugging mode?"=w3, "Debugging Cluster:Insturment Debugging:Photodetector"=w4, instance out=w5)
      Property Node(instance in=w5) -> ("Instruments Coms Info:Photodetector IVI session"=w6, instance out=w2)
      Logical And(w3, not w4) -> w7
      Is Equal(x="", y=w6) -> w8
      Logical Or(w8, w7) -> w9
      case (w9) {
        frame True {
          w1 = $"Error In"
        }
        frame False {
          call "TLPM Close.gvi"(IVI session in=w6, error in (no error)=$"Error In") -> (error out=w1)
        }
      }
    }
  }
  $"Instrument Control Mega Cluster Out" <- w2
  $"Error Out" <- w1
