vi "Photodetector Guarantee Measurement.gvi"   [LabVIEW NXG 5.0.0]
inputs:
  "Error In": error
  "Instrument Control Mega Cluster In": "Instrument Control Mega Cluster.gtype"
  "Timeout (s)": f64
  "Stabilization time (ms)": u32
outputs:
  "Error Out": error
  "Instrument Control Mega Cluster Out": "Instrument Control Mega Cluster.gtype"
  "Measured Power": f64
types:
  "Instrument Coms Info.gtype" = cluster{"Arduino Coms Info": "Arduino Detection cluster control.gtype", "Photodetector Names": string[], "Keythley Address": "VISA Instr", "Photodetector Detected?": bool, "Thorlabs Motors Detected?": bool, "Keithley Detected?": bool, "Thorlabs Motors Serial Number": "Thorlabs Motors Serial Number In.gtype", "Photodetector IVI session": "Ivi IviDefault", "Flame ID": string, "Flame Detected?": bool, "Flame Wrapper ID": u64}
  "Debugging Cluster.gtype" = cluster{"Debugging mode?": bool, "Initialize App": bool, "Insturment Debugging": "Insturment Debugging Cluster.gtype"}
  "Instrument Control Mega Cluster.gtype" = cluster{"Instruments Coms Info": "Instrument Coms Info.gtype", "Debugging Cluster": "Debugging Cluster.gtype"}
uses:
  Rainbow Measurement Setup::Side Functions::Utilities::Time Related Operations::Wait ms.gvi
  Rainbow Measurement Setup::Side Functions::Instrument Control::Photodetector::Photodetector Measure Power.gvi
diagram:
  # This SubVI Makes as many photodetector measurements as needed
  # until it exceeds the timeout or the output becomes a real number.
  case ($"Error In") {
    frame Error, Default {
      w1 = $"Error In"
      w2 = $"Instrument Control Mega Cluster In"
      w3 = default
    }
    frame No Error {
      call "Wait ms.gvi"(Error In=$"Error In", Milliseconds to Wait=$"Stabilization time (ms)") -> (Error Out=w4)
      s1 = $"Instrument Control Mega Cluster In"  # shift register
      s2 = w4  # shift register
      while (iteration -> i1) {
        call "Photodetector Measure Power.gvi"(Instrument Control Mega Cluster In=s1, Error In=s2) -> (Instrument Control Mega Cluster Out=w5, Measured Power=w3, Error Out=w6)
        Multiply($"Timeout (s)", 10) -> w7
        To Double Precision Float(number=i1) -> w8
        Is Greater(x=w8, y=w7) -> w9
        Is Not A Number Or Path Or Refnum(number=w3) -> w10
        Not(x=w10) -> w11
        Logical Or(w9, w11, w6) -> w12
        Wait Until Next Multiple(multiple to wait=100)
        next s1 = w5
        next s2 = w6
        stop if w12
      }
      w1 = s2
      w2 = s1
    }
  }
  $"Instrument Control Mega Cluster Out" <- w2
  $"Measured Power" <- w3
  $"Error Out" <- w1
