vi "Photodetector Initialize.gvi"   [LabVIEW NXG 5.0.0]
inputs:
  "Instrument Control Mega Cluster In": "Instrument Control Mega Cluster.gtype"
  "Error In": error
outputs:
  "Instrument Control Mega Cluster Out": "Instrument Control Mega Cluster.gtype"
  "Error Out": error
types:
  "Instrument Coms Info.gtype" = cluster{"Arduino Coms Info": "Arduino Detection cluster control.gtype", "Photodetector Names": string[], "Keythley Address": "VISA Instr", "Photodetector Detected?": bool, "Thorlabs Motors Detected?": bool, "Keithley Detected?": bool, "Thorlabs Motors Serial Number": "Thorlabs Motors Serial Number In.gtype", "Photodetector IVI session": "Ivi IviDefault", "Flame ID": string, "Flame Detected?": bool, "Flame Wrapper ID": u64}
  "Debugging Cluster.gtype" = cluster{"Debugging mode?": bool, "Initialize App": bool, "Insturment Debugging": "Insturment Debugging Cluster.gtype"}
  "Instrument Control Mega Cluster.gtype" = cluster{"Instruments Coms Info": "Instrument Coms Info.gtype", "Debugging Cluster": "Debugging Cluster.gtype"}
uses:
  LabView_NXG_Thorlabs_PM100::Examples::Photodetector initialization Sequence with prompt.gvi
diagram:
  # This SubVI detects the photodetector and appends it to the Instrument Coms Cluster in case
  # the debugging allows it to do so.
  case ($"Error In") {
    frame Error, Default {
      w1 = $"Error In"
      w2 = $"Instrument Control Mega Cluster In"
    }
    frame No Error {
      Property Node(instance in=$"Instrument Control Mega Cluster In") -> ("Debugging Cluster:Debugging mode?"=w3, "Debugging Cluster:Insturment Debugging:Photodetector"=w4, instance out=w5)
      Logical And[output inverted](w3, not w4) -> w6
      case (w6) {
        frame False, Default {
          w1 = $"Error In"
          w2 = w5
        }
        frame True {
          call "Photodetector initialization Sequence with prompt.gvi"(Error In=$"Error In") -> (Photodetector IVI session=w7, Error Out=w1)
          Property Node(instance in=w5, "Instruments Coms Info:Photodetector IVI session"=w7) -> (instance out=w2)
        }
      }
    }
  }
  $"Error Out" <- w1
  $"Instrument Control Mega Cluster Out" <- w2
