vi "Modify Thorlabs File.gvi"   [LabVIEW NXG 5.0.0]
inputs:
  "Error In": error
  "Path In": path, required
  "Thorlabs Motor Serial Number File Operations": "Thorlabs Motor Serial Number File Operations.gtype" = "Read", required
  "Thorlabs Motors Serial Number In": "Thorlabs Motors Serial Number In.gtype"
outputs:
  "Error Out": error
  "Path Out": path
  "Thorlabs Motors Serial Number Out": "Thorlabs Motors Serial Number In.gtype"
types:
  "Thorlabs Motors Serial Number In.gtype" = cluster{"Thorlabs Blue Motor": string, "Thorlabs Red Motor": string}
  "Thorlabs Motor Serial Number File Operations.gtype" = enum{"Read", "Write"}
uses:
  NI::G Core::Strings::Trim Whitespace.gvi
diagram:
  # This is a SubVI that Reads or writes the Thorlabs Motors Serial Number on a txt file so that they can be retrieved when needed.
  case ($"Error In") {
    frame Error, Default {
      w1 = $"Error In"
      w2 = $"Path In"
      w3 = $"Thorlabs Motors Serial Number In"
    }
    frame No Error {
      case ($"Thorlabs Motor Serial Number File Operations") {
        frame "Read", Default {
          Cluster To Array(cluster=$"Thorlabs Motors Serial Number In") -> (array=w4)
          Open Or Create Or Replace File(error in=$"Error In", file path (use dialog)=$"Path In", operation (0:open)="open") -> (error out=w5, refnum out=w6)
          Read From Text File(error in=w5, file (use dialog)=w6) -> (error out=w7, refnum out=w8, text=w9)
          Spreadsheet String To Array(array type=w4, format string="%g", spreadsheet string=w9) -> (array=w10)
          Array To Cluster[NumberOfClusterElements=9](array=w10) -> (cluster=w11)
          Property Node(instance in=w11) -> ("Element 1"=w12, "Element 2"=w13)
          call "Trim Whitespace.gvi"(string=w12) -> (trimmed string=w14)
          call "Trim Whitespace.gvi"(string=w13) -> (trimmed string=w15)
          Property Node(instance in=$"Thorlabs Motors Serial Number In", "Thorlabs Blue Motor"=w14, "Thorlabs Red Motor"=w15) -> (instance out=w3)
          Close File(error in=w7, refnum=w8) -> (error out=w1, path=w2)
        }
        frame "Write" {
          Open Or Create Or Replace File(error in=$"Error In", file path (use dialog)=$"Path In", operation (0:open)="replace or create") -> (error out=w16, refnum out=w17)
          Cluster To Array(cluster=$"Thorlabs Motors Serial Number In") -> (array=w18)
          Array To Spreadsheet String(array=w18, format string="%g") -> (spreadsheet string=w19)
          Concatenate Strings("Blue Motor Serial Number  Red Motor Serial Number", "\t", "\r\n", w19) -> w20
          Write To Text File(error in=w16, file (use dialog)=w17, text=w20) -> (error out=w21, refnum out=w22)
          Close File(error in=w21, refnum=w22) -> (error out=w1, path=w2)
          w3 = $"Thorlabs Motors Serial Number In"
        }
      }
    }
  }
  $"Thorlabs Motors Serial Number Out" <- w3
  $"Path Out" <- w2
  $"Error Out" <- w1
