vi "Thorlabs Serial Number Check.gvi"   [LabVIEW NXG 5.0.0]
inputs:
  "Error In": error
  "Initialize App Bundle Cluster In": "Initialize App Bundle Cluster.gtype"
outputs:
  "Error Out": error
  "Thorlabs Motors Serial Number Out": "Thorlabs Motors Serial Number In.gtype"
  "Initialize App Bundle Cluster Out": "Initialize App Bundle Cluster.gtype"
panel indicators:
  "Thorlabs Motor Serial Number File Path": path
types:
  "Thorlabs Motors Serial Number In.gtype" = cluster{"Thorlabs Blue Motor": string, "Thorlabs Red Motor": string, "Blue Motor Homed?": bool, "Red Motor Homed?": bool}
  "Instrument Coms Info.gtype" = cluster{"Arduino Coms Info": "Arduino Detection cluster control.gtype", "Photodetector Names": string[], "Keythley Address": "VISA Instr", "Photodetector Detected?": bool, "Thorlabs Motors Detected?": bool, "Keithley Detected?": bool, "Thorlabs Motors Serial Number": "Thorlabs Motors Serial Number In.gtype", "Photodetector IVI session": "Ivi IviDefault", "Flame ID": string, "Flame Detected?": bool, "Flame Wrapper ID": u64}
  "Full Reference Cluster.gtype" = cluster{"Enum Reference Cluster": "Enum Control Reference Cluster.gtype", "Boolean Reference Cluster": "Boolean Control Reference Cluster.gtype", "Numeric Reference Cluster": "Numeric Control Reference Cluster.gtype", "Numeric Cluster Reference Cluster": "Numeric Cluster Reference Cluster.gtype", "Path Reference Cluster": "Path Reference Cluster.gtype", "Cluster Reference Cluster": "Cluster Reference Cluster.gtype"}
  "Debugging Cluster.gtype" = cluster{"Debugging mode?": bool, "Initialize App": bool, "Insturment Debugging": "Insturment Debugging Cluster.gtype"}
  "All Paths Cluster.gtype" = cluster{"Thorlabs Motor Serial Number File Path": path}
  "Initialize App Bundle Cluster.gtype" = cluster{"Instrument Coms Info": "Instrument Coms Info.gtype", "Full Reference Cluster": "Full Reference Cluster.gtype", "Debugging Cluster": "Debugging Cluster.gtype", "All Paths": "All Paths Cluster.gtype"}
uses:
  Rainbow Measurement Setup::Side Functions::Global Abort::FGV Global Abort.gvi
  NI::G Core::File IO (General)::Check if File or Folder Exists.gvi
  Rainbow Measurement Setup::Side Functions::Messages And Prompts::Select file prompt.gvi
  Rainbow Measurement Setup::Side Functions::Instrument Control::Thorlabs Motors::Detection::Thorlabs motor Detector.gvi
  NI::G Core::Strings::1D String Array to Delimited String.gvi
  NI::G Core::File IO (General)::Create Directory Recursive.gvi
  Rainbow Measurement Setup::Side Functions::Instrument Control::Thorlabs Motors::Detection::Modify Thorlabs File.gvi
diagram:
  # This SubVI Checks if there is any Thorlabs Motor Serial Number reference file. If there is it just reads and outputs the serial numbers for the red and blue motors. If there isn't it prompts the user with various options:
  # They can either create it themselves, they can locate the file elsewhere or a new file can be created with the currently connected motors. It is VERY IMPORTANT that if one chooses the latter option ONLY 2 motors are
  # connected and no active simulations are in place, otherwise the stored serial numbers will be wrong and they will have to be modified.
  case ($"Error In") {
    frame Error, Default {
      w1 = $"Error In"
      w2 = $"Initialize App Bundle Cluster In"
    }
    frame No Error {
      Get Component Directory() -> (Path=w3)
      Strip Path(path=w3) -> (stripped path=w4)
      Build Path(base path=w4, name or relative path="Extra installers\\Thorlabs_Motors_Serial_Number.txt") -> (appended path=w5)
      s1 = w5  # shift register
      while (iteration -> i1) {
        call "FGV Global Abort.gvi"(Global Abort Instructions="Read Current State", Error In=$"Error In") -> (Global Abort Out=w6, Error Out=w7)
        call "Check if File or Folder Exists.gvi"(file or folder=s1, error in=w7) -> (file or folder exists?=w8, error out=w9)
        case (w8) {
          frame False, Default {
            Path To String(path=s1) -> (string=w13)
            w14 = "I could not find the Thorlabs_Motors_Serial_Number file in \nthis location:\n"
            w15 = """
Please make sure that the file is put back on that
location, provide an alternative path with the file or,
if you want, we can generate a file with the currently
detected Motor Serial Number Values."""
            Concatenate Strings(w14, w13, w15) -> w16
            w17 = "I will make sure\nthe file is placed\nback where it \nbelongs"
            Three Button Dialog(Allow user to close window? (TRUE)=FALSE, Center Button Text ("No")=w17, Left Button Text ("Yes")="I will provide an\nalternative path", Right Button Text ("Cancel")="Create a New File, i\ndo not know where the\nother is.", Window Title (" ")="Thorlabs_Motors_Serial_Number.txt not found", message=w16) -> (Which Button?=w18)
            case (w18) {
              frame "center button" {
                Wait Until Next Multiple(multiple to wait=20000)
                w11 = w9
                w12 = s1
              }
              frame "left button", Default {
                call "Select file prompt.gvi"(Main Message="Please select the Thorlabs_Motors_Serial_Number.txt file.", Sub message="It is usually on the extra installers folder", Error In=w9) -> (New Path=w12, Error Out=w11)
              }
              frame "right button" {
                call "Thorlabs motor Detector.gvi"(First Write Detection=TRUE, Prompt Iterations=2, Error In=w9) -> (Thorlabs Motor Serial Nº Array=w19, Detected?=w20, Error Out=w21)
                case (w20) {
                  frame False, Default {
                    w22 = """We have not detected any
motors, please make sure you
have properly connected them
before asking to create a file with
the currently detected Motor Serial
Number Values."""
                    One Button Dialog(button name ("OK")="Sorry I did not realise", message=w22)
                    w12 = s1
                    w11 = w21
                  }
                  frame True {
                    call "1D String Array to Delimited String.gvi"(string array=w19, delimiter=", ") -> (delimited string=w23)
                    w24 = """
Are you SURE that these are the correct Serial
Numbers and you want to store them for future
use?
(You can always manually modify them in case 
of changing the motors or if they have been reversed)"""
                    Concatenate Strings("These are the connected Motors Serial Number.\n", w23, w24) -> w25
                    Two Button Dialog(F button name ("Cancel")="No please these are not the\ncorrect serial numbers", T button name ("OK")="Yes, I am certain", message=w25) -> (T Button?=w26)
                    case (w26) {
                      frame False, Default {
                        w27 = "Then either create the file yourself \nor connect the right motors please."
                        One Button Dialog(button name ("OK")="Okay sorry.", message=w27)
                        w12 = s1
                        w11 = w21
                      }
                      frame True {
                        Array Index(array=w19) -> (out0[0]=w28, out1[1]=w29)
                        Property Node(instance in="Thorlabs Motors Serial Number In.gtype" {all zero or empty}, "Thorlabs Blue Motor"=w28, "Thorlabs Red Motor"=w29) -> (instance out=w30)
                        Strip Path(path=s1) -> (stripped path=w31)
                        call "Create Directory Recursive.gvi"(folder=w31, error in=w21) -> (error out=w32)
                        call "Modify Thorlabs File.gvi"(Path In=s1, Thorlabs Motor Serial Number File Operations="Write", Thorlabs Motors Serial Number In=w30, Error In=w32) -> (Path Out=w12, Error Out=w11)
                      }
                    }
                  }
                }
              }
            }
            w10 = FALSE
          }
          frame True {
            w10 = TRUE
            w11 = w9
            w12 = s1
          }
        }
        Is Greater(x=i1, y=2) -> w33
        case (w33) {
          frame False, Default {
            w34 = w11
            w35 = FALSE
          }
          frame True {
            w36 = """Seems you're having some trouble
finding the Thorlabs_Motors_Serial_Number.txt
file, do you want to proceed without it
and hope for the best?
(WARNING: some functionalities might
be compromized, or the entire program 
can crash)"""
            Two Button Dialog(F button name ("Cancel")="Oh dear no, I'd rather ask for help", T button name ("OK")="Yes please, I like to live dangerously", message=w36) -> (T Button?=w35)
            w34 = w11
          }
        }
        Logical Or(w35, w10, w6) -> w37
        Wait Until Next Multiple(multiple to wait=500)
        next s1 = w12
        stop if w37
      }
      call "Modify Thorlabs File.gvi"(Path In=s1, Thorlabs Motor Serial Number File Operations="Read", Error In=w34) -> (Path Out=w38, Thorlabs Motors Serial Number Out=w39, Error Out=w1)
      $"Thorlabs Motor Serial Number File Path" <- w38
      Property Node(instance in=$"Initialize App Bundle Cluster In") -> ("All Paths"=w40, "Instrument Coms Info"=w41)
      Property Node(instance in=w40, "Thorlabs Motor Serial Number File Path"=w38) -> (instance out=w42)
      Property Node(instance in=w41, "Thorlabs Motors Serial Number"=w39) -> (instance out=w43)
      Property Node(instance in=$"Initialize App Bundle Cluster In", "All Paths"=w42, "Instrument Coms Info"=w43) -> (instance out=w2)
      $"Thorlabs Motors Serial Number Out" <- w39
    }
  }
  $"Initialize App Bundle Cluster Out" <- w2
  $"Error Out" <- w1
