vi "Thorlabs motor Detector.gvi"   [LabVIEW NXG 5.0.0]
inputs:
  "Error In": error
  "First Write Detection": bool
  "Prompt Iterations": i32 = 3
  "Thorlabs Motors Serial Number In": "Thorlabs Motors Serial Number In.gtype"
outputs:
  "Error Out": error
  "Detected?": bool
  "Thorlabs Motor Serial Nº Array": string[]
  "Thorlabs Motors Serial Number Out": "Thorlabs Motors Serial Number In.gtype"
panel indicators:
  "Blue Motor Detected?": bool
  "Red Motor Detected?": bool
types:
  "Thorlabs Motors Serial Number In.gtype" = cluster{"Thorlabs Blue Motor": string, "Thorlabs Red Motor": string}
uses:
  NXG_KCube_DC_Servo_Control::Examples::Scan Available Devices.gvi
  NI::G Core::Error::Clear Error Cluster.gvi
  Rainbow Measurement Setup::Side Functions::Instrument Control::Thorlabs Motors::Detection::Blue Red Motor Detection.gvi
diagram:
  # This subVI scans the available thorlabs motors and if there are not 2 connected motors it prompts the user
  # to connect all the motors and retries. After 'n' faild attempts it prompts the user to skip this test.
  # If it is trying to create a new Serial Number File it has to detect ONLY 2 motors to assign them.
  case ($"Error In") {
    frame Error, Default {
      w1 = $"Error In"
    }
    frame No Error {
      while (iteration -> i1) {
        case ($"Error In") {
          frame Error, Default {
            w2 = $"Error In"
          }
          frame No Error {
            $"Blue Motor Detected?" <- FALSE
            $"Red Motor Detected?" <- FALSE
            w2 = $"Error In"
          }
        }
        call "Scan Available Devices.gvi"(Error In=w2) -> (Number Of Devices=w3, Device ID array=w4, Error Out=w5)
        Is Equal(x=w3, y=2) -> w6
        Is Greater Or Equal(x=w3, y=2) -> w7
        Select(s=$"First Write Detection", t=w6, f=w7) -> w8
        case (w8) {
          frame False, Default {
            while {
              Number To Decimal String(number=w3) -> (decimal integer string=w13)
              w14 = """ thorlabs motors, 
there should be at least 2 
connected. Please make 
sure that they are
propperly connected and  
that they are powered on.

(If you are trying to create a new
Motor Serial Number File MAKE SURE
you have only connected two Thorlabs
motors to this computer)
"""
              Concatenate Strings("I detected ", w13, w14) -> w15
              One Button Dialog(button name ("OK")="Okay i will fix it", message=w15) -> (true=w16)
              Wait Until Next Multiple(multiple to wait=500)
              stop if w16
            }
            call "Clear Error Cluster.gvi"(error in=w5) -> (error out=w9)
            w10 = FALSE
            w11 = default
            w12 = w4
          }
          frame True {
            case ($"First Write Detection") {
              frame False, Default {
                call "Blue Red Motor Detection.gvi"(Device ID Array=w4, Thorlabs Motors Serial Number In=$"Thorlabs Motors Serial Number In") -> (Blue Motor Detected?=w17, Both Motors Detected?=w10, Red Motor Detected?=w18)
                # If it is not the first time, we will want to
                # decide if the connected motors are the ones
                # we need to use (which one is blue and Which
                # one is red) so we compare them with the file
                # we had saved before.
                $"Blue Motor Detected?" <- w17
                $"Red Motor Detected?" <- w18
                w12 = w4
                w9 = w5
              }
              frame True {
                # If we are trying to detect the
                # motors for the first time wi will
                # take any serial number there is
                # and set them as the correct ones.
                # Connect ONLY the correct motors
                w12 = w4
                w9 = w5
                w10 = TRUE
              }
            }
            w11 = w10
          }
        }
        $"Thorlabs Motor Serial Nº Array" <- w12
        Is Greater Or Equal(x=i1, y=$"Prompt Iterations") -> w19
        case (w19) {
          frame False, Default {
            w20 = FALSE
            w1 = w9
          }
          frame True {
            w21 = """Seems you're having some trouble
connecting the thorlabs motors, do you 
want to proceed without connecting them
and hope for the best?
(WARNING: some functionalities might
be compromized)"""
            Two Button Dialog(F button name ("Cancel")="Oh dear no, I'd rather ask for help", T button name ("OK")="Yes please, I like to live dangerously", message=w21) -> (T Button?=w20)
            w1 = w9
          }
        }
        Logical Or(w10, w20) -> w22
        $"Thorlabs Motors Serial Number Out" <- $"Thorlabs Motors Serial Number In"
        stop if w22
      }
      $"Detected?" <- w11
    }
  }
  $"Error Out" <- w1
