vi "Dividing Wavelength Calibration File Handling.gvi"   [LabVIEW NXG 5.0.0]
inputs:
  "Error In": error
  "Dividing Wavelength Calibration Data In": "Dividing Wavelength Calibration Data.gtype"
  "Modify File Operation": "Modify File Operation.gtype" = "Save TXT"
outputs:
  "Error Out": error
  "Dividing Wavelength Calibration Data Out": "Dividing Wavelength Calibration Data.gtype"
types:
  "Dividing Wavelength Calibration Data.gtype" = cluster{"Dividing Wavelength (nm) Array": f64[], "Blue Motor Position (mm) Array": f64[], "Red Motor Position (mm) Array": f64[]}
  "Modify File Operation.gtype" = enum{"Save TXT", "Load TXT"}
uses:
  Rainbow Measurement Setup::Side Functions::Utilities::Cell Naming::txt Extension adder.gvi
  NI::G Core::File IO (General)::Check if File or Folder Exists.gvi
  Rainbow Measurement Setup::Side Functions::Messages And Prompts::Select file prompt.gvi
  Rainbow Measurement Setup::Main Functions::Modify TXT file::Modify Measurement TXT File.gvi
diagram:
  # This SubVI is in charge of handling the writting and loading of the Dividing Wavelength Calibration file
  # which stores the relation between the guillotine motors position and the measured spectral output.
  case ($"Error In") {
    frame Error, Default {
      w1 = $"Error In"
      w2 = $"Dividing Wavelength Calibration Data In"
    }
    frame No Error {
      case ($"Modify File Operation") {
        frame "Load TXT", Default {
          Get Component Directory() -> (Path=w3)
          Strip Path(path=w3) -> (stripped path=w4)
          Build Path(base path=w4, name or relative path="Extra installers\\Calibration_Files\\Div_Wav_To_Motor_Pos") -> (appended path=w5)
          call "txt Extension adder.gvi"(Name without .txt="Dividing Wavelength To Motor Position Calibration File") -> (Name with .txt=w6)
          Build Path(base path=w5, name or relative path=w6) -> (appended path=w7)
          call "Check if File or Folder Exists.gvi"(file or folder=w7, error in=$"Error In") -> (file or folder exists?=w8, error out=w9)
          Is Empty String Or Path(string/path=w7) -> w10
          Logical Or(w10, not w8) -> w11
          case (w11) {
            frame False {
              w12 = w7
              w13 = w9
            }
            frame True {
              w14 = "Please select the Dividing Wavelength \nto motor position calibration file"
              call "Select file prompt.gvi"(Main Message=w14, Sub message="It Should be on the Extra installers folder", Error In=w9) -> (New Path=w12, Error Out=w13)
            }
          }
          call "Modify Measurement TXT File.gvi"(Filename to load/save=w12, Modify File Operation=$"Modify File Operation", Error In=w13, Measurement File Type="Dividing Wavelength To Motor Position") -> (Loaded Data=w15, Error Out=w1)
          Array Index(array=w15) -> (out0[_, 0]=w16, out1[_, 1]=w17, out2[_, 2]=w18)
          Property Node(instance in=$"Dividing Wavelength Calibration Data In", "Dividing Wavelength (nm) Array"=w16, "Blue Motor Position (mm) Array"=w17, "Red Motor Position (mm) Array"=w18) -> (instance out=w2)
        }
        frame "Save TXT" {
          Property Node(instance in=$"Dividing Wavelength Calibration Data In") -> ("Dividing Wavelength (nm) Array"=w19, "Blue Motor Position (mm) Array"=w20, "Red Motor Position (mm) Array"=w21, instance out=w2)
          Build Array(w19, w20, w21) -> w22
          Transpose 2D Array(2D array=w22) -> (transposed array=w23)
          call "Modify Measurement TXT File.gvi"(Modify File Operation=$"Modify File Operation", Data To Save=w23, Error In=$"Error In", Measurement File Type="Dividing Wavelength To Motor Position") -> (Error Out=w1)
        }
      }
    }
  }
  $"Dividing Wavelength Calibration Data Out" <- w2
  $"Error Out" <- w1
