vi "KCube Dividing Wavelength Translator.gvi"   [LabVIEW NXG 5.0.0]
inputs:
  "Error In": error
  "Dividing Wavelength": f64
  "Rainbow Sweep Types": "Rainbow Sweep Types.gtype" = "Red Sweep Closing"
  "Dividing Wavelength Calibration Data In": "Dividing Wavelength Calibration Data.gtype"
  "Instrument Control Mega Cluster In": "Instrument Control Mega Cluster.gtype"
outputs:
  "Error Out": error
  "KCube Coordinates": "KCube Coordinates.gtype"
  "Instrument Control Mega Cluster Out": "Instrument Control Mega Cluster.gtype"
  "Real Dividing Wavelength": f64
types:
  "Rainbow Sweep Types.gtype" = enum{"Red Sweep Closing", "Red Sweep Opening", "Blue Sweep Closing", "Blue Sweep Opening"}
  "KCube Coordinates.gtype" = cluster{"Blue Motor Position to move to (mm)": f64, "Red Motor Position to move to (mm)": f64}
  "Dividing Wavelength Calibration Data.gtype" = cluster{"Dividing Wavelength (nm) Array": f64[], "Blue Motor Position (mm) Array": f64[], "Red Motor Position (mm) Array": f64[]}
  "Instrument Coms Info.gtype" = cluster{"Arduino Coms Info": "Arduino Detection cluster control.gtype", "Photodetector Names": string[], "Keythley Address": "VISA Instr", "Photodetector Detected?": bool, "Thorlabs Motors Detected?": bool, "Keithley Detected?": bool, "Thorlabs Motors Serial Number": "Thorlabs Motors Serial Number In.gtype", "Photodetector IVI session": "Ivi IviDefault", "Flame ID": string, "Flame Detected?": bool, "Flame Wrapper ID": u64}
  "Debugging Cluster.gtype" = cluster{"Debugging mode?": bool, "Initialize App": bool, "Insturment Debugging": "Insturment Debugging Cluster.gtype"}
  "Instrument Control Mega Cluster.gtype" = cluster{"Instruments Coms Info": "Instrument Coms Info.gtype", "Debugging Cluster": "Debugging Cluster.gtype"}
uses:
  Rainbow Measurement Setup::Side Functions::Utilities::Array Operations::Find Closest In Array.gvi
  Rainbow Measurement Setup::Side Functions::Messages And Prompts::FGV Cancel Prompts until Finished Routine.gvi
  NXG_KCube_DC_Servo_Control::Utilities::Move To Position.gvi
diagram:
  # This subVI takes the dividing wavelength calibration data and the dividing wavelength and calculates
  # the position of the guillotine motors so as to have that exact wavelength. It looks for the closest value within
  # the array and gives out that closest value as well as the coordinates for that value.
  # All that only if the debugging allows for it.
  case ($"Error In") {
    frame Error, Default {
      w1 = $"Error In"
      w2 = default
      w3 = $"Instrument Control Mega Cluster In"
      w4 = $"Dividing Wavelength"
    }
    frame No Error {
      Property Node(instance in=$"Dividing Wavelength Calibration Data In") -> ("Dividing Wavelength (nm) Array"=w5, "Blue Motor Position (mm) Array"=w6, "Red Motor Position (mm) Array"=w7)
      call "Find Closest In Array.gvi"(Array In=w5, Desired Value=$"Dividing Wavelength", Tolerance=2, Error In=$"Error In") -> (Closest Value Index=w8, Closest Value=w4, Within Tolerance?=w9, Error Out=w10)
      Property Node(instance in=$"Instrument Control Mega Cluster In") -> ("Debugging Cluster:Debugging mode?"=w11, "Debugging Cluster:Insturment Debugging:Thorlabs Motors"=w12, instance out=w13)
      Logical And[output inverted](w11, not w12) -> w14
      Is Less Than 0(x=w8) -> w15
      Logical Or(w15, not w9) -> w16
      case (w14) {
        frame False, Default {
          w1 = w10
          w3 = w13
          w2 = default
        }
        frame True {
          case (w16) {
            frame True {
              call "FGV Cancel Prompts until Finished Routine.gvi"(Error In=w10, FGV Instructions="Read State") -> (Prompt? Out=w17, Error Out=w18)
              case (w17) {
                frame False, Default {
                  w1 = w18
                }
                frame True {
                  w19 = """Dividing wavelength not in the calibration file
please extend either the range or the resolution
of the calibration file or contact Martí 
Problem in KCube Dividing Wavelength Translator)"""
                  Two Button Dialog(F button name ("Cancel")="Okay But stop \nthis prompts please", T button name ("OK")="Okay I will", message=w19) -> (T Button?=w20)
                  call "FGV Cancel Prompts until Finished Routine.gvi"(Error In=w18, FGV Instructions="Set State", Prompt? In=w20) -> (Error Out=w1)
                }
              }
              w3 = w13
              w2 = default
            }
            frame False {
              case ($"Rainbow Sweep Types") {
                frame "Red Sweep Closing", Default {
                  Array Index(array=w6) -> (out0[w8]=w21)
                  Property Node(instance in="KCube Coordinates.gtype" {all zero or empty}, "Blue Motor Position to move to (mm)"=w21) -> (instance out=w2)
                  Property Node(instance in=w13) -> ("Instruments Coms Info:Thorlabs Motors Serial Number:Thorlabs Blue Motor"=w22, instance out=w3)
                  call "Move To Position.gvi"(Motor Serial Number In=w22, Position to move in mm=w21, Error In=w10) -> (Error Out=w1)
                }
                frame "Red Sweep Opening" {
                  Array Index(array=w6) -> (out0[w8]=w23)
                  Property Node(instance in="KCube Coordinates.gtype" {all zero or empty}, "Blue Motor Position to move to (mm)"=w23) -> (instance out=w2)
                  Property Node(instance in=w13) -> ("Instruments Coms Info:Thorlabs Motors Serial Number:Thorlabs Blue Motor"=w24, instance out=w3)
                  call "Move To Position.gvi"(Motor Serial Number In=w24, Position to move in mm=w23, Error In=w10) -> (Error Out=w1)
                }
                frame "Blue Sweep Closing" {
                  Array Index(array=w7) -> (out0[w8]=w25)
                  Property Node(instance in="KCube Coordinates.gtype" {all zero or empty}, "Red Motor Position to move to (mm)"=w25) -> (instance out=w2)
                  Property Node(instance in=w13) -> ("Instruments Coms Info:Thorlabs Motors Serial Number:Thorlabs Red Motor"=w26, instance out=w3)
                  call "Move To Position.gvi"(Motor Serial Number In=w26, Position to move in mm=w25, Error In=w10) -> (Error Out=w1)
                }
                frame "Blue Sweep Opening" {
                  Array Index(array=w7) -> (out0[w8]=w27)
                  Property Node(instance in="KCube Coordinates.gtype" {all zero or empty}, "Red Motor Position to move to (mm)"=w27) -> (instance out=w2)
                  Property Node(instance in=w13) -> ("Instruments Coms Info:Thorlabs Motors Serial Number:Thorlabs Red Motor"=w28, instance out=w3)
                  call "Move To Position.gvi"(Motor Serial Number In=w28, Position to move in mm=w27, Error In=w10) -> (Error Out=w1)
                }
              }
            }
          }
        }
      }
    }
  }
  $"Instrument Control Mega Cluster Out" <- w3
  $"KCube Coordinates" <- w2
  $"Error Out" <- w1
  $"Real Dividing Wavelength" <- w4
