vi "KCube Initialize and Home.gvi"   [LabVIEW NXG 5.0.0]
inputs:
  "Instrument Control Mega Cluster In": "Instrument Control Mega Cluster.gtype"
  "Error In": error
  "KCube Motor Selector": "KCube Motor Selector.gtype" = "Red Motor"
outputs:
  "Instrument Control Mega Cluster Out": "Instrument Control Mega Cluster.gtype"
  "Error Out": error
types:
  "KCube Motor Selector.gtype" = enum{"Red Motor", "Blue Motor"}
  "Instrument Coms Info.gtype" = cluster{"Arduino Coms Info": "Arduino Detection cluster control.gtype", "Photodetector Names": string[], "Keythley Address": "VISA Instr", "Photodetector Detected?": bool, "Thorlabs Motors Detected?": bool, "Keithley Detected?": bool, "Thorlabs Motors Serial Number": "Thorlabs Motors Serial Number In.gtype", "Photodetector IVI session": "Ivi IviDefault", "Flame ID": string, "Flame Detected?": bool, "Flame Wrapper ID": u64}
  "Debugging Cluster.gtype" = cluster{"Debugging mode?": bool, "Initialize App": bool, "Insturment Debugging": "Insturment Debugging Cluster.gtype"}
  "Instrument Control Mega Cluster.gtype" = cluster{"Instruments Coms Info": "Instrument Coms Info.gtype", "Debugging Cluster": "Debugging Cluster.gtype"}
uses:
  NXG_KCube_DC_Servo_Control::Utilities::Initialize Motor and Home.gvi
diagram:
  # This SubVI Initializes and Homes the KCube Thorlabs selected Motor if the Debugging Allows for it
  case ($"Error In") {
    frame Error, Default {
      w1 = $"Error In"
      w2 = $"Instrument Control Mega Cluster In"
    }
    frame No Error {
      Property Node(instance in=$"Instrument Control Mega Cluster In") -> ("Debugging Cluster:Debugging mode?"=w3, "Debugging Cluster:Insturment Debugging:Thorlabs Motors"=w4, instance out=w5)
      Logical And[output inverted](w3, not w4) -> w6
      case (w6) {
        frame False, Default {
          w1 = $"Error In"
          w2 = w5
        }
        frame True {
          case ($"KCube Motor Selector") {
            frame "Red Motor" {
              Property Node(instance in=w5) -> ("Instruments Coms Info:Thorlabs Motors Serial Number:Thorlabs Red Motor"=w7, "Instruments Coms Info:Thorlabs Motors Serial Number:Red Motor Homed?"=w8, instance out=w9)
              call "Initialize Motor and Home.gvi"(Current Motor Serial nº In=w7, Homed? In=w8, Error In=$"Error In") -> (Homed? Out=w10, Error Out=w1)
              Property Node(instance in=w9, "Instruments Coms Info:Thorlabs Motors Serial Number:Red Motor Homed?"=w10) -> (instance out=w2)
            }
            frame "Blue Motor", Default {
              Property Node(instance in=w5) -> ("Instruments Coms Info:Thorlabs Motors Serial Number:Thorlabs Blue Motor"=w11, "Instruments Coms Info:Thorlabs Motors Serial Number:Blue Motor Homed?"=w12, instance out=w13)
              call "Initialize Motor and Home.gvi"(Current Motor Serial nº In=w11, Homed? In=w12, Error In=$"Error In") -> (Homed? Out=w14, Error Out=w1)
              Property Node(instance in=w13, "Instruments Coms Info:Thorlabs Motors Serial Number:Blue Motor Homed?"=w14) -> (instance out=w2)
            }
          }
        }
      }
    }
  }
  $"Instrument Control Mega Cluster Out" <- w2
  $"Error Out" <- w1
