vi "KCube Motor Single Move to Position.gvi"   [LabVIEW NXG 5.0.0]
inputs:
  "Error In": error
  "KCube Motor Selector": "KCube Motor Selector.gtype" = "Red Motor"
  "Instrument Control Mega Cluster In": "Instrument Control Mega Cluster.gtype"
  "Motor Position to move to (mm)": f64
outputs:
  "Error Out": error
  "Instrument Control Mega Cluster Out": "Instrument Control Mega Cluster.gtype"
types:
  "KCube Motor Selector.gtype" = enum{"Red Motor", "Blue Motor"}
  "Instrument Coms Info.gtype" = cluster{"Arduino Coms Info": "Arduino Detection cluster control.gtype", "Photodetector Names": string[], "Keythley Address": "VISA Instr", "Photodetector Detected?": bool, "Thorlabs Motors Detected?": bool, "Keithley Detected?": bool, "Thorlabs Motors Serial Number": "Thorlabs Motors Serial Number In.gtype", "Photodetector IVI session": "Ivi IviDefault", "Flame ID": string, "Flame Detected?": bool, "Flame Wrapper ID": u64}
  "Debugging Cluster.gtype" = cluster{"Debugging mode?": bool, "Initialize App": bool, "Insturment Debugging": "Insturment Debugging Cluster.gtype"}
  "Instrument Control Mega Cluster.gtype" = cluster{"Instruments Coms Info": "Instrument Coms Info.gtype", "Debugging Cluster": "Debugging Cluster.gtype"}
uses:
  NXG_KCube_DC_Servo_Control::Utilities::Move To Position.gvi
diagram:
  # This SubVI Writes the desired position onto the Specified Motor If the Debugging Allows for it
  case ($"Error In") {
    frame Error, Default {
      w1 = $"Error In"
      w2 = $"Instrument Control Mega Cluster In"
    }
    frame No Error {
      Property Node(instance in=$"Instrument Control Mega Cluster In") -> ("Debugging Cluster:Debugging mode?"=w3, "Debugging Cluster:Insturment Debugging:Thorlabs Motors"=w4, instance out=w5)
      Logical And[output inverted](w3, not w4) -> w6
      case (w6) {
        frame False, Default {
          w1 = $"Error In"
          w2 = w5
        }
        frame True {
          Property Node(instance in=w5) -> ("Instruments Coms Info:Thorlabs Motors Serial Number:Thorlabs Blue Motor"=w7, "Instruments Coms Info:Thorlabs Motors Serial Number:Thorlabs Red Motor"=w8, instance out=w2)
          case ($"KCube Motor Selector") {
            frame "Blue Motor" {
              call "Move To Position.gvi"(Motor Serial Number In=w7, Position to move in mm=$"Motor Position to move to (mm)", Error In=$"Error In") -> (Error Out=w1)
            }
            frame "Red Motor" {
              call "Move To Position.gvi"(Motor Serial Number In=w8, Position to move in mm=$"Motor Position to move to (mm)", Error In=$"Error In") -> (Error Out=w1)
            }
          }
        }
      }
    }
  }
  $"Error Out" <- w1
  $"Instrument Control Mega Cluster Out" <- w2
