vi "KCube Motors Home sequence.gvi"   [LabVIEW NXG 5.0.0]
inputs:
  "Error In": error
  "Instrument Coms Info In": "Instrument Coms Info.gtype"
outputs:
  "Error Out": error
  "Homed?": bool
  "Instrument Coms Info Out": "Instrument Coms Info.gtype"
types:
  T1 = cluster{"Element 1": "VISA Instr", "Element 2": string}
  "Arduino Detection cluster control.gtype" = cluster{"XZ Stage Arduino Address": "VISA Instr", "XZ Stage Arduino Detected?": bool, "Multiplexer Arduino Detected?": bool, "Multiplexer Arduino Address": "VISA Instr", "Arduinos List": T1[], "XZ Stage Log": string, "Multiplexer Log": string}
  "Thorlabs Motors Serial Number In.gtype" = cluster{"Thorlabs Blue Motor": string, "Thorlabs Red Motor": string, "Blue Motor Homed?": bool, "Red Motor Homed?": bool}
  "Instrument Coms Info.gtype" = cluster{"Arduino Coms Info": "Arduino Detection cluster control.gtype", "Photodetector Names": string[], "Keythley Address": "VISA Instr", "Photodetector Detected?": bool, "Thorlabs Motors Detected?": bool, "Keithley Detected?": bool, "Thorlabs Motors Serial Number": "Thorlabs Motors Serial Number In.gtype", "Photodetector IVI session": "Ivi IviDefault"}
uses:
  NXG_KCube_DC_Servo_Control::Utilities::Home Subroutine.gvi
  Rainbow Measurement Setup::Side Functions::Messages And Prompts::General Failed Loop Prompt.gvi
diagram:
  # This SubVI Homes both motors and prompts the user when the motor homing
  # process has some problems giving him the oportunity to decide if he wants to
  # continue or if he wants to stop.
  case ($"Error In") {
    frame Error, Default {
      w1 = $"Error In"
      w2 = $"Instrument Coms Info In"
      w3 = default
    }
    frame No Error {
      Property Node(instance in=$"Instrument Coms Info In") -> ("Thorlabs Motors Serial Number:Thorlabs Blue Motor"=w4, "Thorlabs Motors Serial Number:Thorlabs Red Motor"=w5, instance out=w6)
      while (iteration -> i1) {
        call "Home Subroutine.gvi"(Motor Serial Number In=w4, Error In=$"Error In") -> (Homed?=w7, Error Out=w8)
        call "Home Subroutine.gvi"(Motor Serial Number In=w5, Error In=w8) -> (Homed?=w9, Error Out=w10)
        Logical And(w7, w9) -> w3
        w11 = """It seems like the KCube Motors
are having some problems homing.
Make sure the connections are still
okay and they are powered on. 
(You can try to unplug and replug
them.
You might have to restart the software)"""
        w12 = """Seems you're having some trouble
homing the thorlabs motors, do you 
want to proceed without homing them
and hope for the best?
(WARNING: some functionalities might
be compromized, ONLY ADVANCED USERS)"""
        call "General Failed Loop Prompt.gvi"(Call to Action Message=w12, Call To Action True / Left Answer="Yes please, I like to live dangerously", Call To Action False / Center Answer="Oh dear no, I'd rather ask for help", General Failed Loop Prompt Call to Action Selector="Two Button Action", Succesful loop?=w3, Failed Loop Message=w11, Failed Loop Messager Response="Okay I will", Error In=w10, Call to action Iterations=2, Loop Iterations=i1) -> (Call To Action Boolean Answer=w13, Error Out=w1)
        Logical Or(w3, w13) -> w14
        stop if w14
      }
      Property Node(instance in=w6, "Thorlabs Motors Serial Number:Blue Motor Homed?"=w7, "Thorlabs Motors Serial Number:Red Motor Homed?"=w9) -> (instance out=w2)
    }
  }
  $"Homed?" <- w3
  $"Instrument Coms Info Out" <- w2
  $"Error Out" <- w1
