vi "KCube Motors Move to Position.gvi"   [LabVIEW NXG 5.0.0]
inputs:
  "Error In": error
  "Blue Motor Position to move to (mm)": f64
  "Instrument Control Mega Cluster In": "Instrument Control Mega Cluster.gtype"
  "Red Motor Position to move to (mm)": f64
outputs:
  "Error Out": error
  "Instrument Control Mega Cluster Out": "Instrument Control Mega Cluster.gtype"
types:
  "Instrument Coms Info.gtype" = cluster{"Arduino Coms Info": "Arduino Detection cluster control.gtype", "Photodetector Names": string[], "Keythley Address": "VISA Instr", "Photodetector Detected?": bool, "Thorlabs Motors Detected?": bool, "Keithley Detected?": bool, "Thorlabs Motors Serial Number": "Thorlabs Motors Serial Number In.gtype", "Photodetector IVI session": "Ivi IviDefault", "Flame ID": string, "Flame Detected?": bool, "Flame Wrapper ID": u64}
  "Debugging Cluster.gtype" = cluster{"Debugging mode?": bool, "Initialize App": bool, "Insturment Debugging": "Insturment Debugging Cluster.gtype"}
  "Instrument Control Mega Cluster.gtype" = cluster{"Instruments Coms Info": "Instrument Coms Info.gtype", "Debugging Cluster": "Debugging Cluster.gtype"}
uses:
  NXG_KCube_DC_Servo_Control::Utilities::Move To Position.gvi
diagram:
  # This SubVI Writes the desired position onto the motors
  case ($"Error In") {
    frame Error, Default {
      w1 = $"Error In"
      w2 = $"Instrument Control Mega Cluster In"
    }
    frame No Error {
      Property Node(instance in=$"Instrument Control Mega Cluster In") -> ("Instruments Coms Info:Thorlabs Motors Serial Number:Thorlabs Blue Motor"=w3, "Instruments Coms Info:Thorlabs Motors Serial Number:Thorlabs Red Motor"=w4, instance out=w2)
      call "Move To Position.gvi"(Motor Serial Number In=w3, Position to move in mm=$"Blue Motor Position to move to (mm)", Error In=$"Error In") -> (Error Out=w5)
      call "Move To Position.gvi"(Motor Serial Number In=w4, Position to move in mm=$"Red Motor Position to move to (mm)", Error In=w5) -> (Error Out=w1)
    }
  }
  $"Instrument Control Mega Cluster Out" <- w2
  $"Error Out" <- w1
