vi "KCube Move to 0 or Home.gvi"   [LabVIEW NXG 5.0.0]
inputs:
  "Error In": error
  "Instrument Control Mega Cluster In": "Instrument Control Mega Cluster.gtype"
  "Close After Homing?": bool
outputs:
  "Error Out": error
  "Instrument Control Mega Cluster Out": "Instrument Control Mega Cluster.gtype"
types:
  "Instrument Coms Info.gtype" = cluster{"Arduino Coms Info": "Arduino Detection cluster control.gtype", "Photodetector Names": string[], "Keythley Address": "VISA Instr", "Photodetector Detected?": bool, "Thorlabs Motors Detected?": bool, "Keithley Detected?": bool, "Thorlabs Motors Serial Number": "Thorlabs Motors Serial Number In.gtype", "Photodetector IVI session": "Ivi IviDefault", "Flame ID": string, "Flame Detected?": bool, "Flame Wrapper ID": u64}
  "Debugging Cluster.gtype" = cluster{"Debugging mode?": bool, "Initialize App": bool, "Insturment Debugging": "Insturment Debugging Cluster.gtype"}
  "Instrument Control Mega Cluster.gtype" = cluster{"Instruments Coms Info": "Instrument Coms Info.gtype", "Debugging Cluster": "Debugging Cluster.gtype"}
uses:
  Rainbow Measurement Setup::Main Functions::Instruction Queue::Current State::FGV Current State.gvi
  Rainbow Measurement Setup::Side Functions::Instrument Control::Thorlabs Motors::Movement::KCube Motors Initialize.gvi
  Rainbow Measurement Setup::Side Functions::Instrument Control::Thorlabs Motors::Movement::KCube Motors Move to Position.gvi
  Rainbow Measurement Setup::Side Functions::Instrument Control::Thorlabs Motors::Movement::KCube Motors Home sequence.gvi
  Rainbow Measurement Setup::Side Functions::Instrument Control::Thorlabs Motors::Movement::KCube Motors Close.gvi
diagram:
  # This subVI moves the motors to 0 or homes them in case they are not homed yet
  # to reset the position of the guillotine.
  # It also checks if the debugging is on and if the user wants to use the motors or not
  case ($"Error In") {
    frame Error, Default {
      w1 = $"Error In"
      w2 = $"Instrument Control Mega Cluster In"
    }
    frame No Error {
      Property Node(instance in=$"Instrument Control Mega Cluster In") -> ("Debugging Cluster:Debugging mode?"=w3, "Debugging Cluster:Insturment Debugging:Thorlabs Motors"=w4, instance out=w5)
      Logical And[output inverted](w3, not w4) -> w6
      case (w6) {
        frame False, Default {
          w1 = $"Error In"
          w2 = w5
        }
        frame True {
          Property Node(instance in=w5) -> ("Instruments Coms Info:Thorlabs Motors Serial Number:Blue Motor Homed?"=w7, "Instruments Coms Info:Thorlabs Motors Serial Number:Red Motor Homed?"=w8, instance out=w9)
          call "FGV Current State.gvi"(Current State Instructions="Set Current Substate", Current Substate="Initializing KCube Motors", Error In=$"Error In") -> (Error Out=w10)
          call "KCube Motors Initialize.gvi"(Instrument Control Mega Cluster In=w9, Error In=w10) -> (Instrument Control Mega Cluster Out=w11, Error Out=w12)
          Logical And(w7, w8) -> w13
          case (w13) {
            frame True {
              call "KCube Motors Move to Position.gvi"(Instrument Control Mega Cluster In=w11, Blue Motor Position to move to (mm)=50, Red Motor Position to move to (mm)=50, Error In=w12) -> (Instrument Control Mega Cluster Out=w14, Error Out=w15)
            }
            frame False {
              call "KCube Motors Home sequence.gvi"(Instrument Control Mega Cluster In=w11, Error In=w12, Home to Max?=TRUE, Move Away from 0?=TRUE) -> (Instrument Control Mega Cluster Out=w14, Error Out=w15)
            }
          }
          case ($"Close After Homing?") {
            frame False, Default {
              w2 = w14
              w1 = w15
            }
            frame True {
              call "KCube Motors Close.gvi"(Instrument Control Mega Cluster In=w14, Error In=w15) -> (Instrument Control Mega Cluster Out=w2, Error Out=w1)
            }
          }
        }
      }
    }
  }
  $"Instrument Control Mega Cluster Out" <- w2
  $"Error Out" <- w1
