vi "Initializing app prompt.gvi"   [LabVIEW NXG 5.0.0]
inputs:
  "Error In": error
outputs:
  "Error Out": error
panel indicators:
  "Linear Progress Bar": f64
  "sin": f64
  "SubStates": string[]
  "States": "Queue Instructions Control.gtype"[]
  "Current SubState Out": string
types:
  "Queue Instructions Control.gtype" = enum{"Undefined State", "Initialize App", "Idle", "Light Calibration Irradiance", "Light Calibration Spectral Density", "Light Calibration Power Density", "Access TXT File", "Stop App"}
uses:
  Rainbow Measurement Setup::Main Functions::Instruction Queue::Current State::FGV Current State.gvi
  Rainbow Measurement Setup::Side Functions::Messages And Prompts::Beating Star.gvi
diagram:
  Property Node(instance in=reference to unnamed native front panel, error in=$"Error In") -> ("Window"=w1, error out=w2)
  Open Window(reference in=w1, error in=w2) -> (reference out=w3, error out=w4)
  # This loop checks the current state and poorly advances a horizontal progress bar while displaying the current state and
  # substate
  s1 = uninitialised  # shift register
  s2 = 0  # shift register
  s3 = uninitialised  # shift register
  s4 = 0  # shift register
  while (iteration -> i1) {
    Wait Until Next Multiple(multiple to wait=50)
    Increment(x=s2) -> w7
    call "FGV Current State.gvi"(Current State Instructions="Read Current State and Substate", Error In=w4) -> (Current State Out=w8, Current SubState Out=w9, Error Out=w10)
    Is Not Equal(x=w9, y=s3) -> w11
    Select(s=w11, t=w7, f=s2) -> w12
    call "Beating Star.gvi"(Input=reference to unnamed path, loop iteration=i1, Speed Divider=10) -> (sin=w13)
    $sin <- w13
    Is Not Equal(x=w8, y=s1) -> w14
    Multiply(s2, 25) -> w15
    Increment(x=s4) -> w16
    Add(w15, 25) -> w17
    In Range And Coerce(lower limit=0, upper limit=w17, x=w16) -> (coerced(x)=w18)
    Select(s=w11, t=w15, f=w18) -> w19
    $"Linear Progress Bar" <- w19
    $"Current SubState Out" <- w9
    Is Greater(x=i1, y=20000) -> w20
    Is Equal(x=w8, y="Idle") -> w21
    Logical Or(w20, w21) -> w22
    append w8 to w5 if w14
    append w9 to w6 if w11
    next s1 = w8
    next s2 = w12
    next s3 = w9
    next s4 = w19
    stop if w22
  }
  $States <- w5
  Close Window(reference in=w3, error in=w10) -> (error out=w23)
  $"Error Out" <- w23
  $SubStates <- w6
