vi "Select path prompt.gvi"   [LabVIEW NXG 5.0.0]
inputs:
  "Main Message": string = "Please specify a path"
  "Sub message": string = "Somebody forgot to program which path it was"
  "Error In": error
outputs:
  "Error Out": error
  "New Path": path
panel controls:
  "Path where to save files": path
  "Okay": bool
diagram:
  case ($"Error In") {
    frame Error, Default {
      w1 = $"Error In"
    }
    frame No Error {
      Is Empty String Or Path(string/path=$"Sub message") -> w2
      Select(s=w2, t="Somebody forgot to program which path it was", f=$"Sub message") -> w3
      Property Node(instance in=reference to unnamed text, "Text"=w3, error in=$"Error In") -> (error out=w4)
      Is Empty String Or Path(string/path=$"Main Message") -> w5
      Select(s=w5, t="Please specify a path", f=$"Main Message") -> w6
      Property Node(instance in=reference to unnamed text, "Text"=w6, error in=w4) -> (error out=w7)
      Property Node(instance in=reference to unnamed native front panel, error in=w7) -> ("Window"=w8, error out=w9)
      Open Window(reference in=w8, error in=w9) -> (reference out=w10, error out=w11)
      while {
        w12 = $"Path where to save files"
        Is Empty String Or Path(string/path=w12) -> w13
        Not(x=w13) -> w14
        Logical And(w14, $Okay) -> w15
        Logical And(w13, $Okay) -> w16
        case (w16) {
          frame False, Default { }
          frame True {
            One Button Dialog(button name ("OK")="Oh sorry, I wanted to save\nmy files in the void of space", message="The path cannot be EMPTY,\nthanks:)")
          }
        }
        Wait Until Next Multiple(multiple to wait=50)
        stop if w15
      }
      $"New Path" <- w12
      Close Window(reference in=w10, error in=w11) -> (error out=w1)
    }
  }
  $"Error Out" <- w1
