vi "Measurement File Header Generator.gvi"   [LabVIEW NXG 5.0.0]
inputs:
  "Error In": error
  "Measurement File Type": "Measurement File Type.gtype" = "Single Cell Rainbow"
  "Variable Header Info": string
outputs:
  "Error Out": error
  "Header Items": string[]
types:
  "Measurement File Type.gtype" = enum{"Single Cell Rainbow", "Multiple Cell Rainbow", "Light Calibration Power", "Light Calibration Spectral Density", "Light Calibration Power Density", "Light Calibration Dividing Wavelength Spectrum", "Dividing Wavelength To Motor Position"}
diagram:
  # This SubVi generates the headers for the savefiles of each type of measurement file
  case ($"Error In") {
    frame Error, Default {
      w1 = $"Error In"
    }
    frame No Error {
      case ($"Measurement File Type") {
        frame "Single Cell Rainbow", Default {
          w2 = ["Dividing Wavelength (nm)", "", ""]
        }
        frame "Light Calibration Power" {
          Build Array(["Dividing Wavelength (nm)", "Power (W)"], $"Variable Header Info") -> w2
        }
        frame "Multiple Cell Rainbow" {
          w2 = ["Dividing Wavelength (nm)", "", ""]
        }
        frame "Light Calibration Spectral Density" {
          w2 = ["Dividing Wavelength (nm)", "", ""]
        }
        frame "Light Calibration Dividing Wavelength Spectrum" {
          Build Array(["Dividing Wavelength (nm)", "Counts (n)"], $"Variable Header Info") -> w2
        }
        frame "Dividing Wavelength To Motor Position" {
          w3 = ["Dividing Wavelength (nm)", "Blue Motor Position (mm)", "Red Motor Position (mm)"]
          w2 = w3
        }
        frame "Light Calibration Power Density" {
          w2 = ["Dividing Wavelength (nm)", "", ""]
        }
      }
      $"Header Items" <- w2
      w1 = $"Error In"
    }
  }
  $"Error Out" <- w1
