vi "Path Check & Generation.gvi"   [LabVIEW NXG 5.0.0]
inputs:
  "Error In": error
  "Default Data Saving Location": path
  "Measurement File Type": "Measurement File Type.gtype" = "Single Cell Rainbow Raw"
  "Cell Naming Cluster": "Cell Naming Cluster.gtype"
  "Filename to load/save": path
  "Rainbow Sweep Types": "Rainbow Sweep Types.gtype" = "Red Sweep Closing"
outputs:
  "Error Out": error
  "File path": path
  "Folder to save data": path
types:
  "Measurement File Type.gtype" = enum{"Single Cell Rainbow Raw", "Single Cell Rainbow Refined", "Multiple Cell Rainbow Raw", "Multiple Cell Rainbow Refined", "Light Calibration Power", "Light Calibration Spectral Density", "Light Calibration Power Density", "Light Calibration Dividing Wavelength Spectrum", "Dividing Wavelength To Motor Position"}
  "Cell Naming Cluster.gtype" = cluster{"Cell Label": string, "Sample Prefix": string, "Author Initials": string, "Current Date": string, "Batch Name": string}
  "Rainbow Sweep Types.gtype" = enum{"Red Sweep Closing", "Red Sweep Opening", "Blue Sweep Closing", "Blue Sweep Opening"}
uses:
  NI::G Core::File IO (General)::Check if File or Folder Exists.gvi
  Rainbow Measurement Setup::Side Functions::Messages And Prompts::Select path prompt.gvi
  Rainbow Measurement Setup::Side Functions::Path Manipulation::Create or Open Folder.gvi
  Rainbow Measurement Setup::Side Functions::Sample Naming::txt Extension adder.gvi
  NI::G Core::File IO (General)::Create Directory Recursive.gvi
diagram:
  # This SubVI Generates the file paths and filenames for the different types of files that will be saved
  case ($"Error In") {
    frame Error, Default {
      w1 = $"Error In"
      w2 = default
      w3 = $"Default Data Saving Location"
    }
    frame No Error {
      case ($"Measurement File Type") {
        frame "Single Cell Rainbow Raw", Default {
          call "Check if File or Folder Exists.gvi"(file or folder=$"Default Data Saving Location", error in=$"Error In") -> (file or folder exists?=w4, error out=w5)
          Is Empty String Or Path(string/path=$"Default Data Saving Location") -> w6
          Logical Or(w6, not w4) -> w7
          case (w7) {
            frame False {
              w3 = $"Default Data Saving Location"
              w8 = w5
            }
            frame True {
              w9 = "Please specify the path where you want to save all your measurements:"
              call "Select path prompt.gvi"(Main Message=w9, Sub message="Sub paths with your name, date and device will be created", Error In=w5) -> (New Path=w3, Error Out=w8)
            }
          }
          Format Into String(errIn=w8, $"Rainbow Sweep Types") -> (outString=w10, errOut=w11)
          Concatenate Strings(w10, " Raw IV Curves") -> w12
          Property Node(instance in=$"Cell Naming Cluster") -> ("Author Initials"=w13, "Current Date"=w14, "Batch Name"=w15, "Sample Prefix"=w16, "Cell Label"=w17)
          Concatenate Strings("Device ", w15) -> w18
          call "Create or Open Folder.gvi"(Folder Root Path=w3, Folder Name=w13, Error In=w11) -> (New Folder's Path=w19, Error Out=w20)
          call "Create or Open Folder.gvi"(Folder Root Path=w19, Folder Name=w14, Error In=w20) -> (New Folder's Path=w21, Error Out=w22)
          call "Create or Open Folder.gvi"(Folder Root Path=w21, Folder Name=w18, Error In=w22) -> (New Folder's Path=w23, Error Out=w24)
          call "Create or Open Folder.gvi"(Folder Root Path=w23, Folder Name="TXT files", Error In=w24) -> (New Folder's Path=w25, Error Out=w26)
          call "Create or Open Folder.gvi"(Folder Root Path=w25, Folder Name=w17, Error In=w26) -> (New Folder's Path=w27, Error Out=w28)
          call "Create or Open Folder.gvi"(Folder Root Path=w27, Folder Name=w12, Error In=w28) -> (New Folder's Path=w29, Error Out=w30)
          call "txt Extension adder.gvi"(Name without .txt=w16, Error In=w30) -> (Name with .txt=w31, Error Out=w1)
          Build Path(base path=w29, name or relative path=w31) -> (appended path=w2)
        }
        frame "Single Cell Rainbow Refined" {
          Property Node(instance in=$"Cell Naming Cluster") -> ("Author Initials"=w32, "Current Date"=w33, "Batch Name"=w34, "Cell Label"=w35, "Sample Prefix"=w36)
          call "Check if File or Folder Exists.gvi"(file or folder=$"Default Data Saving Location", error in=$"Error In") -> (file or folder exists?=w37, error out=w38)
          Is Empty String Or Path(string/path=$"Default Data Saving Location") -> w39
          Logical Or(w39, not w37) -> w40
          case (w40) {
            frame False {
              w3 = $"Default Data Saving Location"
              w41 = w38
            }
            frame True {
              w42 = "Please specify the path where you want to save all your measurements:"
              call "Select path prompt.gvi"(Main Message=w42, Sub message="Sub paths with your name, date and device will be created", Error In=w38) -> (New Path=w3, Error Out=w41)
            }
          }
          Format Into String(errIn=w41, $"Rainbow Sweep Types") -> (outString=w43, errOut=w44)
          call "Create or Open Folder.gvi"(Folder Root Path=w3, Folder Name=w32, Error In=w44) -> (New Folder's Path=w45, Error Out=w46)
          call "Create or Open Folder.gvi"(Folder Root Path=w45, Folder Name=w33, Error In=w46) -> (New Folder's Path=w47, Error Out=w48)
          Concatenate Strings("Device ", w34) -> w49
          call "Create or Open Folder.gvi"(Folder Root Path=w47, Folder Name=w49, Error In=w48) -> (New Folder's Path=w50, Error Out=w51)
          call "Create or Open Folder.gvi"(Folder Root Path=w50, Folder Name="TXT files", Error In=w51) -> (New Folder's Path=w52, Error Out=w53)
          call "Create or Open Folder.gvi"(Folder Root Path=w52, Folder Name=w35, Error In=w53) -> (New Folder's Path=w54, Error Out=w55)
          Concatenate Strings(w36, w35, ".", w43) -> w56
          call "txt Extension adder.gvi"(Name without .txt=w56, Error In=w55) -> (Name with .txt=w57, Error Out=w1)
          Build Path(base path=w54, name or relative path=w57) -> (appended path=w2)
        }
        frame "Light Calibration Power" {
          Property Node(instance in=$"Cell Naming Cluster") -> ("Author Initials"=w58, "Current Date"=w59, "Batch Name"=w60, "Sample Prefix"=w61)
          call "Check if File or Folder Exists.gvi"(file or folder=$"Default Data Saving Location", error in=$"Error In") -> (file or folder exists?=w62, error out=w63)
          Is Empty String Or Path(string/path=$"Default Data Saving Location") -> w64
          Logical Or(w64, not w62) -> w65
          case (w65) {
            frame False {
              w3 = $"Default Data Saving Location"
              w66 = w63
            }
            frame True {
              w67 = "Please specify the path where you want to save all your measurements:"
              call "Select path prompt.gvi"(Main Message=w67, Sub message="Sub paths with your name, date and device will be created", Error In=w63) -> (New Path=w3, Error Out=w66)
            }
          }
          Format Into String(errIn=w66, $"Rainbow Sweep Types") -> (outString=w68, errOut=w69)
          call "Create or Open Folder.gvi"(Folder Root Path=w3, Folder Name=w58, Error In=w69) -> (New Folder's Path=w70, Error Out=w71)
          call "Create or Open Folder.gvi"(Folder Root Path=w70, Folder Name=w59, Error In=w71) -> (New Folder's Path=w72, Error Out=w73)
          Concatenate Strings("Device ", w60) -> w74
          call "Create or Open Folder.gvi"(Folder Root Path=w72, Folder Name=w74, Error In=w73) -> (New Folder's Path=w75, Error Out=w76)
          call "Create or Open Folder.gvi"(Folder Root Path=w75, Folder Name="TXT files", Error In=w76) -> (New Folder's Path=w77, Error Out=w78)
          Concatenate Strings(w61, "Power_Calibration_", w68) -> w79
          call "txt Extension adder.gvi"(Name without .txt=w79, Error In=w78) -> (Name with .txt=w80, Error Out=w1)
          Build Path(base path=w77, name or relative path=w80) -> (appended path=w2)
        }
        frame "Light Calibration Spectral Density" {
          Get Component Directory() -> (Path=w81)
          Strip Path(path=w81) -> (stripped path=w82)
          Build Path(base path=w82, name or relative path="Extra installers\\Calibration_Files") -> (appended path=w83)
          call "Check if File or Folder Exists.gvi"(file or folder=w83, error in=$"Error In") -> (file or folder exists?=w84, error out=w85)
          Is Empty String Or Path(string/path=w83) -> w86
          Logical Or(w86, not w84) -> w87
          case (w87) {
            frame False {
              w3 = w83
              w88 = w85
            }
            frame True {
              call "Create Directory Recursive.gvi"(folder=w83, error in=w85) -> (error out=w88)
              w3 = w83
            }
          }
          call "txt Extension adder.gvi"(Name without .txt="Spectral_Density_Calibration", Error In=w88) -> (Name with .txt=w89, Error Out=w1)
          Build Path(base path=w3, name or relative path=w89) -> (appended path=w2)
        }
        frame "Light Calibration Power Density" {
          Get Component Directory() -> (Path=w90)
          Strip Path(path=w90) -> (stripped path=w91)
          Build Path(base path=w91, name or relative path="Extra installers\\Calibration_Files") -> (appended path=w92)
          call "Check if File or Folder Exists.gvi"(file or folder=w92, error in=$"Error In") -> (file or folder exists?=w93, error out=w94)
          Is Empty String Or Path(string/path=w92) -> w95
          Logical Or(w95, not w93) -> w96
          case (w96) {
            frame False {
              w3 = w92
              w97 = w94
            }
            frame True {
              call "Create Directory Recursive.gvi"(folder=w92, error in=w94) -> (error out=w97)
              w3 = w92
            }
          }
          call "txt Extension adder.gvi"(Name without .txt="Power_Density_Calibration", Error In=w97) -> (Name with .txt=w98, Error Out=w1)
          Build Path(base path=w3, name or relative path=w98) -> (appended path=w2)
        }
        frame "Light Calibration Dividing Wavelength Spectrum" {
          Strip Path(path=$"Filename to load/save") -> (stripped path=w3)
          w1 = $"Error In"
          w2 = $"Filename to load/save"
        }
        frame "Dividing Wavelength To Motor Position" {
          Get Component Directory() -> (Path=w99)
          Strip Path(path=w99) -> (stripped path=w100)
          Build Path(base path=w100, name or relative path="Extra installers\\Calibration_Files\\Div_Wav_To_Motor_Pos") -> (appended path=w101)
          call "Check if File or Folder Exists.gvi"(file or folder=w101, error in=$"Error In") -> (file or folder exists?=w102, error out=w103)
          Is Empty String Or Path(string/path=w101) -> w104
          Logical Or(w104, not w102) -> w105
          case (w105) {
            frame False {
              w3 = w101
              w106 = w103
            }
            frame True {
              call "Create Directory Recursive.gvi"(folder=w101, error in=w103) -> (error out=w106)
              w3 = w101
            }
          }
          call "txt Extension adder.gvi"(Name without .txt="Dividing Wavelength To Motor Position Calibration File", Error In=w106) -> (Name with .txt=w107, Error Out=w1)
          Build Path(base path=w3, name or relative path=w107) -> (appended path=w2)
        }
      }
    }
  }
  $"Folder to save data" <- w3
  $"File path" <- w2
  $"Error Out" <- w1
