vi "Rename Window.gvi"   [LabVIEW NXG 3.1.0]
inputs:
  "Error In": error
  "Original Filename": string = "Input your new filename"
outputs:
  "Output": string
  "Error Out": error
panel controls:
  "Filename:": string
  "Okay button": bool
  "Reset Button": bool
diagram:
  case ($"Error In") {
    frame Error, Default {
      w1 = $"Error In"
    }
    frame No Error {
      # We store the original filename
      # And set the current one as the
      # original
      # We first open the prompt window separately
      Property Node(instance in=reference to unnamed native front panel, error in=$"Error In") -> ("Window"=w2, error out=w3)
      Open Window(reference in=w2, error in=w3, modal=TRUE) -> (reference out=w4, error out=w5)
      Property Node(instance in=reference to "Filename:", "Value"=$"Original Filename", error in=w5) -> (error out=w6)
      while {
        Wait Until Next Multiple(multiple to wait=50)
        w7 = $"Filename:"
        for {
          w8 = each element of ["/", "\\", "*", ":", "?", "\"", ">", "<", "|"]
          # We erase any non accepted characters before outputting the
          # filename
          Search And Replace String(error in (no error)=w6, input string=w7, replace all (F)=TRUE, search string=w8) -> (error out=w9, result string=w10)
        }
        Select(s=$"Reset Button", t=$"Original Filename", f=w10) -> w11
        Is Not Equal(x=w11, y=$"Original Filename") -> w12
        Not(x=w12) -> w13
        Logical And(w13, $"Okay button") -> w14
        case (w14) {
          frame False, Default { }
          frame True {
            One Button Dialog(button name ("OK")="Oh sorry, I thought this name\nwas different :O", message="Renaming the file means you \nhave to change the name :')")
          }
        }
        Is Empty String Or Path(string/path=w11) -> w15
        Logical And($"Okay button", w15) -> w16
        # We prompt the user if the provided filenames are
        # not acceptable
        case (w16) {
          frame False, Default { }
          frame True {
            w17 = "Oh sorry, I thought an empty \nfilename was completely acceptable\nand not :O"
            w18 = "Renaming the file means you \nhave to change the name not \ncompletely erase it :')"
            One Button Dialog(button name ("OK")=w17, message=w18)
          }
        }
        Property Node(instance in=reference to "Filename:", "Value"=w11, error in=w9) -> (error out=w19)
        Logical And($"Okay button", w12) -> w20
        stop if w20
      }
      String Length(string=w11) -> (length=w21)
      Subtract(x=w21, y=4) -> w22
      Replace Substring(length (len. of substring)=4, offset=w22, string=w11) -> (replaced substring=w23)
      Is Not Equal(x=w23, y=".txt") -> w24
      # If the filename does not contain extension
      # we add the extension automatically
      case (w24) {
        frame False, Default {
          w25 = w11
        }
        frame True {
          Concatenate Strings(w11, ".txt") -> w25
        }
      }
      $Output <- w25
      Close Window(reference in=w4, error in=w19) -> (error out=w1)
    }
  }
  $"Error Out" <- w1
