vi "Rainbow Sweep Param Generator.gvi"   [LabVIEW NXG 5.0.0]
inputs:
  "Error In": error
  "Rainbow Sweep Parameters": "Rainbow Sweep Param Selector.gtype" = {0, 1100, 300, 1, 1, 0}
outputs:
  "Error Out": error
  "Rainbow Sweep Parameters Array": "Rainbow Sweep Parameters.gtype"[]
types:
  "Rainbow Sweep Types.gtype" = enum{"Red Sweep Closing", "Red Sweep Opening", "Blue Sweep Closing", "Blue Sweep Opening"}
  "Rainbow Sweep Parameters.gtype" = cluster{"Dividing Wavelength Array": f64[], "Rainbow Sweep Types": "Rainbow Sweep Types.gtype"}
  "Raibow Sweep Selector.gtype" = enum{"Red Sweep", "Blue Sweep", "Full Sweep Red First", "Full Sweep Blue First"}
  T1 = enum{"Red Sweep Closing", "Red Sweep Opening", "Red Sweep Both Ways"}
  T2 = enum{"Blue Sweep Opening", "Blue Sweep Closing", "Blue Sweep Both Ways"}
  "Rainbow Sweep Type Selector.gtype" = cluster{"Red Sweep Mode": T1, "Blue Sweep Mode": T2}
  "Rainbow Sweep Param Selector.gtype" = cluster{"Raibow Sweep Selector": "Raibow Sweep Selector.gtype", "Max Wavelength (nm)": f64, "Min Wavelength (nm)": f64, "Wavelength Step (nm)": f64, "Rainbow Sweep Type Selector": "Rainbow Sweep Type Selector.gtype"}
uses:
  Rainbow Measurement Setup::Side Functions::Rainbow Sweep::Rainbow Sweep Type Extractor.gvi
diagram:
  # This SubVI Takes the desired wavelength range as well as the wavelength steps and the type of Rainbow Sweep that we want to perform and it outputs an array
  # that contains a cluster with the dividing wavelength array as well as the type of Rainbow sweep. It is an array because we might want to perform more than one sweep
  # per measurement.
  case ($"Error In") {
    frame Error, Default {
      w1 = $"Error In"
      w2 = default
    }
    frame No Error {
      Property Node(instance in=$"Rainbow Sweep Parameters") -> ("Max Wavelength (nm)"=w3, "Min Wavelength (nm)"=w4, "Wavelength Step (nm)"=w5, instance out=w6)
      In Range And Coerce[IncludeHighLimit=True](lower limit=0.1, upper limit=100, x=w5) -> (coerced(x)=w7)
      Subtract(x=w3, y=w4) -> w8
      Absolute Value(x=w8) -> w9
      Divide(x=w9, y=w7) -> w10
      Round Toward Negative Infinity(x=w10) -> w11
      Increment(x=w11) -> w12
      call "Rainbow Sweep Type Extractor.gvi"(Rainbow Sweep Parameters=w6, Error In=$"Error In") -> (Rainbow Sweep Array=w13, Error Out=w14)
      To Signed 32 Bit Integer(number=w12) -> w15
      s1 = w14  # shift register
      for {
        w16 = each element of w13
        # w3: Max Wavelength
        # w4: Min Wavelength
        # w12: Ammount of Steps
        # w7: Wavelength Step
        case (w16) {
          frame "Red Sweep Opening", Default {
            for (N = w15) (iteration -> i1) {
              To Double Precision Float(number=i1) -> w19
              Multiply(w7, w19) -> w20
              Subtract(x=w3, y=w20) -> w21
              append w21 to w18
            }
            Property Node(instance in="Rainbow Sweep Parameters.gtype" {all zero or empty}, "Dividing Wavelength Array"=w18, "Rainbow Sweep Types"=w16) -> (instance out=w17)
          }
          frame "Red Sweep Closing" {
            for (N = w15) (iteration -> i2) {
              To Double Precision Float(number=i2) -> w23
              Multiply(w7, w23) -> w24
              Add(w4, w24) -> w25
              append w25 to w22
            }
            Property Node(instance in="Rainbow Sweep Parameters.gtype" {all zero or empty}, "Dividing Wavelength Array"=w22, "Rainbow Sweep Types"=w16) -> (instance out=w17)
          }
          frame "Blue Sweep Closing" {
            for (N = w15) (iteration -> i3) {
              To Double Precision Float(number=i3) -> w27
              Multiply(w7, w27) -> w28
              Subtract(x=w3, y=w28) -> w29
              append w29 to w26
            }
            Property Node(instance in="Rainbow Sweep Parameters.gtype" {all zero or empty}, "Dividing Wavelength Array"=w26, "Rainbow Sweep Types"=w16) -> (instance out=w17)
          }
          frame "Blue Sweep Opening" {
            for (N = w15) (iteration -> i4) {
              To Double Precision Float(number=i4) -> w31
              Multiply(w7, w31) -> w32
              Add(w4, w32) -> w33
              append w33 to w30
            }
            Property Node(instance in="Rainbow Sweep Parameters.gtype" {all zero or empty}, "Dividing Wavelength Array"=w30, "Rainbow Sweep Types"=w16) -> (instance out=w17)
          }
        }
        append w17 to w2
      }
      w1 = s1
    }
  }
  $"Error Out" <- w1
  $"Rainbow Sweep Parameters Array" <- w2
