vi "Rainbow Sweep Type Extractor.gvi"   [LabVIEW NXG 5.0.0]
inputs:
  "Error In": error
  "Rainbow Sweep Parameters": "Rainbow Sweep Param Selector.gtype"
outputs:
  "Error Out": error
  "Rainbow Sweep Array": "Rainbow Sweep Types.gtype"[]
types:
  "Raibow Sweep Selector.gtype" = enum{"Red Sweep", "Blue Sweep", "Full Sweep Red First", "Full Sweep Blue First"}
  "Rainbow Sweep Type Selector.gtype" = cluster{"Red Sweep Mode": enum{"Red Sweep Closing", "Red Sweep Opening"}, "Blue Sweep Mode": enum{"Blue Sweep Opening", "Blue Sweep Closing"}}
  "Rainbow Sweep Param Selector.gtype" = cluster{"Raibow Sweep Selector": "Raibow Sweep Selector.gtype", "Max Wavelength (nm)": f64, "Min Wavelength (nm)": f64, "Wavelength Step (nm)": f64, "Rainbow Sweep Types": "Rainbow Sweep Type Selector.gtype"}
  "Rainbow Sweep Types.gtype" = enum{"Red Sweep Closing", "Red Sweep Opening", "Blue Sweep Closing", "Blue Sweep Opening"}
diagram:
  # This SubVI Extracts all the Sweeping Modes From the Rainbow Sweep parameter and assembles an array so that the measurement
  # is performed on the specified order
  case ($"Error In") {
    frame Error, Default {
      w1 = $"Error In"
    }
    frame No Error {
      Property Node(instance in=$"Rainbow Sweep Parameters") -> ("Raibow Sweep Selector"=w2, "Rainbow Sweep Types"=w3)
      Is Equal(x="Red Sweep", y=w2) -> w4
      Is Equal(x=w2, y="Blue Sweep") -> w5
      Is Equal(x=w2, y="Full Sweep Red First") -> w6
      Is Equal(x=w2, y="Full Sweep Blue First") -> w7
      Build Array(w4, w5, w6, w7) -> w8
      Boolean Array To Number(Boolean array=w8) -> (number=w9)
      case (w9) {
        frame 0, Default {
          w10 = "Rainbow Sweep Types.gtype"[] []
        }
        frame 1 {
          Property Node(instance in=w3) -> ("Red Sweep Mode"=w11)
          Is Equal(x="Red Sweep Closing", y=w11) -> w12
          Select(s=w12, t="Red Sweep Closing", f="Red Sweep Opening") -> w13
          Insert Into Array(inArray="Rainbow Sweep Types.gtype"[] [], index0=0, new=w13) -> w10
        }
        frame 2 {
          Property Node(instance in=w3) -> ("Blue Sweep Mode"=w14)
          Is Equal(x="Blue Sweep Opening", y=w14) -> w15
          Select(s=w15, t="Blue Sweep Opening", f="Blue Sweep Closing") -> w16
          Insert Into Array(inArray="Rainbow Sweep Types.gtype"[] [], index0=0, new=w16) -> w10
        }
        frame 4 {
          Property Node(instance in=w3) -> ("Red Sweep Mode"=w17, instance out=w18)
          Property Node(instance in=w18) -> ("Blue Sweep Mode"=w19)
          Is Equal(x="Blue Sweep Opening", y=w19) -> w20
          Select(s=w20, t="Blue Sweep Opening", f="Blue Sweep Closing") -> w21
          Is Equal(x="Red Sweep Closing", y=w17) -> w22
          Select(s=w22, t="Red Sweep Closing", f="Red Sweep Opening") -> w23
          Insert Into Array(inArray="Rainbow Sweep Types.gtype"[] [], index0=0, new=w23) -> w24
          Insert Into Array(inArray=w24, index0=1, new=w21) -> w10
        }
        frame 8 {
          Property Node(instance in=w3) -> ("Red Sweep Mode"=w25, instance out=w26)
          Is Equal(x="Red Sweep Closing", y=w25) -> w27
          Select(s=w27, t="Red Sweep Closing", f="Red Sweep Opening") -> w28
          Property Node(instance in=w26) -> ("Blue Sweep Mode"=w29)
          Is Equal(x="Blue Sweep Opening", y=w29) -> w30
          Select(s=w30, t="Blue Sweep Opening", f="Blue Sweep Closing") -> w31
          Insert Into Array(inArray="Rainbow Sweep Types.gtype"[] [], index0=0, new=w31) -> w32
          Insert Into Array(inArray=w32, index0=1, new=w28) -> w10
        }
      }
      $"Rainbow Sweep Array" <- w10
      w1 = $"Error In"
    }
  }
  $"Error Out" <- w1
