vi "Sample Name Checkup Subroutine.gvi"   [LabVIEW NXG 5.0.0]
inputs:
  "Error In": error
  "Sample Naming Cluster": "Sample Naming Cluster.gtype"
outputs:
  "Error Out": error
  "Sample Prefix": string
  "Current Date": string
  "Label Info Error Label": string
  "Label Info Missing Error": bool
  "Cell Naming Cluster": "Cell Naming Cluster.gtype"
types:
  "Sample Naming Cluster.gtype" = cluster{"Author Initials": string, "Batch Name": string, "Sample Comments": string, "Main Tab control": i32, "Rainbow Measurement tab": i32, "Cell Number": string, "Cell Number ref": "StringControl reference", "Custom date": bool, "Current Date": string, "Current Date ref": "StringControl reference"}
  "Cell Naming Cluster.gtype" = cluster{"Cell Label": string, "Sample Prefix": string, "Author Initials": string, "Current Date": string, "Batch Name": string}
uses:
  Rainbow Measurement Setup::Side Functions::Utilities::Get date as YYMMDD.gvi
  Rainbow Measurement Setup::Side Functions::Sample Naming::Prefix Generator.gvi
diagram:
  Property Node(instance in=$"Sample Naming Cluster") -> ("Author Initials"=w1, "Batch Name"=w2, "Sample Comments"=w3, "Main Tab control"=w4, "Rainbow Measurement tab"=w5, "Cell Number"=w6, "Cell Number ref"=w7, "Custom date"=w8, "Current Date"=w9, "Current Date ref"=w10)
  case ($"Error In") {
    frame Error, Default {
      w11 = $"Error In"
      w12 = default
      w13 = default
      w14 = default
      w15 = default
      w16 = w6
      w17 = w1
      w18 = w2
    }
    frame No Error {
      case (w8) {
        frame True {
          Property Node(instance in=w10, "Disabled"=FALSE, error in=$"Error In") -> (error out=w19)
          w12 = w9
        }
        frame False {
          Property Node(instance in=w10, "Disabled"=TRUE, error in=$"Error In") -> (error out=w20)
          call "Get date as YYMMDD.gvi"(Error In=w20) -> (Date YYMMDD=w12, Error Out=w19)
        }
      }
      Is Equal(x=w4, y=0) -> w21
      Is Equal(x=w5, y=1) -> w22
      Logical And(w21, w22) -> w23
      case (w23) {
        frame False, Default {
          Property Node(instance in=w7, "Disabled"=TRUE, error in=w19) -> (error out=w26)
          w24 = ""
          w25 = FALSE
        }
        frame True {
          Property Node(instance in=w7, "Disabled"=FALSE, error in=w19) -> (error out=w26)
          w24 = w6
          w25 = TRUE
        }
      }
      call "Prefix Generator.gvi"(Author Initials=w1, Current Date=w12, Batch Name=w2, Cell Number=w24, Sample Comments=w3, Error In=w26, Cell number required?=w25) -> (Sample Prefix=w14, Missing Error=w13, Error Label=w15, Error Out=w11)
      w16 = w6
      w17 = w1
      w18 = w2
    }
  }
  Property Node(instance in="Cell Naming Cluster.gtype" {all zero or empty}, "Cell Label"=w16, "Sample Prefix"=w14, "Author Initials"=w17, "Current Date"=w12, "Batch Name"=w18) -> (instance out=w27)
  $"Cell Naming Cluster" <- w27
  $"Current Date" <- w12
  $"Sample Prefix" <- w14
  $"Label Info Missing Error" <- w13
  $"Label Info Error Label" <- w15
  $"Error Out" <- w11
