vi "Scan XZ Coordinate to Gcode.gvi"   [LabVIEW NXG 5.0.0]
inputs:
  "Error In": error
  "XZ Coordinate Array In": "XZ Coordinate Cluster.gtype"[]
outputs:
  "Error Out": error
  "XZ Coordinate Array Out": "XZ Coordinate Cluster.gtype"[]
types:
  "XZ Coordinate Cluster.gtype" = cluster{"X Coordinate": f64, "Z Coordinate": f64, "Coordinate Gcode": string}
diagram:
  # This SubVI converts an XZ Coordinate cluster array into the commands needed to
  # move to all the required coordinates.
  case ($"Error In") {
    frame Error, Default {
      w1 = $"Error In"
      w2 = $"XZ Coordinate Array In"
    }
    frame No Error {
      s1 = $"Error In"  # shift register
      for {
        w3 = each element of $"XZ Coordinate Array In"
        Property Node(instance in=w3) -> ("X Coordinate"=w4, "Z Coordinate"=w5, instance out=w6)
        Number To Fractional String(number=w4, precision (6)=2, use system decimal point (T)=FALSE) -> (F-format string=w7)
        Search And Replace String(error in (no error)=s1, input string=w7, replace string ("")=".", search string=",") -> (error out=w8, result string=w9)
        Number To Fractional String(number=w5, precision (6)=2, use system decimal point (T)=FALSE) -> (F-format string=w10)
        Search And Replace String(input string=w10, replace string ("")=".", search string=",") -> (result string=w11)
        Concatenate Strings("G1 X", w9, " Z", w11) -> w12
        Property Node(instance in=w6, "Coordinate Gcode"=w12) -> (instance out=w13)
        append w13 to w2
        next s1 = w8
      }
      w1 = s1
    }
  }
  $"Error Out" <- w1
  $"XZ Coordinate Array Out" <- w2
