vi "Timeout Sequence.gvi"   [LabVIEW NXG 5.0.0]
inputs:
  "Error In": error
  "Queue In": Queue<"Queue Instructions Control.gtype">
outputs:
  "Error Out": error
  "Current State Out": "Queue Instructions Control.gtype"
  "Current SubState Out": string
  "Stop App?": bool
  "Queue Out": Queue<"Queue Instructions Control.gtype">
types:
  "Queue Instructions Control.gtype" = enum{"Undefined State", "Debug Check", "Initialize App", "Idle", "Light Power Calibration", "Light Calibration Irradiance", "Light Calibration Spectral Density", "Light Calibration Power Density", "MSpot Spectrum Calibration", "Access TXT File", "Stop App"}
uses:
  Rainbow Measurement Setup::Main Functions::Instruction Queue::Current State::FGV Current State.gvi
  Rainbow Measurement Setup::Side Functions::Messages And Prompts::Initializing app prompt.gvi
  Rainbow Measurement Setup::Side Functions::Global Abort::FGV Global Abort.gvi
diagram:
  # It also checks for the Global Abort state. In case the local abort is triggered it flushes the Queue
  # and enqueues an Idle instruction. Otherwise if the Global abort is true it flushes the queue and
  # enqueues a Stop App instruction
  # This is the sequence that executes every 50 ms to check
  # the current state of the application. It outputs the current
  # state and substate and also shows the Initialization prompt
  # when the application is initializing.
  # Finally it checks if the current state is Stop App and outputs
  # the result to stop the master loop.
  case ($"Error In") {
    frame Error, Default {
      w1 = $"Error In"
      w2 = $"Queue In"
    }
    frame No Error {
      call "FGV Current State.gvi"(Current State Instructions="Read Current State and Substate", Error In=$"Error In") -> (Current State Out=w3, Current SubState Out=w4, Error Out=w5)
      Is Equal(x=w3, y="Stop App") -> w6
      Is Equal(x=w3, y="Initialize App") -> w7
      case (w7) {
        frame False, Default {
          w8 = w5
        }
        frame True {
          call "Initializing app prompt.gvi"(Error In=w5) -> (Error Out=w8)
        }
      }
      call "FGV Global Abort.gvi"(Global Abort Instructions="Read Current State", Error In=w8) -> (Local Abort Out=w9, Global Abort Out=w10, Error Out=w11)
      case (w10) {
        frame True {
          Flush Queue(error in=w11, queue=$"Queue In") -> (error out=w13, queue out=w14)
          Enqueue Element At Opposite End(element="Stop App", error in=w13, queue=w14) -> (error out=w1, queue out=w2)
          w12 = TRUE
        }
        frame False {
          case (w9) {
            frame False, Default {
              w1 = w11
              w2 = $"Queue In"
            }
            frame True {
              Flush Queue(error in=w11, queue=$"Queue In") -> (error out=w15, queue out=w16)
              Enqueue Element At Opposite End(element="Idle", error in=w15, queue=w16) -> (error out=w1, queue out=w2)
            }
          }
          w12 = FALSE
        }
      }
      Logical Or(w12, w6) -> w17
      $"Stop App?" <- w17
      $"Current State Out" <- w3
      $"Current SubState Out" <- w4
    }
  }
  $"Queue Out" <- w2
  $"Error Out" <- w1
