vi "Read FGV Data Changed Idle Control Check.gvi"   [LabVIEW NXG 5.0.0]
inputs:
  "Error In": error
  "Misc Data Mega Cluster In": "Misc Data Mega Cluster.gtype"
outputs:
  "Error Out": error
  "Misc Data Mega Cluster Out": "Misc Data Mega Cluster.gtype"
  "Update IV Plot?": bool
  "Update Refined IV Plot?": bool
types:
  "Full Reference Cluster.gtype" = cluster{"Enum Reference Cluster": "Enum Control Reference Cluster.gtype", "Boolean Reference Cluster": "Boolean Control Reference Cluster.gtype", "Numeric Reference Cluster": "Numeric Control Reference Cluster.gtype", "Numeric Cluster Reference Cluster": "Numeric Cluster Reference Cluster.gtype", "Path Reference Cluster": "Path Reference Cluster.gtype", "Cluster Reference Cluster": "Cluster Reference Cluster.gtype", "XZ Stage Controls Reference Cluster": "XZ Stage Controls Reference Cluster.gtype"}
  "Cell Naming Cluster.gtype" = cluster{"Cell Label": string, "Sample Prefix": string, "Author Initials": string, "Current Date": string, "Batch Name": string}
  T1 = cluster{"X Coordinate (mm)": f64, "Z Coordinate (mm)": f64}
  T2 = cluster{"X Coordinate (mm)": f64, "Z Coordinate (mm)": f64, "Vertical Spacing (mm)": f64}
  "XZ All Position Cluster.gtype" = cluster{"Diffusor Coordinates": T1, "Photodetector Coordinates": T1, "Cell R.01 Coordinates": T2}
  T3 = cluster{"Thorlabs Motor Serial Number File Path": path, "Default Data Saving Location": path}
  "Misc Data Mega Cluster.gtype" = cluster{"Full Reference Cluster": "Full Reference Cluster.gtype", "Cell Naming Cluster": "Cell Naming Cluster.gtype", "All XZ Position Cluster": "XZ All Position Cluster.gtype", "All Paths": T3}
diagram:
  # This SubVI Checks if the controls have changed and if so it outputs a true flag so that the graphs update accordingly
  case ($"Error In") {
    frame Error, Default {
      w1 = $"Error In"
      w2 = $"Misc Data Mega Cluster In"
      w3 = default
      w4 = default
    }
    frame No Error {
      s1 = uninitialised  # shift register
      s2 = $"Error In"  # shift register
      s3 = $"Misc Data Mega Cluster In"  # shift register
      s4 = uninitialised  # shift register
      s5 = uninitialised  # shift register
      s6 = uninitialised  # shift register
      s7 = uninitialised  # shift register
      s8 = uninitialised  # shift register
      while {
        Property Node(instance in=s3) -> ("Full Reference Cluster:Enum Reference Cluster:Main Tab"=w5, "Full Reference Cluster:Enum Reference Cluster:Rainbow Measurement tab"=w6, "Full Reference Cluster:Cluster Reference Cluster:SRM Raw Plot Rainbow Sweep Selector"=w7, "Full Reference Cluster:Enum Reference Cluster:SRM Plot Parameter Selector Ref"=w8, "Full Reference Cluster:Cluster Reference Cluster:SRM Refined Plot Rainbow Sweep Types"=w9, "Full Reference Cluster:Cluster Reference Cluster:MRM Cell Refined Plot Selector ref"=w10, "Full Reference Cluster:Cluster Reference Cluster:MRM Current Raw Cell Plot"=w11, "Full Reference Cluster:Cluster Reference Cluster:MRM Raw Plot Rainbow Sweep Relector Ref"=w12, instance out=w13)
        Property Node(instance in=w12, error in=s2) -> ("Value"=w14, error out=w15)
        Is Not Equal(x=w14, y=s8) -> w16
        Property Node(instance in=w11, error in=w15) -> ("Value"=w17, error out=w18)
        Is Not Equal(x=w17, y=s7) -> w19
        Property Node(instance in=w10, error in=w18) -> ("Value"=w20, error out=w21)
        Property Node(instance in=w8, error in=w21) -> ("Value"=w22, error out=w23)
        Property Node(instance in=w9, error in=w23) -> ("Value"=w24, error out=w25)
        Property Node(instance in=w5, error in=w25) -> ("Value"=w26, error out=w27)
        Property Node(instance in=w6, error in=w27) -> ("Value"=w28, error out=w29)
        Property Node(instance in=w7, error in=w29) -> ("Value"=w30, error out=w31)
        Is Not Equal(x=s1, y=w30) -> w32
        Logical Or(w32, w19, w16) -> w3
        Is Not Equal(x=w20, y=s6) -> w33
        Is Not Equal(x=w22, y=s5) -> w34
        Is Not Equal(x=w24, y=s4) -> w35
        Logical Or(w35, w34, w33) -> w36
        Is Equal To 0(x=w26) -> w37
        Is Equal(x=w28, y=2) -> w38
        Logical And(w37, w38, w36) -> w4
        next s1 = w30
        next s2 = w31
        next s3 = w13
        next s4 = w24
        next s5 = w22
        next s6 = w20
        next s7 = w17
        next s8 = w14
        stop if TRUE
      }
      w1 = s2
      w2 = s3
    }
  }
  $"Error Out" <- w1
  $"Update IV Plot?" <- w3
  $"Update Refined IV Plot?" <- w4
  $"Misc Data Mega Cluster Out" <- w2
