vi "Timeout Read FGV Data Subroutine.gvi"   [LabVIEW NXG 5.0.0]
inputs:
  "Misc Data Mega Cluster In": "Misc Data Mega Cluster.gtype"
  "Error In": error
outputs:
  "Misc Data Mega Cluster Out": "Misc Data Mega Cluster.gtype"
  "Error Out": error
types:
  "Full Reference Cluster.gtype" = cluster{"Enum Reference Cluster": "Enum Control Reference Cluster.gtype", "Boolean Reference Cluster": "Boolean Control Reference Cluster.gtype", "Numeric Reference Cluster": "Numeric Control Reference Cluster.gtype", "Numeric Cluster Reference Cluster": "Numeric Cluster Reference Cluster.gtype", "Path Reference Cluster": "Path Reference Cluster.gtype", "Cluster Reference Cluster": "Cluster Reference Cluster.gtype", "XZ Stage Controls Reference Cluster": "XZ Stage Controls Reference Cluster.gtype"}
  "Cell Naming Cluster.gtype" = cluster{"Cell Label": string, "Sample Prefix": string, "Author Initials": string, "Current Date": string, "Batch Name": string}
  T1 = cluster{"X Coordinate (mm)": f64, "Z Coordinate (mm)": f64}
  T2 = cluster{"X Coordinate (mm)": f64, "Z Coordinate (mm)": f64, "Vertical Spacing (mm)": f64}
  "XZ All Position Cluster.gtype" = cluster{"Diffusor Coordinates": T1, "Photodetector Coordinates": T1, "Cell R.01 Coordinates": T2}
  T3 = cluster{"Thorlabs Motor Serial Number File Path": path, "Default Data Saving Location": path}
  "Misc Data Mega Cluster.gtype" = cluster{"Full Reference Cluster": "Full Reference Cluster.gtype", "Cell Naming Cluster": "Cell Naming Cluster.gtype", "All XZ Position Cluster": "XZ All Position Cluster.gtype", "All Paths": T3}
uses:
  Rainbow Measurement Setup::Main Functions::Rainbow Measurement::Cell Single Rainbow Measurement::SRM Live Parameters::SRM Sweep Live Reference Clustering.gvi
  Rainbow Measurement Setup::Main Functions::Rainbow Measurement::Cell Single Rainbow Measurement::SRM Live Parameters::SRM Sweep Live Parameters FGV.gvi
  Rainbow Measurement Setup::Main Functions::Rainbow Measurement::Cell Single Rainbow Measurement::Plotting::SRM Sweep Refined Data FGV.gvi
  Rainbow Measurement Setup::Main Functions::Rainbow Measurement::Cell Multiple Rainbow Measurement::Plotting::MRM Sweep Refined Data FGV.gvi
  Rainbow Measurement Setup::Side Functions::Timeout Subroutines::Read FGV Data Changed Idle Control Check.gvi
  Rainbow Measurement Setup::Main Functions::Rainbow Measurement::Single Multiple Measurement Utilities::FGV Last Measurement Type.gvi
  Rainbow Measurement Setup::Main Functions::Rainbow Measurement::Light Power Calibration::Light Calibration Live Parameters FGV.gvi
diagram:
  # This SubVI Reads the data stored in the FGVs and outputs it so that
  # the graphs and everything can be populated, but it only does during
  # their respective subroutines so that it does not get overwhelmed
  case ($"Error In") {
    frame Error, Default {
      w1 = $"Error In"
      w2 = $"Misc Data Mega Cluster In"
    }
    frame No Error {
      s1 = uninitialised  # shift register
      s1.prev1 = uninitialised  # shift register
      s1.prev2 = uninitialised  # shift register
      s2 = $"Misc Data Mega Cluster In"  # shift register
      while {
        Property Node(instance in=s2) -> ("Full Reference Cluster"=w3, "Full Reference Cluster:Enum Reference Cluster:Current State Ref"=w4, instance out=w5)
        Property Node(instance in=w4, error in=$"Error In") -> ("Value"=w6, error out=w7)
        Is Equal(x=s1, y=s1.prev1) -> w8
        Is Equal(x=s1.prev1, y=s1.prev2) -> w9
        Logical And(w8, w9) -> w10
        Select(s=w10, t=w6, f=s1.prev2) -> w11
        case (w11) {
          frame "Rainbow Single Measurement" {
            call "SRM Sweep Live Reference Clustering.gvi"(Full Reference Cluster=w3) -> (SRM sweep live parameters FGV Cluster Out=w13)
            call "SRM Sweep Live Parameters FGV.gvi"(FGV Instructions="Read State", SRM sweep live parameters FGV Cluster In=w13, Error In=w7) -> (SRM Live Parameters=w14, IV Plot Out=w15, Error Out=w16)
            call "SRM Sweep Refined Data FGV.gvi"(Misc Data Mega Cluster In=w5, Error In=w16, FGV Instructions="Read State") -> (IV Extracted Parameters Plot=w17, Error Out=w18)
            Property Node(instance in=w5) -> ("Full Reference Cluster:Cluster Reference Cluster:Sweep Live Parameters RSM"=w19, "Full Reference Cluster:Cluster Reference Cluster:IV Plot Out Ref"=w20, "Full Reference Cluster:Cluster Reference Cluster:IV Extracted Parameter Plot "=w21, instance out=w12)
            Property Node(instance in=w19, "Value"=w14, error in=w18) -> (error out=w22)
            Property Node(instance in=w20, "Value"=w15, error in=w22) -> (error out=w23)
            Property Node(instance in=w21, "Value"=w17, error in=w23) -> (error out=w1)
          }
          frame "Rainbow Multiple Measurement" {
            call "SRM Sweep Live Reference Clustering.gvi"(Full Reference Cluster=w3) -> (SRM sweep live parameters FGV Cluster Out=w24)
            call "SRM Sweep Live Parameters FGV.gvi"(FGV Instructions="Read State", SRM sweep live parameters FGV Cluster In=w24, Error In=w7) -> (SRM Live Parameters=w25, IV Plot Out=w26, Error Out=w27)
            call "MRM Sweep Refined Data FGV.gvi"(Misc Data Mega Cluster In=w5, Error In=w27, FGV Instructions="Read State") -> (IV Extracted Parameters Plot=w28, Error Out=w29)
            Property Node(instance in=w5) -> ("Full Reference Cluster:Cluster Reference Cluster:Sweep Live Parameters RSM"=w30, "Full Reference Cluster:Cluster Reference Cluster:IV Plot Out Multiple Reference"=w31, "Full Reference Cluster:Cluster Reference Cluster:IV Extracted Parameter Plot "=w32, instance out=w12)
            Property Node(instance in=w30, "Value"=w25, error in=w29) -> (error out=w33)
            Property Node(instance in=w31, "Value"=w26, error in=w33) -> (error out=w34)
            Property Node(instance in=w32, "Value"=w28, error in=w34) -> (error out=w1)
          }
          frame "Idle", Default {
            call "Read FGV Data Changed Idle Control Check.gvi"(Misc Data Mega Cluster In=w5, Error In=w7) -> (Misc Data Mega Cluster Out=w35, Update IV Plot?=w36, Update Refined IV Plot?=w37, Error Out=w38)
            case (w37) {
              frame False, Default {
                w39 = w38
                w40 = w35
              }
              frame True {
                call "FGV Last Measurement Type.gvi"(FGV Instructions="Read State", Error In=w38) -> (Last Measurement State Out=w41, Error Out=w42)
                case (w41) {
                  frame "Rainbow Single Measurement", Default {
                    call "MRM Sweep Refined Data FGV.gvi"(Misc Data Mega Cluster In=w35, Error In=w42) -> (IV Extracted Parameters Plot=w44, Error Out=w43)
                  }
                  frame "Rainbow Multiple Measurement" {
                    call "SRM Sweep Refined Data FGV.gvi"(Misc Data Mega Cluster In=w35, Error In=w42) -> (IV Extracted Parameters Plot=w44, Error Out=w43)
                  }
                }
                Property Node(instance in=w35) -> ("Full Reference Cluster:Cluster Reference Cluster:IV Extracted Parameter Plot "=w45, instance out=w40)
                Property Node(instance in=w45, "Value"=w44, error in=w43) -> (error out=w39)
              }
            }
            case (w36) {
              frame False, Default {
                w1 = w39
                w12 = w40
              }
              frame True {
                Property Node(instance in=w40) -> ("Full Reference Cluster:Cluster Reference Cluster:IV Plot Out Ref"=w46, instance out=w12)
                call "SRM Sweep Live Reference Clustering.gvi"(Full Reference Cluster=w3) -> (SRM sweep live parameters FGV Cluster Out=w47)
                call "SRM Sweep Live Parameters FGV.gvi"(FGV Instructions="Read State", SRM sweep live parameters FGV Cluster In=w47, Error In=w39) -> (IV Plot Out=w48, Error Out=w49)
                Property Node(instance in=w46, "Value"=w48, error in=w49) -> (error out=w1)
              }
            }
          }
          frame "Light Power Calibration" {
            Property Node(instance in=w5) -> ("Full Reference Cluster:Cluster Reference Cluster:Light Power Calibration"=w50, "Full Reference Cluster:Numeric Cluster Reference Cluster:Sweep Live Parameters LPC ref"=w51, instance out=w12)
            call "Light Calibration Live Parameters FGV.gvi"(Full Reference Cluster=w3, FGV Instructions="Read State", Error In=w7) -> (Light Calibration Parameters Out=w52, Light Power Calibration Graph Out=w53, Error Out=w54)
            Property Node(instance in=w50, "Value"=w53, error in=w54) -> (error out=w55)
            Property Node(instance in=w51, "Value"=w52, error in=w55) -> (error out=w1)
          }
        }
        next s1 = w6
        next s2 = w12
        stop if TRUE
      }
      w2 = s2
    }
  }
  $"Error Out" <- w1
  $"Misc Data Mega Cluster Out" <- w2
