vi "Timeout Sequence.gvi"   [LabVIEW NXG 5.0.0]
inputs:
  "Error In": error
  "Queue In": Queue<"Queue Instructions Control.gtype">
  "Misc Data Mega Cluster In": "Misc Data Mega Cluster.gtype"
outputs:
  "Error Out": error
  "Misc Data Mega Cluster Out": "Misc Data Mega Cluster.gtype"
  "Stop App?": bool
  "Queue Out": Queue<"Queue Instructions Control.gtype">
types:
  "Queue Instructions Control.gtype" = enum{"Undefined State", "Debug Check", "Initialize App", "Idle", "Light Power Calibration", "Rainbow Single Measurement", "Light Calibration Irradiance", "Light Calibration Spectral Density", "Light Calibration Power Density", "Stand Alone Photodetector Measurement", "MSpot Spectrum Calibration", "Move XZ Stage", "Change Cell", "Update All Info Meta Cluster", "Access TXT File", "Stop App", "Multiple Cell Measurement", "State 1", "State 2 ", "State 3 ", "State 4"}
  "Full Reference Cluster.gtype" = cluster{"Enum Reference Cluster": "Enum Control Reference Cluster.gtype", "Boolean Reference Cluster": "Boolean Control Reference Cluster.gtype", "Numeric Reference Cluster": "Numeric Control Reference Cluster.gtype", "Numeric Cluster Reference Cluster": "Numeric Cluster Reference Cluster.gtype", "Path Reference Cluster": "Path Reference Cluster.gtype", "Cluster Reference Cluster": "Cluster Reference Cluster.gtype", "XZ Stage Controls Reference Cluster": "XZ Stage Controls Reference Cluster.gtype"}
  "Cell Naming Cluster.gtype" = cluster{"Cell Label": string, "Sample Prefix": string, "Author Initials": string, "Current Date": string, "Batch Name": string}
  T1 = cluster{"X Coordinate (mm)": f64, "Z Coordinate (mm)": f64}
  T2 = cluster{"X Coordinate (mm)": f64, "Z Coordinate (mm)": f64, "Vertical Spacing (mm)": f64}
  "XZ All Position Cluster.gtype" = cluster{"Diffusor Coordinates": T1, "Photodetector Coordinates": T1, "Cell R.01 Coordinates": T2}
  T3 = cluster{"Thorlabs Motor Serial Number File Path": path, "Default Data Saving Location": path}
  "Misc Data Mega Cluster.gtype" = cluster{"Full Reference Cluster": "Full Reference Cluster.gtype", "Cell Naming Cluster": "Cell Naming Cluster.gtype", "All XZ Position Cluster": "XZ All Position Cluster.gtype", "All Paths": T3}
uses:
  Rainbow Measurement Setup::Main Functions::Instruction Queue::Current State::FGV Current State.gvi
  Rainbow Measurement Setup::Side Functions::Messages And Prompts::Initializing app prompt.gvi
  Rainbow Measurement Setup::Side Functions::Global Abort::FGV Global Abort.gvi
diagram:
  # This is the sequence that executes every 50 ms to check
  # the current state of the application. It outputs the current
  # state and substate and also shows the Initialization prompt
  # when the application is initializing.
  # Finally it checks if the current state is Stop App and outputs
  # the result to stop the master loop.
  # It also checks for the Global Abort state. In case the local abort is triggered it flushes the Queue
  # and enqueues an Idle instruction. Otherwise if the Global abort is true it flushes the queue and
  # enqueues a Stop App instruction
  case ($"Error In") {
    frame Error, Default {
      w1 = $"Error In"
      w2 = $"Queue In"
      w3 = default
      w4 = $"Misc Data Mega Cluster In"
    }
    frame No Error {
      call "FGV Current State.gvi"(Current State Instructions="Read Current State and Substate", Error In=$"Error In") -> (Current State Out=w5, Current SubState Out=w6, Error Out=w7)
      Is Equal(x=w5, y="Stop App") -> w8
      Is Equal(x=w5, y="Initialize App") -> w9
      case (w9) {
        frame False, Default {
          w10 = w7
        }
        frame True {
          call "Initializing app prompt.gvi"(Error In=w7) -> (Error Out=w10)
        }
      }
      call "FGV Global Abort.gvi"(Global Abort Instructions="Read Current State", Error In=w10) -> (Local Abort Out=w11, Global Abort Out=w12, Error Out=w13)
      case (w12) {
        frame True {
          Flush Queue(error in=w13, queue=$"Queue In") -> (error out=w16, queue out=w17)
          Enqueue Element At Opposite End(element="Stop App", error in=w16, queue=w17) -> (error out=w14, queue out=w2)
          w15 = TRUE
        }
        frame False {
          case (w11) {
            frame False, Default {
              w14 = w13
              w2 = $"Queue In"
            }
            frame True {
              Flush Queue(error in=w13, queue=$"Queue In") -> (error out=w18, queue out=w19)
              Enqueue Element At Opposite End(element="Idle", error in=w18, queue=w19) -> (error out=w14, queue out=w2)
            }
          }
          w15 = FALSE
        }
      }
      Logical Or(w15, w8) -> w3
      Property Node(instance in=$"Misc Data Mega Cluster In") -> ("Full Reference Cluster:Cluster Reference Cluster:State"=w20, "Full Reference Cluster:Cluster Reference Cluster:Current Substate"=w21, "Full Reference Cluster:Cluster Reference Cluster:Substate"=w22, "Full Reference Cluster:Enum Reference Cluster:Current State Ref"=w23, instance out=w4)
      Format Into String(errIn=w14, w5) -> (outString=w24, errOut=w25)
      Property Node(instance in=w20, "Value"=w24, error in=w25) -> (error out=w26)
      Property Node(instance in=w21, "Value"=w6, error in=w26) -> (error out=w27)
      Property Node(instance in=w22, "Value"=w6, error in=w27) -> (error out=w28)
      Property Node(instance in=w23, "Value"=w5, error in=w28) -> (error out=w1)
    }
  }
  $"Misc Data Mega Cluster Out" <- w4
  $"Stop App?" <- w3
  $"Queue Out" <- w2
  $"Error Out" <- w1
