vi "Update Graphs Control Change.gvi"   [LabVIEW NXG 5.0.0]
inputs:
  "Misc Data Mega Cluster In": "Misc Data Mega Cluster.gtype"
  "Update Refined IV Plot?": bool
  "Error In": error
outputs:
  "Misc Data Mega Cluster Out": "Misc Data Mega Cluster.gtype"
  "Error Out": error
types:
  "Full Reference Cluster.gtype" = cluster{"Enum Reference Cluster": "Enum Control Reference Cluster.gtype", "Boolean Reference Cluster": "Boolean Control Reference Cluster.gtype", "Numeric Reference Cluster": "Numeric Control Reference Cluster.gtype", "Numeric Cluster Reference Cluster": "Numeric Cluster Reference Cluster.gtype", "Path Reference Cluster": "Path Reference Cluster.gtype", "Cluster Reference Cluster": "Cluster Reference Cluster.gtype", "XZ Stage Controls Reference Cluster": "XZ Stage Controls Reference Cluster.gtype"}
  "Cell Naming Cluster.gtype" = cluster{"Cell Label": string, "Sample Prefix": string, "Author Initials": string, "Current Date": string, "Batch Name": string}
  T1 = cluster{"X Coordinate (mm)": f64, "Z Coordinate (mm)": f64}
  T2 = cluster{"X Coordinate (mm)": f64, "Z Coordinate (mm)": f64, "Vertical Spacing (mm)": f64}
  "XZ All Position Cluster.gtype" = cluster{"Diffusor Coordinates": T1, "Photodetector Coordinates": T1, "Cell R.01 Coordinates": T2}
  T3 = cluster{"Thorlabs Motor Serial Number File Path": path, "Default Data Saving Location": path}
  "Misc Data Mega Cluster.gtype" = cluster{"Full Reference Cluster": "Full Reference Cluster.gtype", "Cell Naming Cluster": "Cell Naming Cluster.gtype", "All XZ Position Cluster": "XZ All Position Cluster.gtype", "All Paths": T3}
uses:
  Rainbow Measurement Setup::Main Functions::Rainbow Measurement::Single Multiple Measurement Utilities::FGV Last Measurement Type.gvi
  Rainbow Measurement Setup::Main Functions::Rainbow Measurement::Cell Multiple Rainbow Measurement::Plotting::MRM Sweep Refined Data FGV.gvi
  Rainbow Measurement Setup::Main Functions::Rainbow Measurement::Cell Single Rainbow Measurement::Plotting::SRM Sweep Refined Data FGV.gvi
diagram:
  # This SubVI updates the graphs after a measurement depending on the
  # fact if the measurement has been a single or a multiple measurement.
  case ($"Error In") {
    frame Error, Default {
      w1 = $"Error In"
      w2 = $"Misc Data Mega Cluster In"
    }
    frame No Error {
      case ($"Update Refined IV Plot?") {
        frame False, Default {
          w1 = $"Error In"
          w2 = $"Misc Data Mega Cluster In"
        }
        frame True {
          call "FGV Last Measurement Type.gvi"(FGV Instructions="Read State", Error In=$"Error In") -> (Last Measurement State Out=w3, Error Out=w4)
          case (w3) {
            frame "Rainbow Multiple Measurement" {
              Property Node(instance in=$"Misc Data Mega Cluster In") -> ("Full Reference Cluster:Cluster Reference Cluster:MRM Cell Refined Plot Selector ref"=w7, instance out=w8)
              Property Node(instance in=w7, "Disabled"=FALSE, error in=w4) -> (error out=w9)
              call "MRM Sweep Refined Data FGV.gvi"(Misc Data Mega Cluster In=w8, Error In=w9) -> (IV Extracted Parameters Plot=w6, Error Out=w5)
            }
            frame "Rainbow Single Measurement", Default {
              Property Node(instance in=$"Misc Data Mega Cluster In") -> ("Full Reference Cluster:Cluster Reference Cluster:MRM Cell Refined Plot Selector ref"=w10, instance out=w11)
              Property Node(instance in=w10, "Disabled"=TRUE, error in=w4) -> (error out=w12)
              call "SRM Sweep Refined Data FGV.gvi"(Misc Data Mega Cluster In=w11, Error In=w12) -> (IV Extracted Parameters Plot=w6, Error Out=w5)
            }
          }
          Property Node(instance in=$"Misc Data Mega Cluster In") -> ("Full Reference Cluster:Cluster Reference Cluster:IV Extracted Parameter Plot "=w13, instance out=w2)
          Property Node(instance in=w13, "Value"=w6, error in=w5) -> (error out=w1)
        }
      }
    }
  }
  $"Misc Data Mega Cluster Out" <- w2
  $"Error Out" <- w1
