vi "Update LPC Controls.gvi"   [LabVIEW NXG 5.0.0]
inputs:
  "Error In": error
  "Misc Data Mega Cluster In": "Misc Data Mega Cluster.gtype"
  "LPC Mega Cluster In": "LPC Mega Cluster.gtype"
outputs:
  "Error Out": error
  "Misc Data Mega Cluster Out": "Misc Data Mega Cluster.gtype"
  "LPC Mega Cluster Out": "LPC Mega Cluster.gtype"
types:
  "Full Reference Cluster.gtype" = cluster{"Enum Reference Cluster": "Enum Control Reference Cluster.gtype", "Boolean Reference Cluster": "Boolean Control Reference Cluster.gtype", "Numeric Reference Cluster": "Numeric Control Reference Cluster.gtype", "Numeric Cluster Reference Cluster": "Numeric Cluster Reference Cluster.gtype", "Path Reference Cluster": "Path Reference Cluster.gtype", "Cluster Reference Cluster": "Cluster Reference Cluster.gtype", "XZ Stage Controls Reference Cluster": "XZ Stage Controls Reference Cluster.gtype"}
  "Cell Naming Cluster.gtype" = cluster{"Cell Label": string, "Sample Prefix": string, "Author Initials": string, "Current Date": string, "Batch Name": string}
  T1 = cluster{"X Coordinate (mm)": f64, "Z Coordinate (mm)": f64}
  T2 = cluster{"X Coordinate (mm)": f64, "Z Coordinate (mm)": f64, "Vertical Spacing (mm)": f64}
  "XZ All Position Cluster.gtype" = cluster{"Diffusor Coordinates": T1, "Photodetector Coordinates": T1, "Cell R.01 Coordinates": T2}
  T3 = cluster{"Thorlabs Motor Serial Number File Path": path, "Default Data Saving Location": path}
  "Misc Data Mega Cluster.gtype" = cluster{"Full Reference Cluster": "Full Reference Cluster.gtype", "Cell Naming Cluster": "Cell Naming Cluster.gtype", "All XZ Position Cluster": "XZ All Position Cluster.gtype", "All Paths": T3}
  "Raibow Sweep Selector.gtype" = enum{"Red Sweep", "Blue Sweep", "Full Sweep Red First", "Full Sweep Blue First"}
  "Rainbow Sweep Param Selector.gtype" = cluster{"Raibow Sweep Selector": "Raibow Sweep Selector.gtype", "Max Wavelength (nm)": f64, "Min Wavelength (nm)": f64, "Wavelength Step (nm)": f64, "Rainbow Sweep Type Selector": "Rainbow Sweep Type Selector.gtype"}
  "Light power Calibration Parameters.gtype" = cluster{"Powermeter Averages": u32, "Photodtctr Area (m^2)": f64, "Only Full Spectrum": bool}
  T4 = cluster{"Dividing Wavelength Array": f64[], "Measured Power Array": f64[], "Power Density Array": f64[]}
  "Rainbow Sweep Types.gtype" = enum{"Red Sweep Closing", "Red Sweep Opening", "Blue Sweep Closing", "Blue Sweep Opening"}
  "Light Power Calibration Data.gtype" = cluster{"Single Light Calibration": T4, "Rainbow Sweep Types": "Rainbow Sweep Types.gtype", "Total Light Power Density": f64}
  "LPC Mega Cluster.gtype" = cluster{"Rainbow Sweep Parameters LPC": "Rainbow Sweep Param Selector.gtype", "LPC Specific Parameters": "Light power Calibration Parameters.gtype", "Light Power Calibration Data": "Light Power Calibration Data.gtype"[]}
diagram:
  # This SubVI Updates the values of the control for the LPC parameters and stores them in the LPC Mega Cluster so that they can be used afterwards
  case ($"Error In") {
    frame Error, Default {
      w1 = $"Error In"
      w2 = $"Misc Data Mega Cluster In"
      w3 = $"LPC Mega Cluster In"
    }
    frame No Error {
      Property Node(instance in=$"Misc Data Mega Cluster In") -> ("Full Reference Cluster:Numeric Cluster Reference Cluster:LPC Parameters Ref"=w4, "Full Reference Cluster:Cluster Reference Cluster:Rainbow Sweep Parameters LPC"=w5, instance out=w2)
      Property Node(instance in=w4, error in=$"Error In") -> ("Value"=w6, error out=w7)
      Property Node(instance in=w5, error in=w7) -> ("Value"=w8, error out=w1)
      Property Node(instance in=$"LPC Mega Cluster In", "Rainbow Sweep Parameters LPC"=w8, "LPC Specific Parameters"=w6) -> (instance out=w3)
    }
  }
  $"Misc Data Mega Cluster Out" <- w2
  $"Error Out" <- w1
  $"LPC Mega Cluster Out" <- w3
