vi "Progress General Calculator.gvi"   [LabVIEW NXG 5.0.0]
inputs:
  "Error In": error
  "Starting Value": f64
  "Ending Value": f64
  "Number Of Steps": f64
  "Current Step": f64
outputs:
  "Error Out": error
  "Current Progress": f64
diagram:
  # This SubVI Easily calculates the current
  # progress based on 4 very simple parameters
  case ($"Error In") {
    frame Error, Default {
      w1 = $"Error In"
      w2 = 0
    }
    frame No Error {
      Subtract(x=$"Ending Value", y=$"Starting Value") -> w3
      Divide(x=$"Current Step", y=$"Number Of Steps") -> w4
      Multiply(w3, w4) -> w5
      Add($"Starting Value", w5) -> w2
      w1 = $"Error In"
    }
  }
  $"Error Out" <- w1
  $"Current Progress" <- w2
